# Grasshopper definition 200723_shelter_karamba.gh (Grasshopper 1.0.7)
# plug-ins: treesloth01, Pufferfish, karambaGH

# ---- group: movement 07c
crv = Curve([<curve referenced from the Rhino model> x41])

# ----
crv_2 = Curve(crv)

# ----
# Bake for process design
number_slider = Slider(1000, range=0..1000)
scale = Scale(Geometry=crv_2, Center=Point(0, 0, 0), Factor=number_slider)  # -> Geometry, Transform

# ----
# Total length of timber
len = Length(Curve=crv_2)
ma = MassAddition(Input=len)  # -> Result, PartialResults
total_length_of_timber_m = Panel(ma.Result)

# ----
# Shortest and longest timber
sort = SortList(Keys=crv_2)  # -> Keys, ValuesA
first_last = FirstLast(List=sort.Keys)  # -> FirstValue, LastValue
shortest_and_longest_timber_m = Panel([first_last.FirstValue, first_last.LastValue])

# ----
# Volume of timber
len_2 = Length(Curve=crv_2)
multiplication = Multiplication(A=len_2, B="0.01")
ma_2 = MassAddition(Input=multiplication)  # -> Result, PartialResults
# Structural Analysis Data
volume_of_timber_m3 = Panel(ma_2.Result)

# ----
# Number of timber
lng = ListLength(List=crv_2)
number_of_timber = Panel(lng)

# ----
# Create lines for Karamba
topoly = CurveToPolyline(Curve=crv_2, ToleranceDistance=0, ToleranceAngle=0)  # -> Polyline, Segments
llinter = LineLineIntersectionKaramba3D(Line=topoly.Polyline, LimitDistance_m=0.005)  # -> IntersectionPoints, simplify(flatten(LineSubSegements))

line = Line(llinter.LineSubSegements)
sort_2 = SortList(Keys=line, ValuesA=line)  # -> Keys, ValuesA
panel = Panel(sort_2.Keys)
item = ListItem(List=sort_2.ValuesA, Index=Slider(45, range=0..150), Wrap=True)

# ----
# Material (optional)
matselect = MaterialSelectionKaramba3D(menu=[dropdown(4), dropdown(1)])
disassemble = DisassembleMaterialKaramba3D(Material=matselect)  # -> Material, TypeOfMaterial, FamilyNameOfMaterial, NameOfMaterial, ElemIdentifiers, Color, YoungsModulusKNCm2Dir12, InPlaneShearModulus_kN_cm2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

end = EndPoints(Curve=llinter.LineSubSegements)  # -> Start, End
pt = Point(end.Start)

# ----
# Create timber (m)
end_2 = EndPoints(Curve=flatten(topoly.Polyline))  # -> Start, End
vec2pt = Vector2Pt(PointA=end_2.Start, PointB=end_2.End, Unitize=False)  # -> Vector, Length
pl = PlaneNormal(Origin=end_2.Start, ZAxis=vec2pt.Vector)
prot = RotatePlane(Plane=pl, Angle=degrees(Slider(0, range=0..100)))
rectangle = Rectangle(Plane=prot, XSize="0.1", YSize="0.1", Radius=0)  # -> Rectangle, Length
area = Area(Geometry=rectangle.Rectangle)  # -> Area, Centroid
move2pt = MoveToPoint(Geometry=rectangle.Rectangle, PointA=area.Centroid, PointB=end_2.Start)  # -> Moved, Vector, Transform
boxrec = BoxRectangle(Rectangle=move2pt.Moved, Height=vec2pt.Length)
mesh = Mesh(boxrec)
brec = BoundingRectangle(Geometry=flatten(boxrec), Plane=PlaneXY(0, 0, 0), Axis=0, Slide=0, Union=True)  # -> Bounding, DimensionX, DimensionY
area_2 = Area(Geometry=brec.Bounding)  # -> Area, Centroid
pln = Plane(area_2.Centroid)
rotate = Rotate(Geometry=boxrec, Angle=degrees(Slider(0, range=0..360)), Plane=pln)  # -> Geometry, Transform
preview = CustomPreview(Geometry=rotate.Geometry, Material=ColourSwatch(SwatchColor=RGB(255, 210, 116)))

pdecon = Deconstruct(Point=pt)  # -> XComponent, YComponent, ZComponent

panel_2 = Panel(disassemble.SpecificWeight_kN_m3)

equalst = EqualityWithinTolerance(FirstNumber=pdecon.ZComponent, SecondNumber=0, Tolerance=0.01)  # -> Equality, Inequality

# ----
# Cross Section (optional)
cross_section = CrossSectionKaramba3D(
    FamilyNameOfCrossSection="DefaultCroSec",
    Material=disassemble.Material,
    Height_cm="10",
    UpperFlangeWidth_cm="10",
    LowerFlangeWidth_cm="10",
    mode="Trapezoid")
disassemble_2 = DisassembleCrossSectionKaramba3D(CroSec=cross_section)  # -> CrossSection, FamilyNameOfCrossSection, TypeNameOfCrossSection, ElemIdentifiers, Color, Material, LocalEccentricity_cm, Heights_cm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

cull = CullPattern(List=llinter.LineSubSegements, CullPattern=invert(equalst.Equality))
cull_2 = CullPattern(List=llinter.LineSubSegements, CullPattern=equalst.Equality)

# ----
# Support
lower_pt = LowerPt(C=cull_2)  # -> flatten(i)

# ----
# Bake for process design
number_slider_2 = Slider(1000, range=0..1000)
scale_2 = Scale(Geometry=lower_pt, Center=Point(0, 0, 0), Factor=number_slider_2)  # -> Geometry, Transform

# ---- group: Wind direction
number_slider_3 = Slider(0, range=0..23)
# Note: wind load min 0.08 kN/m2
pressure_kn_sqm = Slider(0.08, range=0..1)
X = UnitX(Factor=1)
multiplication_2 = Multiplication(A=number_slider_3, B="15")
rotate_2 = Rotate(Geometry=X, Angle=degrees(multiplication_2), Plane=PlaneXY(0, 0, 0))  # -> Geometry, Transform
amp = Amplitude(Vector=rotate_2.Geometry, Amplitude=pressure_kn_sqm)
vlen = VectorLength(Vector=amp)

# ----
vdis = VectorDisplay(Anchor=area.Centroid, Vector=rotate_2.Geometry)

# ---- group: Input wind load
loads = LoadsKaramba3D(Vector=amp, Mesh=mesh, LCase=0, mode="MeshLoad -Const.", menu=[buttons(off, off, on), buttons(off, on)])

# ---- group: Input supports
supp = SupportKaramba3D(PosInd=lower_pt, menu=[buttons(on, on, on, off, off, off)])

# ----
linetobeam = LineToBeamKaramba3D(Line=cull, Identifier="other", New=True, Remove=True, LimitDistance_m=0.005)  # -> flatten(Element), Points, Info

# ---- group: Input elements
linetobeam_2 = LineToBeamKaramba3D(Line=cull_2, Identifier="support", New=True, Remove=True, LimitDistance_m=0.005)  # -> flatten(Element), Points, Info

# ----
# Structural Analysis
button = Button()
batchrun = BatchRun(mySliders=number_slider_3, startme=button)  # -> out; inputs mySliders: list, startme: Boolean
# ---------- batchrun: C# usings ----------
using System.IO;
using System.Linq;
using System.Data;
using System.Drawing;
using System.Reflection;
using System.Windows.Forms;
using System.Xml;
using System.Xml.Linq;
using System.Runtime.InteropServices;

using Rhino.DocObjects;
using Rhino.Collections;
using GH_IO;
using GH_IO.Serialization;
# ---------- batchrun: C# ----------
    if (!startme)
      return;

    if (_running)
      return;


    _run = true;

    _mySliders = mySliders;

    GrasshopperDocument.SolutionEnd += OnSolutionEnd;
    Print(_rtnmessage);
# ---------- batchrun: C# additional code ----------
  private bool _run = false;
  private bool _running = false;
  private List<System.Object> _mySliders;
  private string _rtnmessage;

  private void OnSolutionEnd(object sender, GH_SolutionEventArgs e)
  {
    // Unregister the event, we don't want to get called again.
    e.Document.SolutionEnd -= OnSolutionEnd;

    // If we're not supposed to run, abort now.
    if (!_run)
      return;

    //throw new System.ArgumentException("Parameter cannot be null", "something weird");

    // If we're already running, abort now.
    if (_running)
      return;

    // Reset run and running states.
    _run = false;
    _running = true;

    try
    {
      // Find the Guid for connected slides
      List<System.Guid> guids = new List<System.Guid>(); //empty list for guids
      Grasshopper.Kernel.IGH_Param selSlidersInput = Component.Params.Input[0]; //ref for input where sliders are connected to this component
      IList<Grasshopper.Kernel.IGH_Param> sources = selSlidersInput.Sources; //list of things connected on this input
      bool isAnythingConnected = sources.Any(); //is there actually anything connected?

      if (isAnythingConnected) { //if something's connected,
        foreach (var source in sources) //for each of these connected things:
        {
          IGH_DocumentObject component = source.Attributes.GetTopLevel.DocObject; //for this connected thing, bring it into the code in a way where we can access its properties
          Grasshopper.Kernel.Special.GH_NumberSlider mySlider = component as Grasshopper.Kernel.Special.GH_NumberSlider; //...then cast (?) it as a slider
          if (mySlider == null) //of course, if the thing isn't a slider, the cast doesn't work, so we get null. let's filter out the nulls
            continue;
          guids.Add(mySlider.InstanceGuid); //things left over are sliders and are connected to our input. save this guid.
          //we now have a list of guids of sliders connected to our input, saved in list var 'mySlider'
        }
      }

      // Find all sliders.
      List<Grasshopper.Kernel.Special.GH_NumberSlider> sliders = new List<Grasshopper.Kernel.Special.GH_NumberSlider>();
      foreach (IGH_DocumentObject docObject in GrasshopperDocument.Objects)
      {
        Grasshopper.Kernel.Special.GH_NumberSlider slider = docObject as Grasshopper.Kernel.Special.GH_NumberSlider;
        if (slider != null)
        {
          // check if the slider is in the selected list
          if (isAnythingConnected)
          {
            if (guids.Contains(slider.InstanceGuid)) sliders.Add(slider);
          }
          else sliders.Add(slider);
        }
      }
      if (sliders.Count == 0)
      {
        System.Windows.Forms.MessageBox.Show("No sliders could be found", "<harsh buzzing sound>", MessageBoxButtons.OK);
        return;
      }

      //we now have all sliders
      //ask the user to give a sanity check
      int totalLoops = 1;
      string message = null;
      foreach(Grasshopper.Kernel.Special.GH_NumberSlider slider in sliders)
      {
        totalLoops *= (slider.TickCount + 1);
        message += slider.ImpliedNickName;
        message += "\n";
      }
      if (System.Windows.Forms.MessageBox.Show(sliders.Count + " slider(s) connected:\n" + message + "\n" + totalLoops.ToString() + " iterations will be done. Continue?", "Start?", MessageBoxButtons.YesNo) == DialogResult.No) return;



      // Set all sliders back to zero.
      //GH_Document.EnableSolutions = false;
      foreach (Grasshopper.Kernel.Special.GH_NumberSlider slider in sliders)
        slider.TickValue = 0;

      // Start a giant loop in which we'll permutate our way across all slider layouts.
      while (true)
      {
        int idx = 0;
        if (!MoveToNextPermutation(ref idx, sliders))
          break;

        // We've just got a new valid permutation. Solve the new solution.
        e.Document.NewSolution(false);
        Rhino.RhinoDoc.ActiveDoc.Views.Redraw();
      }
    }
    catch {
      _rtnmessage = "something went wrong!";
    }
    finally {
      // Always make sure that _running is switched off.
      _running = false;
    }
  }

  private bool MoveToNextPermutation(ref int index, List<Grasshopper.Kernel.Special.GH_NumberSlider> sliders)
  {
    if (index >= sliders.Count)
      return false;

    Grasshopper.Kernel.Special.GH_NumberSlider slider = sliders[index];
    if (slider.TickValue < slider.TickCount)
    {
      // Increment the slider.
      slider.TickValue++;
      return true;
    }
    else
    {
      // The current slider is already at the maximum value. Reset it back to zero.
      slider.TickValue = 0;

      // Move on to the next slider.
      index++;

      // If we've run out of sliders to modify, we're done permutatin'
      if (index >= sliders.Count)
        return false;

      return MoveToNextPermutation(ref index, sliders);
    }
  }
# ---------- end batchrun ----------
loads_2 = LoadsKaramba3D(Vector=Vector(0, 0, -1), LCase=0, mode="Gravity")
assemble = AssembleModelKaramba3D(
    Elem=[linetobeam_2.Element, linetobeam.Element],
    Support=supp,
    Load=[loads_2, loads],
    CrossSection=cross_section,
    Material=disassemble.Material,
    LimitDistance_m=0.005)  # -> Model, Info, Mass_kg, CenterOfGravity
panel_3 = Panel(assemble.Model)

disassemble_3 = DisassembleModelKaramba3D(Model=assemble.Model)  # -> Model, Point, Beam, Shell, Support, Load, Line, Mesh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
tencomelim = TensionCompressionEliminatorKaramba3D(
    Model=assemble.Model,
    MaximumIerations="50",
    BeamIdentifiers="support",
    LoadCaseToConsider=0,
    CompressionElementsOnly=True)  # -> MaximumDisplacement, OptimizedModel, ElementIsActive
int = Integer(tencomelim.ElementIsActive)
ma_3 = MassAddition(Input=int)  # -> Result, PartialResults
lng_2 = ListLength(List=disassemble_3.Beam)
subtraction = Subtraction(A=lng_2, B=ma_3.Result)
number_of_lifted_support = Panel(subtraction)

analyze = AnalyzeKaramba3D(Model=tencomelim.OptimizedModel)  # -> CalculatedModel, MaximumDisplacement_cm, ResultingForceOfGravity_kN, ElasticEnergy_kNm
modelview = ModelViewKaramba3D(Model=analyze.CalculatedModel, ResultFactors=1, ResultCase=-1)  # -> Model, DeformedMesh, DeformedAxes, DeformedModel
beamview = BeamViewKaramba3D(Model=modelview.Model)  # -> Model, MeshesOfRenderedBeams, DeformedBeamAxes, LegendColors, LegendTags

# ---- group: Check horizontal output
react = ReactionForcesKaramba3D(AnalyzedModel=modelview.Model, ResultCase=0)  # -> AnalyzedModel, ReactionForces_kN, ReactionMoments_kNm, SupportPosition, SumOfReactionForces_kN, SumOfReactionMoments_kNm
devec = DeconstructVector(Vector=react.SumOfReactionForces_kN)  # -> XComponent, YComponent, ZComponent
vec = VectorXYZ(XComponent=devec.XComponent, YComponent=devec.YComponent, ZComponent=0)  # -> Vector, Length
vlen_2 = VectorLength(Vector=vec.Vector)

# ----
react_2 = ReactionForcesKaramba3D(AnalyzedModel=modelview.Model, ResultCase=0)  # -> AnalyzedModel, ReactionForces_kN, ReactionMoments_kNm, SupportPosition, SumOfReactionForces_kN, SumOfReactionMoments_kNm
b_forces = BeamForcesKaramba3D(AnalyzedModel=modelview.Model, LCase=-1, MaximumDistanceBetweenResults_m=-1, NumberOfResultsPerBeamElement=2)  # -> AnalyzedModel, NormalForce_kN, ShearForceVz_kN, ShearForceVy_kN, BendingMomentMt_kNm, flatten(BendingMomentMy_kNm), BendingMomentMz_kNm
devec_2 = DeconstructVector(Vector=react_2.ReactionForces_kN)  # -> XComponent, YComponent, ZComponent
abs = Absolute(Value=b_forces.BendingMomentMy_kNm)
sort_3 = SortList(Keys=devec_2.ZComponent)  # -> Keys, ValuesA
legend = Legend(Colour=beamview.LegendColors, Tags=beamview.LegendTags, LegendType=1)
sort_4 = SortList(Keys=abs)  # -> reverse(Keys), ValuesA
item_2 = ListItem(List=sort_3.Keys, Index=0, Wrap=True)
item_3 = ListItem(List=sort_4.Keys, Index=0, Wrap=True)
largest_bending_moment = Panel(item_3)
this_should_be_positive = Panel(item_2)
downward_reaction_force = Panel(devec.ZComponent)

hori_reaction_force = Panel(vlen_2)

rec = DataRecorder(item_3, DataLimit=-10, RecordData=True)
rec_2 = DataRecorder(item_2, DataLimit=-10, RecordData=True)
multiplication_3 = Multiplication(A=downward_reaction_force, B=pressure_kn_sqm)
division = Division(A=hori_reaction_force, B=downward_reaction_force)  # -> flatten(Result)
rec_3 = DataRecorder(division, DataLimit=-10, RecordData=True)
sort_5 = SortList(Keys=rec)  # -> reverse(Keys), ValuesA
sort_6 = SortList(Keys=rec_2)  # -> Keys, ValuesA
panel_4 = Panel(multiplication_3)
item_4 = ListItem(List=sort_6.Keys, Index=0, Wrap=True)
item_5 = ListItem(List=sort_5.Keys, Index=0, Wrap=True)
sort_7 = SortList(Keys=rec_3)  # -> reverse(Keys), ValuesA
largest_bending_moment_2 = Panel(item_5)
this_should_be_positive_2 = Panel(item_4)
item_6 = ListItem(List=sort_7.Keys, Index=0, Wrap=True)
highest_ratio_horizontal_vertical = Panel(item_6)
# keep between 20 to 30% max
panel_5 = Panel(rec_3)

# ==== cluster LowerPt
C = ClusterInput()
end = EndPoints(Curve=graft(C))  # -> Start, End
pdecon = Deconstruct(Point=end.Start)  # -> XComponent, YComponent, ZComponent
pdecon_2 = Deconstruct(Point=end.End)  # -> XComponent, YComponent, ZComponent
merge = Merge(Data1=end.Start, Data2=end.End)
merge_2 = Merge(Data1=pdecon.ZComponent, Data2=pdecon_2.ZComponent)
sort = SortList(Keys=merge_2, ValuesA=merge)  # -> Keys, ValuesA
item = ListItem(List=sort.ValuesA, Index=0, Wrap=True)
i = ClusterOutput(item)
