# Grasshopper definition Process Path Planning.gh (Grasshopper 1.0.7)

# Matteo: -179 to 179
# -90 to 150
# -180 to 75
# -181 to 181
# -100 to 100
# -181 to 181
confortable = Panel("""-179 to 179
-90 to 150
-180 to 75
-181 to 181
-90 to 90
-181 to 181""")

# ----
# Load Process File
reload_process_from_disk = Button()
process_path = GhPythonScript()  # -> path
# ---------- process_path: Python ----------
from Rhino.RhinoDoc import ActiveDoc
import os
path = os.path.splitext(ActiveDoc.Path)[0] + "_process.json"
print path
# ---------- end process_path ----------
file_path = FilePath(process_path)
json_unpickle = GhPythonScript(path=file_path, enable=True, reload=reload_process_from_disk)  # -> warn_col, warn_msg, data; inputs enable: Boolean
# ---------- json_unpickle: Python ----------
import jsonpickle
import os
import datetime
if enable and not reload:
    exist = os.path.exists(path)
    if exist:
        with open(path, 'r') as f:
            data = jsonpickle.decode(f.read(), keys=True)
        c_time = datetime.datetime.fromtimestamp(os.path.getmtime(path))
        warn_col = "lime"
        warn_msg = "Process File loaded with %s Beams, %s Clamps, %s Grippers.\n File Modified on %s." % (len(list(data.assembly.beams())), len(list(data.clamps)), len(list(data.grippers)), c_time)
    else:
        warn_col = "orange"    
        warn_msg = "Process File not created yet"
# ---------- end json_unpickle ----------
legend = Legend(Colour=json_unpickle.warn_col, Tags=json_unpickle.warn_msg, LegendType=2)
process = Data(json_unpickle.data)

# ----
# Reload Python Modules (if Module Code is Changed)
python_module_to_reload = Panel("""compas
compas_fab
roslibpy
integral_timber_joints
clamp_controller""")
# Development Tools
reload = Button()
py = PythonScript(reload_module_button=reload, module_names=python_module_to_reload)  # inputs module_names: list
# ---------- py: Python ----------
import compas_ghpython
from compas_ghpython import unload_modules
if reload_module_button:
    for module in module_names:
        unload_modules(module)
# ---------- end py ----------

# ----
# Check Path and Environment
compas_version = GhPythonScript()  # -> out, compas_version, compas_fab_version, compas_path, compas_fab_path, compas_env_name, python_directory
# ---------- compas_version: Python ----------
__author__ = "leungp"
__version__ = "2020.04.20"

import rhinoscriptsyntax as rs
import compas
import compas_fab
compas_version  = compas.__version__
compas_fab_version = compas_fab.__version__
import os
compas_path = os.path.abspath(compas.__file__)
compas_fab_path = os.path.abspath(compas_fab.__file__)

import compas_bootstrapper
compas_env_name = compas_bootstrapper.ENVIRONMENT_NAME
python_directory = compas_bootstrapper.PYTHON_DIRECTORY
# ---------- end compas_version ----------
compas_environment_name = Panel(compas_version.compas_env_name)
compas_version_2 = Panel(compas_version.compas_version)
compas_fab_version = Panel(compas_version.compas_fab_version)
compas_path = Panel(compas_version.compas_path)
compas_fab_path = Panel(compas_version.compas_fab_path)
python_directory = Panel(compas_version.python_directory)

# ----
# Connect to MoveIt via ROS and load Robot
panel = Panel("192.168.0.117")
units = ValueList({"m": 1, "cm": 100, "mm": 1000}, selected="mm")
restart = Button()
load = Button()
ros = PythonScript(ip=panel, restart=restart)  # -> out, ros_client
# ---------- ros: Python ----------
import sys
import time
import scriptcontext as sc

from compas_fab.backends import RosClient

from System import TimeSpan
from System.Threading import ManualResetEventSlim


key = 'rosclient_%s' % str(ghenv.Component.InstanceGuid)
previous_client = sc.sticky.get(key, None)
if previous_client:
    previous_client.terminate()

ros_client = RosClient(ip, 9090)
sc.sticky[key] = ros_client

waitLock = ManualResetEventSlim(False)

ros_client.on_ready(lambda: waitLock.Set())

if not waitLock.Wait(TimeSpan.FromSeconds(5)):
    raise Exception('Unable to connect to ROS')


print "ROS is connected:", ros_client.is_connected
# ---------- end ros ----------
robot = PythonScript(client=ros.ros_client, unit=units, load=load)  # -> robot; inputs load: Boolean
# ---------- robot: Python ----------
from compas_fab.ghpython import RobotArtist

robot = client.load_robot(load_geometry=True,
                          urdf_param_name='/robot_description',
                          srdf_param_name='/robot_description_semantic',
                          precision=None,
                          local_cache_directory=None)

robot.scale(unit)
robot.artist = RobotArtist(robot.model)

print robot.info()
# ---------- end robot ----------
panel_2 = Panel(ros.out)

# ----
# Robot Joint Constraint (Path)
# -179 to 179
# -90 to 150
# -180 to 75
# -181 to 181
# -95 to 95
# -181 to 181
panel_3 = Panel("""robot12_joint_1
robot12_joint_2
robot12_joint_3
robot12_joint_4
robot12_joint_5
robot12_joint_6""")
jointconstraint = GhPythonScript(joint_name=panel_3, limit_deg=confortable)  # -> out, joint_constraint
# ---------- jointconstraint: Python ----------
from compas_fab.robots import JointConstraint
from math import radians

value = radians((limit_deg[1] + limit_deg[0]) / 2)
tolerance_above = radians(limit_deg[1]) - value
tolerance_below = value - radians(limit_deg[0])

# JointConstraint(joint_name, value, tolerance_above=0., tolerance_below=0., weight=1.)
joint_constraint = JointConstraint(joint_name, value, tolerance_above, tolerance_below, 1.0)

print value
print tolerance_above
print tolerance_below
# ---------- end jointconstraint ----------
robot_add_constraints = GhPythonScript(robot=robot, planning_group="robot12_eaYZ", joint_constraints=jointconstraint.joint_constraint)  # -> out, robot_out; inputs joint_constraints: list
# ---------- robot_add_constraints: Python ----------
robot_out = robot
robot.current_joint_constraints = joint_constraints
robot.current_planning_group = planning_group
# ---------- end robot_add_constraints ----------

# ----
# Robot Pipes ACM
link2_extraacm = Mesh(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)
link3_extraacm = Mesh(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)
robot_add_constraints_2 = GhPythonScript(robot=robot_add_constraints.robot_out, robot_link2_acm=link2_extraacm, robot_link3_acm=link3_extraacm)  # -> out, robot_out; inputs robot_link3_acm: list
# ---------- robot_add_constraints_2: Python ----------
robot_out = robot

from compas_rhino.geometry import RhinoMesh
from compas_fab.robots import AttachedCollisionMesh, CollisionMesh

acm2_mesh = RhinoMesh.from_geometry(robot_link2_acm).to_compas()
acm2 = AttachedCollisionMesh(CollisionMesh(acm2_mesh.copy(), 'attached_cm_pipe2'), 'robot12_link_2', ['robot12_link_2'])

acm3_mesh = RhinoMesh.from_geometry(robot_link3_acm).to_compas()
acm3 = AttachedCollisionMesh(CollisionMesh(acm3_mesh.copy(), 'attached_cm_pipe3'), 'robot12_link_3', ['robot12_link_3'])

robot.extra_acms = [acm2, acm3]
# ---------- end robot_add_constraints_2 ----------

transform_design_to_robotworld = Transform({TransformCount=1, Name="Orientation", source.origin.x=-50, source.origin.y=850, source.origin.z=0, source.xaxis.x=0, source.xaxis.y=-1, source.xaxis.z=0, source.yaxis.x=1, source.yaxis.y=0, source.yaxis.z=0, target.origin.x=24991.934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})
xform_to_compas = GhPythonScript(xform=transform_design_to_robotworld)  # -> transformation
# ---------- xform_to_compas: Python ----------
from compas.geometry import Transformation
def transformation_from_xform(transformation):
    """Creates a Compas Transformation instance from a Rhino Transform
    """
    transform = Transformation()
    for i in range(0, 4):
        for j in range(0, 4):
            transform[i, j] = transformation[i, j]
    return transform

transformation = transformation_from_xform(xform)
# ---------- end xform_to_compas ----------

# ----
# Static Collision - Environment Scene
collision_mesh_scene_static = Mesh([<mesh referenced from the Rhino model> x37])
mjoin = MeshJoin(Meshes=flatten(collision_mesh_scene_static))
set_process_things = GhPythonScript(process=process, environment_mesh=mjoin, robot_world_transform=xform_to_compas)  # -> out, process_out
# ---------- set_process_things: Python ----------
process_out = process

from compas_rhino.geometry import RhinoMesh
process.environment_meshes = RhinoMesh.from_geometry(environment_mesh).to_compas()
process.robot_world_transform = robot_world_transform
# ---------- end set_process_things ----------

group = Data("robot12_eaYZ")
robot_2 = Data(robot_add_constraints_2.robot_out)
process_2 = Data(set_process_things.process_out)

Z = UnitZ(Factor=Slider(20, range=0..20))
Y = UnitY(Factor=Slider(14, range=0..20))
addition = Addition(A=Z, B=Y)
process_adjust_frame = GhPythonScript(process=process_2, beam_id="b3", frame_key="assembly_wcf_inclampapproach", adj_vector=addition, run=Button())  # -> out, process_out; inputs adj_vector: Vector3d
# ---------- process_adjust_frame: Python ----------
from copy import deepcopy
from compas_rhino.geometry import RhinoVector
from compas.geometry import Translation

old_frame = process.assembly.get_beam_attribute(beam_id, frame_key)
adj_vector = RhinoVector.from_geometry(adj_vector).to_compas()

print old_frame
new_frame = old_frame.transformed(Translation.from_vector(adj_vector))
print new_frame


process_out = deepcopy(process)
process_out.assembly.set_beam_attribute(beam_id, frame_key, new_frame)
# ---------- end process_adjust_frame ----------

# ----
# Select Path to Plan
beam_sequence_number = Slider(28, range=1..40)

# ----
# Select Beam to plan
process_3 = Data(process_adjust_frame.process_out)
python = GhPythonScript(process=process_3)  # -> out, beam_ids, beam_seq_ids, gripper_types
# ---------- python: Python ----------
beam_ids = [b for b in process.assembly.sequence]
beam_seq_ids = ["S%i"%(i+1) for i in range(len(process.assembly.sequence))]
gripper_types = [process.assembly.get_beam_attribute(b, 'gripper_type')  for b in process.assembly.sequence]
# ---------- end python ----------
item = ListItem(List=python.beam_ids, Index=expr("x-1", beam_sequence_number), Wrap=True)
item_2 = ListItem(List=python.beam_seq_ids, Index=expr("x-1", beam_sequence_number), Wrap=True)
sequence_number = Panel(item_2)
beam_id = Panel(item)

flange_pos_in_robworld = GhPythonScript(process=process_3, beam_id=python.beam_ids)  # -> out, assembly_wcf_inclampapproach, assembly_wcf_inclamp, assembly_wcf_final, assembly_wcf_finalretract
# ---------- flange_pos_in_robworld: Python ----------
from compas.geometry import Frame, Transformation

from compas_ghpython import draw_frame


def flange_frame_at(process, beam_id, attribute_name, transformation = None):
    """ Returns the T0CP (robot flange) for the gripper at different location.
    The result takes into account the gripper (tool) and toolchanger (tool) offsets.
    
    Optional transformation can be supplied for transforming from design-world to Robot-world
    This function has a side effect changing the process.toolchanger and gripper 's current frame.
    """
    if process.get_gripper_t0cp_for_beam_at(beam_id, attribute_name) is None:
        return None  # Return None if the position doesn't exist

    assembly = process.assembly
    gripper_type = assembly.get_beam_attribute(beam_id, 'gripper_type')
    gripper = process.get_one_gripper_by_type(gripper_type)
    toolchanger = process.robot_toolchanger

    gripper_t0cp = process.get_gripper_t0cp_for_beam_at(beam_id, attribute_name)
    toolchanger.set_current_frame_from_tcp(gripper_t0cp)
    t0cp = toolchanger.current_frame.copy()
    # Post transformation
    if transformation is not None:
        t0cp.transform(transformation)
    return t0cp

robot_world_transform = process.robot_world_transform

if process.get_gripper_t0cp_for_beam_at(beam_id, 'assembly_wcf_inclampapproach'):
    assembly_wcf_inclampapproach =  draw_frame(flange_frame_at(process, beam_id, 'assembly_wcf_inclampapproach', robot_world_transform))
else:
    assembly_wcf_inclampapproach =  draw_frame(flange_frame_at(process, beam_id, 'assembly_wcf_inclamp', robot_world_transform))
assembly_wcf_inclamp =  draw_frame(flange_frame_at(process, beam_id, 'assembly_wcf_inclamp', robot_world_transform))
assembly_wcf_final =  draw_frame(flange_frame_at(process, beam_id, 'assembly_wcf_final', robot_world_transform))
assembly_wcf_finalretract =  draw_frame(flange_frame_at(process, beam_id, 'assembly_wcf_finalretract', robot_world_transform))
# ---------- end flange_pos_in_robworld ----------
python_2 = GhPythonScript(process=process_3)  # -> out, beam_ids, beam_seq_ids, a
# ---------- python_2: Python ----------
beam_ids = [b for b in process.assembly.sequence]
beam_seq_ids = ["S%i"%(i+1) for i in range(len(process.assembly.sequence))]
# ---------- end python_2 ----------
panel_4 = Panel(python.gripper_types)
orient = Orient(
    Geometry=flange_pos_in_robworld.assembly_wcf_final,
    Source=flange_pos_in_robworld.assembly_wcf_inclamp,
    Target=PlaneXY(0, 0, 0))  # -> Geometry, Transform
panel_5 = Panel(orient.Geometry)

# ----
# Connect to RFL robot via ROS (Execution)
get_robot_frame = Button()
init_robot = Button()
ghpython_script = GhPythonScript(ros_client=ros.ros_client, init_robot=init_robot)  # -> robot_11, robot_12, robots; inputs init_robot: Boolean
# ---------- ghpython_script: Python ----------
from compas_rrc import *

if ros_client:
    robot_11 = AbbClient(ros_client, "/robot_1")
    robot_12 = AbbClient(ros_client, "/robot_2")
    
    robots = (robot_11, robot_12, None, None)
# ---------- end ghpython_script ----------
ghpython_script_2 = GhPythonScript(get_robot_frame=get_robot_frame, robot=ghpython_script.robot_12)  # -> plane; inputs get_robot_frame: Boolean
# ---------- ghpython_script_2: Python ----------
from scriptcontext import sticky as st
from compas_rrc import *
from compas_ghpython import draw_frame



# output sticky
guid = str(ghenv.Component.InstanceGuid)
response_key_frame = "robot_frame_" + guid
if response_key_frame not in st:
    st[response_key_frame] = None



if get_robot_frame:
    
    
    # get current robot pose
    robot.send(SetWorkObject('wobj0'))
    robot.send(SetTool('tool0'))
    
    #robot.send(SetWorkObject('wobj0'))
    #robot.send(SetTool('tool0'))
    
    robot_current_robtarget = robot.send_and_wait(GetRobtarget(), timeout=10)

    robot_current_frame = robot_current_robtarget[0]
    robot_current_external_exes = robot_current_robtarget[1]
    
    st[response_key_frame] = robot_current_frame



plane = draw_frame(st[response_key_frame])
# ---------- end ghpython_script_2 ----------
data = Data(ghpython_script_2)

# ----
# Connect to Clamps via ROS (Execution)
init_robot_2 = Button()
python_3 = GhPythonScript(ros_ip=panel, reload=init_robot_2)  # -> out, clamps_connection
# ---------- python_3: Python ----------
from clamp_controller.RemoteClampFunctionCall import RemoteClampFunctionCall

if not reload:
    clamps_connection = RemoteClampFunctionCall(ros_ip)
# ---------- end python_3 ----------

# ----
# Beam Geometry - All Beams
swatch = ColourSwatch(SwatchColor=RGB(194, 194, 194))
all_beams = GhPythonScript(process=process_3, beam_color=swatch)  # -> beams; inputs beam_color: Color
# ---------- all_beams: Python ----------
__author__ = "leungp"
__version__ = "2020.02.19"

from compas_ghpython.helpers import mesh_draw
from compas.geometry import Transformation
from compas.datastructures import meshes_join

from Rhino.Geometry import Mesh as RhinoMesh
assembly = process.assembly

beams = []
for beam in process.assembly.beams():
    beams.append(mesh_draw(beam.cached_mesh, color = beam_color))
# ---------- end all_beams ----------
transform_design_to_robotworld_2 = Transform({TransformCount=1, Name="Orientation", source.origin.x=-50, source.origin.y=850, source.origin.z=0, source.xaxis.x=0, source.xaxis.y=-1, source.xaxis.z=0, source.yaxis.x=1, source.yaxis.y=0, source.yaxis.z=0, target.origin.x=24991.934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})
transform = Transform(Geometry=all_beams, Transform=transform_design_to_robotworld_2)

# ----
# Extracting Frames from Process
flange_pos_in_robworld_2 = GhPythonScript(process=process_3, beam_id=item)  # -> out, assembly_wcf_inclampapproach, assembly_wcf_inclamp, assembly_wcf_final, assembly_wcf_finalretract; same code as flange_pos_in_robworld

# ----
# Collision Meshes
visualize_beams = GhPythonScript(process=process_3, beam_id=item)  # -> out, previous_beams, current_beam_final, acm_origin_beam, acm_origin_tool_group, visual_origin_wrist, clamps_on_structure, clamp_types
# ---------- visualize_beams: Python ----------
__author__ = "leungp"
__version__ = "2020.02.19"

from compas_ghpython.helpers import mesh_draw
from compas.geometry import Transformation
from compas.datastructures import meshes_join

from Rhino.Geometry import Mesh as RhinoMesh
assembly = process.assembly

robot_world_transform = process.robot_world_transform
    
##########################
# Previous Beams
##########################

# Collect the previously-assembled beam(s)
previous_beams = []

for this_beam_id in assembly.get_already_built_beams(beam_id):
    beam = assembly.beam(this_beam_id)
    previous_beams.append(mesh_draw(beam.cached_mesh.transformed(robot_world_transform)))

###################################
# Current Beam (Different Location)
###################################

# Select the current beam
beam = assembly.beam(beam_id)

def beam_mesh_at(attribute_name, robot_world_transform):
    T = assembly.get_beam_transformaion_to(beam_id, attribute_name)
    if T is not None:
        return (mesh_draw(beam.cached_mesh.transformed(T).transformed(robot_world_transform)))
    else: return None

current_beam_storage = beam_mesh_at('assembly_wcf_storage',robot_world_transform)
current_beam_final = beam_mesh_at('assembly_wcf_final',robot_world_transform)
###################################
# Clamps (multiple clamps)
###################################

clamps_on_structure = []
clamp_types = []
# Visualize clamps
for neighbour_id in assembly.get_already_built_neighbors(beam_id):
    joint_id = (neighbour_id, beam_id)
    clamp_wcf_final = assembly.get_joint_attribute(joint_id, 'clamp_wcf_final')
    clamp_type = assembly.get_joint_attribute(joint_id, 'clamp_type')
    clamp = process.get_one_clamp_by_type(clamp_type).copy()
    clamp.current_frame = clamp_wcf_final
    clamp.clamp_jaw_position = 120
    clamp.gripper_jaw_position = 0
    clamps_on_structure += [mesh_draw(m.transformed(robot_world_transform)) for m in clamp.draw_visuals()]
    print ("Clamps needed at " , joint_id, clamp.type_name)
    clamp_types.append(clamp.type_name)
    

###################################
# Gripper (At Origin for ACM)
###################################

from compas.geometry import Frame
# Tool changer (At Origin)
toolchanger = process.robot_toolchanger
toolchanger.current_frame = Frame.worldXY()
acm_origin_tool_group =  [mesh_draw(m) for m in toolchanger.draw_visuals()]

# Gripper (At Tool Changer)
gripper_type = assembly.get_beam_attribute(beam_id, 'gripper_type')
gripper = process.get_one_gripper_by_type(gripper_type)
gripper.current_frame = process.robot_toolchanger.tool_coordinate_frame.copy()
acm_origin_tool_group +=  [mesh_draw(m) for m in gripper.draw_visuals()]

# Beam (In Gripper)
gripper_t0cp = process.get_gripper_t0cp_for_beam_at(beam_id, 'assembly_wcf_final')
T = Transformation.from_frame_to_frame(gripper_t0cp, gripper.current_frame.copy())
acm_origin_beam = [mesh_draw(beam.cached_mesh.transformed(T))]

###################################
# Gripper (Different Location)
###################################

gripper = []
# Get Gripper and move it to the beam's frame
gripper_type = assembly.get_beam_attribute(beam_id, 'gripper_type')
_gripper = process.get_one_gripper_by_type(gripper_type)

#gripper_tcp_in_ocf = assembly.get_beam_attribute(beam_id, "gripper_tcp_in_ocf")
#gripper_tcp_in_wcf = gripper_tcp_in_ocf.transformed(Transformation.from_frame(beam.frame))

def draw_gripper_at(attribute_name, gripper_open = True):
    gripper_t0cp = process.get_gripper_t0cp_for_beam_at(beam_id, attribute_name)
    if gripper_t0cp is not None:
        _gripper.current_frame = gripper_t0cp
        if gripper_open: _gripper.open_gripper()
        else: _gripper.close_gripper()
        
        process.robot_toolchanger.set_current_frame_from_tcp(gripper_t0cp)

        meshes = meshes_join(_gripper.draw_visuals() + process.robot_toolchanger.draw_visuals())
        gripper.append(mesh_draw(meshes,  color = gripper_color))
        
    else: gripper.append(None)

visual_origin_wrist = mesh_draw(process.robot_wrist_collision_mesh)
# ---------- end visualize_beams ----------

# ----
# Visualization - Current Beam at final Pos
transform_design_to_robotworld_3 = Transform({TransformCount=1, Name="Orientation", source.origin.x=-50, source.origin.y=850, source.origin.z=0, source.xaxis.x=0, source.xaxis.y=-1, source.xaxis.z=0, source.yaxis.x=1, source.yaxis.y=0, source.yaxis.z=0, target.origin.x=24991.934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})
transform_2 = Transform(Geometry=visualize_beams.current_beam_final, Transform=transform_design_to_robotworld_3)
preview = CustomPreview(Geometry=visualize_beams.current_beam_final, Shader=ColourSwatch(SwatchColor=RGBA(50, 166, 0, 23)))

# ----
# Attached Collision Mesh
unweld = UnweldMesh(Mesh=visualize_beams.acm_origin_beam, Angle=0.1)
attached_colision_mesh_at_origin_gripper = Geometry(visualize_beams.acm_origin_tool_group)  # "Attached Colision Mesh (at origin) - Gripper and Toolchanger"
attached_colision_mesh_at_origin_beam = Geometry(unweld)

# ----
# Static Collision - Already Built Beams
colour_swatch = ColourSwatch(SwatchColor=RGB(166, 94, 0))
preview_2 = CustomPreview(Geometry=visualize_beams.previous_beams, Shader=colour_swatch)

# ----
# Visualization - Clamp on Structure
colour_swatch_2 = ColourSwatch(SwatchColor=RGB(166, 94, 0))
preview_3 = CustomPreview(Geometry=visualize_beams.clamps_on_structure, Shader=colour_swatch_2)

# ----
# Visualize - Attached CM at target
orient_2 = Orient(
    Geometry=attached_colision_mesh_at_origin_gripper,
    Source=PlaneXY(0, 0, 0),
    Target=flange_pos_in_robworld_2.assembly_wcf_final)  # -> Geometry, Transform
preview_4 = CustomPreview(Geometry=orient_2.Geometry, Shader=ColourSwatch(SwatchColor=RGBA(153, 255, 0, 0)))

# ----
# How close am I
get_robot_frame_2 = Button()
ghpython_script_3 = GhPythonScript(get_robot_frame=get_robot_frame_2, robot=ghpython_script.robot_12)  # -> plane; inputs get_robot_frame: Boolean; same code as ghpython_script_2
assembly_wcf_inclamp = Plane(flange_pos_in_robworld_2.assembly_wcf_inclamp)
assembly_wcf_final = Plane(flange_pos_in_robworld_2.assembly_wcf_final)
data_2 = Data(ghpython_script_3)
dist = Distance(PointA=assembly_wcf_final, PointB=data_2)
dist_2 = Distance(PointA=assembly_wcf_inclamp, PointB=data_2)
assembly_wcf_inclamp_2 = Panel(dist_2)
assembly_wcf_inclamp_3 = Panel(dist)

# ----
# Making Robot Soft / Hard (Manual Action)
hard = Button()
soft = Button()
make_robot_soft = GhPythonScript(robot=ghpython_script.robot_12, execute_soft=soft, execute_hard=hard)  # -> out
# ---------- make_robot_soft: Python ----------
import compas_rrc as rrc

if execute_soft:
    robot.send(rrc.CustomInstruction('r_A067_ActSoftServo'))
    robot_current_joints, robot_current_ext = robot.send_and_wait(rrc.GetJoints(), timeout=30)
    robot.send(rrc.MoveToJoints(robot_current_joints, robot_current_ext, 500, rrc.Zone.FINE))
    
if execute_hard:
    robot.send(rrc.CustomInstruction('r_A067_DeactSoftServo'))
# ---------- end make_robot_soft ----------
rec = DataRecorder(make_robot_soft, DataLimit=-10, RecordData=True)
panel_6 = Panel(rec)

# ----
# Moving Clamps (Manual Action)
number_slider = Slider(2, range=1..5)
# Sending Rob-Clamp Sync Command
button = Button()
clamps_address = Panel("""3
4""")
python_4 = GhPythonScript(
    clamp=python_3.clamps_connection,
    clamp_addresses=clamps_address,
    clamp_position=Slider(220, range=101..220),
    velocity=number_slider,
    execute=button)  # -> out, a; inputs clamp_addresses: list
# ---------- python_4: Python ----------
import compas_rrc as rrc

if execute:
    # Send command to clamp
    result = clamp.send_ROS_VEL_GOTO_COMMAND_wait(clamp_addresses, clamp_position, velocity)
    print result
# ---------- end python_4 ----------
rec_2 = DataRecorder(python_4.out, DataLimit=-10, RecordData=True)
panel_7 = Panel(rec_2)

# ----
# Original
gantry_x = Slider(22500, range=20500..25000)
robot_12_yz_6joints = Panel("""-4056
-4000
0
-22
-30
0
52
0""")
robot_11_yz_6joints = Panel("""-0
-4900
0
-70
60
0
0
0""")

panel_8 = Panel("""robot12_joint_1
robot12_joint_2
robot12_joint_3
robot12_joint_4
robot12_joint_5
robot12_joint_6""")
panel_9 = Panel("""robot11_joint_EA_Y
robot11_joint_EA_Z""")
iksolution_guide = Data("Grasshopper.Kernel.Types.GH_ObjectWrapper")
python_5 = GhPythonScript(x=iksolution_guide)  # -> out, a
# ---------- python_5: Python ----------
print x.joint_names
# ---------- end python_5 ----------
jointconstraint_2 = GhPythonScript(joint_name=panel_8, configuration=iksolution_guide)  # -> flatten(out), joint_constraint
# ---------- jointconstraint_2: Python ----------
from compas_fab.robots import JointConstraint

value = dict(zip(configuration.joint_names, configuration.values))[joint_name]

joint_constraint = JointConstraint(joint_name, value, tolerance_above=0.001, tolerance_below=0.001, weight=1.)


print joint_name, value
# ---------- end jointconstraint_2 ----------

# ----
# Starting Configuration
# Starting Ganrty X value can be within 22500 to 24000
gantry_x_2 = Slider(25500, range=20500..26000)
robot_11_yz_6joints_2 = Panel("""-0
-4900
0
-70
60
0
0
0""")
robot_12_yz_6joints_2 = Panel("""-4056
-4000
0
-22
-30
0
52
0""")
merge = Merge(Data1=flatten(gantry_x_2), Data2=flatten(robot_11_yz_6joints_2))  # -> flatten(Result)
python_script = PythonScript(robot11=merge, robot12=robot_12_yz_6joints_2)  # -> c; inputs robot11: list, robot12: list
# ---------- python_script: Python ----------
from compas_fab.robots import Configuration
from math import radians as rad


start_full_configuration = Configuration(
    values = (
        robot11[0],
        robot11[1], robot11[2],
        rad(robot11[3]), rad(robot11[4]), rad(robot11[5]), rad(robot11[6]), rad(robot11[7]), rad(robot11[8]),
        robot12[0], robot12[1],
        rad(robot12[2]), rad(robot12[3]), rad(robot12[4]), rad(robot12[5]), rad(robot12[6]), rad(robot12[7]),
        38000,
        0, -4915,
        0, 0, 0, 0, 0, 0,
        -12237, -4915,
        0, 0, 0, 0, 0, 0
        ),
    types = (
        2,
        2, 2,
        0, 0, 0, 0, 0, 0,
        2, 2,
        0, 0, 0, 0, 0, 0,
        2,
        2, 2,
        0, 0, 0, 0, 0, 0,
        2, 2,
        0, 0, 0, 0, 0, 0
        ),
    joint_names = (
        'bridge1_joint_EA_X',
        'robot11_joint_EA_Y', 'robot11_joint_EA_Z',
        'robot11_joint_1', 'robot11_joint_2', 'robot11_joint_3', 'robot11_joint_4', 'robot11_joint_5', 'robot11_joint_6',
        'robot12_joint_EA_Y', 'robot12_joint_EA_Z',
        'robot12_joint_1', 'robot12_joint_2', 'robot12_joint_3', 'robot12_joint_4', 'robot12_joint_5', 'robot12_joint_6',
        'bridge2_joint_EA_X',
        'robot21_joint_EA_Y', 'robot21_joint_EA_Z',
        'robot21_joint_1', 'robot21_joint_2', 'robot21_joint_3', 'robot21_joint_4', 'robot21_joint_5', 'robot21_joint_6',
        'robot22_joint_EA_Y', 'robot22_joint_EA_Z',
        'robot22_joint_1', 'robot22_joint_2', 'robot22_joint_3', 'robot22_joint_4', 'robot22_joint_5', 'robot22_joint_6'
        )
    )

c = start_full_configuration
# ---------- end python_script ----------
temporary_pick_up_location = Plane(Plane(origin=(23238.19823, 4056.088379, 934.2950249), x=(-0.06608858708, 0, 0.9978137595), y=(0, -1, 0)))
pickup_fconfig = Data(python_script)
python_6 = GhPythonScript(robot=robot_2, configuration=pickup_fconfig)  # -> out, ee_frame
# ---------- python_6: Python ----------
from compas_ghpython import draw_frame

ee_frame = draw_frame(robot.forward_kinematics(configuration, group=robot.current_planning_group))
# ---------- end python_6 ----------

# ----
# Visualize - Attached CM at Pickup
orient_3 = Orient(
    Geometry=[attached_colision_mesh_at_origin_gripper, attached_colision_mesh_at_origin_beam],
    Source=PlaneXY(0, 0, 0),
    Target=python_6.ee_frame)  # -> Geometry, Transform
preview_5 = CustomPreview(Geometry=orient_3.Geometry, Shader=ColourSwatch(SwatchColor=RGBA(153, 255, 0, 0)))

# ----
# Planner for No-Clamp Beams
allowed_planning_time = Slider(20, range=0..20)
clear_previously_saved_trajectory = Button()
plan_motion = Button()
plan_motion_2 = Button()
list = ValueList({"RRT", "RRT*": "RRTStar", "EST", "PRM": "RPM", "PRM*": "RPMStar", "SPARS"}, selected="RRT*")
plan_no_clamp_path = GhPythonScript(
    process=process_3,
    robot=robot_2,
    pick_up_full_config=pickup_fconfig,
    joint_constraints=jointconstraint.joint_constraint,
    planner_id=list,
    allowed_planning_time=allowed_planning_time,
    num_planning_attempts=Slider(5, range=0..10),
    beam_id=beam_id,
    compute=plan_motion,
    compute2=plan_motion,
    clear_prev_traj=clear_previously_saved_trajectory)  # -> out, flatten(trajectory_1), t1_end_frame, flatten(trajectory_2), t2_end_frame, attached_collision_meshes, report; inputs joint_constraints: list
# ---------- plan_no_clamp_path: Python ----------
from compas.geometry import Frame, Transformation
from compas_ghpython import draw_frame
from compas_rhino.geometry import RhinoMesh
from compas_fab.robots import CollisionMesh, AttachedCollisionMesh
from compas_fab.robots import AttachedCollisionMesh
from compas.datastructures import meshes_join
from copy import deepcopy
import math

beam_has_clamps = len(list(process.get_clamp_ids_for_beam(beam_id))) > 0
group = robot.current_planning_group

attached_collision_meshes = []
trajectory_1 = []
trajectory_2 = []
    
# Code to cache (and clear) planned trajectory in Sticky
import scriptcontext as sc
guid = str(ghenv.Component.InstanceGuid)
trajectory_1_key = "traj1_" + guid
trajectory_2_key = "traj2_" + guid
if (trajectory_1_key not in sc.sticky) or clear_prev_traj: sc.sticky[trajectory_1_key] = None
if (trajectory_2_key not in sc.sticky) or clear_prev_traj: sc.sticky[trajectory_2_key] = None

robot_world_transform = process.robot_world_transform

def flange_frame_at(process, beam_id, attribute_name, transformation = None):
    """ Returns the T0CP (robot flange) for the gripper at different location.
    The result takes into account the gripper (tool) and toolchanger (tool) offsets.
    
    Optional transformation can be supplied for transforming from design-world to Robot-world
    This function has a side effect changing the process.toolchanger and gripper 's current frame.
    """
    if process.get_gripper_t0cp_for_beam_at(beam_id, attribute_name) is None:
        return None  # Return None if the position doesn't exist

    assembly = process.assembly
    gripper_type = assembly.get_beam_attribute(beam_id, 'gripper_type')
    gripper = process.get_one_gripper_by_type(gripper_type)
    toolchanger = process.robot_toolchanger

    gripper_t0cp = process.get_gripper_t0cp_for_beam_at(beam_id, attribute_name)
    toolchanger.set_current_frame_from_tcp(gripper_t0cp)
    t0cp = toolchanger.current_frame.copy()
    # Post transformation
    if transformation is not None:
        t0cp.transform(transformation)
    return t0cp



def get_previous_beams_meshes(process, beam_id, transformation = None):
    beam_meshes = []
    for this_beam_id in process.assembly.get_already_built_beams(beam_id):
        beam_mesh = process.assembly.beam(this_beam_id).cached_mesh.copy()
        if transformation is not None:
            beam_mesh.transform(transformation)
        beam_meshes.append(beam_mesh)
    return beam_meshes

def get_clamp_meshes(process, beam_id, clamp_jaw_position = 120, gripper_jaw_position = 0, transformation = None):
    clamps_on_structure = []
    # Visualize clamps
    for neighbour_id in process.assembly.get_already_built_neighbors(beam_id):
        joint_id = (neighbour_id, beam_id)
        clamp_wcf_final = process.assembly.get_joint_attribute(joint_id, 'clamp_wcf_final')
        clamp_type = process.assembly.get_joint_attribute(joint_id, 'clamp_type')
        clamp = process.get_one_clamp_by_type(clamp_type).copy()
        clamp.current_frame = clamp_wcf_final
        clamp.clamp_jaw_position = clamp_jaw_position
        clamp.gripper_jaw_position = gripper_jaw_position
        clamps_on_structure += [m.transformed(transformation) for m in clamp.draw_visuals()]
    return clamps_on_structure

def get_meshes_for_acm(process, beam_id):
    # Tool changer (At Origin)
    toolchanger = process.robot_toolchanger
    toolchanger.current_frame = Frame.worldXY()
    tc_meshes =  [m.copy() for m in toolchanger.draw_visuals()]
    
    # Gripper (At Tool Changer)
    gripper_type = process.assembly.get_beam_attribute(beam_id, 'gripper_type')
    gripper = process.get_one_gripper_by_type(gripper_type)
    gripper.current_frame = process.robot_toolchanger.tool_coordinate_frame.copy()
    tool_meshes =  [m.copy() for m in gripper.draw_visuals()]
    
    
    gripper_t0cp = process.get_gripper_t0cp_for_beam_at(beam_id, 'assembly_wcf_final')
    T = Transformation.from_frame_to_frame(gripper_t0cp, gripper.current_frame.copy())
    beam_mesh = beam.cached_mesh.transformed(T)
    
    return (tc_meshes, tool_meshes, beam_mesh)
    
if not beam_has_clamps:

    ######################################
    # Perhaps functional settings for OMPL
    ######################################
    
    import roslibpy
    maximum_waypoint_distance = 0.0000001
    roslibpy.Param(robot.client, '/move_group/ompl/maximum_waypoint_distance').set(maximum_waypoint_distance)
    longest_valid_segment_fraction = 0.00000001
    reply = roslibpy.Param(robot.client, '/move_group/ompl/longest_valid_segment_fraction').set(longest_valid_segment_fraction)
    
    ##########################################################
    # Extract and transform the target plans from process file
    ##########################################################
    
    assembly_wcf_inclamp =  flange_frame_at(process, beam_id, 'assembly_wcf_inclamp', robot_world_transform)
    assembly_wcf_final =  flange_frame_at(process, beam_id, 'assembly_wcf_final', robot_world_transform)
    assembly_wcf_finalretract =  flange_frame_at(process, beam_id, 'assembly_wcf_finalretract', robot_world_transform)
    
    ######################################################
    # Extract and transform geometry from process file.
    ######################################################
    
    
    # Beam (At Final Location)
    beam = process.assembly.beam(beam_id)
    current_beam_at_wcf_final = beam.cached_mesh.transformed(robot_world_transform)
    
    
    ######################################
    # Plan First motion (Transfer - Free)
    ######################################
    
    # Setup planning scene
    from compas_fab.robots import PlanningScene
    scene = PlanningScene(robot)
    
    # Static CM (Environment + Previous Beams)
    scene.remove_collision_mesh('static_cm_env')
    #environment_mesh = RhinoMesh.from_geometry(environment_mesh).to_compas()
    environment_mesh = process.environment_meshes
    scene.add_collision_mesh(CollisionMesh(deepcopy(environment_mesh), 'static_cm_env'), True)
    
    scene.remove_collision_mesh('static_cm_beams')
    previous_beams_meshes = get_previous_beams_meshes(process, beam_id, robot_world_transform)
    if len(previous_beams_meshes):
        previous_beams_meshes = meshes_join(previous_beams_meshes)
        scene.add_collision_mesh(CollisionMesh(deepcopy(previous_beams_meshes), 'static_cm_beams'), True)
    
    attached_collision_meshes = []
    attached_collision_meshes_nobeam = []
    
    # Attached CM (Tool changer and Tool)
    tc_meshes, tool_meshes, current_beam_at_acm =  get_meshes_for_acm(process, beam_id)
    scene.remove_attached_collision_mesh('attached_cm_tool')
    tc_tool_meshes = meshes_join(tc_meshes + tool_meshes)
    attached_cm_tool = AttachedCollisionMesh(CollisionMesh(tc_tool_meshes, 'attached_cm_tool'), 'robot12_tool0', ['robot12_tool0', 'robot12_link_6'])
    scene.add_attached_collision_mesh(attached_cm_tool, True)
    attached_collision_meshes.append(attached_cm_tool)
    attached_collision_meshes_nobeam.append(attached_cm_tool)
    
    # Attached CM (Pipes around Robot)
    for extra_acm in robot.extra_acms:
        scene.remove_attached_collision_mesh(extra_acm.collision_mesh.id)
        copied_extra_acm = deepcopy(extra_acm)
        scene.add_attached_collision_mesh(copied_extra_acm, True)
        attached_collision_meshes.append(copied_extra_acm)
        attached_collision_meshes_nobeam.append(copied_extra_acm)
    
    # Attached CM (Current Beam)
    scene.remove_attached_collision_mesh('attached_cm_beam')
    attached_cm_beam = AttachedCollisionMesh(CollisionMesh(current_beam_at_acm, 'attached_cm_beam'), 'robot12_tool0', ['robot12_tool0', 'robot12_link_6'])
    scene.add_attached_collision_mesh(attached_cm_beam, True)
    attached_collision_meshes.append(attached_cm_beam)
    
    # Creating starting configuration
    start_configuration =  pick_up_full_config
    
    # Creating Goal Constraint (assembly_wcf_inclamp)
    tolerance_deg = 0.1
    tolerance_position = 0.001
    tolerances_axes = [math.radians(tolerance_deg)] * 3
    goal_constraints = robot.constraints_from_frame(assembly_wcf_inclamp, tolerance_position, tolerances_axes, group)
    
    
    if compute and robot and robot.client and robot.client.is_connected:
        trajectory_1 = robot.plan_motion(
                                        goal_constraints,
                                        start_configuration,
                                        group,
                                        options = {
                                            'path_constraints' : joint_constraints,
                                            'planner_id' : str(planner_id),
                                            'attached_collision_meshes' : attached_collision_meshes,
                                            'allowed_planning_time' : allowed_planning_time,
                                            'num_planning_attempts' : num_planning_attempts
                                            }
                                        )
        sc.sticky[trajectory_1_key] = trajectory_1
        sc.sticky[trajectory_2_key] = None # Clear out the previous second path if the first path is planned
                                        
    if compute2 and robot and robot.client and robot.client.is_connected:
        trajectory_1 = sc.sticky[trajectory_1_key]
        trajectory_1_last_config = trajectory_1.points[-1] # Partial Config
        trajectory_1_last_config = robot.merge_group_with_full_configuration(trajectory_1_last_config, trajectory_1.start_configuration, group) #Full Config
        print (trajectory_1_last_config)
        start_configuration = trajectory_1_last_config
        frames_WCF = [assembly_wcf_inclamp, assembly_wcf_final]
        trajectory_2 = robot.plan_cartesian_motion(
                                        frames_WCF ,
                                        start_configuration,
                                        group,
                                        options = {
                                            'max_step' : 4,
                                            'path_constraints' : joint_constraints,
                                            'attached_collision_meshes' : attached_collision_meshes_nobeam,
                                            }
                                        )
        sc.sticky[trajectory_2_key] = trajectory_2
    
    #####################################
    # Attached CM (Take away current beam)
    #####################################
    
    trajectory_1 = sc.sticky[trajectory_1_key]
    trajectory_2 = sc.sticky[trajectory_2_key]
    
    t1_end_frame = assembly_wcf_inclamp
    t2_end_frame = assembly_wcf_final
    report = []
    
    if trajectory_1 is not None:
        report.append("trajectory_1 planned")
    else:
        report.append("trajectory_1 MISSING")
        
    if trajectory_2 is not None:
        report.append("trajectory_2 planned")
    else:
        report.append("trajectory_2 MISSING")
# ---------- end plan_no_clamp_path ----------

# ----
# Planner for Clamped Beams
allowed_planning_time_2 = Slider(60, range=0..60)
clear_previously_saved_trajectory_2 = Button()
plan_motion_3 = Button()
plan_motion_4 = Button()
link3_extraacm_2 = Mesh(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)
link2_extraacm_2 = Mesh(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)
list_2 = ValueList({"RRT", "RRT*": "RRTStar", "EST", "PRM": "RPM", "PRM*": "RPMStar", "SPARS"}, selected="RRT*")
plan_clamped_beam_path = GhPythonScript(
    process=process_3,
    robot=robot_2,
    pick_up_full_config=pickup_fconfig,
    joint_constraints=jointconstraint.joint_constraint,
    robot_link2_acm=link2_extraacm_2,
    robot_link3_acm=link3_extraacm_2,
    planner_id=list_2,
    allowed_planning_time=allowed_planning_time_2,
    num_planning_attempts=Slider(10, range=0..10),
    beam_id=beam_id,
    compute=plan_motion_3,
    compute2=plan_motion_4,
    clear_prev_traj=clear_previously_saved_trajectory_2,
    inclampapproach_adjust=addition)  # -> out, flatten(trajectory_1), flatten(trajectory_2), flatten(trajectory_3), flatten(trajectory_4), attached_collision_meshes, report; inputs joint_constraints: list, ik_solution_constraints: list, robot_link2_acm: Mesh, robot_link3_acm: Mesh
# ---------- plan_clamped_beam_path: Python ----------
from compas.geometry import Frame, Transformation
from compas_ghpython import draw_frame
from compas_rhino.geometry import RhinoMesh
from compas_fab.robots import CollisionMesh, AttachedCollisionMesh
from compas_fab.robots import AttachedCollisionMesh
from compas.datastructures import meshes_join
from copy import deepcopy
import math

beam_has_clamps = len(list(process.get_clamp_ids_for_beam(beam_id))) > 0
group = robot.current_planning_group
robot_world_transform = process.robot_world_transform
attached_collision_meshes = []
trajectory_1 = []
trajectory_2 = []
trajectory_3 = []
trajectory_4 = []

# Code to cache (and clear) planned trajectory in Sticky
import scriptcontext as sc
guid = str(ghenv.Component.InstanceGuid)
trajectory_1_key = "traj1_" + guid
trajectory_2_key = "traj2_" + guid
trajectory_3_key = "traj3_" + guid
trajectory_4_key = "traj4_" + guid
if (trajectory_1_key not in sc.sticky) or clear_prev_traj: sc.sticky[trajectory_1_key] = None
if (trajectory_2_key not in sc.sticky) or clear_prev_traj: sc.sticky[trajectory_2_key] = None
if (trajectory_3_key not in sc.sticky) or clear_prev_traj: sc.sticky[trajectory_3_key] = None
if (trajectory_4_key not in sc.sticky) or clear_prev_traj: sc.sticky[trajectory_4_key] = None

def flange_frame_at(process, beam_id, attribute_name, transformation = None):
    """ Returns the T0CP (robot flange) for the gripper at different location.
    The result takes into account the gripper (tool) and toolchanger (tool) offsets.
    
    Optional transformation can be supplied for transforming from design-world to Robot-world
    This function has a side effect changing the process.toolchanger and gripper 's current frame.
    """
    if process.get_gripper_t0cp_for_beam_at(beam_id, attribute_name) is None:
        return None  # Return None if the position doesn't exist

    assembly = process.assembly
    gripper_type = assembly.get_beam_attribute(beam_id, 'gripper_type')
    gripper = process.get_one_gripper_by_type(gripper_type)
    toolchanger = process.robot_toolchanger

    gripper_t0cp = process.get_gripper_t0cp_for_beam_at(beam_id, attribute_name)
    toolchanger.set_current_frame_from_tcp(gripper_t0cp)
    t0cp = toolchanger.current_frame.copy()
    # Post transformation
    if transformation is not None:
        t0cp.transform(transformation)
    return t0cp

def get_previous_beams_meshes(process, beam_id, transformation = None):
    beam_meshes = []
    for this_beam_id in process.assembly.get_already_built_beams(beam_id):
        beam_mesh = process.assembly.beam(this_beam_id).cached_mesh.copy()
        if transformation is not None:
            beam_mesh.transform(transformation)
        beam_meshes.append(beam_mesh)
    return beam_meshes

def get_clamp_meshes(process, beam_id, transformation, clamp_jaw_position = 120, gripper_jaw_position = 0):
    clamps_on_structure = []
    # Visualize clamps
    for neighbour_id in process.assembly.get_already_built_neighbors(beam_id):
        joint_id = (neighbour_id, beam_id)
        clamp_wcf_final = process.assembly.get_joint_attribute(joint_id, 'clamp_wcf_final')
        clamp_type = process.assembly.get_joint_attribute(joint_id, 'clamp_type')
        clamp = process.get_one_clamp_by_type(clamp_type).copy()
        clamp.current_frame = clamp_wcf_final
        clamp.clamp_jaw_position = clamp_jaw_position
        clamp.gripper_jaw_position = gripper_jaw_position
        clamps_on_structure += [m.transformed(transformation) for m in clamp.draw_visuals()]
    return clamps_on_structure

def get_meshes_for_acm(process, beam_id):
    # Tool changer (At Origin)
    toolchanger = process.robot_toolchanger
    toolchanger.current_frame = Frame.worldXY()
    tc_meshes =  [m.copy() for m in toolchanger.draw_visuals()]
    
    # Gripper (At Tool Changer)
    gripper_type = process.assembly.get_beam_attribute(beam_id, 'gripper_type')
    gripper = process.get_one_gripper_by_type(gripper_type)
    gripper.current_frame = process.robot_toolchanger.tool_coordinate_frame.copy()
    tool_meshes =  [m.copy() for m in gripper.draw_visuals()]
    
    
    gripper_t0cp = process.get_gripper_t0cp_for_beam_at(beam_id, 'assembly_wcf_final')
    T = Transformation.from_frame_to_frame(gripper_t0cp, gripper.current_frame.copy())
    beam_mesh = beam.cached_mesh.transformed(T)
    
    return (tc_meshes, tool_meshes, beam_mesh)
    
if beam_has_clamps:

    ######################################
    # Perhaps functional settings for OMPL
    ######################################
    
    import roslibpy
    maximum_waypoint_distance = 0.0000001
    roslibpy.Param(robot.client, '/move_group/ompl/maximum_waypoint_distance').set(maximum_waypoint_distance)
    longest_valid_segment_fraction = 0.00000001
    reply = roslibpy.Param(robot.client, '/move_group/ompl/longest_valid_segment_fraction').set(longest_valid_segment_fraction)
    
    ##########################################################
    # Extract and transform the target plans from process file
    ##########################################################
    
    assembly_wcf_inclampapproach =  flange_frame_at(process, beam_id, 'assembly_wcf_inclampapproach', robot_world_transform)
    assembly_wcf_inclamp =  flange_frame_at(process, beam_id, 'assembly_wcf_inclamp', robot_world_transform)
    assembly_wcf_final =  flange_frame_at(process, beam_id, 'assembly_wcf_final', robot_world_transform)
    assembly_wcf_finalretract =  flange_frame_at(process, beam_id, 'assembly_wcf_finalretract', robot_world_transform)
    
    ######################################################
    # Extract and transform geometry from process file.
    ######################################################
    
    
    # Beam (At Final Location)
    beam = process.assembly.beam(beam_id)
    current_beam_at_wcf_final = beam.cached_mesh.transformed(robot_world_transform)
    
    
    ######################################
    # Plan First motion (Transfer - Free)
    ######################################
    
    # Setup planning scene
    from compas_fab.robots import PlanningScene
    scene = PlanningScene(robot)
    
    # Static CM (Environment + Previous Beams)
    scene.remove_collision_mesh('static_cm_env')
    #environment_mesh = RhinoMesh.from_geometry(environment_mesh).to_compas()
    environment_mesh = process.environment_meshes
    scene.add_collision_mesh(CollisionMesh(deepcopy(environment_mesh), 'static_cm_env'), True)
    
    scene.remove_collision_mesh('static_cm_beams')
    previous_beams_meshes = get_previous_beams_meshes(process, beam_id, robot_world_transform)
    if len(previous_beams_meshes):
        previous_beams_meshes = meshes_join(previous_beams_meshes)
        scene.add_collision_mesh(CollisionMesh(deepcopy(previous_beams_meshes), 'static_cm_beams'), True)
    
    scene.remove_collision_mesh('static_cm_clamps')
    clamps_mesh = get_clamp_meshes(process, beam_id, robot_world_transform)
    
    # Attached CM (Tool changer and Tool)
    attached_collision_meshes = []
    attached_collision_meshes_nobeam = []
    tc_meshes, tool_meshes, current_beam_at_acm =  get_meshes_for_acm(process, beam_id)
    scene.remove_attached_collision_mesh('attached_cm_tool')
    tc_tool_meshes = meshes_join(tc_meshes + tool_meshes)
    attached_cm_tool = AttachedCollisionMesh(CollisionMesh(tc_tool_meshes, 'attached_cm_tool'), 'robot12_tool0', ['robot12_tool0', 'robot12_link_6'])
    scene.add_attached_collision_mesh(attached_cm_tool, True)
    attached_collision_meshes.append(attached_cm_tool)
    attached_collision_meshes_nobeam.append(attached_cm_tool)

    
    # Attached CM (Pipes around Robot)
    for extra_acm in robot.extra_acms:
        scene.remove_attached_collision_mesh(extra_acm.collision_mesh.id)
        copied_extra_acm = deepcopy(extra_acm)
        scene.add_attached_collision_mesh(copied_extra_acm, True)
        attached_collision_meshes.append(copied_extra_acm)
        attached_collision_meshes_nobeam.append(copied_extra_acm)
    
    # Attached CM (Current Beam)
    scene.remove_attached_collision_mesh('attached_cm_beam')
    attached_cm_beam = AttachedCollisionMesh(CollisionMesh(current_beam_at_acm, 'attached_cm_beam'), 'robot12_tool0', ['robot12_tool0', 'robot12_link_6'])
    scene.add_attached_collision_mesh(attached_cm_beam, True)
    attached_collision_meshes.append(attached_cm_beam)
    
    # Creating starting configuration
    start_configuration =  pick_up_full_config
    
    # Creating Goal Constraint (assembly_wcf_inclamp)
    tolerance_deg = 0.1
    tolerance_position = 0.001
    tolerances_axes = [math.radians(tolerance_deg)] * 3
    goal_constraints = robot.constraints_from_frame(assembly_wcf_inclampapproach, tolerance_position, tolerances_axes, group)
    # Add IK Solution constraints
    if len(ik_solution_constraints) > 0:
        goal_constraints += ik_solution_constraints
    
    if compute and robot and robot.client and robot.client.is_connected:
        trajectory_1 = robot.plan_motion(
                                        goal_constraints,
                                        start_configuration,
                                        group,
                                        options = {
                                            'path_constraints' : joint_constraints,
                                            'planner_id' : str(planner_id),
                                            'attached_collision_meshes' : attached_collision_meshes,
                                            'allowed_planning_time' : allowed_planning_time,
                                            'num_planning_attempts' : num_planning_attempts
                                            }
                                        )
        sc.sticky[trajectory_1_key] = trajectory_1
        sc.sticky[trajectory_2_key] = None # Clear out the previous second path if the first path is planned
        sc.sticky[trajectory_3_key] = None # Clear out the previous second path if the first path is planned

    # Second liner path plan will need to not move the robot base from the last config

    if compute and robot and robot.client and robot.client.is_connected:
        # To Inclamp
        trajectory_1 = sc.sticky[trajectory_1_key]
        trajectory_1_last_config = trajectory_1.points[-1] # Partial Config
        trajectory_1_last_config = robot.merge_group_with_full_configuration(trajectory_1_last_config, trajectory_1.start_configuration, group) #Full Config
        print (trajectory_1_last_config)
        start_configuration = trajectory_1_last_config
        frames_WCF = [assembly_wcf_inclampapproach, assembly_wcf_inclamp]
        trajectory_2 = robot.plan_cartesian_motion(
                                        frames_WCF ,
                                        start_configuration,
                                        group,
                                        options = {
                                            'max_step' : 4,
                                            'path_constraints' : joint_constraints,
                                            'attached_collision_meshes' : attached_collision_meshes,
                                            }
                                        )
        sc.sticky[trajectory_2_key] = trajectory_2
        sc.sticky[trajectory_3_key] = None
        
        # Clamp CM will be in closed state.
        scene.remove_collision_mesh('static_cm_clamps')
        #clamps_mesh = get_clamp_meshes(process, beam_id, robot_world_transform, clamp_jaw_position = 0)
        #scene.add_collision_mesh(CollisionMesh(deepcopy(meshes_join(clamps_mesh)), 'static_cm_clamps'), True)
        
        # To Final 
        frames_WCF = [assembly_wcf_inclamp, assembly_wcf_final]
        trajectory_3 = robot.plan_cartesian_motion(
                                        frames_WCF ,
                                        start_configuration,
                                        group,
                                        options = {
                                            'max_step' : 4,
                                            'path_constraints' : joint_constraints,
                                            'attached_collision_meshes' : attached_collision_meshes_nobeam,
                                            }
                                        )
        sc.sticky[trajectory_3_key] = trajectory_3


    
    #####################################
    # Attached CM (Take away current beam)
    #####################################
    
    trajectory_1 = sc.sticky[trajectory_1_key]
    trajectory_2 = sc.sticky[trajectory_2_key]
    trajectory_3 = sc.sticky[trajectory_3_key]
    trajectory_4 = sc.sticky[trajectory_4_key]
    
    t1_end_frame = assembly_wcf_inclamp
    t2_end_frame = assembly_wcf_final
    report = []
    
    if trajectory_1 is not None:
        report.append("trajectory_1 planned")
    else:
        report.append("trajectory_1 MISSING")
        
    if trajectory_2 is not None:
        report.append("trajectory_2 planned")
    else:
        report.append("trajectory_2 MISSING")
# ---------- end plan_clamped_beam_path ----------

toggle = BooleanToggle(False)
deg = Degrees(Radians=Slider(1.6, range=-3..10))
panel_10 = Panel(deg)
panel_11 = Panel(plan_clamped_beam_path.report)

# ----
# Visualize Planned Motion
list_3 = ValueList({"Pick Up State": 0, "In Clamp IK": 1, "Final IK": 2, "Planned Path (this script)": 3, "Planned Path (import)": 4}, selected="In Clamp IK")
idx = Slider(0, range=0..328)

rec_3 = DataRecorder(plan_clamped_beam_path.out, DataLimit=-10, RecordData=True)
trajectory_1 = Data([plan_clamped_beam_path.trajectory_1, plan_no_clamp_path.trajectory_1])
trajectory_2 = Data([plan_no_clamp_path.trajectory_2, plan_clamped_beam_path.trajectory_2])
trajectory_3 = Data(plan_clamped_beam_path.trajectory_3)
acms = Data(flatten([plan_clamped_beam_path.attached_collision_meshes, plan_no_clamp_path.attached_collision_meshes]))

# ----
# Position Hack
number_slider_2 = Slider(0, range=-50..100)
Z_2 = UnitZ(Factor=Slider(0, range=0..1000))
Y_2 = UnitY(Factor=number_slider_2)
addition_2 = Addition(A=Z_2, B=Y_2)
move = Move(Geometry=flange_pos_in_robworld_2.assembly_wcf_inclampapproach, Motion=addition_2)  # -> Geometry, Transform
orient_4 = Orient(
    Geometry=[attached_colision_mesh_at_origin_gripper, attached_colision_mesh_at_origin_beam],
    Source=PlaneXY(0, 0, 0),
    Target=move.Geometry)  # -> Geometry, Transform
preview_6 = CustomPreview(Geometry=orient_4.Geometry, Shader=ColourSwatch(SwatchColor=RGBA(153, 255, 0, 0)))

# ----
# Polyline Visualization
panel_12 = Panel(plan_no_clamp_path.report)
waypoints = Waypoints(robot=robot_2, trajectory=trajectory_1)  # -> full_configurations, L, points
waypoints_2 = Waypoints(robot=robot_2, trajectory=trajectory_2)  # -> full_configurations, L, points
len_points = Panel(waypoints.L)
merge_2 = Merge(Data1=flatten(waypoints.full_configurations), Data2=flatten(waypoints_2.full_configurations))
len_points_2 = Panel(waypoints_2.L)
null = NullItem(Item=merge_2)  # -> NullFlags, InvalidFlags, Description
cull = CullPattern(List=merge_2, CullPattern=invert(null.NullFlags))

# ----
# Send Gantry Guy to Park
button_2 = Button()
send_robot_11_to_park = GhPythonScript(robot_11=ghpython_script.robot_11, values=merge, send=button_2)  # -> out; inputs values: list, send: Boolean
# ---------- send_robot_11_to_park: Python ----------
import compas_rrc as rrc
from compas_fab.robots import to_degrees
from copy import deepcopy

assert len(values) == 9
# Values are Ext Values in mm and Joint angles in degrees
# Sending to park

if send:
    # Send Gantry to correct X position first (with 30 sec initial wait)
    robot_11.send(rrc.PrintText('Moving Robot 11 to park'))
    robot_11_current_joints, robot_11_current_ext = robot_11.send_and_wait(rrc.GetJoints(), timeout=30)


    ext_values = values[0:3]
    joint_values = values[3:10]
    robot_11.send(rrc.MoveToJoints(joint_values, ext_values, 500, rrc.Zone.FINE))
# ---------- end send_robot_11_to_park ----------

preview_7 = CustomPreview(Geometry=waypoints.points, Material=ColourSwatch(SwatchColor=RGB(59, 161, 95)))
preview_8 = CustomPreview(Geometry=waypoints_2.points, Material=ColourSwatch(SwatchColor=RGB(59, 154, 161)))

# ----
# IK solution - assembly_wcf_final (columns)
number_slider_3 = Slider(20, range=0..100)
iksolution = GhPythonScript(
    robot=robot_2,
    group=group,
    goal_plane=flange_pos_in_robworld_2.assembly_wcf_inclamp,
    attempts=number_slider_3,
    acm=plan_no_clamp_path.attached_collision_meshes,
    constraints=jointconstraint.joint_constraint,
    start_configuration=pickup_fconfig,
    compute=Button())  # -> out, configuration; inputs attempts: Int32, acm: list, constraints: list
# ---------- iksolution: Python ----------
from compas_rhino.geometry import RhinoPlane

frame = RhinoPlane.from_geometry(goal_plane).to_compas()

#guid = str(ghenv.Component.InstanceGuid)
#response_key = "response_" + guid
#if response_key not in sc.sticky:
#    sc.sticky[response_key] = None

if not compute:
    if start_configuration is None:
        start_configuration = robot.zero_configuration()
    
    options = {
        'avoid_collisions' : True,
        'attempts' : attempts,
        'return_full_configuration' : True,
        'attached_collision_meshes' : acm,
        'constraints' : constraints,
        }
        
    configuration = robot.inverse_kinematics(frame, start_configuration, group, options)
    
    print("Found configuration", configuration)
# ---------- end iksolution ----------

# ----
# IK solution - assembly_wcf_inclampapproach
# IK solution - assembly_wcf_inclamp (columns)
number_slider_4 = Slider(20, range=0..100)
iksolution_sampler = GhPythonScript(
    robot=robot_2,
    process=process_3,
    beam_id=item,
    attempts=number_slider_4,
    constraints=jointconstraint.joint_constraint,
    start_configuration=pickup_fconfig,
    compute=Button())  # -> out, configuration; inputs attempts: Int32, constraints: list; disabled
# ---------- iksolution_sampler: Python ----------
from compas_rhino.geometry import RhinoPlane

guid = str(ghenv.Component.InstanceGuid)
solution_key = "solution_" + guid
if solution_key not in sc.sticky:
    sc.sticky[solution_key] = None
    
group = robot.current_planning_group

if compute:
    # sample a number of X values
    
    sc.sticky[solution_key] = {}
    if start_configuration is None:
        start_configuration = robot.zero_configuration()
    
    options = {
        'avoid_collisions' : True,
        'attempts' : attempts,
        'return_full_configuration' : True,
        'attached_collision_meshes' : acm,
        'constraints' : constraints,
        }
        
    configuration = robot.inverse_kinematics(frame, start_configuration, group, options)
    
    print("Found configuration", configuration)
    
if sc.sticky[solution_key] is not None:
    print sc.sticky[solution_key]
# ---------- end iksolution_sampler ----------

# ----
# IK solution - assembly_wcf_inclampapproach
# IK solution - assembly_wcf_inclamp (columns)
number_slider_5 = Slider(100, range=0..100)
iksolution_2 = GhPythonScript(
    robot=robot_2,
    group=group,
    goal_plane=move.Geometry,
    attempts=number_slider_5,
    acm=acms,
    constraints=jointconstraint.joint_constraint,
    start_configuration=pickup_fconfig,
    compute=Button())  # -> out, configuration; inputs attempts: Int32, acm: list, constraints: list
# ---------- iksolution_2: Python ----------
from compas_rhino.geometry import RhinoPlane

frame = RhinoPlane.from_geometry(goal_plane).to_compas()

#guid = str(ghenv.Component.InstanceGuid)
#response_key = "response_" + guid
#if response_key not in sc.sticky:
#    sc.sticky[response_key] = None
group = robot.current_planning_group

if not compute:
    if start_configuration is None:
        start_configuration = robot.zero_configuration()
    
    options = {
        'avoid_collisions' : True,
        'attempts' : attempts,
        'return_full_configuration' : True,
        'attached_collision_meshes' : acm,
        'constraints' : constraints,
        }
        
    configuration = robot.inverse_kinematics(frame, start_configuration, group, options)
    
    print("Found configuration", configuration)
# ---------- end iksolution_2 ----------

visualize_beams_2 = GhPythonScript(process=process_3, beam_id=item)  # -> out, clamps_on_structure, clamps_frame, clamp_types, clamp_addresses
# ---------- visualize_beams_2: Python ----------
__author__ = "leungp"
__version__ = "2020.02.19"

from compas_ghpython.helpers import mesh_draw
from compas.geometry import Transformation
from compas.datastructures import meshes_join

from Rhino.Geometry import Mesh as RhinoMesh
from compas_ghpython import draw_frame

assembly = process.assembly

###################################
# Clamps (multiple clamps)
###################################
clamp_colours = { 'CL3' : [0,200,0], 'CL3M' : [0,0,200]}
available_clamp_addresses = { 'CL3' : ['1','2'], 'CL3M' : ['3','4']}

clamps_on_structure = []
clamp_types = []
clamp_addresses = []
clamps_frame = []
# Visualize clamps
for neighbour_id in assembly.get_already_built_neighbors(beam_id):
    joint_id = (neighbour_id, beam_id)
    clamp_wcf_final = assembly.get_joint_attribute(joint_id, 'clamp_wcf_final')
    clamp_type = assembly.get_joint_attribute(joint_id, 'clamp_type')
    clamp = process.get_one_clamp_by_type(clamp_type).copy()
    clamp.current_frame = clamp_wcf_final
    clamps_frame.append(draw_frame(clamp_wcf_final))
    clamp.clamp_jaw_position = 120
    clamp.gripper_jaw_position = 0
    clamps_on_structure += [mesh_draw(m, clamp_colours[clamp.type_name]) for m in clamp.draw_visuals()]
    neighbour_seq_id = 'S%i'% assembly.sequence.index(joint_id[0])
    clamp_address = available_clamp_addresses[clamp.type_name].pop(0)
    clamp_addresses.append(clamp_address)
    print ("Install Clamp %s (address %s) on Beam %s (Joint %s-%s)" % (clamp.type_name, clamp_address, neighbour_seq_id, joint_id[0], joint_id[1]))
    clamp_types.append(clamp.type_name)
# ---------- end visualize_beams_2 ----------

# ----
# Clamps on Beam
transform_design_to_robotworld_4 = Transform({TransformCount=1, Name="Orientation", source.origin.x=-50, source.origin.y=850, source.origin.z=0, source.xaxis.x=0, source.xaxis.y=-1, source.xaxis.z=0, source.yaxis.x=1, source.yaxis.y=0, source.yaxis.z=0, target.origin.x=24991.934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})
transform_3 = Transform(Geometry=visualize_beams_2.clamps_frame, Transform=transform_design_to_robotworld_4)
cluster = Cluster(P=transform_3)
tag = TextTag3D(Location=cluster, Text=visualize_beams_2.clamp_types, Size=150, Colour=RGB(191, 191, 191), Justification=5)

panel_13 = Panel("3")

# ----
# Save Trajectory
trajectory_path = GhPythonScript(beam_id=beam_id, seq_id=sequence_number)  # -> t_1_path, t_2_path
# ---------- trajectory_path: Python ----------
from Rhino.RhinoDoc import ActiveDoc
import os
t_1_path = os.path.dirname(ActiveDoc.Path) + os.path.sep + "trajectory_" + beam_id + "_t1.json"
t_2_path = os.path.dirname(ActiveDoc.Path) + os.path.sep + "trajectory_" + beam_id + "_t2.json"
# ---------- end trajectory_path ----------
panel_14 = Panel(trajectory_path.t_1_path)
save = Button()
save_2 = Button()
save_traj = GhPythonScript(trajectory=trajectory_2, path=trajectory_path.t_2_path, save=save)  # -> out, a; inputs save: Boolean
# ---------- save_traj: Python ----------
import json
if save: 
    with open(path, "w") as outfile: 
        json.dump(trajectory.data, outfile)
# ---------- end save_traj ----------
save_traj_2 = GhPythonScript(trajectory=trajectory_1, path=trajectory_path.t_1_path, save=save_2)  # -> out, a; inputs save: Boolean; same code as save_traj

python_7 = GhPythonScript(trajectory=trajectory_1)  # -> out, y, z, a, b, c, d, e, f
# ---------- python_7: Python ----------
from math import degrees
assert len(trajectory.points[0].values) == 8

y = [degrees(point.values[0]) for point in trajectory.points]
z = [degrees(point.values[1]) for point in trajectory.points]

a = [degrees(point.values[2]) for point in trajectory.points]
b = [degrees(point.values[3]) for point in trajectory.points]
c = [degrees(point.values[4]) for point in trajectory.points]
d = [degrees(point.values[5]) for point in trajectory.points]
e = [degrees(point.values[6]) for point in trajectory.points]
f = [degrees(point.values[7]) for point in trajectory.points]
# ---------- end python_7 ----------
panel_15 = Panel(python_7.e)
bnd = Bounds(Numbers=python_7.d)
addition_3 = Addition(A=python_7.d, B=python_7.f)
panel_17 = Panel(bnd)
item_3 = ListItem(List=python_7.e, Index=-1, Wrap=True)
item_4 = ListItem(List=python_7.f, Index=-1, Wrap=True)
item_5 = ListItem(List=python_7.d, Index=-1, Wrap=True)
_5 = Panel(item_3)
_6 = Panel(item_4)
_4 = Panel(item_5)

# ----
# Load Trajectory
trajectory_path_2 = GhPythonScript(beam_id=beam_id, seq_id=item_2)  # -> yijiang_path
# ---------- trajectory_path_2: Python ----------
from Rhino.RhinoDoc import ActiveDoc
import os

yijiang_path = os.path.dirname(ActiveDoc.Path) + os.path.sep + "traj_results" + os.path.sep + "trajectory_dict_" + seq_id.ToLower() + "_" + beam_id.ToLower() + "_full.json"
# ---------- end trajectory_path_2 ----------
path = FilePath(trajectory_path_2)
load_yijiangtraj = GhPythonScript(path=path)  # -> out, transfer, approach_to_inclamp, inclamp_to_final, final_to_retract
# ---------- load_yijiangtraj: Python ----------
import json
from compas_fab.robots import JointTrajectory
with open(path) as f:
  data = json.load(f)
  transfer = JointTrajectory.from_data(data['transfer'])
  approach_to_inclamp = JointTrajectory.from_data(data['approach_to_inclamp'])
  inclamp_to_final = JointTrajectory.from_data(data['inclamp_to_final'])
  final_to_retract = JointTrajectory.from_data(data['final_to_retract'])
# ---------- end load_yijiangtraj ----------
panel_18 = Panel(path)
python_8 = GhPythonScript(x=load_yijiangtraj.inclamp_to_final)  # -> out, a
# ---------- python_8: Python ----------
for p in x.points:
    print p.values
# ---------- end python_8 ----------

# ----
# Basic Trajectory Check
millimeters = Slider(100, range=0..100)
rad = Radians(Degrees=Slider(10, range=0..10))
python_9 = GhPythonScript(
    trajectories=[load_yijiangtraj.transfer, load_yijiangtraj.approach_to_inclamp, load_yijiangtraj.inclamp_to_final, load_yijiangtraj.final_to_retract],
    allowable_linear_jump=millimeters,
    allowable_angular_jump=rad)  # -> out, warn_col, warn_msg, largest_joint_jump; inputs trajectories: list
# ---------- python_9: Python ----------
warn_col = 'lime'
warn_msg = []

def check_point_len(trajectories):
    for trajectory in trajectories:
        for point in trajectory.points:
            if len(point.values) != 8:
                return False
    return True

def check_joint_jump(trajectories, allowable_linear_jump, allowable_angular_jump):
    """ check if the trajectories have large jumps between them.
    allowable_angular_jump : radians
    """
    last_point = None
    for trajectory in trajectories:
        for this_point in trajectory.points:
            if last_point is not None:
                # Check linear jump
                for i in range (0,2):
                    if abs(this_point.values[i] - last_point.values[i]) > allowable_linear_jump: return False
                for i in range (2,8):
                    if abs(this_point.values[i] - last_point.values[i]) > allowable_angular_jump: return False
            last_point = this_point
    return True

def joint_jumps(trajectories):
    """ check if the trajectories have large jumps between them.
    allowable_angular_jump : radians
    """
    largest_jump = [0] * 8
    last_point = None
    for trajectory in trajectories:
        for this_point in trajectory.points:
            if last_point is not None:
                for i in range (0,8):
                    jump = abs(this_point.values[i] - last_point.values[i])
                    if jump > largest_jump[i] : largest_jump[i] = jump
            last_point = this_point
    print largest_jump
    return True

if not check_point_len(trajectories):
    warn_col = 'red'
    warn_msg.append('check_point_len() failed')

# 100mm / 9 deg
if not check_joint_jump(trajectories, allowable_linear_jump, allowable_angular_jump):
    warn_col = 'red'
    warn_msg.append('check_joint_jump() failed. Joint jump larger than threshold')

largest_joint_jump = joint_jumps(trajectories)

if len(warn_msg) == 0:
    warn_msg = "All checks passed."
# ---------- end python_9 ----------
legend_2 = Legend(Colour=python_9.warn_col, Tags=python_9.warn_msg, LegendType=1)

# ----
# Trajectory Polyline Visualization
idx_2 = Slider(0, range=0..1)
waypoints_3 = Waypoints(
    robot=robot_2,
    trajectory=[load_yijiangtraj.transfer, load_yijiangtraj.approach_to_inclamp, load_yijiangtraj.inclamp_to_final, load_yijiangtraj.final_to_retract])  # -> flatten(full_configurations), flatten(L), flatten(points)
animate = PythonScript(robot=robot_2, configurations=waypoints_3.full_configurations, idx=idx_2)  # -> configuration; inputs configurations: list, idx: Int32
# ---------- animate: Python ----------
import Grasshopper
from compas_fab.utilities import map_range
from compas_fab.robots import Configuration

count = len(configurations)
group = robot.current_planning_group

for i in range(ghenv.Component.Params.Input.Count):
    nslider = ghenv.Component.Params.Input[i].Sources[0]
    if nslider.GetType() == Grasshopper.Kernel.Special.GH_NumberSlider:
        nslider.Slider.Maximum = max(count - 1, 1)
        nslider.Slider.Minimum = 0
        if nslider.Slider.Value > nslider.Slider.Maximum:
            nslider.Slider.Value = 0

if count and robot and configurations[0] != None:
    configuration = configurations[idx]
# ---------- end animate ----------
preview_9 = CustomPreview(Geometry=waypoints_3.points, Material=ColourSwatch(SwatchColor=RGB(59, 161, 95)))
number_of_points = Panel(waypoints_3.L)

# ----
# Visualize - Robot Planned Path
animate_2 = PythonScript(robot=robot_2, group=group, configurations=cull, idx=idx)  # -> configuration; inputs configurations: list, idx: Int32
# ---------- animate_2: Python ----------
import Grasshopper
from compas_fab.utilities import map_range
from compas_fab.robots import Configuration

count = len(configurations)

for i in range(ghenv.Component.Params.Input.Count):
    nslider = ghenv.Component.Params.Input[i].Sources[0]
    if nslider.GetType() == Grasshopper.Kernel.Special.GH_NumberSlider and nslider.NickName == 'idx':
        nslider.Slider.Maximum = max(count - 1, 1)
        nslider.Slider.Minimum = 0
        if nslider.Slider.Value > nslider.Slider.Maximum:
            nslider.Slider.Value = 0

if count and robot and configurations[0] != None:
    configuration = configurations[idx]
# ---------- end animate_2 ----------
filter = StreamFilter(
    Gate=list_3,
    Stream0=pickup_fconfig,
    Stream1=iksolution_2.configuration,
    Stream2=iksolution.configuration,
    Stream3=animate_2,
    Stream4=animate)
show_end_effector_frame = BooleanToggle(True)
show_base_frame = BooleanToggle(False)
show_collision = BooleanToggle(False)
show_frames = BooleanToggle(False)
show_visual = BooleanToggle(True)
show_acm = BooleanToggle(True)
show_tool = BooleanToggle(False)
visualize = PythonScript(
    robot=robot_2,
    acms=acms,
    group="robot12_eaYZ",
    configuration=filter,
    show_visual=show_visual,
    show_acm=show_acm,
    show_tool=show_tool,
    show_collision=show_collision)  # -> robot, visual, acm_meshes, collision, tool, frames, frames_color, planes, ee_frame; inputs acms: list, tool_visualization: list of Mesh, show_tool: Boolean
# ---------- visualize: Python ----------
import Rhino.Geometry as rg
import ghpythonlib.components as ghcomp

from compas.geometry import Vector, Point
from compas_ghpython.utilities import draw_pipes
from compas_ghpython.utilities import draw_frame
from compas.geometry import Transformation, Scale

from ghpythonlib.components import Transform as gh_Transform

from System.Drawing import Color
from compas_ghpython import draw_frame
from compas_ghpython.helpers import mesh_draw

if robot and configuration:
    #print configuration
    frames = []
    
    robot.artist.update(configuration, visual=show_visual, collision=show_collision)
    
    if show_visual:
        visual = robot.artist.draw_visual()
    
    if show_tool:
        if robot.attached_tool:
            _ee_frame = robot.forward_kinematics(configuration, group=group)
            tool_T = rg.Transform.PlaneToPlane(rg.Plane.WorldXY, cFrame2rPlane(_ee_frame))
            tool = gh_Transform(tool_visualization, tool_T)
    
    if show_acm:
        
        acm_meshes = []
        for acm in acms:
            _acm_mesh = acm.collision_mesh.mesh.transformed(Scale.from_factors([robot.scale_factor] * 3))
            _ee_frame = robot.forward_kinematics(configuration, group=group, options = {'ee_link' : acm.link_name})
            _acm_mesh = _acm_mesh.transformed(Transformation.from_frame(_ee_frame))
            acm_meshes.append(mesh_draw(_acm_mesh))
      
    if show_collision:
        collision = robot.artist.draw_collision()


ee_frame = draw_frame( robot.forward_kinematics(configuration, group=group))
# ---------- end visualize ----------
preview_10 = CustomPreview(Geometry=visualize.acm_meshes, Shader=ColourSwatch(SwatchColor=RGBA(112, 112, 112, 218)))
preview_11 = CustomPreview(Geometry=visualize.visual, Shader=ColourSwatch(SwatchColor=RGBA(105, 105, 105, 0)))
preview_12 = CustomPreview(Geometry=visualize.collision, Shader=ColourSwatch(SwatchColor=RGBA(255, 0, 0, 200)))
preview_13 = CustomPreview(Geometry=visualize.tool, Shader=ColourSwatch(SwatchColor=RGB(66, 66, 66)))
preview_14 = CustomPreview(Geometry=visualize.frames, Shader=visualize.frames_color)

# ----
# Sender for Columns
number_slider_6 = Slider(-0.76, range=-2..2)
send_t3_final_to_retract = Button()
send_robot_to_pick_up_point = Button()
send_t1_transfer_path = Button()
send_t2_to_final = Button()
transform_design_to_robotworld_5 = Transform({TransformCount=1, Name="Orientation", source.origin.x=-50, source.origin.y=850, source.origin.z=0, source.xaxis.x=0, source.xaxis.y=-1, source.xaxis.z=0, source.yaxis.x=1, source.yaxis.y=0, source.yaxis.z=0, target.origin.x=24991.934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})
movel___to_t1_end_inclampapproach = Button()
send_trajectory_columns = GhPythonScript(
    robot_11=ghpython_script.robot_11,
    robot_12=ghpython_script.robot_12,
    robot_12_J6_offset=number_slider_6,
    process=process_3,
    beam_id=item,
    robot_world_transform=transform_design_to_robotworld_5,
    trajectory1=load_yijiangtraj.transfer,
    trajectory2=load_yijiangtraj.inclamp_to_final,
    trajectory3=load_yijiangtraj.final_to_retract,
    send_pickup_point=send_robot_to_pick_up_point,
    send1=send_t1_transfer_path,
    send_t1_end=movel___to_t1_end_inclampapproach,
    send2=send_t2_to_final,
    send3=send_t3_final_to_retract)  # -> out
# ---------- send_trajectory_columns: Python ----------
import compas_rrc as rrc
from compas_fab.robots import to_degrees
from copy import deepcopy
from compas.geometry import Vector, Frame, Translation, Transformation, Rotation
from math import radians


def transformation_from_xform(transformation):
    """Creates a Compas Transformation instance from a Rhino Transform
    """
    transform = Transformation()
    for i in range(0, 4):
        for j in range(0, 4):
            transform[i, j] = transformation[i, j]
    return transform

def flange_frame_at(process, beam_id, attribute_name, transformation = None):
    """ Returns the T0CP (robot flange) for the gripper at different location.
    The result takes into account the gripper (tool) and toolchanger (tool) offsets.
    
    Optional transformation can be supplied for transforming from design-world to Robot-world
    This function has a side effect changing the process.toolchanger and gripper 's current frame.
    """
    if process.get_gripper_t0cp_for_beam_at(beam_id, attribute_name) is None:
        return None  # Return None if the position doesn't exist

    assembly = process.assembly
    gripper_type = assembly.get_beam_attribute(beam_id, 'gripper_type')
    gripper = process.get_one_gripper_by_type(gripper_type)
    toolchanger = process.robot_toolchanger

    gripper_t0cp = process.get_gripper_t0cp_for_beam_at(beam_id, attribute_name)
    toolchanger.set_current_frame_from_tcp(gripper_t0cp)
    t0cp = toolchanger.current_frame.copy()
    # Post transformation
    if transformation is not None:
        t0cp.transform(transformation)
    return t0cp

def intermediate_frame_by_distance(source, target, distance_to_target):
    move_backwards_vector = Vector.from_start_end(target.point, source.point).unitized()
    move_backwards_vector.scale(distance_to_target)
    intermediate_frame_point = target.point.transformed(Translation.from_vector(move_backwards_vector))
    intermediate_frame = Frame(intermediate_frame_point, target.xaxis, target.yaxis)
    return intermediate_frame
    
def fix_joint_6(joint_values):
    joint_values[-1] += robot_12_J6_offset
    return joint_values

def fix_frame_joint_6(frame):
    T = Rotation.from_axis_and_angle(frame.zaxis, radians(robot_12_J6_offset), frame.point)
    frame = frame.transformed(T)
    return frame

########################################
# Compute target frames location
########################################

robot_world_transform = transformation_from_xform(robot_world_transform)

assembly_wcf_inclamp =  flange_frame_at(process, beam_id, 'assembly_wcf_inclamp', robot_world_transform)
assembly_wcf_final =  flange_frame_at(process, beam_id, 'assembly_wcf_final', robot_world_transform)
assembly_wcf_finalretract =  flange_frame_at(process, beam_id, 'assembly_wcf_finalretract', robot_world_transform)
inclamp_to_final_dist = assembly_wcf_inclamp.point.distance_to_point(assembly_wcf_final.point)

t1_end_frame = assembly_wcf_inclamp
t2_end_frame = assembly_wcf_final
t3_end_frame = assembly_wcf_finalretract

t1_start_config_dict = dict(zip(trajectory1.start_configuration.joint_names, trajectory1.start_configuration.values))
t1_gantry_x = t1_start_config_dict['bridge1_joint_EA_X']

########################################
# Functions to execute Trajectory
########################################

def execute_pick_up_point():
    """ Execute Send Robot to Starting Point """
    
    # Send user confirm message
    robot_12.send(rrc.CustomInstruction('r_A067_TPErase'))
    robot_12.send(rrc.CustomInstruction('r_A067_TPPlot',['Press PLAY to move to starting point. Gantry and Robot 12 will move']))
    robot_11.send(rrc.Stop())
    robot_12.send(rrc.Stop())
    
    # Send Gantry to correct X position first (with 30 sec initial wait)
    robot_11_current_joints, robot_11_current_ext = robot_11.send_and_wait(rrc.GetJoints(), timeout=30)
    robot_11_current_ext[0] = t1_gantry_x
    robot_11.send(rrc.MoveToJoints(robot_11_current_joints, robot_11_current_ext, 500, rrc.Zone.FINE))
    
    ext_values = [t1_gantry_x] + trajectory1.points[0].values[0:2]
    joint_values = to_degrees(trajectory1.points[0].values[2:9])
    robot_12.send(rrc.MoveToJoints(fix_joint_6(joint_values), ext_values, 500, rrc.Zone.FINE))
    robot_12.send(rrc.CustomInstruction('r_A067_TPPlot',['Starting Point Reached']))

def execute_trajectory_1():
    """ Execute Trajectory 1 - transfer """
    
    # Send user confirm message
    robot_12.send(rrc.SetTool('tool0'))
    robot_12.send(rrc.CustomInstruction('r_A067_TPErase'))
    robot_12.send(rrc.CustomInstruction('r_A067_TPPlot',['Press PLAY to execute Trajectory 1 (Transfer to inclampapproach)']))
    robot_12.send(rrc.Stop())
    robot_12.send(rrc.CustomInstruction('r_A067_TPPlot',['Trajectory 1 begins']))
    
    # Send Gantry to correct X position first (with 30 sec initial wait)
    robot_11_current_joints, robot_11_current_ext = robot_11.send_and_wait(rrc.GetJoints(), timeout=30)
    robot_11_current_ext[0] = t1_gantry_x
    robot_11.send(rrc.MoveToJoints(robot_11_current_joints, robot_11_current_ext, 1000, rrc.Zone.FINE))
    
    # Send the rest of the trajectory
    for n, point in enumerate(trajectory1.points):
        assert len(point.values) == 8
        ext_values = [t1_gantry_x] + point.values[0:2]
        joint_values = to_degrees(point.values[2:9])
        print (ext_values, joint_values)
        zone = rrc.Zone.Z0
        speed = 1000
        # Speed and acuracy override for final moments.
        if len(trajectory1.points) - n < 6:
            zone = rrc.Zone.FINE
            speed = 20
        robot_12.send(rrc.MoveToJoints(fix_joint_6(joint_values), ext_values, speed, zone))

    # Send last point as fine point
    robot_12.send(rrc.CustomInstruction('r_A067_TPPlot',['Trajectory 1 completed']))

def execute_trajectory_1_endPoint():
    # Send user confirm message
    robot_12.send(rrc.CustomInstruction('r_A067_TPErase'))
    robot_12.send(rrc.CustomInstruction('r_A067_TPPlot',['Press PLAY to moveL to inclampapproach']))
    robot_12.send(rrc.Stop())
    robot_12.send(rrc.CustomInstruction('r_A067_TPPlot',['Move L to inclampapproach begins']))
    
    # Deactiavtes Soft Move just to be sure.
    #robot_12.send(rrc.CustomInstruction('r_A067_DeactSoftServo'))
    robot_12.send(rrc.CustomInstruction("r_A067_DeactSoftMove"))
    
    # Send movement
    t1_last_ext_values = [t1_gantry_x] + trajectory1.points[-1].values[0:2]
    robot_12.send(rrc.MoveToRobtarget(fix_frame_joint_6(t1_end_frame), t1_last_ext_values, 20, rrc.Zone.FINE))
    robot_12.send(rrc.CustomInstruction('r_A067_TPPlot',['Move L to inclampapproach completed']))


def execute_trajectory_2():
    """ Execute Trajectory 2 - Soft Move to Column Final.
    """
    # Send user confirm message
    robot_12.send(rrc.CustomInstruction('r_A067_TPErase'))
    robot_12.send(rrc.CustomInstruction('r_A067_TPPlot',['Press PLAY to execute Trajectory 2 (soft to final)']))
    robot_12.send(rrc.SetTool('t_A067_T1_Gripper'))
    robot_12.send(rrc.Stop())
    robot_12.send(rrc.CustomInstruction('r_A067_TPPlot',['Trajectory 2 begins']))
    
    # Send intermediate frame
    intermediate_frame = intermediate_frame_by_distance(t1_end_frame, t2_end_frame, 20)
    robot_12.send(rrc.CustomInstruction('r_A067_TPPlot',['Begin moving to intermediate_frame']))
    t2_last_ext_values = [t1_gantry_x] + trajectory2.points[-1].values[0:2]
    robot_12.send(rrc.MoveToRobtarget(fix_frame_joint_6(intermediate_frame), t2_last_ext_values, 10, rrc.Zone.FINE)) 
    robot_12.send(rrc.CustomInstruction('r_A067_TPPlot',['Intermediate plane reached']))

    # Make Robot Soft
    soft_direction = "XYZ"           # soft_direction modes available are "Z", "XY", "XYZ"
    stiffness = 70                   # Stiffness in the specified direction, 0 is softest, 100 is stiffness
    stiffness_non_soft_dir = 80     # Stiffness in the other non specified direction, 0 is softest, 100 is stiffness
    robot_12.send(rrc.CustomInstruction("r_A067_ActSoftMove", [soft_direction], [stiffness, stiffness_non_soft_dir]))
    #robot_12.send(rrc.CustomInstruction('r_A067_ActSoftServo'))
    robot_12.send(rrc.MoveToRobtarget(fix_frame_joint_6(t2_end_frame), t2_last_ext_values, 10, rrc.Zone.FINE))
    robot_12.send(rrc.CustomInstruction('r_A067_TPPlot',['Trajectory 2 target reached, robot is still soft.']))
    robot_12.send(rrc.CustomInstruction('r_A067_TPPlot',['Press PLAY again after fixing to foundation.']))
    robot_12.send(rrc.Stop())
    
    # Send the robot to be hard again
    robot_12.send(rrc.CustomInstruction("r_A067_DeactSoftMove"))
    #robot_12.send(rrc.CustomInstruction('r_A067_DeactSoftServo'))
    robot_12.send(rrc.CustomInstruction('r_A067_TPPlot',['Trajectory 2 completed']))

def execute_trajectory_final_to_retract():
    # Send user confirm message
    robot_12.send(rrc.CustomInstruction('r_A067_TPErase'))
    robot_12.send(rrc.CustomInstruction('r_A067_TPPlot',['Press PLAY to execute Trajectory 3 (to retract)']))
    robot_12.send(rrc.SetTool('t_A067_T1_Gripper'))
    robot_12.send(rrc.Stop())
    
    # Send the trajectory
    robot_12.send(rrc.CustomInstruction('r_A067_TPPlot',['Trajectory 3 begins']))
    for point in trajectory3.points:
        assert len(point.values) == 8
        ext_values = [t1_gantry_x] + point.values[0:2]
        joint_values = to_degrees(point.values[2:9])
        print (ext_values, joint_values)
        robot_12.send(rrc.MoveToJoints(fix_joint_6(joint_values), ext_values, 20, rrc.Zone.Z0))
        
    robot_12.send(rrc.CustomInstruction('r_A067_TPPlot',['Trajectory 3 completed']))

if len(process.assembly.get_already_built_neighbors(beam_id)) > 0:
    print ('Selected beam have clamps. Use a different sender.')
else:
    if send_pickup_point:
        execute_pick_up_point()
    if send1:
        execute_trajectory_1()
    if send_t1_end:
        execute_trajectory_1_endPoint()
    if send2:
        execute_trajectory_2()
    if send3:
        execute_trajectory_final_to_retract()
# ---------- end send_trajectory_columns ----------
rec_4 = DataRecorder(send_trajectory_columns, DataLimit=-10, RecordData=True)
panel_19 = Panel(rec_4)

# ----
# Sender for Clamped Pieces
send_t1_transfer_path_2 = Button()
send_t2_approach_to_inclamp = Button()
send_t3_inclamp_to_final = Button()
send_t4_final_to_retract = Button()
send_robot_to_pick_up_point_2 = Button()
movel___to_t2_end_inclamp = Button()
movel___to_t1_end_inclampapproach_2 = Button()
transform_design_to_robotworld_6 = Transform({TransformCount=1, Name="Orientation", source.origin.x=-50, source.origin.y=850, source.origin.z=0, source.xaxis.x=0, source.xaxis.y=-1, source.xaxis.z=0, source.yaxis.x=1, source.yaxis.y=0, source.yaxis.z=0, target.origin.x=24991.934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})
send_trajectory_clamped = GhPythonScript(
    robot_11=ghpython_script.robot_11,
    robot_12=ghpython_script.robot_12,
    robot_12_J6_offset=Slider(-0.76, range=-2..2),
    clamp_connection=python_3.clamps_connection,
    process=process_3,
    beam_id=item,
    robot_world_transform=transform_design_to_robotworld_6,
    trajectory1=load_yijiangtraj.transfer,
    trajectory2=load_yijiangtraj.approach_to_inclamp,
    trajectory3=load_yijiangtraj.inclamp_to_final,
    trajectory4=load_yijiangtraj.final_to_retract,
    clamping_velocity=Slider(4, range=0.5..4),
    send_pickup_point=send_robot_to_pick_up_point_2,
    send1=send_t1_transfer_path_2,
    send_t1_end=movel___to_t1_end_inclampapproach_2,
    send2=send_t2_approach_to_inclamp,
    send_t2_end=movel___to_t2_end_inclamp,
    send3=send_t3_inclamp_to_final,
    send4=send_t4_final_to_retract)  # -> out, warn_col, warn_msg, clamps_types, clamps_address, clamps_frame, clamps_instructions; inputs send2: Boolean, send3: Boolean, send4: Boolean
# ---------- send_trajectory_clamped: Python ----------
import compas_rrc as rrc
from compas_fab.robots import to_degrees
from math import radians
from copy import deepcopy
from compas_ghpython import draw_frame
from compas.geometry import Vector, Frame, Translation, Transformation
from compas.geometry import Rotation


def transformation_from_xform(transformation):
    """Creates a Compas Transformation instance from a Rhino Transform
    """
    transform = Transformation()
    for i in range(0, 4):
        for j in range(0, 4):
            transform[i, j] = transformation[i, j]
    return transform

def flange_frame_at(process, beam_id, attribute_name, transformation = None):
    """ Returns the T0CP (robot flange) for the gripper at different location.
    The result takes into account the gripper (tool) and toolchanger (tool) offsets.
    
    Optional transformation can be supplied for transforming from design-world to Robot-world
    This function has a side effect changing the process.toolchanger and gripper 's current frame.
    """
    if process.get_gripper_t0cp_for_beam_at(beam_id, attribute_name) is None:
        return None  # Return None if the position doesn't exist

    assembly = process.assembly
    gripper_type = assembly.get_beam_attribute(beam_id, 'gripper_type')
    gripper = process.get_one_gripper_by_type(gripper_type)
    toolchanger = process.robot_toolchanger

    gripper_t0cp = process.get_gripper_t0cp_for_beam_at(beam_id, attribute_name)
    toolchanger.set_current_frame_from_tcp(gripper_t0cp)
    t0cp = toolchanger.current_frame.copy()
    # Post transformation
    if transformation is not None:
        t0cp.transform(transformation)
    return t0cp

def fix_joint_6(joint_values):
    joint_values[-1] += robot_12_J6_offset
    return joint_values

def fix_frame_joint_6(frame):
    T = Rotation.from_axis_and_angle(frame.zaxis, radians(robot_12_J6_offset), frame.point)
    frame = frame.transformed(T)
    return frame

########################################
# Compute target frames location
########################################
robot_world_transform = transformation_from_xform(robot_world_transform)

assembly_wcf_inclampapproach =  flange_frame_at(process, beam_id, 'assembly_wcf_inclampapproach', robot_world_transform)
assembly_wcf_inclamp =  flange_frame_at(process, beam_id, 'assembly_wcf_inclamp', robot_world_transform)
assembly_wcf_final =  flange_frame_at(process, beam_id, 'assembly_wcf_final', robot_world_transform)
assembly_wcf_finalretract =  flange_frame_at(process, beam_id, 'assembly_wcf_finalretract', robot_world_transform)
inclamp_to_final_dist = assembly_wcf_inclamp.point.distance_to_point(assembly_wcf_final.point)

t1_end_frame = assembly_wcf_inclampapproach
t2_end_frame = assembly_wcf_inclamp
t3_end_frame = assembly_wcf_final
t4_end_frame = assembly_wcf_finalretract

########################################
# Clamps (deciding which clamps to use)
########################################
assembly = process.assembly


available_clamp_addresses = { 'CL3' : ['1','2'], 'CL3M' : ['3','4']}
clamp_open_position = 220
clamp_start_position = 205
clamp_close_position = 102
clamps_types = []
clamps_address = []
clamps_frame = []
clamps_instructions = []

########################################
# Visualize clamps for manual placement
########################################

for neighbour_id in assembly.get_already_built_neighbors(beam_id):
    joint_id = (neighbour_id, beam_id)
    clamp_wcf_final = assembly.get_joint_attribute(joint_id, 'clamp_wcf_final')
    clamp_type = assembly.get_joint_attribute(joint_id, 'clamp_type')
    clamp = process.get_one_clamp_by_type(clamp_type).copy()
    clamp.current_frame = clamp_wcf_final
    clamps_frame.append(draw_frame(clamp_wcf_final))
    clamp.clamp_jaw_position = 120
    clamp.gripper_jaw_position = 0
    neighbour_seq_id = 'S%i'% assembly.sequence.index(joint_id[0])
    clamp_address = available_clamp_addresses[clamp.type_name].pop(0)
    clamps_address.append(clamp_address)
    clamps_instructions.append("Install Clamp %s (address %s) on Beam %s (Joint %s-%s)" % (clamp.type_name, clamp_address, neighbour_seq_id, joint_id[0], joint_id[1]))
    clamps_types.append(clamp.type_name)


t1_start_config_dict = dict(zip(trajectory1.start_configuration.joint_names, trajectory1.start_configuration.values))
t1_gantry_x = t1_start_config_dict['bridge1_joint_EA_X']

########################################
# Functions to execute Trajectory
########################################

def execute_pick_up_point():
    """ Execute Send Robot to Starting Point """

    # Send user confirm message
    robot_12.send(rrc.CustomInstruction('r_A067_TPErase'))
    robot_12.send(rrc.CustomInstruction('r_A067_TPPlot',['Press PLAY to move to starting point. Gantry and Robot 12 will move']))
    robot_11.send(rrc.Stop())
    robot_12.send(rrc.Stop())
    
    # Send Gantry to correct X position first (with 30 sec initial wait)
    robot_11_current_joints, robot_11_current_ext = robot_11.send_and_wait(rrc.GetJoints(), timeout=30)
    robot_11_current_ext[0] = t1_gantry_x
    robot_11.send(rrc.MoveToJoints(robot_11_current_joints, robot_11_current_ext, 500, rrc.Zone.FINE))
    
    ext_values = [t1_gantry_x] + trajectory1.points[0].values[0:2]
    joint_values = to_degrees(trajectory1.points[0].values[2:9])
    robot_12.send(rrc.MoveToJoints(fix_joint_6(joint_values), ext_values, 500, rrc.Zone.FINE))
    robot_12.send(rrc.CustomInstruction('r_A067_TPPlot',['Starting Point Reached']))
    

def execute_trajectory_1():
    """ Execute Trajectory 1 - transfer """
    
    # Send user confirm message
    robot_12.send(rrc.SetTool('tool0'))
    robot_12.send(rrc.CustomInstruction('r_A067_TPErase'))
    robot_12.send(rrc.CustomInstruction('r_A067_TPPlot',['Press PLAY to execute Trajectory 1 (Transfer to inclampapproach)']))
    robot_12.send(rrc.Stop())
    robot_12.send(rrc.CustomInstruction('r_A067_TPPlot',['Trajectory 1 begins']))
    
    # Send Gantry to correct X position first (with 30 sec initial wait)
    robot_11_current_joints, robot_11_current_ext = robot_11.send_and_wait(rrc.GetJoints(), timeout=30)
    robot_11_current_ext[0] = t1_gantry_x
    robot_11.send(rrc.MoveToJoints(robot_11_current_joints, robot_11_current_ext, 1000, rrc.Zone.FINE))
    
    # Send the rest of the trajectory
    for n, point in enumerate(trajectory1.points):
        assert len(point.values) == 8
        ext_values = [t1_gantry_x] + point.values[0:2]
        joint_values = to_degrees(point.values[2:9])
        print (ext_values, joint_values)
        zone = rrc.Zone.Z0
        speed = 1000
        # Speed and acuracy override for final moments.
        if len(trajectory1.points) - n < 6:
            zone = rrc.Zone.FINE
            speed = 20
        robot_12.send(rrc.MoveToJoints(fix_joint_6(joint_values), ext_values, speed, zone))

    robot_12.send(rrc.CustomInstruction('r_A067_TPPlot',['Trajectory 1 completed']))

def execute_trajectory_1_endPoint():
    # Send user confirm message
    robot_12.send(rrc.CustomInstruction('r_A067_TPErase'))
    robot_12.send(rrc.CustomInstruction('r_A067_TPPlot',['Press PLAY to moveL to inclampapproach']))
    robot_12.send(rrc.Stop())
    robot_12.send(rrc.CustomInstruction('r_A067_TPPlot',['Move L to inclampapproach begins']))

    # Send movement
    #robot_12.send(rrc.CustomInstruction('r_A067_DeactSoftServo'))
    robot_12.send(rrc.CustomInstruction("r_A067_DeactSoftMove"))
    t1_last_ext_values = [t1_gantry_x] + trajectory1.points[-1].values[0:2]
    robot_12.send(rrc.MoveToRobtarget(fix_frame_joint_6(t1_end_frame), t1_last_ext_values, 20, rrc.Zone.FINE))
    robot_12.send(rrc.CustomInstruction('r_A067_TPPlot',['Move L to inclampapproach completed']))

def execute_trajectory_2():
    # Send user confirm message
    robot_12.send(rrc.CustomInstruction('r_A067_TPErase'))
    robot_12.send(rrc.CustomInstruction('r_A067_TPPlot',['Press PLAY to execute Trajectory 2 (inclampapproach)']))
    robot_12.send(rrc.Stop())
    robot_12.send(rrc.CustomInstruction('r_A067_TPPlot',['Trajectory 2 begins']))
    
    # Send the trajectory
    for point in trajectory2.points:
        assert len(point.values) == 8
        ext_values = [t1_gantry_x] + point.values[0:2]
        joint_values = to_degrees(point.values[2:9])
        print (ext_values, joint_values)
        robot_12.send(rrc.MoveToJoints(fix_joint_6(joint_values), ext_values, 10, rrc.Zone.Z0))
    
    robot_12.send(rrc.CustomInstruction('r_A067_TPPlot',['Trajectory 2 completed']))

def execute_trajectory_2_endPoint():
    # Send user confirm message
    robot_12.send(rrc.CustomInstruction('r_A067_TPErase'))
    robot_12.send(rrc.CustomInstruction('r_A067_TPPlot',['Press PLAY to moveL to inclamp']))
    robot_12.send(rrc.SetTool('t_A067_T1_Gripper'))
    robot_12.send(rrc.Stop())
    robot_12.send(rrc.PrintText('Move L to inclamp begins'))
    
    # Deactiavtes Soft Move just to be sure.
    robot_12.send(rrc.CustomInstruction("r_A067_DeactSoftMove"))
    #robot_12.send(rrc.CustomInstruction('r_A067_DeactSoftServo'))
    
    # Send movement
    t2_last_ext_values = [t1_gantry_x] + trajectory1.points[-1].values[0:2]
    robot_12.send(rrc.MoveToRobtarget(fix_frame_joint_6(t2_end_frame), t2_last_ext_values, 20, rrc.Zone.FINE))
    robot_12.send(rrc.CustomInstruction('r_A067_TPPlot',['MoveL to inclamp completed']))

def intermediate_frame_by_distance(source, target, distance_to_target):
    move_backwards_vector = Vector.from_start_end(target.point, source.point).unitized()
    move_backwards_vector.scale(distance_to_target)
    intermediate_frame_point = target.point.transformed(Translation.from_vector(move_backwards_vector))
    intermediate_frame = Frame(intermediate_frame_point, target.xaxis, target.yaxis)
    return intermediate_frame

def execute_trajectory_3():
    # Send user confirm message
    robot_12.send(rrc.CustomInstruction('r_A067_TPErase'))
    robot_12.send(rrc.CustomInstruction('r_A067_TPPlot',['Press PLAY to execute Trajectory 3 (soft to final)']))
    robot_12.send(rrc.SetTool('t_A067_T1_Gripper'))
    robot_12.send(rrc.Stop())
    robot_12.send_and_wait(rrc.CustomInstruction('r_A067_TPPlot',['Trajectory 3 begins']), timeout=120)
    
    robot_12.send(rrc.CustomInstruction('r_A067_TPPlot',['Checking Clamp Connection']))
    # Close Jaw until it touches beam at 205mm
    result = clamp_connection.send_ROS_VEL_GOTO_COMMAND_wait(clamps_address, clamp_start_position, clamping_velocity)
    if not result:
        print "clamp_connection not ok"
        robot_12.send(rrc.CustomInstruction('r_A067_TPPlot',['- Clamp Connection Fails. Execution stopped.']))
        return
    #Trajectory 3 with clamps begins. Make sure Speed is 100pct. 
    robot_12.send(rrc.CustomInstruction('r_A067_TPPlot',['- Clamp Connection OK']))
    robot_12.send(rrc.CustomInstruction('r_A067_TPPlot',['Press PLAY after clamps stops.']))
    robot_12.send(rrc.Stop())
    
    # Compute intermediate plane before soft move kicks in.
    distance_to_target = 55
    t3_last_ext_values = [t1_gantry_x] + trajectory1.points[-1].values[0:2]
    intermediate_frame = intermediate_frame_by_distance(t2_end_frame, t3_end_frame, 55)
    
    # User press Play
    # send_and_wait() used to sync robot command with the clamp commands
    robot_12.send_and_wait(rrc.CustomInstruction('r_A067_TPPlot',['Trajectory 3 with clamps begins.']), timeout=120)
    
    # Send command to clamps first and confirm if ok.
    result = clamp_connection.send_ROS_VEL_GOTO_COMMAND_wait(clamps_address, clamp_close_position, clamping_velocity)
    if not result:
        clamp_connection.send_ROS_STOP_COMMAND(clamps_address)
        robot_12.send(rrc.CustomInstruction('r_A067_TPPlot',['Clamp Movement Command Fails. Execution stopped.']))
        return
    
    # Send command to robot.
    # Send intermediate plane (Fine point such that program pointer wait)
    robot_12.send(rrc.CustomInstruction('r_A067_TPPlot',['Begin moving to intermediate_frame']))
    robot_12.send(rrc.MoveToRobtarget(fix_frame_joint_6(intermediate_frame), t3_last_ext_values, clamping_velocity, rrc.Zone.Z0)) 
    robot_12.send(rrc.CustomInstruction('r_A067_TPPlot',['Intermediate plane reached']))
    # Activate soft servo and send final plane
    soft_direction = "XYRZ"           # soft_direction modes available are "Z", "XY", "XYZ"
    stiffness = 10                   # Stiffness in the specified direction, 0 is softest, 100 is stiffness
    stiffness_non_soft_dir = 80     # Stiffness in the other non specified direction, 0 is softest, 100 is stiffness
    robot_12.send(rrc.CustomInstruction("r_A067_ActSoftMove", [soft_direction], [stiffness, stiffness_non_soft_dir]))

    #robot_12.send(rrc.CustomInstruction('r_A067_ActSoftServo'))
    robot_12.send(rrc.MoveToRobtarget(fix_frame_joint_6(t3_end_frame), t3_last_ext_values, clamping_velocity, rrc.Zone.FINE))
    
    
    # Send the robot to be hard again
    robot_12.send(rrc.CustomInstruction("r_A067_DeactSoftMove"))
    #robot_12.send(rrc.CustomInstruction('r_A067_DeactSoftServo'))
    robot_12.send(rrc.CustomInstruction('r_A067_TPPlot',['Trajectory 3 with clamps completed. Congratulations!']))

def execute_trajectory_final_to_retract():
    
    # Send user confirm message
    robot_12.send(rrc.CustomInstruction('r_A067_TPErase'))
    robot_12.send(rrc.CustomInstruction('r_A067_TPPlot',['Press PLAY to execute Trajectory 4 (to retract)']))
    robot_12.send(rrc.SetTool('t_A067_T1_Gripper'))
    robot_12.send(rrc.Stop())
    
    # Send the trajectory
    robot_12.send(rrc.CustomInstruction('r_A067_TPPlot',['Trajectory 4 begins']))
    for point in trajectory4.points:
        assert len(point.values) == 8
        ext_values = [t1_gantry_x] + point.values[0:2]
        joint_values = to_degrees(point.values[2:9])
        print (ext_values, joint_values)
        robot_12.send(rrc.MoveToJoints(fix_joint_6(joint_values), ext_values, 20, rrc.Zone.Z0))
        
    robot_12.send(rrc.CustomInstruction('r_A067_TPPlot',['Trajectory 4 completed']))


if len(clamps_address) > 0:
    if send_pickup_point:
        execute_pick_up_point()
    if send1:
        execute_trajectory_1()
    if send_t1_end:
        execute_trajectory_1_endPoint()
    if send2:
        execute_trajectory_2()
    if send_t2_end:
        execute_trajectory_2_endPoint()
    if send3:
        execute_trajectory_3()
    if send4:
        execute_trajectory_final_to_retract()
else:
    print ('Selected beam do not have clamps. Use a different sender.')
# ---------- end send_trajectory_clamped ----------
rec_5 = DataRecorder(send_trajectory_clamped.out, DataLimit=-10, RecordData=True)
panel_20 = Panel(send_trajectory_clamped.clamps_instructions)
panel_21 = Panel(rec_5)

send_to_tool_change_position = Button()
robot_11_yz_6joints_3 = Panel("""23640
-0
-4900
0
-70
60
0
0
0""")
robot_12_yz_6joints_3 = Panel("""-4056
-2700
0
30
-30
0
85
0""")
send_trajectory_columns_2 = GhPythonScript(
    robot_11=ghpython_script.robot_11,
    robot_12=ghpython_script.robot_12,
    robot_11_values=robot_11_yz_6joints_3,
    robot_12_values=robot_12_yz_6joints_3,
    robot_12_J6_offset=number_slider_6,
    send_toolchange_point=send_to_tool_change_position)  # -> out; inputs robot_11_values: list, robot_12_values: list
# ---------- send_trajectory_columns_2: Python ----------
import compas_rrc as rrc
from compas_fab.robots import to_degrees
from copy import deepcopy
from compas.geometry import Vector, Frame, Translation, Transformation, Rotation
from math import radians

def fix_joint_6(joint_values):
    joint_values[-1] += robot_12_J6_offset
    return joint_values

def fix_frame_joint_6(frame):
    T = Rotation.from_axis_and_angle(frame.zaxis, radians(robot_12_J6_offset), frame.point)
    frame = frame.transformed(T)
    return frame

assert len(robot_11_values) == 9
assert len(robot_12_values) == 8

# Sending Trajectory 1 (Transfer)
if send_toolchange_point:
    # Send user confirm message
    robot_12.send(rrc.PrintText('Press PLAY to move to ToolChange Point'))
    robot_12.send(rrc.Stop())
    robot_11.send(rrc.Stop())

    jnt_values = robot_11_values[3:10]
    ext_values = robot_11_values[0:3]
    print "robot_11", jnt_values, ext_values
    robot_11.send(rrc.MoveToJoints(jnt_values, ext_values, 500, rrc.Zone.FINE))
    
    jnt_values = fix_joint_6(robot_12_values[2:9])
    ext_values = robot_11_values[0:1] + robot_12_values[0:2]
    print "robot_12", jnt_values, ext_values
    robot_12.send(rrc.MoveToJoints(jnt_values, ext_values, 500, rrc.Zone.FINE))
    
    robot_12.send(rrc.PrintText('Tool change Point Reached'))
# ---------- end send_trajectory_columns_2 ----------

rec_6 = DataRecorder(send_trajectory_columns_2, DataLimit=-10, RecordData=True)
panel_22 = Panel(rec_6)

# ----
# Sender for Clamped Pieces (Before Soft Move)
send_t1_transfer_path_3 = Button()  # disabled
send_t2_approach_to_inclamp_2 = Button()  # disabled
send_t3_inclamp_to_final_2 = Button()  # disabled
send_t4_final_to_retract_2 = Button()  # disabled
send_robot_to_pick_up_point_3 = Button()  # disabled
movel___to_t2_end_inclamp_2 = Button()  # disabled
movel___to_t1_end_inclampapproach_3 = Button()  # disabled
number_slider_7 = Slider(-0.76, range=-2..2)  # disabled
number_slider_8 = Slider(2, range=0.5..4)  # disabled
transform_design_to_robotworld_7 = Transform({TransformCount=1, Name="Orientation", source.origin.x=-50, source.origin.y=850, source.origin.z=0, source.xaxis.x=0, source.xaxis.y=-1, source.xaxis.z=0, source.yaxis.x=1, source.yaxis.y=0, source.yaxis.z=0, target.origin.x=24991.934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})  # disabled
send_trajectory_clamped_2 = GhPythonScript(
    robot_11=ghpython_script.robot_11,
    robot_12=ghpython_script.robot_12,
    robot_12_J6_offset=number_slider_7,
    clamp_connection=python_3.clamps_connection,
    process=process_3,
    beam_id=item,
    robot_world_transform=transform_design_to_robotworld_7,
    trajectory1=load_yijiangtraj.transfer,
    trajectory2=load_yijiangtraj.approach_to_inclamp,
    trajectory3=load_yijiangtraj.inclamp_to_final,
    trajectory4=load_yijiangtraj.final_to_retract,
    clamping_velocity=number_slider_8,
    send_pickup_point=send_robot_to_pick_up_point_3,
    send1=send_t1_transfer_path_3,
    send_t1_end=movel___to_t1_end_inclampapproach_3,
    send2=send_t2_approach_to_inclamp_2,
    send_t2_end=movel___to_t2_end_inclamp_2,
    send3=send_t3_inclamp_to_final_2,
    send4=send_t4_final_to_retract_2)  # -> out, warn_col, warn_msg, clamps_types, clamps_address, clamps_frame, clamps_instructions; inputs send2: Boolean, send3: Boolean, send4: Boolean; disabled
# ---------- send_trajectory_clamped_2: Python ----------
import compas_rrc as rrc
from compas_fab.robots import to_degrees
from math import radians
from copy import deepcopy
from compas_ghpython import draw_frame
from compas.geometry import Vector, Frame, Translation, Transformation
from compas.geometry import Rotation


def transformation_from_xform(transformation):
    """Creates a Compas Transformation instance from a Rhino Transform
    """
    transform = Transformation()
    for i in range(0, 4):
        for j in range(0, 4):
            transform[i, j] = transformation[i, j]
    return transform

def flange_frame_at(process, beam_id, attribute_name, transformation = None):
    """ Returns the T0CP (robot flange) for the gripper at different location.
    The result takes into account the gripper (tool) and toolchanger (tool) offsets.
    
    Optional transformation can be supplied for transforming from design-world to Robot-world
    This function has a side effect changing the process.toolchanger and gripper 's current frame.
    """
    if process.get_gripper_t0cp_for_beam_at(beam_id, attribute_name) is None:
        return None  # Return None if the position doesn't exist

    assembly = process.assembly
    gripper_type = assembly.get_beam_attribute(beam_id, 'gripper_type')
    gripper = process.get_one_gripper_by_type(gripper_type)
    toolchanger = process.robot_toolchanger

    gripper_t0cp = process.get_gripper_t0cp_for_beam_at(beam_id, attribute_name)
    toolchanger.set_current_frame_from_tcp(gripper_t0cp)
    t0cp = toolchanger.current_frame.copy()
    # Post transformation
    if transformation is not None:
        t0cp.transform(transformation)
    return t0cp

def fix_joint_6(joint_values):
    joint_values[-1] += robot_12_J6_offset
    return joint_values

def fix_frame_joint_6(frame):
    T = Rotation.from_axis_and_angle(frame.zaxis, radians(robot_12_J6_offset), frame.point)
    frame = frame.transformed(T)
    return frame

########################################
# Compute target frames location
########################################
robot_world_transform = transformation_from_xform(robot_world_transform)

assembly_wcf_inclampapproach =  flange_frame_at(process, beam_id, 'assembly_wcf_inclampapproach', robot_world_transform)
assembly_wcf_inclamp =  flange_frame_at(process, beam_id, 'assembly_wcf_inclamp', robot_world_transform)
assembly_wcf_final =  flange_frame_at(process, beam_id, 'assembly_wcf_final', robot_world_transform)
assembly_wcf_finalretract =  flange_frame_at(process, beam_id, 'assembly_wcf_finalretract', robot_world_transform)
inclamp_to_final_dist = assembly_wcf_inclamp.point.distance_to_point(assembly_wcf_final.point)

t1_end_frame = assembly_wcf_inclampapproach
t2_end_frame = assembly_wcf_inclamp
t3_end_frame = assembly_wcf_final
t4_end_frame = assembly_wcf_finalretract

########################################
# Clamps (deciding which clamps to use)
########################################
assembly = process.assembly


available_clamp_addresses = { 'CL3' : ['1','2'], 'CL3M' : ['3','4']}
clamp_open_position = 220
clamp_start_position = 205
clamp_close_position = 102
clamps_types = []
clamps_address = []
clamps_frame = []
clamps_instructions = []

########################################
# Visualize clamps for manual placement
########################################

for neighbour_id in assembly.get_already_built_neighbors(beam_id):
    joint_id = (neighbour_id, beam_id)
    clamp_wcf_final = assembly.get_joint_attribute(joint_id, 'clamp_wcf_final')
    clamp_type = assembly.get_joint_attribute(joint_id, 'clamp_type')
    clamp = process.get_one_clamp_by_type(clamp_type).copy()
    clamp.current_frame = clamp_wcf_final
    clamps_frame.append(draw_frame(clamp_wcf_final))
    clamp.clamp_jaw_position = 120
    clamp.gripper_jaw_position = 0
    neighbour_seq_id = 'S%i'% assembly.sequence.index(joint_id[0])
    clamp_address = available_clamp_addresses[clamp.type_name].pop(0)
    clamps_address.append(clamp_address)
    clamps_instructions.append("Install Clamp %s (address %s) on Beam %s (Joint %s-%s)" % (clamp.type_name, clamp_address, neighbour_seq_id, joint_id[0], joint_id[1]))
    clamps_types.append(clamp.type_name)


t1_start_config_dict = dict(zip(trajectory1.start_configuration.joint_names, trajectory1.start_configuration.values))
t1_gantry_x = t1_start_config_dict['bridge1_joint_EA_X']

# Sending Trajectory 1 (Transfer)
if send_pickup_point:
    # Send user confirm message
#    robot_12.send(rrc.PrintText('Press PLAY to move to starting point. Gantry to X %i and Robot 12 to pickup location' % t1_gantry_x))
    robot_12.send(rrc.PrintText('Press PLAY to move to starting point'))
    robot_12.send(rrc.Stop())
    
    # Send Gantry to correct X position first (with 30 sec initial wait)
    robot_11_current_joints, robot_11_current_ext = robot_11.send_and_wait(rrc.GetJoints(), timeout=30)
    robot_11_current_ext[0] = t1_gantry_x
    robot_11.send(rrc.MoveToJoints(robot_11_current_joints, robot_11_current_ext, 500, rrc.Zone.FINE))
    
    ext_values = [t1_gantry_x] + trajectory1.points[0].values[0:2]
    joint_values = to_degrees(trajectory1.points[0].values[2:9])
    robot_12.send(rrc.MoveToJoints(fix_joint_6(joint_values), ext_values, 500, rrc.Zone.FINE))
    robot_12.send(rrc.PrintText('Starting Point Reached'))
    

def execute_trajectory_1():
    # Send user confirm message
    robot_12.send(rrc.SetWorkObject('wobj0'))
    robot_12.send(rrc.SetTool('tool0'))
    robot_12.send(rrc.PrintText('Press PLAY to execute Trajectory 1 (Transfer to inclampapproach)'))
    robot_12.send(rrc.Stop())
    robot_12.send(rrc.PrintText('Trajectory 1 begins'))
    
    # Send Gantry to correct X position first (with 30 sec initial wait)
    robot_11_current_joints, robot_11_current_ext = robot_11.send_and_wait(rrc.GetJoints(), timeout=30)
    robot_11_current_ext[0] = t1_gantry_x
    robot_11.send(rrc.MoveToJoints(robot_11_current_joints, robot_11_current_ext, 1000, rrc.Zone.FINE))
    
    # Send the rest of the trajectory
    for n, point in enumerate(trajectory1.points):
        assert len(point.values) == 8
        ext_values = [t1_gantry_x] + point.values[0:2]
        joint_values = to_degrees(point.values[2:9])
        print (ext_values, joint_values)
        zone = rrc.Zone.Z0
        speed = 1000
        # Speed and acuracy override for final moments.
        if len(trajectory1.points) - n < 6:
            zone = rrc.Zone.FINE
            speed = 20
        robot_12.send(rrc.MoveToJoints(fix_joint_6(joint_values), ext_values, speed, zone))

#     Send last point as fine point
#    robot_12.send(rrc.MoveToJoints(fix_joint_6(joint_values), ext_values, 500, rrc.Zone.FINE)) # Send last point as Fine
    robot_12.send(rrc.PrintText('Trajectory 1 completed'))

def execute_trajectory_1_endPoint():
    # Send user confirm message
    robot_12.send(rrc.SetWorkObject('wobj0'))
    robot_12.send(rrc.SetTool('tool0'))
    robot_12.send(rrc.PrintText('Press PLAY to moveL to inclampapproach'))
    robot_12.send(rrc.Stop())
    # Send movement
    robot_12.send(rrc.PrintText('Move L to inclampapproach begins'))
    robot_12.send(rrc.CustomInstruction('r_A067_DeactSoftServo'))
    t1_last_ext_values = [t1_gantry_x] + trajectory1.points[-1].values[0:2]
    robot_12.send(rrc.MoveToRobtarget(fix_frame_joint_6(t1_end_frame), t1_last_ext_values, 20, rrc.Zone.FINE))
    robot_12.send(rrc.PrintText('Move L to inclampapproach completed'))

def execute_trajectory_2():
    robot_12.send(rrc.PrintText('Trajectory 2 begins'))
    
    # Send the trajectory
    for point in trajectory2.points:
        assert len(point.values) == 8
        ext_values = [t1_gantry_x] + point.values[0:2]
        joint_values = to_degrees(point.values[2:9])
        print (ext_values, joint_values)
        robot_12.send(rrc.MoveToJoints(fix_joint_6(joint_values), ext_values, 10, rrc.Zone.Z0))
    
    robot_12.send(rrc.PrintText('Trajectory 2 completed'))

def execute_trajectory_2_endPoint():
    # Send user confirm message
    robot_12.send(rrc.SetWorkObject('wobj0'))
    robot_12.send(rrc.SetTool('tool0'))
    robot_12.send(rrc.PrintText('Press PLAY to moveL to inclamp'))
    robot_12.send(rrc.Stop())
    # Send movement
    robot_12.send(rrc.PrintText('Move L to inclamp begins'))
    robot_12.send(rrc.CustomInstruction('r_A067_DeactSoftServo'))
    t2_last_ext_values = [t1_gantry_x] + trajectory1.points[-1].values[0:2]
    robot_12.send(rrc.MoveToRobtarget(fix_frame_joint_6(t2_end_frame), t2_last_ext_values, 20, rrc.Zone.FINE))
    robot_12.send(rrc.PrintText('Move L to inclamp completed'))

def intermediate_frame_by_distance(source, target, distance_to_target):
    move_backwards_vector = Vector.from_start_end(target.point, source.point).unitized()
    move_backwards_vector.scale(distance_to_target)
    intermediate_frame_point = target.point.transformed(Translation.from_vector(move_backwards_vector))
    intermediate_frame = Frame(intermediate_frame_point, target.xaxis, target.yaxis)
    return intermediate_frame

def execute_trajectory_3():
    
    # Close Jaw until it touches beam at 205mm
    result = clamp_connection.send_ROS_VEL_GOTO_COMMAND(clamps_address, clamp_start_position, clamping_velocity)
    if not result:
        print "clamp_connection not ok"
        return
    #Trajectory 3 with clamps begins. Make sure Speed is 100pct. 
    robot_12.send(rrc.PrintText('T3. PLAY after clamps 205mm stop'))
    robot_12.send(rrc.Stop())
    
    # Compute intermediate plane before soft move kicks in.
    distance_to_target = 55
    
    t3_last_ext_values = [t1_gantry_x] + trajectory1.points[-1].values[0:2]
#    t3_move_backwards_vector = Vector.from_start_end(t3_end_frame.point, t2_end_frame.point).unitized()
#    t3_move_backwards_vector.scale(distance_to_target)
#    intermediate_frame_point = t3_end_frame.point.transformed(Translation.from_vector(t3_move_backwards_vector))
#    intermediate_frame = Frame(intermediate_frame_point, t3_end_frame.xaxis, t3_end_frame.yaxis)
    intermediate_frame = intermediate_frame_by_distance(t2_end_frame, t3_end_frame, 55)
    
    # User press Play
    # send_and_wait() used to sync robot command with the clamp commands
    robot_12.send_and_wait(rrc.PrintText('Trajectory 3 with clamps begins.'), timeout=120)
    
    # Send command to clamps first and confirm if ok.
    result = clamp_connection.send_ROS_VEL_GOTO_COMMAND_wait(clamps_address, clamp_close_position, clamping_velocity)
    if not result:
        clamp_connection.send_ROS_STOP_COMMAND(clamps_address)
        return
    
    # Send command to robot.
    # Send intermediate plane (Fine point such that program pointer wait)
    robot_12.send(rrc.PrintText('Begin moving to intermediate_frame'))
    robot_12.send(rrc.MoveToRobtarget(fix_frame_joint_6(intermediate_frame), t3_last_ext_values, clamping_velocity, rrc.Zone.Z0)) 
    robot_12.send(rrc.PrintText('Intermediate plane reached'))
    # Activate soft servo and send final plane
    robot_12.send(rrc.CustomInstruction('r_A067_ActSoftServo'))
    robot_12.send(rrc.MoveToRobtarget(fix_frame_joint_6(t3_end_frame), t3_last_ext_values, clamping_velocity, rrc.Zone.FINE))
    robot_12.send(rrc.CustomInstruction('r_A067_DeactSoftServo'))
    robot_12.send(rrc.PrintText('Trajectory 3 with clamps completed'))

def execute_trajectory_final_to_retract():
    # Send user confirm message
    robot_12.send(rrc.SetWorkObject('wobj0'))
    robot_12.send(rrc.SetTool('tool0'))
    robot_12.send(rrc.PrintText('Press PLAY to execute Trajectory 4 (to retract)'))
    robot_12.send(rrc.Stop())
    
    # Send the trajectory
    robot_12.send(rrc.PrintText('Trajectory 4 begins'))
    for point in trajectory4.points:
        assert len(point.values) == 8
        ext_values = [t1_gantry_x] + point.values[0:2]
        joint_values = to_degrees(point.values[2:9])
        print (ext_values, joint_values)
        robot_12.send(rrc.MoveToJoints(fix_joint_6(joint_values), ext_values, 20, rrc.Zone.Z0))
        
    robot_12.send(rrc.PrintText('Trajectory 4 completed'))


if len(clamps_address) > 0:
    if send1:
        execute_trajectory_1()
    if send_t1_end:
        execute_trajectory_1_endPoint()
    if send2:
        execute_trajectory_2()
    if send_t2_end:
        execute_trajectory_2_endPoint()
    if send3:
        execute_trajectory_3()
    if send4:
        execute_trajectory_final_to_retract()
else:
    print ('Selected beam do not have clamps. Use a different sender.')
# ---------- end send_trajectory_clamped_2 ----------
rec_7 = DataRecorder(send_trajectory_clamped_2.out, DataLimit=-10, RecordData=True)  # disabled
panel_23 = Panel(send_trajectory_clamped_2.clamps_instructions)  # disabled
panel_24 = Panel(rec_7)  # disabled

# ==== cluster Cluster
P = ClusterInput()
deplane = DeconstructPlane(Plane=P)  # -> Origin, XAxis, YAxis, ZAxis
amp = Amplitude(Vector=deplane.ZAxis, Amplitude=Slider(-62, range=-100..100))
move = Move(Geometry=deplane.Origin, Motion=amp)  # -> Geometry, Transform
rev = Reverse(Vector=deplane.YAxis)
pl = ConstructPlane(Origin=move.Geometry, XAxis=deplane.XAxis, YAxis=rev)
pl_2 = ClusterOutput(pl)

# ==== cluster Waypoints
robot = ClusterInput()
trajectory = ClusterInput()
waypoints = PythonScript(robot=robot, trajectory=trajectory)  # -> configurations, full_configurations, planes, points, fraction, time
# ---------- waypoints: Python ----------
import Rhino.Geometry as rg

from compas_ghpython import draw_frame
group = robot.current_planning_group

planes = []
points = []

if trajectory:
    configurations = trajectory.points
    full_configurations = [robot.merge_group_with_full_configuration(c, trajectory.start_configuration, group) for c in configurations]
    start_configuration = trajectory.start_configuration
    fraction = trajectory.fraction
    time = trajectory.time_from_start

    for c in full_configurations:
        frame_WCF = robot.forward_kinematics(c, group, options = {'backend' : 'model'})
        planes.append(draw_frame(frame_WCF))
        points.append(rg.Point3d(*list(frame_WCF.point)))
# ---------- end waypoints ----------
full_configurations = ClusterOutput(waypoints.full_configurations)
pline = PolyLine(Vertices=waypoints.points, Closed=False)
lng = ListLength(List=waypoints.points)
points = ClusterOutput(waypoints.points)
L = ClusterOutput(lng)
