# Grasshopper definition Robot World Migration Tool.gh (Grasshopper 1.0.7)

# ---- group: Origin Frame
number_slider = Slider(100, range=0..100)
pt = Point(Point(0, 0, 0))
Y = UnitY(Factor=1)
X = UnitX(Factor=1)
line = LineSDL(Start=pt, Direction=Y, Length=number_slider)
# Just a collection of tools
line_2 = LineSDL(Start=pt, Direction=X, Length=number_slider)

# ----
# Quaternion to Frame
panel = Panel("""23237.5
4567.06
935.09""")
panel_2 = Panel("""0.00802
-0.68335
-0.00317
-0.73004""")
quaternion_to_frame = GhPythonScript(point=panel, quaternion=panel_2)  # -> out, compas_frame, rhino_plane; inputs point: list, quaternion: list
# ---------- quaternion_to_frame: Python ----------
__author__ = "leungp"
__version__ = "2020.07.13"

import rhinoscriptsyntax as rs

from compas.geometry import Frame
from compas_ghpython import draw_frame
compas_frame = Frame.from_quaternion(quaternion, point)
rhino_plane = draw_frame(compas_frame)
# ---------- end quaternion_to_frame ----------
pln_robot = Plane(quaternion_to_frame.rhino_plane)

# ---- group: igps robotworld converter
igps_wobj0_offset = Data(Plane(origin=(-2614.766, -2058.444, 29.42), x=(0.9999999933, -6.800263172e-05, -9.399809561e-05), y=(6.799736772e-05, 0.9999999961, -5.600319577e-05)))
igps_world_stuff = Data([line_2, line])
robotworld_stuff = Data()
orient = Orient(Geometry=robotworld_stuff, Source=igps_wobj0_offset, Target=PlaneXY(0, 0, 0))  # -> Geometry, Transform
orient_2 = Orient(Geometry=igps_world_stuff, Source=PlaneXY(0, 0, 0), Target=igps_wobj0_offset)  # -> Geometry, Transform
igps_world_stuff_2 = Data(orient.Geometry)
robotworld_stuff_2 = Data(orient_2.Geometry)

# ----
# igps_tool0 Offset
panel_3 = Panel("""0.999993
-0.001117
-0.003492
-0.000893""")
panel_4 = Panel("""0.187
-0.324
77.428""")
python = GhPythonScript(point=panel_4, quaternion=panel_3)  # -> out, robot_frame, preview; inputs point: list, quaternion: list
# ---------- python: Python ----------
__author__ = "leungp"
__version__ = "2020.07.13"

import rhinoscriptsyntax as rs

from compas.geometry import Frame
from compas_ghpython import draw_frame
robot_frame = Frame.from_quaternion(quaternion, point)
preview = draw_frame(robot_frame)
# ---------- end python ----------
igps_tool0_offset = Data(python.preview)

# ----
# igps_wobj0 Offset
panel_5 = Panel("""1.000000
-0.000028
0.000047
-0.000034""")
panel_6 = Panel("""-2614.766
-2058.444
29.420""")
python_2 = GhPythonScript(point=panel_6, quaternion=panel_5)  # -> out, robot_frame, preview; inputs point: list, quaternion: list; same code as python
igps_wobj0_offset_2 = Data(python_2.preview)
