# Grasshopper definition Update Tools for Process.gh (Grasshopper 1.0.7)
# plug-ins: Human

reload_process_from_disk = Button()
process_path = GhPythonScript()  # -> path
# ---------- process_path: Python ----------
from Rhino.RhinoDoc import ActiveDoc
import os
path = os.path.splitext(ActiveDoc.Path)[0] + "_process.json"
print path
# ---------- end process_path ----------
file_path = FilePath(process_path)
json_unpickle = GhPythonScript(path=file_path, enable=True, reload=reload_process_from_disk)  # -> warn_col, warn_msg, data; inputs enable: Boolean
# ---------- json_unpickle: Python ----------
import jsonpickle
import os
import datetime
if enable and not reload:
    exist = os.path.exists(path)
    if exist:
        with open(path, 'r') as f:
            data = jsonpickle.decode(f.read(), keys=True)
        c_time = datetime.datetime.fromtimestamp(os.path.getmtime(path))
        warn_col = "lime"
        warn_msg = "Process File loaded with %s Beams, %s Clamps, %s Grippers.\n File Modified on %s." % (len(list(data.assembly.beams())), len(list(data.clamps)), len(list(data.grippers)), c_time)
    else:
        warn_col = "orange"    
        warn_msg = "Process File not created yet"
# ---------- end json_unpickle ----------
legend = Legend(Colour=json_unpickle.warn_col, Tags=json_unpickle.warn_msg, LegendType=2)
process = Data(json_unpickle.data)

# ----
# Update Tool Changer
tool_definition_file_location = Panel("tools/TC2.json")
load_tool = LoadTool(filename=tool_definition_file_location)  # -> warn_col, warn_msg, tool_2
legend_2 = Legend(Colour=load_tool.warn_col, Tags=load_tool.warn_msg, LegendType=2)
python = GhPythonScript(process=process, toolchanger=load_tool.tool_2, activate=Button())  # -> out, process_out
# ---------- python: Python ----------
process_out = process

if activate:
    process.robot_toolchanger = toolchanger
# ---------- end python ----------

# ----
# Update cached_mesh of Beams due to manual adjustments
# (identified by previous baked name)
mesh = Mesh([<mesh referenced from the Rhino model> x40])
objatts = ObjectAttributes(ObjectOrAttributes=mesh)  # -> Name, LayerName, LayerFullPath, Color, MaterialName, LinetypeName, GroupIndices, PlotWeight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
transform_design_to_robotworld = Transform({TransformCount=1, Name="Orientation", source.origin.x=-50, source.origin.y=850, source.origin.z=0, source.xaxis.x=0, source.xaxis.y=-1, source.xaxis.z=0, source.yaxis.x=1, source.yaxis.y=0, source.yaxis.z=0, target.origin.x=24991.934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})
replace = Button()
inverse = InverseTransform(Transform=transform_design_to_robotworld)
transform = Transform(Geometry=mesh, Transform=inverse)
python_2 = GhPythonScript(process=python.process_out, seq_names=objatts.Name, meshes=transform, replace=replace)  # -> out, process_out; inputs seq_names: list, meshes: list of Mesh
# ---------- python_2: Python ----------
from compas_rhino.geometry import RhinoMesh

for seq_name, mesh in zip (seq_names, meshes):
    print ('seq_name = %s' % seq_name)
    seq = int(seq_name[1:]) - 1
    beam_id = process.assembly.sequence[seq]
    print ('beam_id = %s' % beam_id)
    c_mesh = RhinoMesh.from_geometry(mesh).to_compas()
    if replace:
        process.assembly.beam(beam_id).cached_mesh = c_mesh

process_out = process
# ---------- end python_2 ----------

b3_adjusted_assembly_wcf_inclampapproach = Plane(Plane(origin=(3450.016721, -195.0234993, 685.939825), x=(0, 0, 1), y=(0, 1, 0)))
b3_adjusted_assembly_wcf_inclampapproach_2 = Plane(Plane(origin=(1628.725965, 854.9999002, 444.3020153), x=(-0.4694715628, 0, 0.8829475929), y=(0, 1, 0)))

# ----
# Update default assembly vector for beams with no clamps
number_slider = Slider(-50, range=-100..0)
change = Button()
vec = VectorXYZ(XComponent=Slider(10, range=0..10), YComponent=0, ZComponent=number_slider)  # -> Vector, Length
change_columns_assembly_vector = GhPythonScript(process=python_2.process_out, assembly_vector_if_no_joint=vec.Vector, change=change)  # -> out, process_out; inputs assembly_vector_if_no_joint: Vector3d, change: Boolean
# ---------- change_columns_assembly_vector: Python ----------
from compas_rhino.geometry import RhinoVector
from compas.geometry import Translation
assembly_vector_wcf = RhinoVector.from_geometry(assembly_vector_if_no_joint).to_compas()
print assembly_vector_wcf
process_out = process

for beam_id in process.assembly.sequence:
    beam = process.assembly.beam(beam_id)
    joint_ids = process.assembly.get_joint_ids_of_beam_clamps(beam_id)
    print "Beam %s has %s clamps: %s" % (beam_id, len(joint_ids), joint_ids)
    if len(joint_ids) == 0 :
        if change:
            print "- Changing assembly_wcf_inclamp" 
            process.assembly.set_beam_attribute(beam_id, 'assembly_vector_final', assembly_vector_wcf)
            wcf_clamp_transform = Translation.from_vector(assembly_vector_wcf.scaled(-1.0))
            process.assembly.set_beam_attribute(beam_id, 'assembly_wcf_inclamp', beam.frame.transformed(wcf_clamp_transform))
# ---------- end change_columns_assembly_vector ----------
panel = Panel(change_columns_assembly_vector.out)

# ----
# Update beam b3 assembly_wcf_inclampapproach
panel_2 = Panel("assembly_wcf_inclampapproach")
b3_adjusted_assembly_wcf_inclampapproach_3 = Plane(Plane(origin=(861.147806, 854.997168, 247.2704934), x=(-0.4226182617, 0, 0.906307787), y=(0, 1, 0)))
process_adjust_frame = GhPythonScript(
    process=change_columns_assembly_vector.process_out,
    beam_id="b3",
    frame_key=panel_2,
    new_frame=b3_adjusted_assembly_wcf_inclampapproach_3,
    run=Button())  # -> out, process_out; inputs new_frame: Plane
# ---------- process_adjust_frame: Python ----------
from compas_rhino.geometry import RhinoPlane
from compas.geometry import Translation

old_frame = process.assembly.get_beam_attribute(beam_id, frame_key)
new_frame = RhinoPlane.from_geometry(new_frame).to_compas()

print old_frame
print new_frame
if run:
    process.assembly.set_beam_attribute(beam_id, frame_key, new_frame)
process_out = process
# ---------- end process_adjust_frame ----------

# ----
# Update beam b3 assembly_wcf_inclampapproach
panel_3 = Panel("assembly_wcf_inclampapproach")
process_adjust_frame_2 = GhPythonScript(
    process=change_columns_assembly_vector.process_out,
    beam_id="b33",
    frame_key=panel_3,
    new_frame=b3_adjusted_assembly_wcf_inclampapproach,
    run=Button())  # -> out, process_out; inputs new_frame: Plane; same code as process_adjust_frame

# ----
# Update beam b3 assembly_wcf_inclampapproach
panel_4 = Panel("b8")
process_adjust_frame_3 = GhPythonScript(
    process=process_adjust_frame_2.process_out,
    beam_id=panel_4,
    frame_key="assembly_wcf_inclampapproach",
    new_frame=b3_adjusted_assembly_wcf_inclampapproach_2,
    run=Button())  # -> out, process_out; inputs new_frame: Plane; same code as process_adjust_frame

# ----
# Save Edits
save_process_to_disk = Button()
json_pickle = GhPythonScript(stuff=process_adjust_frame_3.process_out, path=file_path, output=save_process_to_disk)  # -> out; inputs output: Boolean
# ---------- json_pickle: Python ----------
import integral_timber_joints
from integral_timber_joints.process import RobotClampAssemblyProcess

if output:
    import jsonpickle
    json_str = jsonpickle.encode(stuff, keys= True)
    print ("out json_str len:" , len(json_str))
    with open(path, 'w') as f:
        f.write(json_str)
# ---------- end json_pickle ----------

# ----
# make adjsutment in robot world
flange_pos_in_robworld = GhPythonScript(process=process, beam_id="b33")  # -> out, assembly_wcf_inclampapproach, assembly_wcf_inclamp, assembly_wcf_final, assembly_wcf_finalretract
# ---------- flange_pos_in_robworld: Python ----------
from compas.geometry import Frame, Transformation

from compas_ghpython import draw_frame

assembly_wcf_inclampapproach = draw_frame(process.assembly.get_beam_attribute(beam_id, 'assembly_wcf_inclampapproach'))
assembly_wcf_inclamp = draw_frame(process.assembly.get_beam_attribute(beam_id, 'assembly_wcf_inclamp'))
# ---------- end flange_pos_in_robworld ----------
transform_design_to_robotworld_2 = Transform({TransformCount=1, Name="Orientation", source.origin.x=-50, source.origin.y=850, source.origin.z=0, source.xaxis.x=0, source.xaxis.y=-1, source.xaxis.z=0, source.yaxis.x=1, source.yaxis.y=0, source.yaxis.z=0, target.origin.x=24991.934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})
X = UnitX(Factor=Slider(-40, range=-50..100))
Z = UnitZ(Factor=Slider(250, range=0..1000))
transform_2 = Transform(Geometry=flange_pos_in_robworld.assembly_wcf_inclampapproach, Transform=transform_design_to_robotworld_2)
addition = Addition(A=Z, B=X)
move = Move(Geometry=transform_2, Motion=addition)  # -> Geometry, Transform
inverse_2 = InverseTransform(Transform=transform_design_to_robotworld_2)
transform_3 = Transform(Geometry=move.Geometry, Transform=inverse_2)
b3_adjusted_assembly_wcf_inclampapproach_4 = Plane(transform_3)

# ----
# make adjsutment in robot world
flange_pos_in_robworld_2 = GhPythonScript(process=process, beam_id="b3")  # -> out, assembly_wcf_inclampapproach, assembly_wcf_inclamp, assembly_wcf_final, assembly_wcf_finalretract; same code as flange_pos_in_robworld
transform_design_to_robotworld_3 = Transform({TransformCount=1, Name="Orientation", source.origin.x=-50, source.origin.y=850, source.origin.z=0, source.xaxis.x=0, source.xaxis.y=-1, source.xaxis.z=0, source.yaxis.x=1, source.yaxis.y=0, source.yaxis.z=0, target.origin.x=24991.934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})
Z_2 = UnitZ(Factor=Slider(20, range=0..20))
transform_4 = Transform(Geometry=flange_pos_in_robworld_2.assembly_wcf_inclampapproach, Transform=transform_design_to_robotworld_3)
Y = UnitY(Factor=Slider(14, range=0..20))
data = Data(flange_pos_in_robworld_2.assembly_wcf_inclampapproach)
addition_2 = Addition(A=Z_2, B=Y)
move_2 = Move(Geometry=transform_4, Motion=addition_2)  # -> Geometry, Transform
inverse_3 = InverseTransform(Transform=transform_design_to_robotworld_3)
transform_5 = Transform(Geometry=move_2.Geometry, Transform=inverse_3)
b3_adjusted_assembly_wcf_inclampapproach_5 = Plane(transform_5)

# ----
# make adjsutment in robot world
flange_pos_in_robworld_3 = GhPythonScript(process=process, beam_id=panel_4)  # -> out, assembly_wcf_inclampapproach, assembly_wcf_inclamp, assembly_wcf_final, assembly_wcf_finalretract; same code as flange_pos_in_robworld
transform_design_to_robotworld_4 = Transform({TransformCount=1, Name="Orientation", source.origin.x=-50, source.origin.y=850, source.origin.z=0, source.xaxis.x=0, source.xaxis.y=-1, source.xaxis.z=0, source.yaxis.x=1, source.yaxis.y=0, source.yaxis.z=0, target.origin.x=24991.934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})
Z_3 = UnitZ(Factor=Slider(30, range=0..1000))
Y_2 = UnitY(Factor=Slider(-40, range=-50..100))
addition_3 = Addition(A=Z_3, B=Y_2)
transform_6 = Transform(Geometry=flange_pos_in_robworld_3.assembly_wcf_inclampapproach, Transform=transform_design_to_robotworld_4)
move_3 = Move(Geometry=transform_6, Motion=addition_3)  # -> Geometry, Transform
inverse_4 = InverseTransform(Transform=transform_design_to_robotworld_4)
transform_7 = Transform(Geometry=move_3.Geometry, Transform=inverse_4)
b3_adjusted_assembly_wcf_inclampapproach_6 = Plane(transform_7)

# ----
# Mesh from Brep with Simplify
brep = Brep([<brep referenced from the Rhino model> x40])
debrep = DeconstructBrep(Brep=brep)  # -> Faces, Edges, Vertices
debrep_2 = DeconstructBrep(Brep=debrep.Faces)  # -> Faces, Edges, Vertices
number_slider_2 = Slider(1, range=0..1)
objatts_2 = ObjectAttributes(ObjectOrAttributes=brep)  # -> Name, LayerName, LayerFullPath, Color, MaterialName, LinetypeName, GroupIndices, PlotWeight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
join = JoinCurves(Curves=debrep_2.Edges, Preserve=False)
simplify = SimplifyCurve(Curve=join, Tolerance=number_slider_2, AngleTolerance=number_slider_2)  # -> Curve, Simplified
boundary = BoundarySurfaces(Edges=simplify(simplify.Curve))
createatts = CreateAttributes(Name=objatts_2.Name, enableFullPath=False)
pshift = ShiftPaths(Data=boundary, Offset=-1)
custom_mesh_settings = SettingsCustom(
    StitchSeams=True,
    SimplePlanes=True,
    Refine=True,
    MinCount=16,
    MaxCount=1,
    AspectRatio=0,
    MaxDistance=0,
    MaxAngle=20,
    MinEdge=0,
    MaxEdge=0)
join_2 = BrepJoin(Breps=pshift)  # -> Breps, Closed
mesh_2 = MeshBrep(Brep=join_2.Breps, Settings=custom_mesh_settings)
bake = BakeGeometry(Bake=Button(), Geometry=flatten(mesh_2), Attributes=flatten(createatts), DeleteOldBakes=False, PreserveTrees=False)

# ==== cluster LoadTool
filename = ClusterInput()
auto_path = GhPythonScript(filename=filename)  # -> json_path
# ---------- auto_path: Python ----------
from Rhino.RhinoDoc import ActiveDoc
import os
json_path = os.path.dirname(ActiveDoc.Path) + os.sep + filename
# ---------- end auto_path ----------
json_unpickle_mesh = GhPythonScript(path=auto_path, enable=True)  # -> warn_col, warn_msg, data; inputs enable: Boolean
# ---------- json_unpickle_mesh: Python ----------
import jsonpickle
import os
import datetime
if enable:
    exist = os.path.exists(path)
    if exist:
        with open(path, 'r') as f:
            data = jsonpickle.decode(f.read(), keys=True)
        c_time = datetime.datetime.fromtimestamp(os.path.getmtime(path))
        warn_col = "lime"
        warn_msg = "%s Object loaded.\n File Modified on %s." % (data.__class__.__name__, c_time)
    else:
        warn_col = "orange"    
        warn_msg = "Tool File not exist"
# ---------- end json_unpickle_mesh ----------
warn_col = ClusterOutput(json_unpickle_mesh.warn_col)
warn_msg = ClusterOutput(json_unpickle_mesh.warn_msg)
tool = Data(json_unpickle_mesh.data)
tool_2 = ClusterOutput(tool)
