# Grasshopper definition Karamba Joint Modeling01.gh (Grasshopper 1.0.7)
# plug-ins: karambaGH

matselect = MaterialSelectionKaramba3D(menu=[dropdown(4), dropdown(1)])
disassemble = DisassembleMaterialKaramba3D(Material=matselect)  # -> Material, TypeOfMaterial, FamilyNameOfMaterial, NameOfMaterial, ElemIdentifiers, Color, YoungsModulusKNCm2Dir12, InPlaneShearModulus_kN_cm2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
matprops = MaterialPropertiesKaramba3D(
    FamilyOfMaterial=disassemble.FamilyNameOfMaterial,
    Name=disassemble.NameOfMaterial,
    ElementIdentifier=disassemble.ElemIdentifiers,
    Color=disassemble.Color,
    YoungsModulus_kN_cm2=disassemble.YoungsModulusKNCm2Dir12,
    InPlaneShearModulus_kN_cm2=disassemble.InPlaneShearModulus_kN_cm2,
    TransverseShearModulus_kN_cm2=disassemble.TransverseShearModulusKNCm2Dir12,
    SpecificWeight_kN_m3=Slider(4.6, range=0..10),
    CoefficientOfThermalExpansion_1_C=disassemble.CoefficientOfThermalExpansion1CDir12,
    YieldStrength_kN_cm2=disassemble.YieldStrengthKNCm2Dir12,
    mode="Isotrop")
cross_section = CrossSectionKaramba3D(
    FamilyNameOfCrossSection="DefaultCroSec",
    Material=matprops,
    Height_cm="10",
    UpperFlangeWidth_cm="10",
    LowerFlangeWidth_cm="10",
    mode="Trapezoid")

# ---- group: Not sure how to correctly do this part
number_slider = Slider(200, range=0..200)
number_slider_2 = Slider(40, range=0..200)
pt = ConstructPoint(XCoordinate=number_slider, YCoordinate=number_slider, ZCoordinate=number_slider)
pt_2 = ConstructPoint(XCoordinate=number_slider_2, YCoordinate=number_slider_2, ZCoordinate=number_slider_2)
joint_agent = BeamJointAgentKaramba3D(
    AtElementIdentifiers="A",
    ToElementIdentifiers="A",
    Ct_kN_m=Vector(0, 0, 0),
    Cr_kNm_rad=pt,
    menu=[buttons(off, off, off, on, on, on)])
joint_agent_2 = BeamJointAgentKaramba3D(
    AtElementIdentifiers="B",
    ToElementIdentifiers="A",
    Ct_kN_m=Vector(0, 0, 0),
    Cr_kNm_rad=pt_2,
    menu=[buttons(off, off, off, on, on, on)])

# ----
number_slider_3 = Slider(200, range=0..200)

crv = Curve([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])
panel = Panel("""A
A
B
B""")
pt_3 = Point(Point(0, 0, 0))
supp = SupportKaramba3D(PosInd=pt_3, menu=[buttons(on, on, on, on, on, on)])
loads = LoadsKaramba3D(Vector=Vector(0, 0, -1), LCase=0, mode="Gravity")
linetobeam = LineToBeamKaramba3D(
    Line=crv,
    Identifier=panel,
    CrossSection=cross_section,
    New=True,
    Remove=True,
    LimitDistance_m=0.005,
    Bending=Toggle(True))  # -> Element, Points, Info

pt_4 = ConstructPoint(XCoordinate=number_slider_3, YCoordinate=number_slider_3, ZCoordinate=number_slider_3)
joint_agent_3 = BeamJointAgentKaramba3D(
    AtElementIdentifiers="B",
    ToElementIdentifiers="B",
    Ct_kN_m=Vector(0, 0, 0),
    Cr_kNm_rad=pt_4,
    menu=[buttons(off, off, off, on, on, on)])

assemble = AssembleModelKaramba3D(
    Elem=linetobeam.Element,
    Support=supp,
    Load=loads,
    Joint=[joint_agent, joint_agent_2, joint_agent_3],
    LimitDistance_m=0.005)  # -> Model, Info, Mass_kg, CenterOfGravity
analyzethii = AnalyzeThIIKaramba3D(Model=assemble.Model, LoadCase=-1, RTolerance=1e-07, MaxIterations=50, NoTensionalNII=False)  # -> CalculatedModel, MaximumDisplacement_cm, ResultingForceOfGravity_kN, ElasticEnergy_kNm
analyze = AnalyzeKaramba3D(Model=assemble.Model)  # -> CalculatedModel, MaximumDisplacement_cm, ResultingForceOfGravity_kN, ElasticEnergy_kNm
modelview = ModelViewKaramba3D(Model=analyze.CalculatedModel, ResultFactors=1, ResultCase=-1)  # -> Model, DeformedMesh, DeformedAxes, DeformedModel
beamview = BeamViewKaramba3D(Model=modelview.Model)  # -> Model, MeshesOfRenderedBeams, DeformedBeamAxes, LegendColors, LegendTags
