# Grasshopper definition Karamba Joint Modeling02.gh (Grasshopper 1.0.7)
# plug-ins: karambaGH

matselect = MaterialSelectionKaramba3D(menu=[dropdown(4), dropdown(1)])
disassemble = DisassembleMaterialKaramba3D(Material=matselect)  # -> Material, TypeOfMaterial, FamilyNameOfMaterial, NameOfMaterial, ElemIdentifiers, Color, YoungsModulusKNCm2Dir12, InPlaneShearModulus_kN_cm2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
matprops = MaterialPropertiesKaramba3D(
    FamilyOfMaterial=disassemble.FamilyNameOfMaterial,
    Name=disassemble.NameOfMaterial,
    ElementIdentifier=disassemble.ElemIdentifiers,
    Color=disassemble.Color,
    YoungsModulusKNCm2Dir1=disassemble.YoungsModulusKNCm2Dir12,
    YoungsModulusKNCm2Dir2=disassemble.YoungsModulusKNCm2Dir12,
    InPlaneShearModulus_kN_cm2=disassemble.InPlaneShearModulus_kN_cm2,
    InPlaneLateralContractionCoefficient=disassemble.InPlaneLateralContractionCoefficient,
    TransverseShearModulusKNCm2Dir1=disassemble.TransverseShearModulusKNCm2Dir12,
    TransverseShearModulusKNCm2Dir2=disassemble.TransverseShearModulusKNCm2Dir12,
    SpecificWeight_kN_m3=Slider(4.6, range=0..10),
    CoefficientOfThermalExpansion1CDir1=disassemble.CoefficientOfThermalExpansion1CDir12,
    CoefficientOfThermalExpansion1CDir2=disassemble.CoefficientOfThermalExpansion1CDir12,
    YieldStrengthKNCm2Dir1=disassemble.YieldStrengthKNCm2Dir12,
    YieldStrengthKNCm2Dir2=disassemble.YieldStrengthKNCm2Dir12,
    mode="Orthotropic")
cross_section = CrossSectionKaramba3D(
    FamilyNameOfCrossSection="DefaultCroSec",
    Material=matprops,
    Height_cm="10",
    UpperFlangeWidth_cm="10",
    LowerFlangeWidth_cm="10",
    mode="Trapezoid")

matselect_2 = MaterialSelectionKaramba3D(menu=[dropdown(1), dropdown(2)])
number_slider = Slider(2000, range=0..2000)
number_slider_2 = Slider(20.464, range=0.1..100)
vector_xyz = VectorXYZ(XComponent=number_slider, YComponent=number_slider, ZComponent=number_slider)  # -> Vector, Length
vector_xyz_2 = VectorXYZ(XComponent=number_slider_2, YComponent=number_slider_2, ZComponent=number_slider_2)  # -> Vector, Length
cross_section_2 = CrossSectionKaramba3D(
    FamilyNameOfCrossSection="DefaultCroSec",
    CTranslation_kN_m=vector_xyz.Vector,
    CRotation_kNm_rad=vector_xyz_2.Vector,
    mode="Spring")

crv = Curve([<curve referenced from the Rhino model> x4])
pt = Point(Point(0, 0, 0))
supp = SupportKaramba3D(PosInd=pt, menu=[buttons(on, on, on, on, on, on)])
loads = LoadsKaramba3D(Vector=Vector(0, 0, -1), LCase=0, mode="Gravity")
linetobeam = LineToBeamKaramba3D(Line=crv, Identifier="A", CrossSection=cross_section, New=True, Remove=True, LimitDistance_m=0.005)  # -> Element, Points, Info

crv_2 = Curve(<curve referenced from the Rhino model>)
pt_2 = Point(Point(5, 0, 0))  # disabled
end_points = EndPoints(Curve=crv_2)  # -> Start, End
supp_2 = SupportKaramba3D(PosInd=pt_2, menu=[buttons(off, off, on, off, off, off)])  # disabled
linetobeam_2 = LineToBeamKaramba3D(Line=crv_2, Identifier="B", CrossSection=cross_section_2, New=True, Remove=True, LimitDistance_m=0.005, Bending=True)  # -> Element, Points, Info
point = Point(end_points.Start)

assemble = AssembleModelKaramba3D(Elem=flatten([linetobeam.Element, linetobeam_2.Element]), Support=[supp, supp_2], Load=loads, LimitDistance_m=0.005)  # -> Model, Info, Mass_kg, CenterOfGravity
analyze = AnalyzeKaramba3D(Model=assemble.Model)  # -> CalculatedModel, MaximumDisplacement_cm, ResultingForceOfGravity_kN, ElasticEnergy_kNm
modelview = ModelViewKaramba3D(Model=analyze.CalculatedModel, ResultFactors=1, ResultCase=-1)  # -> Model, DeformedMesh, DeformedAxes, DeformedModel
beamview = BeamViewKaramba3D(Model=modelview.Model)  # -> Model, MeshesOfRenderedBeams, DeformedBeamAxes, LegendColors, LegendTags

beam_displacements_karamba3d = BeamDisplacementsKaramba3D(
    AnalyzedModel=analyze.CalculatedModel,
    BeamIdentifiers="A",
    LoadCase=-1,
    MaximumDistanceBetweenResults_m=Slider(1, range=0..1),
    NumberOfResultsPerElement=2)  # -> AnalyzedModel, Translations_m, Rotations_rad
point_2 = Point()
vector_length = VectorLength(Vector=beam_displacements_karamba3d.Translations_m)
panel = Panel(vector_length)
