# Grasshopper definition BeamCenterLineFromMesh.gh (Grasshopper 1.0.7)
# plug-ins: Human

brep = Brep([<brep referenced from the Rhino model> x40])
mesh_brep = MeshBrep(
    Brep=brep,
    Settings={GridMaxCount=0, GridMinCount=16, JaggedSeams=False, MaxEdgeLength=0, MinEdgeLength=0.0001, MinTolerance=0, Refine=True, RefineAngle=0, RelativeTolerance=0.65, SimplePlanes=True, Tolerance=0})
auto_beam_frame_long_short_edge = AutoBeamFrameLongShortEdge(brep=brep)
new_assembly = GhPythonScript(activate=Toggle(True), beam_meshes=mesh_brep, guids=brep, orientation_planes=auto_beam_frame_long_short_edge)  # -> out, assembly, center_lines; inputs beam_meshes: list of Mesh, guids: list of Guid, orientation_planes: list
# ---------- new_assembly: Python ----------
if activate:
    from compas_ghpython.utilities import draw_lines
    from compas_rhino.geometry import RhinoMesh, RhinoPlane, RhinoLine
    from integral_timber_joints.assembly import Assembly
    from integral_timber_joints.geometry import Beam
    
    # Assert List length of beam_mesh, guid, orientation_plane are same
    assert len(beam_meshes) == len(guids)
    assert len(beam_meshes) == len(orientation_planes)
    
    # Create Assmebly object, the main object.
    assembly = Assembly()
    center_lines = []
    # create Beam Elements and add it to Assembly
    for index, (beam_mesh, guid, orientation_plane) in enumerate(zip(beam_meshes, guids, orientation_planes)):
        
        # Convert input to compas mesh
        compas_mesh = RhinoMesh.from_geometry(beam_mesh).to_compas()
        compas_frame = RhinoPlane.from_geometry(orientation_plane).to_compas()
        # Beam class method
        beam = Beam.from_mesh(compas_mesh, compas_frame)
        
        # Create key/identifier of the beam. The number do not represent sequence
        beam.name ='b%s'% index 
#        print (beam.length, beam.frame)
        # Guid of the Rhino object is tracked for later interactive selection design process
#        beam.guid = guid.__str__()
        
        # Add beam to assembly
        assembly.add_beam(beam)
        line = beam.get_center_line()
        #center_lines.append({'start' : line.start, 'end' : line.end})
        center_lines.append(line.to_data())
        print ({'start' : line.start, 'end' : line.end})
        
#        print ("%s : Guid(%s)" % (beam, beam.guid))

    center_lines = draw_lines(center_lines)
# ---------- end new_assembly ----------

objatts = ObjectAttributes(ObjectOrAttributes=brep)  # -> Name, LayerName, LayerFullPath, Color, MaterialName, LinetypeName, GroupIndices, PlotWeight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
volume = Volume(Geometry=brep)  # -> Volume, Centroid
tag = TextTag3D(Location=volume.Centroid, Text=objatts.Name, Size=Slider(76, range=0..1000), Justification=7)

# ==== cluster AutoBeamFrameLongShortEdge
brep = ClusterInput()

brep_2 = Brep(graft(brep))
edges = BrepEdges(Brep=brep_2)  # -> Naked, Interior, NonManifold
end = EndPoints(Curve=edges.Interior)  # -> Start, End
vec2pt = Vector2Pt(PointA=end.Start, PointB=end.End, Unitize=False)  # -> Vector, Length
pl = PlaneNormal(Origin=end.Start, ZAxis=vec2pt.Vector)
bbox = BoundingBox(Content=brep_2, Plane=pl)  # -> Box, Box_2

# ----
# Measure edge lengths
item = ListItem(List=bbox.Box, Index=0, Wrap=True)
pshift = ShiftPaths(Data=item, Offset=-1)
debox = DeconstructBox(Box=pshift)  # -> Plane, X, Y, Z
dedomain = DeconstructDomain(Domain=debox.Z)  # -> Start, End
subtraction = Subtraction(A=dedomain.Start, B=dedomain.End)
abs = Absolute(Value=subtraction)

# ----
# Use longest and shortest edge as X
sort = SortList(Keys=abs, ValuesB=edges.Interior)  # -> Keys, ValuesB
item_2 = ListItem(List=sort.ValuesB, Index=-1, Wrap=True)
item_3 = ListItem(List=sort.ValuesB, Index=0, Wrap=True)
end_2 = EndPoints(Curve=item_2)  # -> Start, End
end_3 = EndPoints(Curve=item_3)  # -> Start, End
vec2pt_2 = Vector2Pt(PointA=end_2.Start, PointB=end_2.End, Unitize=False)  # -> Vector, Length
vec2pt_3 = Vector2Pt(PointA=end_3.Start, PointB=end_3.End, Unitize=False)  # -> Vector, Length
pl_2 = ConstructPlane(Origin=end_2.Start, XAxis=vec2pt_2.Vector, YAxis=vec2pt_3.Vector)

pshift_2 = ShiftPaths(Data=pl_2, Offset=-2)
D = ClusterOutput(pshift_2)
