# Grasshopper definition 20210415.gh (Grasshopper 1.0.7)

# ---- group: height
number_slider = Slider(3753, range=0..4000)

# ----
in_shift = Slider(361, range=0..1000)
cir = Circle(Plane=PlaneXY(0, 0, 0), Radius=Slider(1500, range=0..10000))
divide = DivideCurve(Curve=cir, Count=Slider(3, range=0..10), Kinks=False)  # -> Points, Tangents, Parameters
Z = UnitZ(Factor=number_slider)
rotate = Rotate(Geometry=divide.Points, Angle=Slider(4.18, range=0..6.28), Plane=PlaneXY(0, 0, 0))  # -> Geometry, Transform
move = Move(Geometry=divide.Points, Motion=Z)  # -> Geometry, Transform
ln = Line(StartPoint=divide.Points, EndPoint=rotate.Geometry)
vec = Vector(unitize(ln))
vec_2 = Vector(unitize(ln))
multiplication = Multiplication(A=vec, B=in_shift)
multiplication_2 = Multiplication(A=vec_2, B=Slider(779, range=0..3000))
align = AlignPlane()  # -> Plane, Angle
move_2 = Move(Geometry=divide.Points, Motion=multiplication)  # -> Geometry, Transform
move_3 = Move(Geometry=move.Geometry, Motion=multiplication_2)  # -> Geometry, Transform
vec2pt = Vector2Pt(PointA=move_2.Geometry, PointB=move_3.Geometry, Unitize=False)  # -> Vector, Length
number_slider_2 = Slider(90, range=-180..180)
Z_2 = UnitZ(Factor=1)
pl = PlaneNormal(Origin=move_2.Geometry, ZAxis=vec2pt.Vector)
ln_2 = Line(StartPoint=move_2.Geometry, EndPoint=move_3.Geometry)
align_2 = AlignPlane(Plane=pl, Direction=Z_2)  # -> Plane, Angle
pln = Plane(align_2.Plane)
python = GhPythonScript(beam_centerline=ln_2, beam_plane=pln)  # -> out, flatten(beam); inputs beam_centerline: Line, beam_plane: Plane
# ---------- python: Python ----------
__author__ = "Wenqian"
__version__ = "2021.03.12"

import rhinoscriptsyntax as rs
import Rhino.Geometry as rg

import sys
path = "C:\Users\Wenqian\Documents\GitHub"
if path not in sys.path:
    sys.path.append(path)
    
from compas_ghpython import unload_modules
unload_modules('timber_beams')
import timber_beams

import compas_ghpython

from timber_beams import Beam
from timber_beams import *
from compas_rhino.geometry import RhinoPoint
from compas_rhino.geometry import RhinoPlane
from compas.utilities import pairwise

beam = Beam.from_frame_length(RhinoPlane.from_geometry(beam_plane).to_compas(), beam_centerline.Length)
print (beam)
# ---------- end python ----------
pl_2 = PlaneNormal(Origin=divide.Points, ZAxis=vec)
python_2 = GhPythonScript(beam_centerline=ln, beam_plane=pl_2)  # -> out, flatten(beam); inputs beam_centerline: Line, beam_plane: Plane; same code as python
shift = ShiftList(List=python.beam, Shift=1, Wrap=True)
shift_2 = ShiftList(List=python.beam, Shift=-1, Wrap=True)

# ---- group: connection
beam_connection = GhPythonScript(
    beam1=shift_2,
    beam1_faceflip=Toggle(False),
    beam2=python_2.beam,
    beam2_faceflip=Toggle(False),
    t=graft(Slider(0.33, range=0..1)))  # -> out, flatten(beam_a), flatten(beam_b); inputs beam1_faceflip: Boolean, beam2_faceflip: Boolean
# ---------- beam_connection: Python ----------
__author__ = "Wenqian"
__version__ = "2021.03.12"

import rhinoscriptsyntax as rs
import Rhino.Geometry as rg
from copy import deepcopy
from compas.geometry import Frame
import sys
path = "C:\Users\Wenqian\Documents\GitHub"
if path not in sys.path:
    sys.path.append(path)
    
from compas_ghpython import unload_modules
#unload_modules('timber_beams')
#import timber_beams

import compas_ghpython

from timber_beams import beam_connection
if beam1_faceflip:
    beam1 = deepcopy(beam1)
    beam1.frame = Frame(beam1.frame.point, beam1.frame.yaxis, beam1.frame.xaxis.scaled(-1))
if beam2_faceflip:
    beam2 = deepcopy(beam2)
    beam2.frame = Frame(beam2.frame.point, beam2.frame.yaxis, beam2.frame.xaxis.scaled(-1))
beam_a, beam_b = beam_connection(beam1, beam2, t)
# ---------- end beam_connection ----------

beam_connection_2 = GhPythonScript(
    beam1=shift,
    beam1_faceflip=Toggle(False),
    beam2=shift_2,
    beam2_faceflip=Toggle(False),
    t=graft(Slider(0.03, range=0..1)))  # -> out, flatten(beam_a), flatten(beam_b); inputs beam1_faceflip: Boolean, beam2_faceflip: Boolean; same code as beam_connection

# ----
extension = Slider(703, range=0..1000)
extension_2 = Slider(639, range=0..1000)
extension_3 = GhPythonScript(beam=python_2.beam, extSt=extension, extEnd=extension_2)  # -> out, beam_out
# ---------- extension_3: Python ----------
from copy import deepcopy

beam_out = deepcopy(beam)
from compas.geometry import Translation
T = Translation.from_vector(beam_out.frame.zaxis.scaled(-1 * extSt))
beam_out.frame = beam_out.frame.transformed(T)
beam_out.length = beam_out.length  + extSt + extEnd
# ---------- end extension_3 ----------

# ---- group: beam
python_3 = GhPythonScript()  # -> out, flatten(frames), flatten(lengths); inputs line1: Line, sec_dir1: Vector3d
# ---------- python_3: Python ----------
__author__ = "Wenqian"
__version__ = "2021.03.12"

import rhinoscriptsyntax as rs
import Rhino.Geometry as rg

import sys
path = "C:\Users\Wenqian\Documents\GitHub"
if path not in sys.path:
    sys.path.append(path)

import timber_beams

import compas_ghpython
#from compas_ghpython import unload_modules
#unload_modules('timber_beams')

from timber_beams import Beam
from timber_beams import *
from compas_rhino.geometry import RhinoPoint
from compas_rhino.geometry import RhinoPlane
from compas.utilities import pairwise


beam1 = Beam.from_points_dir(line1.PointAt(0), line1.PointAt(1), sec_dir1)
beams = [beam1]

frames = [RhinoPlane.from_geometry(beam.frame).geometry for beam in beams]
lengths = [beam.length for beam in beams]
# ---------- end python_3 ----------

# ----
visualization = GhPythonScript(beam=extension_3.beam_out)  # -> out, frame, width, height, length
# ---------- visualization: Python ----------
#from timber_beams import *
from compas_rhino.geometry import RhinoPoint
from compas_rhino.geometry import RhinoPlane

frame = RhinoPlane.from_geometry(beam.frame).geometry
length = beam.length
# ---------- end visualization ----------
rectangle = Rectangle(Plane=visualization.frame, XSize=Domain(-50, 50), YSize=Domain(-50, 50), Radius=0)  # -> Rectangle, Length
boxrec = BoxRectangle(Rectangle=rectangle.Rectangle, Height=visualization.length)
preview = CustomPreview(
    Geometry=boxrec,
    Material={diffuse=RGB(174, 180, 109), emission=RGB(0, 0, 0), shine=0.85, specular=RGB(217, 217, 217), transparency=0})

visualization_2 = GhPythonScript(beam=shift)  # -> out, frame, width, height, length; same code as visualization
rectangle_2 = Rectangle(Plane=visualization_2.frame, XSize=Domain(-50, 50), YSize=Domain(-50, 50), Radius=0)  # -> Rectangle, Length
boxrec_2 = BoxRectangle(Rectangle=rectangle_2.Rectangle, Height=visualization_2.length)
preview_2 = CustomPreview(
    Geometry=boxrec_2,
    Material={diffuse=RGB(174, 180, 109), emission=RGB(0, 0, 0), shine=0.85, specular=RGB(217, 217, 217), transparency=0})

extension_4 = Slider(299, range=0..1000)
extension_5 = Slider(253, range=0..1000)
extension_6 = GhPythonScript(beam=[beam_connection.beam_a, beam_connection.beam_b], extSt=extension_4, extEnd=extension_5)  # -> out, beam_out; same code as extension_3

extension_7 = Slider(0, range=0..1000)
extension_8 = Slider(296, range=0..1000)
extension_9 = GhPythonScript(beam=[beam_connection_2.beam_a, beam_connection_2.beam_b], extSt=extension_7, extEnd=extension_8)  # -> out, beam_out; same code as extension_3

cluster = Cluster(G=python_3.frames, extensionstart=Slider(0, range=0..100), length=python_3.lengths)
brep = Brep(cluster)
brep_2 = Brep(brep)
lng = ListLength(List=brep_2)

visualization_3 = GhPythonScript(beam=extension_6.beam_out)  # -> out, frame, width, height, length; same code as visualization
rectangle_3 = Rectangle(Plane=visualization_3.frame, XSize=Domain(-50, 50), YSize=Domain(-50, 50), Radius=0)  # -> Rectangle, Length
boxrec_3 = BoxRectangle(Rectangle=rectangle_3.Rectangle, Height=visualization_3.length)
preview_3 = CustomPreview(Geometry=boxrec_3, Material=ColourSwatch(SwatchColor=RGB(93, 156, 0)))

visualization_4 = GhPythonScript(beam=extension_9.beam_out)  # -> out, frame, width, height, length; same code as visualization
rectangle_4 = Rectangle(Plane=visualization_4.frame, XSize=Domain(-50, 50), YSize=Domain(-50, 50), Radius=0)  # -> Rectangle, Length
boxrec_4 = BoxRectangle(Rectangle=rectangle_4.Rectangle, Height=visualization_4.length)
preview_4 = CustomPreview(Geometry=boxrec_4, Material=ColourSwatch(SwatchColor=RGB(93, 156, 0)))

# ==== cluster Cluster
length = ClusterInput()
extensionend = ClusterInput()
extensionstart = ClusterInput()
G = ClusterInput()
deplane = DeconstructPlane(Plane=G)  # -> Origin, XAxis, YAxis, ZAxis
addition = Addition(A=extensionstart, B=extensionend)
neg = Negative(Value=extensionstart)
multiplication = Multiplication(A=deplane.ZAxis, B=neg)
addition_2 = Addition(A=length, B=addition)
move = Move(Geometry=G, Motion=multiplication)  # -> Geometry, Transform
rectangle = Rectangle(Plane=move.Geometry, XSize=Domain(-50, 50), YSize=Domain(-50, 50), Radius=0)  # -> Rectangle, Length
boxrec = BoxRectangle(Rectangle=rectangle.Rectangle, Height=addition_2)
B = ClusterOutput(boxrec)
