# Grasshopper definition 20210416.gh (Grasshopper 1.0.7)

# ---- group: height
number_slider = Slider(3385, range=0..4000)

# ----
in_shift = Slider(306, range=0..1000)

# ---- group: height
number_slider_2 = Slider(3753, range=0..4000)

# ----
in_shift_2 = Slider(361, range=0..1000)
pln = Plane(PlaneXY(7611.237451, -1196.317092, 0))
cir = Circle(Plane=pln, Radius=Slider(1500, range=0..10000))
cir_2 = Circle(Plane=PlaneXY(0, 0, 0), Radius=Slider(1500, range=0..10000))
divide = DivideCurve(Curve=cir, Count=Slider(3, range=0..10), Kinks=False)  # -> Points, Tangents, Parameters

# ---- group: height
number_slider_3 = Slider(3753, range=0..4000)

# ----
Z = UnitZ(Factor=number_slider)
in_shift_3 = Slider(361, range=0..1000)
divide_2 = DivideCurve(Curve=cir_2, Count=Slider(3, range=0..10), Kinks=False)  # -> Points, Tangents, Parameters
Z_2 = UnitZ(Factor=number_slider_2)
rotate = Rotate(Geometry=divide.Points, Angle=Slider(3.68, range=0..6.28), Plane=pln)  # -> Geometry, Transform
move = Move(Geometry=divide.Points, Motion=Z)  # -> Geometry, Transform
pln_2 = Plane(PlaneXY(13879.73654, -1086.671455, 0))
rotate_2 = Rotate(Geometry=divide_2.Points, Angle=Slider(4.18, range=0..6.28), Plane=PlaneXY(0, 0, 0))  # -> Geometry, Transform

# ---- group: height
number_slider_4 = Slider(4000, range=0..4000)

# ----
ln = Line(StartPoint=divide.Points, EndPoint=rotate.Geometry)
in_shift_4 = Slider(306, range=0..1000)
move_2 = Move(Geometry=divide_2.Points, Motion=Z_2)  # -> Geometry, Transform
cir_3 = Circle(Plane=pln_2, Radius=Slider(1500, range=0..10000))
vec = Vector(unitize(ln))
ln_2 = Line(StartPoint=divide_2.Points, EndPoint=rotate_2.Geometry)
vec_2 = Vector(unitize(ln))
divide_3 = DivideCurve(Curve=cir_3, Count=Slider(4, range=0..10), Kinks=False)  # -> Points, Tangents, Parameters
pln_3 = Plane(PlaneXY(19697.02091, -1394.288185, 0))
Z_3 = UnitZ(Factor=number_slider_3)
vec_3 = Vector(unitize(ln_2))
vec_4 = Vector(unitize(ln_2))
multiplication = Multiplication(A=vec, B=in_shift)
multiplication_2 = Multiplication(A=vec_2, B=Slider(810, range=0..3000))
cir_4 = Circle(Plane=pln_3, Radius=Slider(1900, range=0..10000))
rotate_3 = Rotate(Geometry=divide_3.Points, Angle=Slider(4.18, range=0..6.28), Plane=pln_2)  # -> Geometry, Transform
multiplication_3 = Multiplication(A=vec_3, B=in_shift_2)
align = AlignPlane()  # -> Plane, Angle
multiplication_4 = Multiplication(A=vec_4, B=Slider(779, range=0..3000))
move_3 = Move(Geometry=divide_3.Points, Motion=Z_3)  # -> Geometry, Transform
move_4 = Move(Geometry=divide.Points, Motion=multiplication)  # -> Geometry, Transform
move_5 = Move(Geometry=move.Geometry, Motion=multiplication_2)  # -> Geometry, Transform
divide_4 = DivideCurve(Curve=cir_4, Count=Slider(5, range=0..10), Kinks=False)  # -> Points, Tangents, Parameters
align_2 = AlignPlane()  # -> Plane, Angle
Z_4 = UnitZ(Factor=number_slider_4)
ln_3 = Line(StartPoint=divide_3.Points, EndPoint=rotate_3.Geometry)
move_6 = Move(Geometry=divide_2.Points, Motion=multiplication_3)  # -> Geometry, Transform
move_7 = Move(Geometry=move_2.Geometry, Motion=multiplication_4)  # -> Geometry, Transform
vec_5 = Vector(unitize(ln_3))
vec2pt = Vector2Pt(PointA=move_4.Geometry, PointB=move_5.Geometry, Unitize=False)  # -> Vector, Length
vec_6 = Vector(unitize(ln_3))
rotate_4 = Rotate(Geometry=divide_4.Points, Angle=Slider(3.98, range=0..6.28), Plane=pln_3)  # -> Geometry, Transform
number_slider_5 = Slider(90, range=-180..180)
move_8 = Move(Geometry=divide_4.Points, Motion=Z_4)  # -> Geometry, Transform
vec2pt_2 = Vector2Pt(PointA=move_6.Geometry, PointB=move_7.Geometry, Unitize=False)  # -> Vector, Length
multiplication_5 = Multiplication(A=vec_5, B=in_shift_3)
multiplication_6 = Multiplication(A=vec_6, B=Slider(2452, range=0..3000))
ln_4 = Line(StartPoint=divide_4.Points, EndPoint=rotate_4.Geometry)
Z_5 = UnitZ(Factor=1)
number_slider_6 = Slider(90, range=-180..180)
pl = PlaneNormal(Origin=move_4.Geometry, ZAxis=vec2pt.Vector)
ln_5 = Line(StartPoint=move_4.Geometry, EndPoint=move_5.Geometry)
align_3 = AlignPlane()  # -> Plane, Angle
vec_7 = Vector(unitize(ln_4))
Z_6 = UnitZ(Factor=1)
move_9 = Move(Geometry=divide_3.Points, Motion=multiplication_5)  # -> Geometry, Transform
pl_2 = PlaneNormal(Origin=move_6.Geometry, ZAxis=vec2pt_2.Vector)
ln_6 = Line(StartPoint=move_6.Geometry, EndPoint=move_7.Geometry)
move_10 = Move(Geometry=move_3.Geometry, Motion=multiplication_6)  # -> Geometry, Transform
vec_8 = Vector(unitize(ln_4))
align_4 = AlignPlane(Plane=pl, Direction=Z_5)  # -> Plane, Angle
pln_4 = Plane(align_4.Plane)
multiplication_7 = Multiplication(A=vec_7, B=in_shift_4)
align_5 = AlignPlane(Plane=pl_2, Direction=Z_6)  # -> Plane, Angle
pln_5 = Plane(align_5.Plane)
multiplication_8 = Multiplication(A=vec_8, B=Slider(722, range=0..3000))
vec2pt_3 = Vector2Pt(PointA=move_9.Geometry, PointB=move_10.Geometry, Unitize=False)  # -> Vector, Length
number_slider_7 = Slider(90, range=-180..180)
align_6 = AlignPlane()  # -> Plane, Angle
number_slider_8 = Slider(90, range=-180..180)
move_11 = Move(Geometry=divide_4.Points, Motion=multiplication_7)  # -> Geometry, Transform
move_12 = Move(Geometry=move_8.Geometry, Motion=multiplication_8)  # -> Geometry, Transform
create_beam = GhPythonScript(beam_centerline=ln_5, beam_plane=pln_4)  # -> out, flatten(beam); inputs beam_centerline: Line, beam_plane: Plane
# ---------- create_beam: Python ----------
__author__ = "Wenqian"
__version__ = "2021.03.12"

import rhinoscriptsyntax as rs
import Rhino.Geometry as rg

import sys
path = "C:\Users\Wenqian\Documents\GitHub"
if path not in sys.path:
    sys.path.append(path)
    
from compas_ghpython import unload_modules
unload_modules('timber_beams')
import timber_beams

import compas_ghpython

from timber_beams import Beam
from timber_beams import *
from compas_rhino.geometry import RhinoPoint
from compas_rhino.geometry import RhinoPlane
from compas.utilities import pairwise

beam = Beam.from_frame_length(RhinoPlane.from_geometry(beam_plane).to_compas(), beam_centerline.Length)
print (beam)
# ---------- end create_beam ----------
pl_3 = PlaneNormal(Origin=divide.Points, ZAxis=vec)
Z_7 = UnitZ(Factor=1)
pl_4 = PlaneNormal(Origin=move_9.Geometry, ZAxis=vec2pt_3.Vector)
ln_7 = Line(StartPoint=move_9.Geometry, EndPoint=move_10.Geometry)
python = GhPythonScript(beam_centerline=ln_6, beam_plane=pln_5)  # -> out, flatten(beam); inputs beam_centerline: Line, beam_plane: Plane; same code as create_beam
pl_5 = PlaneNormal(Origin=divide_2.Points, ZAxis=vec_3)
vec2pt_4 = Vector2Pt(PointA=move_11.Geometry, PointB=move_12.Geometry, Unitize=False)  # -> Vector, Length
align_7 = AlignPlane(Plane=pl_4, Direction=Z_7)  # -> Plane, Angle
pln_6 = Plane(align_7.Plane)
create_beam_2 = GhPythonScript(beam_centerline=ln, beam_plane=pl_3)  # -> out, flatten(beam); inputs beam_centerline: Line, beam_plane: Plane; same code as create_beam
ln_8 = Line(StartPoint=move_11.Geometry, EndPoint=move_12.Geometry)
python_2 = GhPythonScript(beam_centerline=ln_2, beam_plane=pl_5)  # -> out, flatten(beam); inputs beam_centerline: Line, beam_plane: Plane; same code as create_beam
Z_8 = UnitZ(Factor=1)
pl_6 = PlaneNormal(Origin=move_11.Geometry, ZAxis=vec2pt_4.Vector)
align_8 = AlignPlane(Plane=pl_6, Direction=Z_8)  # -> Plane, Angle
pln_7 = Plane(align_8.Plane)
create_beam_3 = GhPythonScript(beam_centerline=ln_7, beam_plane=pln_6)  # -> out, flatten(beam); inputs beam_centerline: Line, beam_plane: Plane; same code as create_beam
shift = ShiftList(List=create_beam.beam, Shift=1, Wrap=True)
shift_2 = ShiftList(List=create_beam.beam, Shift=-1, Wrap=True)
pl_7 = PlaneNormal(Origin=divide_3.Points, ZAxis=vec_5)
shift_3 = ShiftList(List=python.beam, Shift=1, Wrap=True)
shift_4 = ShiftList(List=python.beam, Shift=-1, Wrap=True)
create_beam_4 = GhPythonScript(beam_centerline=ln_3, beam_plane=pl_7)  # -> out, flatten(beam); inputs beam_centerline: Line, beam_plane: Plane; same code as create_beam
create_beam_5 = GhPythonScript(beam_centerline=ln_8, beam_plane=pln_7)  # -> out, flatten(beam); inputs beam_centerline: Line, beam_plane: Plane; same code as create_beam
pl_8 = PlaneNormal(Origin=divide_4.Points, ZAxis=vec_7)
create_beam_6 = GhPythonScript(beam_centerline=ln_4, beam_plane=pl_8)  # -> out, flatten(beam); inputs beam_centerline: Line, beam_plane: Plane; same code as create_beam
shift_5 = ShiftList(List=create_beam_3.beam, Shift=0, Wrap=True)
shift_6 = ShiftList(List=create_beam_3.beam, Shift=-1, Wrap=True)
shift_7 = ShiftList(List=create_beam_5.beam, Shift=1, Wrap=True)
shift_8 = ShiftList(List=create_beam_5.beam, Shift=-1, Wrap=True)

# ---- group: connection
beam_connection = GhPythonScript(
    beam1=shift_4,
    beam1_faceflip=Toggle(False),
    beam2=python_2.beam,
    beam2_faceflip=Toggle(False),
    t=graft(Slider(0.33, range=0..1)))  # -> out, flatten(beam_a), flatten(beam_b); inputs beam1_faceflip: Boolean, beam2_faceflip: Boolean
# ---------- beam_connection: Python ----------
__author__ = "Wenqian"
__version__ = "2021.03.12"

import rhinoscriptsyntax as rs
import Rhino.Geometry as rg
from copy import deepcopy
from compas.geometry import Frame
import sys
path = "C:\Users\Wenqian\Documents\GitHub"
if path not in sys.path:
    sys.path.append(path)
    
from compas_ghpython import unload_modules
#unload_modules('timber_beams')
#import timber_beams

import compas_ghpython

from timber_beams import beam_connection
if beam1_faceflip:
    beam1 = deepcopy(beam1)
    beam1.frame = Frame(beam1.frame.point, beam1.frame.yaxis, beam1.frame.xaxis.scaled(-1))
if beam2_faceflip:
    beam2 = deepcopy(beam2)
    beam2.frame = Frame(beam2.frame.point, beam2.frame.yaxis, beam2.frame.xaxis.scaled(-1))
beam_a, beam_b = beam_connection(beam1, beam2, t)
# ---------- end beam_connection ----------

beam_connection_2 = GhPythonScript(
    beam1=shift_3,
    beam1_faceflip=Toggle(False),
    beam2=shift_4,
    beam2_faceflip=Toggle(False),
    t=graft(Slider(0.03, range=0..1)))  # -> out, flatten(beam_a), flatten(beam_b); inputs beam1_faceflip: Boolean, beam2_faceflip: Boolean; same code as beam_connection

# ----
extension = Slider(703, range=0..1000)
extension_2 = Slider(639, range=0..1000)
extension_3 = GhPythonScript(beam=create_beam_2.beam, extSt=extension, extEnd=extension_2)  # -> out, beam_out
# ---------- extension_3: Python ----------
from copy import deepcopy

beam_out = deepcopy(beam)
from compas.geometry import Translation
T = Translation.from_vector(beam_out.frame.zaxis.scaled(-1 * extSt))
beam_out.frame = beam_out.frame.transformed(T)
beam_out.length = beam_out.length  + extSt + extEnd
# ---------- end extension_3 ----------

extension_4 = Slider(703, range=0..1000)
extension_5 = Slider(639, range=0..1000)
extension_6 = GhPythonScript(beam=python_2.beam, extSt=extension_4, extEnd=extension_5)  # -> out, beam_out; same code as extension_3

# ---- group: connection
beam_connection_3 = GhPythonScript(beam1=shift, beam1_faceflip=Toggle(True), beam2=shift_2, beam2_faceflip=Toggle(False), t=graft(Slider(0.29, range=0..1)))  # -> out, flatten(beam_a), flatten(beam_b); inputs beam1_faceflip: Boolean, beam2_faceflip: Boolean; same code as beam_connection

# ----
t2 = Slider(0.22, range=0..1)

# ---- group: connection
beam_connection_4 = GhPythonScript(
    beam1=create_beam_2.beam,
    beam1_faceflip=Toggle(False),
    beam2=create_beam.beam,
    beam2_faceflip=Toggle(False),
    t1=Slider(0.49, range=0..1),
    t2=t2)  # -> out, flatten(beam); inputs beam1_faceflip: Boolean, beam2_faceflip: Boolean
# ---------- beam_connection_4: Python ----------
__author__ = "Wenqian"
__version__ = "2021.03.12"

import rhinoscriptsyntax as rs
import Rhino.Geometry as rg
from copy import deepcopy
from compas.geometry import Frame
import sys
path = "C:\Users\Wenqian\Documents\GitHub"
if path not in sys.path:
    sys.path.append(path)
    
from compas_ghpython import unload_modules
#unload_modules('timber_beams')
#import timber_beams

import compas_ghpython

from timber_beams import beam_connection
from timber_beams import Beam
from compas.geometry import Line

if beam1_faceflip:
    beam1 = deepcopy(beam1)
    beam1.frame = Frame(beam1.frame.point, beam1.frame.yaxis, beam1.frame.xaxis.scaled(-1))
if beam2_faceflip:
    beam2 = deepcopy(beam2)
    beam2.frame = Frame(beam2.frame.point, beam2.frame.yaxis, beam2.frame.xaxis.scaled(-1))

pt1 = Line(*beam1.line).point(t1)
pt2 = Line(*beam2.line).point(t2)

beam = Beam.from_points_dir(pt1, pt2, beam1.frame.zaxis)
# ---------- end beam_connection_4 ----------

beam_connection_5 = GhPythonScript(
    beam1=beam_connection_4.beam,
    beam1_faceflip=Toggle(False),
    beam2=shift_2,
    beam2_faceflip=Toggle(False),
    t=graft(Slider(0.49, range=0..1)))  # -> out, flatten(beam_a), flatten(beam_b); inputs beam1_faceflip: Boolean, beam2_faceflip: Boolean; same code as beam_connection

beam_connection_6 = GhPythonScript(
    beam1=create_beam_2.beam,
    beam1_faceflip=Toggle(False),
    beam2=shift_2,
    beam2_faceflip=Toggle(False),
    t=graft(Slider(0, range=0..1)))  # -> out, flatten(beam_a), flatten(beam_b); inputs beam1_faceflip: Boolean, beam2_faceflip: Boolean; same code as beam_connection

# ----
visualization = GhPythonScript(beam=extension_3.beam_out)  # -> out, frame, width, height, length
# ---------- visualization: Python ----------
#from timber_beams import *
from compas_rhino.geometry import RhinoPoint
from compas_rhino.geometry import RhinoPlane

frame = RhinoPlane.from_geometry(beam.frame).geometry
length = beam.length
# ---------- end visualization ----------
rectangle = Rectangle(Plane=visualization.frame, XSize=Domain(-50, 50), YSize=Domain(-50, 50), Radius=0)  # -> Rectangle, Length
boxrec = BoxRectangle(Rectangle=rectangle.Rectangle, Height=visualization.length)
preview = CustomPreview(
    Geometry=boxrec,
    Material={diffuse=RGB(174, 180, 109), emission=RGB(0, 0, 0), shine=0.85, specular=RGB(217, 217, 217), transparency=0})

visualization_2 = GhPythonScript(beam=extension_6.beam_out)  # -> out, frame, width, height, length; same code as visualization
rectangle_2 = Rectangle(Plane=visualization_2.frame, XSize=Domain(-50, 50), YSize=Domain(-50, 50), Radius=0)  # -> Rectangle, Length
boxrec_2 = BoxRectangle(Rectangle=rectangle_2.Rectangle, Height=visualization_2.length)
preview_2 = CustomPreview(
    Geometry=boxrec_2,
    Material={diffuse=RGB(174, 180, 109), emission=RGB(0, 0, 0), shine=0.85, specular=RGB(217, 217, 217), transparency=0})

visualization_3 = GhPythonScript(beam=create_beam.beam)  # -> out, frame, width, height, length; same code as visualization
rectangle_3 = Rectangle(Plane=visualization_3.frame, XSize=Domain(-50, 50), YSize=Domain(-50, 50), Radius=0)  # -> Rectangle, Length
boxrec_3 = BoxRectangle(Rectangle=rectangle_3.Rectangle, Height=visualization_3.length)
preview_3 = CustomPreview(
    Geometry=boxrec_3,
    Material={diffuse=RGB(174, 180, 109), emission=RGB(0, 0, 0), shine=0.85, specular=RGB(217, 217, 217), transparency=0})

visualization_4 = GhPythonScript(beam=shift_3)  # -> out, frame, width, height, length; same code as visualization
rectangle_4 = Rectangle(Plane=visualization_4.frame, XSize=Domain(-50, 50), YSize=Domain(-50, 50), Radius=0)  # -> Rectangle, Length
boxrec_4 = BoxRectangle(Rectangle=rectangle_4.Rectangle, Height=visualization_4.length)
preview_4 = CustomPreview(
    Geometry=boxrec_4,
    Material={diffuse=RGB(174, 180, 109), emission=RGB(0, 0, 0), shine=0.85, specular=RGB(217, 217, 217), transparency=0})

extension_7 = Slider(703, range=0..1000)
extension_8 = Slider(639, range=0..1000)
extension_9 = GhPythonScript(beam=create_beam_4.beam, extSt=extension_7, extEnd=extension_8)  # -> out, beam_out; same code as extension_3

# ---- group: connection
beam_connection_7 = GhPythonScript(
    beam1=shift_6,
    beam1_faceflip=Toggle(False),
    beam2=create_beam_4.beam,
    beam2_faceflip=Toggle(True),
    t=graft(Slider(0.21, range=0..1)))  # -> out, flatten(beam_a), flatten(beam_b); inputs beam1_faceflip: Boolean, beam2_faceflip: Boolean; same code as beam_connection

# ----
t2_2 = Slider(0.22, range=0..1)

extension_10 = Slider(299, range=0..1000)
extension_11 = Slider(253, range=0..1000)
extension_12 = GhPythonScript(beam=[beam_connection.beam_a, beam_connection.beam_b], extSt=extension_10, extEnd=extension_11)  # -> out, beam_out; same code as extension_3

# ---- group: connection
beam_connection_8 = GhPythonScript(
    beam1=create_beam_4.beam,
    beam1_faceflip=Toggle(False),
    beam2=create_beam_3.beam,
    beam2_faceflip=Toggle(False),
    t1=Slider(0.49, range=0..1),
    t2=t2_2)  # -> out, flatten(beam); inputs beam1_faceflip: Boolean, beam2_faceflip: Boolean; same code as beam_connection_4

# ----
extension_13 = Slider(0, range=0..1000)
extension_14 = Slider(296, range=0..1000)
extension_15 = GhPythonScript(beam=[beam_connection_2.beam_a, beam_connection_2.beam_b], extSt=extension_13, extEnd=extension_14)  # -> out, beam_out; same code as extension_3

t2_3 = Slider(1, range=0..1)

extension_16 = Slider(0, range=0..1000)
extension_17 = Slider(296, range=0..1000)
extension_18 = GhPythonScript(beam=beam_connection_5.beam_b, extSt=extension_16, extEnd=extension_17)  # -> out, beam_out; same code as extension_3

extension_19 = Slider(703, range=0..1000)
extension_20 = Slider(639, range=0..1000)
extension_21 = GhPythonScript(beam=create_beam_6.beam, extSt=extension_19, extEnd=extension_20)  # -> out, beam_out; same code as extension_3

extension_22 = Slider(-1000, range=-1000..1000)

visualization_5 = GhPythonScript(beam=beam_connection_4.beam)  # -> out, frame, width, height, length; same code as visualization
rectangle_5 = Rectangle(Plane=visualization_5.frame, XSize=Domain(-50, 50), YSize=Domain(-50, 50), Radius=0)  # -> Rectangle, Length
boxrec_5 = BoxRectangle(Rectangle=rectangle_5.Rectangle, Height=visualization_5.length)
preview_5 = CustomPreview(
    Geometry=boxrec_5,
    Material={diffuse=RGB(174, 180, 109), emission=RGB(0, 0, 0), shine=0.85, specular=RGB(217, 217, 217), transparency=0})

extension_23 = Slider(687, range=0..1000)
extension_24 = Slider(-1000, range=-1000..1000)
extension_25 = Slider(169, range=0..1000)
extension_26 = GhPythonScript(beam=beam_connection_3.beam_a, extSt=extension_22, extEnd=extension_23)  # -> out, beam_out; same code as extension_3
extension_27 = GhPythonScript(beam=beam_connection_3.beam_b, extSt=extension_24, extEnd=extension_25)  # -> out, beam_out; same code as extension_3

# ---- group: connection
beam_connection_9 = GhPythonScript(
    beam1=extension_26.beam_out,
    beam1_faceflip=Toggle(False),
    beam2=extension_27.beam_out,
    beam2_faceflip=Toggle(False),
    t1=Slider(0.38, range=-2..2),
    t2=t2_3)  # -> out, flatten(beam); inputs beam1_faceflip: Boolean, beam2_faceflip: Boolean
# ---------- beam_connection_9: Python ----------
__author__ = "Wenqian"
__version__ = "2021.03.12"

import rhinoscriptsyntax as rs
import Rhino.Geometry as rg
from copy import deepcopy
from compas.geometry import Frame
import sys
path = "C:\Users\Wenqian\Documents\GitHub"
if path not in sys.path:
    sys.path.append(path)
    
from compas_ghpython import unload_modules
#unload_modules('timber_beams')
#import timber_beams

import compas_ghpython

from timber_beams import beam_connection
from timber_beams import Beam
from compas.geometry import Line

pt1 = Line(*beam1.line).point(t1)
pt2 = Line(*beam2.line).point(t2)

beam = Beam.from_points_dir(pt1, pt2, beam1.frame.zaxis)
# ---------- end beam_connection_9 ----------

# ----
visualization_6 = GhPythonScript(beam=extension_9.beam_out)  # -> out, frame, width, height, length; same code as visualization
rectangle_6 = Rectangle(Plane=visualization_6.frame, XSize=Domain(-50, 50), YSize=Domain(-50, 50), Radius=0)  # -> Rectangle, Length
boxrec_6 = BoxRectangle(Rectangle=rectangle_6.Rectangle, Height=visualization_6.length)
preview_6 = CustomPreview(
    Geometry=boxrec_6,
    Material={diffuse=RGB(174, 180, 109), emission=RGB(0, 0, 0), shine=0.85, specular=RGB(217, 217, 217), transparency=0})

# ---- group: connection
beam_connection_10 = GhPythonScript(
    beam1=shift_7,
    beam1_faceflip=Toggle(False),
    beam2=shift_8,
    beam2_faceflip=Toggle(False),
    t=graft(Slider(0.29, range=0..1)))  # -> out, flatten(beam_a), flatten(beam_b); inputs beam1_faceflip: Boolean, beam2_faceflip: Boolean; same code as beam_connection

# ----
t2_4 = Slider(0.22, range=0..1)

# ---- group: connection
beam_connection_11 = GhPythonScript(
    beam1=create_beam_6.beam,
    beam1_faceflip=Toggle(False),
    beam2=create_beam_5.beam,
    beam2_faceflip=Toggle(False),
    t1=Slider(0.49, range=0..1),
    t2=t2_4)  # -> out, flatten(beam); inputs beam1_faceflip: Boolean, beam2_faceflip: Boolean; same code as beam_connection_4

beam_connection_12 = GhPythonScript(
    beam1=beam_connection_11.beam,
    beam1_faceflip=Toggle(False),
    beam2=shift_8,
    beam2_faceflip=Toggle(False),
    t=graft(Slider(0.59, range=0..1)))  # -> out, flatten(beam_a), flatten(beam_b); inputs beam1_faceflip: Boolean, beam2_faceflip: Boolean; same code as beam_connection

# ----
visualization_7 = GhPythonScript(beam=create_beam_3.beam)  # -> out, frame, width, height, length; same code as visualization
rectangle_7 = Rectangle(Plane=visualization_7.frame, XSize=Domain(-50, 50), YSize=Domain(-50, 50), Radius=0)  # -> Rectangle, Length
boxrec_7 = BoxRectangle(Rectangle=rectangle_7.Rectangle, Height=visualization_7.length)
preview_7 = CustomPreview(
    Geometry=boxrec_7,
    Material={diffuse=RGB(174, 180, 109), emission=RGB(0, 0, 0), shine=0.85, specular=RGB(217, 217, 217), transparency=0})

extension_28 = Slider(506, range=0..1000)
extension_29 = Slider(499, range=0..1000)
extension_30 = GhPythonScript(beam=[beam_connection_6.beam_a, beam_connection_6.beam_b], extSt=extension_28, extEnd=extension_29)  # -> out, beam_out; same code as extension_3

# ---- group: connection
beam_connection_13 = GhPythonScript(
    beam1=create_beam_6.beam,
    beam1_faceflip=Toggle(False),
    beam2=shift_8,
    beam2_faceflip=Toggle(False),
    t=graft(Slider(0, range=0..1)))  # -> out, flatten(beam_a), flatten(beam_b); inputs beam1_faceflip: Boolean, beam2_faceflip: Boolean; same code as beam_connection

# ----
visualization_8 = GhPythonScript(beam=extension_21.beam_out)  # -> out, frame, width, height, length; same code as visualization
rectangle_8 = Rectangle(Plane=visualization_8.frame, XSize=Domain(-50, 50), YSize=Domain(-50, 50), Radius=0)  # -> Rectangle, Length
boxrec_8 = BoxRectangle(Rectangle=rectangle_8.Rectangle, Height=visualization_8.length)
preview_8 = CustomPreview(
    Geometry=boxrec_8,
    Material={diffuse=RGB(174, 180, 109), emission=RGB(0, 0, 0), shine=0.85, specular=RGB(217, 217, 217), transparency=0})

visualization_9 = GhPythonScript(beam=create_beam_5.beam)  # -> out, frame, width, height, length; same code as visualization
rectangle_9 = Rectangle(Plane=visualization_9.frame, XSize=Domain(-50, 50), YSize=Domain(-50, 50), Radius=0)  # -> Rectangle, Length
boxrec_9 = BoxRectangle(Rectangle=rectangle_9.Rectangle, Height=visualization_9.length)
preview_9 = CustomPreview(
    Geometry=boxrec_9,
    Material={diffuse=RGB(174, 180, 109), emission=RGB(0, 0, 0), shine=0.85, specular=RGB(217, 217, 217), transparency=0})

extension_31 = Slider(0, range=0..1000)
extension_32 = Slider(0, range=0..1000)
extension_33 = GhPythonScript(beam=[beam_connection_7.beam_a, beam_connection_7.beam_b], extSt=extension_31, extEnd=extension_32)  # -> out, beam_out; same code as extension_3

# ---- group: connection
beam_connection_14 = GhPythonScript(
    beam1=extension_33.beam_out,
    beam1_faceflip=Toggle(False),
    beam2=create_beam_3.beam,
    beam2_faceflip=Toggle(True),
    t=graft(Slider(0.7, range=0..1)))  # -> out, flatten(beam_a), flatten(beam_b); inputs beam1_faceflip: Boolean, beam2_faceflip: Boolean; same code as beam_connection

# ----
extension_34 = Slider(215, range=0..1000)
extension_35 = Slider(377, range=0..1000)
extension_36 = GhPythonScript(beam=beam_connection_8.beam, extSt=extension_34, extEnd=extension_35)  # -> out, beam_out; same code as extension_3

extension_37 = Slider(647, range=0..1000)
extension_38 = Slider(788, range=0..1000)
extension_39 = Slider(227, range=0..1000)
extension_40 = Slider(269, range=0..1000)
extension_41 = GhPythonScript(beam=[beam_connection_14.beam_a, beam_connection_14.beam_b], extSt=extension_37, extEnd=extension_38)  # -> out, beam_out; same code as extension_3
extension_42 = GhPythonScript(beam=beam_connection_9.beam, extSt=extension_39, extEnd=extension_40)  # -> out, beam_out; same code as extension_3
t2_5 = Slider(1, range=0..1)

visualization_10 = GhPythonScript(beam=extension_12.beam_out)  # -> out, frame, width, height, length; same code as visualization
rectangle_10 = Rectangle(Plane=visualization_10.frame, XSize=Domain(-50, 50), YSize=Domain(-50, 50), Radius=0)  # -> Rectangle, Length
boxrec_10 = BoxRectangle(Rectangle=rectangle_10.Rectangle, Height=visualization_10.length)
preview_10 = CustomPreview(Geometry=boxrec_10, Material=ColourSwatch(SwatchColor=RGB(93, 156, 0)))

visualization_11 = GhPythonScript(beam=extension_15.beam_out)  # -> out, frame, width, height, length; same code as visualization
rectangle_11 = Rectangle(Plane=visualization_11.frame, XSize=Domain(-50, 50), YSize=Domain(-50, 50), Radius=0)  # -> Rectangle, Length
boxrec_11 = BoxRectangle(Rectangle=rectangle_11.Rectangle, Height=visualization_11.length)
preview_11 = CustomPreview(Geometry=boxrec_11, Material=ColourSwatch(SwatchColor=RGB(93, 156, 0)))

extension_43 = Slider(246, range=0..1000)
extension_44 = Slider(296, range=0..1000)
extension_45 = GhPythonScript(beam=beam_connection_12.beam_a, extSt=extension_43, extEnd=extension_44)  # -> out, beam_out; same code as extension_3

extension_46 = Slider(224, range=0..1000)
extension_47 = Slider(296, range=0..1000)
extension_48 = GhPythonScript(beam=beam_connection_12.beam_b, extSt=extension_46, extEnd=extension_47)  # -> out, beam_out; same code as extension_3

visualization_12 = GhPythonScript(beam=extension_18.beam_out)  # -> out, frame, width, height, length; same code as visualization
rectangle_12 = Rectangle(Plane=visualization_12.frame, XSize=Domain(-50, 50), YSize=Domain(-50, 50), Radius=0)  # -> Rectangle, Length
boxrec_12 = BoxRectangle(Rectangle=rectangle_12.Rectangle, Height=visualization_12.length)
preview_12 = CustomPreview(Geometry=boxrec_12, Material=ColourSwatch(SwatchColor=RGB(156, 0, 0)))

visualization_13 = GhPythonScript(beam=beam_connection_11.beam)  # -> out, frame, width, height, length; same code as visualization
rectangle_13 = Rectangle(Plane=visualization_13.frame, XSize=Domain(-50, 50), YSize=Domain(-50, 50), Radius=0)  # -> Rectangle, Length
boxrec_13 = BoxRectangle(Rectangle=rectangle_13.Rectangle, Height=visualization_13.length)
preview_13 = CustomPreview(
    Geometry=boxrec_13,
    Material={diffuse=RGB(174, 180, 109), emission=RGB(0, 0, 0), shine=0.85, specular=RGB(217, 217, 217), transparency=0})

extension_49 = Slider(240, range=-1000..1000)
extension_50 = Slider(230, range=0..1000)
extension_51 = Slider(0, range=-1000..1000)
extension_52 = Slider(0, range=0..1000)
extension_53 = GhPythonScript(beam=beam_connection_10.beam_a, extSt=extension_49, extEnd=extension_50)  # -> out, beam_out; same code as extension_3

visualization_14 = GhPythonScript(beam=extension_26.beam_out)  # -> out, frame, width, height, length; same code as visualization
rectangle_14 = Rectangle(Plane=visualization_14.frame, XSize=Domain(-50, 50), YSize=Domain(-50, 50), Radius=0)  # -> Rectangle, Length
boxrec_14 = BoxRectangle(Rectangle=rectangle_14.Rectangle, Height=visualization_14.length)
preview_14 = CustomPreview(Geometry=boxrec_14, Material=ColourSwatch(SwatchColor=RGB(0, 156, 124)))

extension_54 = GhPythonScript(beam=beam_connection_10.beam_b, extSt=extension_51, extEnd=extension_52)  # -> out, beam_out; same code as extension_3

# ---- group: connection
beam_connection_15 = GhPythonScript(
    beam1=extension_53.beam_out,
    beam1_faceflip=Toggle(False),
    beam2=extension_54.beam_out,
    beam2_faceflip=Toggle(False),
    t1=Slider(0.38, range=-2..2),
    t2=t2_5)  # -> out, flatten(beam); inputs beam1_faceflip: Boolean, beam2_faceflip: Boolean; same code as beam_connection_9

# ----
visualization_15 = GhPythonScript(beam=extension_27.beam_out)  # -> out, frame, width, height, length; same code as visualization
rectangle_15 = Rectangle(Plane=visualization_15.frame, XSize=Domain(-50, 50), YSize=Domain(-50, 50), Radius=0)  # -> Rectangle, Length
boxrec_15 = BoxRectangle(Rectangle=rectangle_15.Rectangle, Height=visualization_15.length)
preview_15 = CustomPreview(Geometry=boxrec_15, Material=ColourSwatch(SwatchColor=RGB(86, 111, 156)))

visualization_16 = GhPythonScript(beam=extension_36.beam_out)  # -> out, frame, width, height, length; same code as visualization
rectangle_16 = Rectangle(Plane=visualization_16.frame, XSize=Domain(-50, 50), YSize=Domain(-50, 50), Radius=0)  # -> Rectangle, Length
boxrec_16 = BoxRectangle(Rectangle=rectangle_16.Rectangle, Height=visualization_16.length)
preview_16 = CustomPreview(
    Geometry=boxrec_16,
    Material={diffuse=RGB(174, 180, 109), emission=RGB(0, 0, 0), shine=0.85, specular=RGB(217, 217, 217), transparency=0})

extension_55 = Slider(506, range=0..1000)
extension_56 = Slider(499, range=0..1000)
extension_57 = GhPythonScript(beam=[beam_connection_13.beam_a, beam_connection_13.beam_b], extSt=extension_55, extEnd=extension_56)  # -> out, beam_out; same code as extension_3

visualization_17 = GhPythonScript(beam=extension_30.beam_out)  # -> out, frame, width, height, length; same code as visualization
rectangle_17 = Rectangle(Plane=visualization_17.frame, XSize=Domain(-50, 50), YSize=Domain(-50, 50), Radius=0)  # -> Rectangle, Length
boxrec_17 = BoxRectangle(Rectangle=rectangle_17.Rectangle, Height=visualization_17.length)
preview_17 = CustomPreview(Geometry=boxrec_17, Material=ColourSwatch(SwatchColor=RGB(93, 156, 0)))

visualization_18 = GhPythonScript(beam=extension_33.beam_out)  # -> out, frame, width, height, length; same code as visualization
rectangle_18 = Rectangle(Plane=visualization_18.frame, XSize=Domain(-50, 50), YSize=Domain(-50, 50), Radius=0)  # -> Rectangle, Length
boxrec_18 = BoxRectangle(Rectangle=rectangle_18.Rectangle, Height=visualization_18.length)
preview_18 = CustomPreview(Geometry=boxrec_18, Material=ColourSwatch(SwatchColor=RGB(156, 0, 0)))

extension_58 = Slider(227, range=0..1000)
extension_59 = Slider(269, range=0..1000)

visualization_19 = GhPythonScript(beam=extension_41.beam_out)  # -> out, frame, width, height, length; same code as visualization
rectangle_19 = Rectangle(Plane=visualization_19.frame, XSize=Domain(-50, 50), YSize=Domain(-50, 50), Radius=0)  # -> Rectangle, Length
boxrec_19 = BoxRectangle(Rectangle=rectangle_19.Rectangle, Height=visualization_19.length)
preview_19 = CustomPreview(Geometry=boxrec_19, Material=ColourSwatch(SwatchColor=RGB(0, 156, 124)))

extension_60 = GhPythonScript(beam=beam_connection_15.beam, extSt=extension_58, extEnd=extension_59)  # -> out, beam_out; same code as extension_3

visualization_20 = GhPythonScript(beam=extension_42.beam_out)  # -> out, frame, width, height, length; same code as visualization
rectangle_20 = Rectangle(Plane=visualization_20.frame, XSize=Domain(-50, 50), YSize=Domain(-50, 50), Radius=0)  # -> Rectangle, Length
boxrec_20 = BoxRectangle(Rectangle=rectangle_20.Rectangle, Height=visualization_20.length)
preview_20 = CustomPreview(Geometry=boxrec_20, Material=ColourSwatch(SwatchColor=RGB(86, 156, 142)))

# ---- group: connection
beam_connection_16 = GhPythonScript(
    beam1=shift,
    beam1_faceflip=Toggle(False),
    beam2=shift_2,
    beam2_faceflip=Toggle(False),
    t=graft(Slider(0.36, range=0..1)))  # -> out, flatten(beam_a), flatten(beam_b); inputs beam1_faceflip: Boolean, beam2_faceflip: Boolean; same code as beam_connection

# ----
visualization_21 = GhPythonScript(beam=extension_45.beam_out)  # -> out, frame, width, height, length; same code as visualization
rectangle_21 = Rectangle(Plane=visualization_21.frame, XSize=Domain(-50, 50), YSize=Domain(-50, 50), Radius=0)  # -> Rectangle, Length
boxrec_21 = BoxRectangle(Rectangle=rectangle_21.Rectangle, Height=visualization_21.length)
preview_21 = CustomPreview(Geometry=boxrec_21, Material=ColourSwatch(SwatchColor=RGB(156, 54, 54)))

visualization_22 = GhPythonScript(beam=extension_48.beam_out)  # -> out, frame, width, height, length; same code as visualization
rectangle_22 = Rectangle(Plane=visualization_22.frame, XSize=Domain(-50, 50), YSize=Domain(-50, 50), Radius=0)  # -> Rectangle, Length
boxrec_22 = BoxRectangle(Rectangle=rectangle_22.Rectangle, Height=visualization_22.length)
preview_22 = CustomPreview(Geometry=boxrec_22, Material=ColourSwatch(SwatchColor=RGB(156, 127, 54)))

visualization_23 = GhPythonScript(beam=extension_53.beam_out)  # -> out, frame, width, height, length; same code as visualization
rectangle_23 = Rectangle(Plane=visualization_23.frame, XSize=Domain(-50, 50), YSize=Domain(-50, 50), Radius=0)  # -> Rectangle, Length
boxrec_23 = BoxRectangle(Rectangle=rectangle_23.Rectangle, Height=visualization_23.length)
preview_23 = CustomPreview(Geometry=boxrec_23, Material=ColourSwatch(SwatchColor=RGB(0, 156, 124)))

visualization_24 = GhPythonScript(beam=extension_54.beam_out)  # -> out, frame, width, height, length; same code as visualization
rectangle_24 = Rectangle(Plane=visualization_24.frame, XSize=Domain(-50, 50), YSize=Domain(-50, 50), Radius=0)  # -> Rectangle, Length
boxrec_24 = BoxRectangle(Rectangle=rectangle_24.Rectangle, Height=visualization_24.length)
preview_24 = CustomPreview(Geometry=boxrec_24, Material=ColourSwatch(SwatchColor=RGB(86, 111, 156)))

visualization_25 = GhPythonScript(beam=extension_57.beam_out)  # -> out, frame, width, height, length; same code as visualization
rectangle_25 = Rectangle(Plane=visualization_25.frame, XSize=Domain(-50, 50), YSize=Domain(-50, 50), Radius=0)  # -> Rectangle, Length
boxrec_25 = BoxRectangle(Rectangle=rectangle_25.Rectangle, Height=visualization_25.length)
preview_25 = CustomPreview(Geometry=boxrec_25, Material=ColourSwatch(SwatchColor=RGB(93, 156, 0)))

# ---- group: connection
beam_connection_17 = GhPythonScript(
    beam1=shift_5,
    beam1_faceflip=Toggle(False),
    beam2=shift_6,
    beam2_faceflip=Toggle(False),
    t=graft(Slider(0.33, range=0..1)))  # -> out, flatten(beam_a), flatten(beam_b); inputs beam1_faceflip: Boolean, beam2_faceflip: Boolean; same code as beam_connection

# ----
extension_61 = Slider(-550, range=-2000..1000)
extension_62 = Slider(296, range=0..1000)
extension_63 = GhPythonScript(beam=beam_connection_16.beam_a, extSt=extension_61, extEnd=extension_62)  # -> out, beam_out; same code as extension_3

visualization_26 = GhPythonScript(beam=extension_60.beam_out)  # -> out, frame, width, height, length; same code as visualization
rectangle_26 = Rectangle(Plane=visualization_26.frame, XSize=Domain(-50, 50), YSize=Domain(-50, 50), Radius=0)  # -> Rectangle, Length
boxrec_26 = BoxRectangle(Rectangle=rectangle_26.Rectangle, Height=visualization_26.length)
preview_26 = CustomPreview(Geometry=boxrec_26, Material=ColourSwatch(SwatchColor=RGB(86, 156, 142)))

extension_64 = Slider(120, range=0..1000)
extension_65 = Slider(1452, range=0..2000)
extension_66 = GhPythonScript(beam=beam_connection_16.beam_b, extSt=extension_64, extEnd=extension_65)  # -> out, beam_out; same code as extension_3

# ---- group: connection
beam_connection_18 = GhPythonScript(
    beam1=shift_7,
    beam1_faceflip=Toggle(False),
    beam2=shift_8,
    beam2_faceflip=Toggle(False),
    t=graft(Slider(0.36, range=0..1)))  # -> out, flatten(beam_a), flatten(beam_b); inputs beam1_faceflip: Boolean, beam2_faceflip: Boolean; same code as beam_connection

# ----
extension_67 = Slider(519, range=-2000..1000)
extension_68 = Slider(339, range=0..1000)
extension_69 = GhPythonScript(beam=beam_connection_17.beam_a, extSt=extension_67, extEnd=extension_68)  # -> out, beam_out; same code as extension_3

extension_70 = Slider(0, range=0..1000)
extension_71 = Slider(1452, range=0..2000)
extension_72 = GhPythonScript(beam=beam_connection_17.beam_b, extSt=extension_70, extEnd=extension_71)  # -> out, beam_out; same code as extension_3

extension_73 = Slider(-550, range=-2000..1000)
extension_74 = Slider(296, range=0..1000)
extension_75 = GhPythonScript(beam=beam_connection_18.beam_a, extSt=extension_73, extEnd=extension_74)  # -> out, beam_out; same code as extension_3

extension_76 = Slider(120, range=0..1000)
extension_77 = Slider(1452, range=0..2000)
extension_78 = GhPythonScript(beam=beam_connection_18.beam_b, extSt=extension_76, extEnd=extension_77)  # -> out, beam_out; same code as extension_3

visualization_27 = GhPythonScript(beam=[extension_63.beam_out, extension_66.beam_out])  # -> out, frame, width, height, length; same code as visualization
rectangle_27 = Rectangle(Plane=visualization_27.frame, XSize=Domain(-50, 50), YSize=Domain(-50, 50), Radius=0)  # -> Rectangle, Length
boxrec_27 = BoxRectangle(Rectangle=rectangle_27.Rectangle, Height=visualization_27.length)
preview_27 = CustomPreview(Geometry=boxrec_27, Material=ColourSwatch(SwatchColor=RGB(93, 156, 0)))

visualization_28 = GhPythonScript(beam=[extension_69.beam_out, extension_72.beam_out])  # -> out, frame, width, height, length; same code as visualization
rectangle_28 = Rectangle(Plane=visualization_28.frame, XSize=Domain(-50, 50), YSize=Domain(-50, 50), Radius=0)  # -> Rectangle, Length
boxrec_28 = BoxRectangle(Rectangle=rectangle_28.Rectangle, Height=visualization_28.length)
preview_28 = CustomPreview(Geometry=boxrec_28, Material=ColourSwatch(SwatchColor=RGB(93, 156, 0)))

visualization_29 = GhPythonScript(beam=[extension_75.beam_out, extension_78.beam_out])  # -> out, frame, width, height, length; same code as visualization
rectangle_29 = Rectangle(Plane=visualization_29.frame, XSize=Domain(-50, 50), YSize=Domain(-50, 50), Radius=0)  # -> Rectangle, Length
boxrec_29 = BoxRectangle(Rectangle=rectangle_29.Rectangle, Height=visualization_29.length)
preview_29 = CustomPreview(Geometry=boxrec_29, Material=ColourSwatch(SwatchColor=RGB(93, 156, 0)))
