# Grasshopper definition 20210312.gh (Grasshopper 1.0.7)

number_slider = Slider(0.1, range=0..1)
number_slider_2 = Slider(0.6, range=0..1)
number_slider_3 = Slider(0.3, range=0..1)
python = GhPythonScript(reload_module_button=Button(), module_names="timber_beams")  # -> out, a
# ---------- python: Python ----------
import compas_ghpython
from compas_ghpython import unload_modules
if reload_module_button:
    for module in module_names:
        unload_modules(module)
# ---------- end python ----------
vec = VectorXYZ(XComponent=1, YComponent=0, ZComponent=0)  # -> Vector, Length
Z = UnitZ(Factor=1)
crv = Curve([<curve referenced from the Rhino model> x4])
vrot = Rotate(
    Vector=vec.Vector,
    Axis=Z,
    Angle=[Slider(0.56, range=0..6.28), Slider(5.08, range=0..6.28), Slider(4, range=0..6.28), Slider(4.47, range=0..6.28)])
shift = ShiftList(List=vrot, Shift=-1, Wrap=False)
shift_2 = ShiftList(List=crv, Shift=-1, Wrap=False)
shift_3 = ShiftList(List=crv, Shift=1, Wrap=False)
shift_4 = ShiftList(List=vrot, Shift=1, Wrap=False)
python_2 = GhPythonScript(lines=crv, sec_dir=vrot, t=[number_slider, number_slider_3, number_slider_2])  # -> out, frames, lengths; inputs lines: list of Line, sec_dir: list of Vector3d, t: list
# ---------- python_2: Python ----------
__author__ = "Wenqian"
__version__ = "2021.03.12"

import rhinoscriptsyntax as rs
import Rhino.Geometry as rg

import sys
path = "C:\Users\Wenqian\Documents\GitHub"
if path not in sys.path:
    sys.path.append(path)

import timber_beams

import compas_ghpython
#from compas_ghpython import unload_modules
#unload_modules('timber_beams')

from timber_beams import Beam
from timber_beams import beam_connection
from compas_rhino.geometry import RhinoPoint
from compas_rhino.geometry import RhinoPlane
from compas.utilities import pairwise

beams = []

for i in range(len(lines)):
    beam = Beam.from_points_dir(lines[i].PointAt(0), lines[i].PointAt(1), sec_dir[i])
    beams.append(beam)

for i, j in pairwise(range(len(lines))):
    beam_a, beam_b = beam_connection(beams[i], beams[j], t[i])
    beams.extend([beam_a, beam_b])

frames = [RhinoPlane.from_geometry(beam.frame).geometry for beam in beams]
lengths = [beam.length for beam in beams]
# ---------- end python_2 ----------
python_3 = GhPythonScript(
    line1=shift_3,
    line2=shift_2,
    sec_dir1=shift_4,
    sec_dir2=shift,
    t=graft([number_slider, number_slider_3, number_slider_2, Slider(0.9, range=0..1)]))  # -> out, frames, lengths; inputs line1: Line, line2: Line, sec_dir1: Vector3d, sec_dir2: Vector3d
# ---------- python_3: Python ----------
__author__ = "Wenqian"
__version__ = "2021.03.12"

import rhinoscriptsyntax as rs
import Rhino.Geometry as rg

import sys
path = "C:\Users\Wenqian\Documents\GitHub"
if path not in sys.path:
    sys.path.append(path)

import timber_beams

import compas_ghpython
#from compas_ghpython import unload_modules
#unload_modules('timber_beams')

from timber_beams import Beam
from timber_beams import *
from compas_rhino.geometry import RhinoPoint
from compas_rhino.geometry import RhinoPlane
from compas.utilities import pairwise




beam1 = Beam.from_points_dir(line1.PointAt(0), line1.PointAt(1), sec_dir1)
beam2 = Beam.from_points_dir(line2.PointAt(0), line2.PointAt(1), sec_dir2)
beams = [beam1, beam2]

beam_a, beam_b = beam_connection_short(beam1, beam2, t)
beams.extend([beam_a, beam_b])

frames = [RhinoPlane.from_geometry(beam.frame).geometry for beam in beams]
lengths = [beam.length for beam in beams]
# ---------- end python_3 ----------
rectangle = Rectangle(Plane=python_2.frames, XSize=Domain(-0.5, 0.5), YSize=Domain(-0.5, 0.5), Radius=0)  # -> Rectangle, Length
rectangle_2 = Rectangle(Plane=python_3.frames, XSize=Domain(-0.5, 0.5), YSize=Domain(-0.5, 0.5), Radius=0)  # -> Rectangle, Length
boxrec = BoxRectangle(Rectangle=rectangle.Rectangle, Height=python_2.lengths)
boxrec_2 = BoxRectangle(Rectangle=rectangle_2.Rectangle, Height=python_3.lengths)
brep = Brep(boxrec)
brep_2 = Brep(boxrec_2)
