# Grasshopper definition 20210329.gh (Grasshopper 1.0.7)

Z = UnitZ(Factor=Slider(11, range=0..30))
xy = XYPlane(Origin=Point(0, 0, 0))
move = Move(Geometry=xy, Motion=Z)  # -> Geometry, Transform
cir = Circle(Plane=PlaneXY(0, 0, 0), Radius=Slider(7, range=0..10))
cir_2 = Circle(Plane=move.Geometry, Radius=Slider(5, range=0..10))
divide = DivideCurve(Curve=cir, Count=Slider(5, range=0..10), Kinks=False)  # -> Points, Tangents, Parameters
divide_2 = DivideCurve(Curve=cir_2, Count=Slider(5, range=0..10), Kinks=False)  # -> Points, Tangents, Parameters
Z_2 = UnitZ(Factor=Slider(20, range=0..100))
Z_3 = UnitZ(Factor=Slider(20, range=0..100))
wav = WeightedAverage(Input=divide_2.Points, Weights=divide_2.Points)
rotate = Rotate(Geometry=divide_2.Points, Angle=Slider(0.82, range=0..6.28), Plane=wav)  # -> Geometry, Transform
move_2 = Move(Geometry=rotate.Geometry, Motion=Z_3)  # -> Geometry, Transform
move_3 = Move(Geometry=divide.Points, Motion=Z_2)  # -> Geometry, Transform
wav_2 = WeightedAverage(Input=move_3.Geometry, Weights=move_3.Geometry)
wav_3 = WeightedAverage(Input=move_2.Geometry, Weights=move_2.Geometry)
scale = Scale(Geometry=move_3.Geometry, Center=wav_2, Factor=Slider(0.5, range=0..1))  # -> Geometry, Transform
scale_2 = Scale(Geometry=move_2.Geometry, Center=wav_3, Factor=Slider(3, range=0..3))  # -> Geometry, Transform
rotate_2 = Rotate(Geometry=scale.Geometry, Angle=Slider(0.85, range=0..6.28), Plane=PlaneXY(0, 0, 0))  # -> Geometry, Transform
rotate_3 = Rotate(Geometry=scale_2.Geometry, Angle=Slider(0.84, range=0..6.28), Plane=PlaneXY(0, 0, 0))  # -> Geometry, Transform
ln = Line(StartPoint=rotate.Geometry, EndPoint=rotate_3.Geometry)
ln_2 = Line(StartPoint=divide.Points, EndPoint=rotate_2.Geometry)
entwine = Entwine(Branch00=ln_2, Branch01=ln, FlattenInputs=True)
flip = FlipMatrix(Data=entwine)  # -> flatten(Data)
clean = CleanTree(RemoveNulls=True, RemoveInvalid=True, RemoveEmpty=False, Tree=flip)
number_slider = Slider(10, range=0..10)  # disabled
number_slider_2 = Slider(5, range=0..10)  # disabled
number_slider_3 = Slider(20, range=0..100)  # disabled
number_slider_4 = Slider(0.3, range=0..1)  # disabled
number_slider_5 = Slider(0.93, range=0..6.28)  # disabled
number_slider_6 = Slider(0.94, range=0..3.14)  # disabled
number_slider_7 = Slider(5, range=0..10)  # disabled
line = Line(ln_2)
crv = Curve(<curve referenced from the Rhino model>)  # disabled
crv_2 = Curve(<curve referenced from the Rhino model>)  # disabled
line_2 = Line(ln)
number_slider_8 = Slider(0.94, range=0..3.14)  # disabled
cir_3 = Circle(Plane=PlaneXY(0, 0, 0), Radius=number_slider)  # disabled
divide_3 = DivideCurve(Curve=crv, Count=number_slider_7, Kinks=False)  # -> Points, Tangents, Parameters; disabled
divide_4 = DivideCurve(Curve=cir_3, Count=number_slider_2, Kinks=False)  # -> Points, Tangents, Parameters; disabled
xz = XZPlane(Origin=divide_3.Points)  # disabled
pcx = CurvePlane(Curve=crv_2, Plane=xz)  # -> flatten(Points), ParamsC, ParamsP; disabled
Z_4 = UnitZ(Factor=number_slider_3)  # disabled
ln_3 = Line(StartPoint=divide_3.Points, EndPoint=pcx.Points)  # disabled
move_4 = Move(Geometry=divide_4.Points, Motion=Z_4)  # -> Geometry, Transform; disabled
wav_4 = WeightedAverage(Input=move_4.Geometry, Weights=move_4.Geometry)  # disabled
python = GhPythonScript(reload_module_button=Button(), module_names="timber_beams")  # -> out, a
# ---------- python: Python ----------
import compas_ghpython
from compas_ghpython import unload_modules
if reload_module_button:
    for module in module_names:
        unload_modules(module)
# ---------- end python ----------
scale_3 = Scale(Geometry=move_4.Geometry, Center=wav_4, Factor=number_slider_4)  # -> Geometry, Transform; disabled
rotate_4 = Rotate(Geometry=scale_3.Geometry, Angle=number_slider_5, Plane=PlaneXY(0, 0, 0))  # -> Geometry, Transform; disabled
number_slider_9 = Slider(0.1, range=0..3.14)  # disabled
ln_4 = Line(StartPoint=divide_4.Points, EndPoint=rotate_4.Geometry)  # disabled
item = ListItem(List=ln_4, Index=0, Wrap=True)  # disabled
lng = ListLength(List=ln_3)  # disabled
item_2 = ListItem(List=clean, Index=0, Wrap=True)
item_3 = ListItem(List=line, Index=0, Wrap=True)
line_3 = Line(flatten([ln_4, item]))  # disabled
item_4 = ListItem(List=line_2, Index=0, Wrap=True)
lng_2 = ListLength(List=ln_4)  # disabled
series = Series(Start=0, Step=number_slider_9, Count=lng)  # disabled
addition = Addition(A=series, B=number_slider_8)  # disabled
line_4 = Line(flatten([clean, item_2]))
lng_3 = ListLength(List=clean)
pi = Pi(Factor=1)  # -> expr("x*2", Output); disabled
line_5 = Line(flatten([line, item_3]))
lng_4 = ListLength(List=line)
line_6 = Line(flatten([line_2, item_4]))
crv_3 = Curve([<curve referenced from the Rhino model> x4])  # disabled
panel = Panel(line_3)  # disabled
lng_5 = ListLength(List=line_2)
number_slider_10 = Slider(0.56, range=0..6.28)  # disabled
number_slider_11 = Slider(5.08, range=0..6.28)  # disabled
number_slider_12 = Slider(5.46, range=0..6.28)  # disabled
number_slider_13 = Slider(1.91, range=0..6.28)  # disabled
lng_6 = ListLength(List=line_3)  # disabled
pi_2 = Pi(Factor=1)  # -> expr("x*2", Output)
pi_3 = Pi(Factor=1)  # -> expr("x*2", Output)
division = Division(A=pi, B=lng_2)  # disabled
panel_2 = Panel(line_4)
pi_4 = Pi(Factor=1)  # -> expr("x*2", Output)
lng_7 = ListLength(List=line_4)
series_2 = Series(Start=0, Step=division, Count=lng_6)  # disabled
addition_2 = Addition(A=series_2, B=number_slider_6)  # disabled
panel_3 = Panel(line_5)
lng_8 = ListLength(List=line_5)
vec = VectorXYZ(XComponent=1, YComponent=0, ZComponent=0)  # -> Vector, Length; disabled
number_slider_14 = Slider(0.5, range=0..1)  # disabled
number_slider_15 = Slider(0.7, range=0..1)  # disabled
number_slider_16 = Slider(0.1, range=0..1)  # disabled
number_slider_17 = Slider(0.3, range=0..1)  # disabled
division_2 = Division(A=pi_2, B=lng_3)
panel_4 = Panel(line_6)
panel_5 = Panel(division)  # disabled
lng_9 = ListLength(List=line_6)
division_3 = Division(A=pi_3, B=lng_4)
series_3 = Series(Start=0, Step=division_2, Count=lng_7)
addition_3 = Addition(A=series_3, B=Slider(0.87, range=0..3.14))
panel_6 = Panel(series_2)  # disabled
division_4 = Division(A=pi_4, B=lng_5)
series_4 = Series(Start=0, Step=division_3, Count=lng_8)
addition_4 = Addition(A=series_4, B=Slider(0.87, range=0..3.14))
panel_7 = Panel("timber_beams")  # disabled
panel_8 = Panel(division_2)
Z_5 = UnitZ(Factor=1)  # disabled
series_5 = Series(Start=0, Step=division_4, Count=lng_9)
addition_5 = Addition(A=series_5, B=Slider(1.45, range=0..3.14))
button = Button()  # disabled
panel_9 = Panel(division_3)
panel_10 = Panel(series_3)
panel_11 = Panel(division_4)
panel_12 = Panel(series_4)
vrot = Rotate(Vector=vec.Vector, Axis=Z_5, Angle=addition)  # disabled
number_slider_18 = Slider(0.1, range=0..1)  # disabled
number_slider_19 = Slider(0.5, range=0..1)  # disabled
vec_2 = VectorXYZ(XComponent=1, YComponent=0, ZComponent=0)  # -> Vector, Length; disabled
number_slider_20 = Slider(0.3, range=0..1)  # disabled
number_slider_21 = Slider(0.7, range=0..1)  # disabled
panel_13 = Panel(series_5)
python_2 = GhPythonScript(reload_module_button=button, module_names=panel_7)  # -> out, a; disabled; same code as python
vec_3 = VectorXYZ(XComponent=1, YComponent=0, ZComponent=0)  # -> Vector, Length
number_slider_22 = Slider(0.1, range=0..1)
number_slider_23 = Slider(0.3, range=0..1)
number_slider_24 = Slider(0.7, range=0..1)
vec_4 = VectorXYZ(XComponent=1, YComponent=0, ZComponent=0)  # -> Vector, Length
number_slider_25 = Slider(0.4, range=0..1)
number_slider_26 = Slider(0.3, range=0..1)
number_slider_27 = Slider(0.7, range=0..1)
Z_6 = UnitZ(Factor=1)  # disabled
shift = ShiftList(List=ln_3, Shift=-1, Wrap=False)  # disabled
shift_2 = ShiftList(List=vrot, Shift=1, Wrap=False)  # disabled
shift_3 = ShiftList(List=ln_3, Shift=1, Wrap=False)  # disabled
shift_4 = ShiftList(List=vrot, Shift=-1, Wrap=False)  # disabled
python_3 = GhPythonScript(reload_module_button=Button(), module_names="timber_beams")  # -> out, a; same code as python
vec_5 = VectorXYZ(XComponent=1, YComponent=0, ZComponent=0)  # -> Vector, Length
number_slider_28 = Slider(0.1, range=0..1)
python_4 = GhPythonScript(reload_module_button=Button(), module_names="timber_beams")  # -> out, a; same code as python
vrot_2 = Rotate(Vector=vec_2.Vector, Axis=Z_6, Angle=addition_2)  # disabled
Z_7 = UnitZ(Factor=1)
python_5 = GhPythonScript(reload_module_button=Button(), module_names="timber_beams")  # -> out, a; same code as python
Z_8 = UnitZ(Factor=1)
Z_9 = UnitZ(Factor=1)
vrot_3 = Rotate(Vector=vec_3.Vector, Axis=Z_7, Angle=addition_3)
vrot_4 = Rotate(Vector=vec_4.Vector, Axis=Z_8, Angle=addition_4)
python_6 = GhPythonScript(
    line1=shift_3,
    line2=shift,
    sec_dir1=shift_2,
    sec_dir2=shift_4,
    t=graft([number_slider_16, number_slider_17, number_slider_14, number_slider_15]))  # -> out, frames, lengths; inputs line1: Line, line2: Line, sec_dir1: Vector3d, sec_dir2: Vector3d; disabled
# ---------- python_6: Python ----------
__author__ = "Wenqian"
__version__ = "2021.03.12"

import rhinoscriptsyntax as rs
import Rhino.Geometry as rg

import sys
path = "C:\Users\Wenqian\Documents\GitHub"
if path not in sys.path:
    sys.path.append(path)

import timber_beams

import compas_ghpython
#from compas_ghpython import unload_modules
#unload_modules('timber_beams')

from timber_beams import Beam
from timber_beams import *
from compas_rhino.geometry import RhinoPoint
from compas_rhino.geometry import RhinoPlane
from compas.utilities import pairwise




beam1 = Beam.from_points_dir(line1.PointAt(0), line1.PointAt(1), sec_dir1)
beam2 = Beam.from_points_dir(line2.PointAt(0), line2.PointAt(1), sec_dir2)
beams = [beam1, beam2]

beam_a, beam_b = beam_connection_short(beam1, beam2, t)
beams.extend([beam_a, beam_b])

frames = [RhinoPlane.from_geometry(beam.frame).geometry for beam in beams]
lengths = [beam.length for beam in beams]
# ---------- end python_6 ----------
shift_5 = ShiftList(List=line_3, Shift=-1, Wrap=False)  # disabled
shift_6 = ShiftList(List=vrot_2, Shift=1, Wrap=False)  # disabled
shift_7 = ShiftList(List=line_3, Shift=1, Wrap=False)  # disabled
shift_8 = ShiftList(List=vrot_2, Shift=-1, Wrap=False)  # disabled
vrot_5 = Rotate(Vector=vec_5.Vector, Axis=Z_9, Angle=addition_5)
shift_9 = ShiftList(List=line_4, Shift=-1, Wrap=False)
shift_10 = ShiftList(List=vrot_3, Shift=1, Wrap=False)
shift_11 = ShiftList(List=line_4, Shift=1, Wrap=False)
shift_12 = ShiftList(List=vrot_3, Shift=-1, Wrap=False)
shift_13 = ShiftList(List=line_5, Shift=-1, Wrap=False)
shift_14 = ShiftList(List=vrot_4, Shift=1, Wrap=False)
shift_15 = ShiftList(List=line_5, Shift=1, Wrap=False)
shift_16 = ShiftList(List=vrot_4, Shift=-1, Wrap=False)
shift_17 = ShiftList(List=line_6, Shift=-1, Wrap=False)
shift_18 = ShiftList(List=vrot_5, Shift=1, Wrap=False)
shift_19 = ShiftList(List=line_6, Shift=1, Wrap=False)
shift_20 = ShiftList(List=vrot_5, Shift=-1, Wrap=False)
python_7 = GhPythonScript(
    line1=shift_7,
    line2=shift_5,
    sec_dir1=shift_6,
    sec_dir2=shift_8,
    t=graft([number_slider_18, number_slider_20, number_slider_19]))  # -> out, frames, lengths; inputs line1: Line, line2: Line, sec_dir1: Vector3d, sec_dir2: Vector3d; disabled; same code as python_6
rectangle = Rectangle(Plane=python_6.frames, XSize=Domain(-0.5, 0.5), YSize=Domain(-0.5, 0.5), Radius=0)  # -> Rectangle, Length; disabled
python_8 = GhPythonScript(line1=shift_11, line2=shift_9, sec_dir1=shift_10, sec_dir2=shift_12, t=graft(Slider(0.4, range=0..1)))  # -> out, frames, lengths; inputs line1: Line, line2: Line, sec_dir1: Vector3d, sec_dir2: Vector3d; same code as python_6
python_9 = GhPythonScript(line1=shift_15, line2=shift_13, sec_dir1=shift_14, sec_dir2=shift_16, t=graft(Slider(0.1, range=0..1)))  # -> out, frames, lengths; inputs line1: Line, line2: Line, sec_dir1: Vector3d, sec_dir2: Vector3d; same code as python_6
boxrec = BoxRectangle(Rectangle=rectangle.Rectangle, Height=python_6.lengths)  # disabled
python_10 = GhPythonScript(
    line1=shift_19,
    line2=shift_17,
    sec_dir1=shift_18,
    sec_dir2=shift_20,
    t=graft([Slider(0.9, range=0..1), Slider(0.6, range=0..1), Slider(0.3, range=0..1)]))  # -> out, frames, lengths; inputs line1: Line, line2: Line, sec_dir1: Vector3d, sec_dir2: Vector3d; same code as python_6
brep = Brep(boxrec)  # disabled
rectangle_2 = Rectangle(Plane=python_7.frames, XSize=Domain(-0.5, 0.5), YSize=Domain(-0.5, 0.5), Radius=0)  # -> Rectangle, Length; disabled
rectangle_3 = Rectangle(Plane=python_8.frames, XSize=Domain(-0.5, 0.5), YSize=Domain(-0.5, 0.5), Radius=0)  # -> Rectangle, Length
rectangle_4 = Rectangle(Plane=python_9.frames, XSize=Domain(-0.5, 0.5), YSize=Domain(-0.5, 0.5), Radius=0)  # -> Rectangle, Length
boxrec_2 = BoxRectangle(Rectangle=rectangle_2.Rectangle, Height=python_7.lengths)  # disabled
rectangle_5 = Rectangle(Plane=python_10.frames, XSize=Domain(-0.5, 0.5), YSize=Domain(-0.5, 0.5), Radius=0)  # -> Rectangle, Length
brep_2 = Brep(boxrec_2)  # disabled
boxrec_3 = BoxRectangle(Rectangle=rectangle_3.Rectangle, Height=python_8.lengths)
boxrec_4 = BoxRectangle(Rectangle=rectangle_4.Rectangle, Height=python_9.lengths)
boxrec_5 = BoxRectangle(Rectangle=rectangle_5.Rectangle, Height=python_10.lengths)
brep_3 = Brep(boxrec_3)
brep_4 = Brep(boxrec_4)
brep_5 = Brep(boxrec_5)
