# Grasshopper definition 20210415.gh (Grasshopper 1.0.7)

cir = Circle(Plane=PlaneXY(0, 0, 0), Radius=Slider(10, range=0..10))
divide = DivideCurve(Curve=cir, Count=Slider(3, range=0..10), Kinks=False)  # -> Points, Tangents, Parameters
Z = UnitZ(Factor=Slider(20, range=0..100))
move = Move(Geometry=divide.Points, Motion=Z)  # -> Geometry, Transform
wav = WeightedAverage(Input=move.Geometry, Weights=move.Geometry)
python = GhPythonScript(reload_module_button=Button(), module_names="timber_beams")  # -> out, a
# ---------- python: Python ----------
import compas_ghpython
from compas_ghpython import unload_modules
if reload_module_button:
    for module in module_names:
        unload_modules(module)
# ---------- end python ----------
scale = Scale(Geometry=move.Geometry, Center=wav, Factor=Slider(0.3, range=0..1))  # -> Geometry, Transform
rotate = Rotate(Geometry=scale.Geometry, Angle=Slider(1.41, range=0..6.28), Plane=PlaneXY(0, 0, 0))  # -> Geometry, Transform
ln = Line(StartPoint=divide.Points, EndPoint=rotate.Geometry)
item = ListItem(List=ln, Index=0, Wrap=True)
line = Line(flatten([ln, item]))
lng = ListLength(List=ln)
pi = Pi(Factor=1)  # -> expr("x*2", Output)
panel = Panel(line)
number_slider = Slider(0.56, range=0..6.28)
number_slider_2 = Slider(5.08, range=0..6.28)
number_slider_3 = Slider(5.46, range=0..6.28)
number_slider_4 = Slider(1.91, range=0..6.28)
lng_2 = ListLength(List=line)
division = Division(A=pi, B=lng)
series = Series(Start=0, Step=division, Count=lng_2)
addition = Addition(A=series, B=Slider(1.8, range=0..3.14))
panel_2 = Panel(division)
panel_3 = Panel(series)
crv = Curve([<curve referenced from the Rhino model> x2])
vec = VectorXYZ(XComponent=1, YComponent=0, ZComponent=0)  # -> Vector, Length
number_slider_5 = Slider(0.7, range=0..1)
vec_2 = VectorXYZ(XComponent=1, YComponent=0, ZComponent=0)  # -> Vector, Length
number_slider_6 = Slider(0.1, range=0..1)
number_slider_7 = Slider(0.3, range=0..1)
number_slider_8 = Slider(0.7, range=0..1)
python_2 = GhPythonScript(reload_module_button=Button(), module_names="timber_beams")  # -> out, a; same code as python
Z_2 = UnitZ(Factor=1)
Z_3 = UnitZ(Factor=1)
vrot = Rotate(Vector=vec.Vector, Axis=Z_2, Angle=addition)
vrot_2 = Rotate(Vector=vec_2.Vector, Axis=Z_3, Angle=Slider(0.96, range=0..3.14))
shift = ShiftList(List=line, Shift=-1, Wrap=False)
shift_2 = ShiftList(List=vrot, Shift=1, Wrap=False)
shift_3 = ShiftList(List=line, Shift=1, Wrap=False)
shift_4 = ShiftList(List=vrot, Shift=-1, Wrap=False)
shift_5 = ShiftList(List=crv, Shift=-1, Wrap=False)
shift_6 = ShiftList(List=vrot_2, Shift=1, Wrap=False)
shift_7 = ShiftList(List=crv, Shift=1, Wrap=False)
shift_8 = ShiftList(List=vrot_2, Shift=-1, Wrap=False)
number_slider_9 = Slider(3, range=0..10)
python_3 = GhPythonScript(
    line1=shift_3,
    line2=shift,
    sec_dir1=shift_2,
    sec_dir2=shift_4,
    t=graft([Slider(0.1, range=0..1), Slider(0.3, range=0..1), Slider(0.5, range=0..1)]))  # -> out, frames, lengths; inputs line1: Line, line2: Line, sec_dir1: Vector3d, sec_dir2: Vector3d
# ---------- python_3: Python ----------
__author__ = "Wenqian"
__version__ = "2021.03.12"

import rhinoscriptsyntax as rs
import Rhino.Geometry as rg

import sys
path = "C:\Users\Wenqian\Documents\GitHub"
if path not in sys.path:
    sys.path.append(path)

import timber_beams

import compas_ghpython
#from compas_ghpython import unload_modules
#unload_modules('timber_beams')

from timber_beams import Beam
from timber_beams import *
from compas_rhino.geometry import RhinoPoint
from compas_rhino.geometry import RhinoPlane
from compas.utilities import pairwise




beam1 = Beam.from_points_dir(line1.PointAt(0), line1.PointAt(1), sec_dir1)
beam2 = Beam.from_points_dir(line2.PointAt(0), line2.PointAt(1), sec_dir2)
beams = [beam1, beam2]

beam_a, beam_b = beam_connection_short(beam1, beam2, t)
beams.extend([beam_a, beam_b])

frames = [RhinoPlane.from_geometry(beam.frame).geometry for beam in beams]
lengths = [beam.length for beam in beams]
# ---------- end python_3 ----------
panel_4 = Panel(vrot_2)
python_4 = GhPythonScript(line1=shift_7, line2=shift_5, sec_dir1=vrot_2, sec_dir2=vrot_2, t=Slider(0.5, range=0..1))  # -> out, frames, lengths; inputs line1: Line, line2: Line, sec_dir1: Vector3d, sec_dir2: Vector3d; same code as python_3
rectangle = Rectangle(Plane=python_4.frames, XSize=Domain(-0.5, 0.5), YSize=Domain(-0.5, 0.5), Radius=0)  # -> Rectangle, Length
cluster = Cluster(P=python_3.frames, G=python_3.frames, x=number_slider_9, A_2=python_3.lengths, A=number_slider_9)
boxrec = BoxRectangle(Rectangle=rectangle.Rectangle, Height=python_4.lengths)
brep = Brep(cluster)
brep_2 = Brep(boxrec)
number_slider_10 = Slider(11, range=0..30)  # disabled
Z_4 = UnitZ(Factor=number_slider_10)  # disabled
xy = XYPlane(Origin=Point(0, 0, 0))  # disabled
number_slider_11 = Slider(0.84, range=0..6.28)  # disabled
number_slider_12 = Slider(20, range=0..100)  # disabled
number_slider_13 = Slider(5, range=0..10)  # disabled
number_slider_14 = Slider(7, range=0..10)  # disabled
number_slider_15 = Slider(5, range=0..10)  # disabled
number_slider_16 = Slider(0.5, range=0..1)  # disabled
number_slider_17 = Slider(0.85, range=0..6.28)  # disabled
number_slider_18 = Slider(5, range=0..10)  # disabled
number_slider_19 = Slider(0.82, range=0..6.28)  # disabled
number_slider_20 = Slider(20, range=0..100)  # disabled
number_slider_21 = Slider(3, range=0..3)  # disabled
move_2 = Move(Geometry=xy, Motion=Z_4)  # -> Geometry, Transform; disabled
cir_2 = Circle(Plane=PlaneXY(0, 0, 0), Radius=number_slider_14)  # disabled
cir_3 = Circle(Plane=move_2.Geometry, Radius=number_slider_18)  # disabled
divide_2 = DivideCurve(Curve=cir_2, Count=number_slider_15, Kinks=False)  # -> Points, Tangents, Parameters; disabled
divide_3 = DivideCurve(Curve=cir_3, Count=number_slider_13, Kinks=False)  # -> Points, Tangents, Parameters; disabled
Z_5 = UnitZ(Factor=number_slider_12)  # disabled
Z_6 = UnitZ(Factor=number_slider_20)  # disabled
wav_2 = WeightedAverage(Input=divide_3.Points, Weights=divide_3.Points)  # disabled
rotate_2 = Rotate(Geometry=divide_3.Points, Angle=number_slider_19, Plane=wav_2)  # -> Geometry, Transform; disabled
move_3 = Move(Geometry=rotate_2.Geometry, Motion=Z_6)  # -> Geometry, Transform; disabled
move_4 = Move(Geometry=divide_2.Points, Motion=Z_5)  # -> Geometry, Transform; disabled
wav_3 = WeightedAverage(Input=move_4.Geometry, Weights=move_4.Geometry)  # disabled
wav_4 = WeightedAverage(Input=move_3.Geometry, Weights=move_3.Geometry)  # disabled
scale_2 = Scale(Geometry=move_4.Geometry, Center=wav_3, Factor=number_slider_16)  # -> Geometry, Transform; disabled
scale_3 = Scale(Geometry=move_3.Geometry, Center=wav_4, Factor=number_slider_21)  # -> Geometry, Transform; disabled
rotate_3 = Rotate(Geometry=scale_2.Geometry, Angle=number_slider_17, Plane=PlaneXY(0, 0, 0))  # -> Geometry, Transform; disabled
rotate_4 = Rotate(Geometry=scale_3.Geometry, Angle=number_slider_11, Plane=PlaneXY(0, 0, 0))  # -> Geometry, Transform; disabled
ln_2 = Line(StartPoint=rotate_2.Geometry, EndPoint=rotate_4.Geometry)  # disabled
ln_3 = Line(StartPoint=divide_2.Points, EndPoint=rotate_3.Geometry)  # disabled
entwine = Entwine(Branch00=ln_3, Branch01=ln_2, FlattenInputs=True)  # disabled
flip = FlipMatrix(Data=entwine)  # -> flatten(Data); disabled
clean = CleanTree(RemoveNulls=True, RemoveInvalid=True, RemoveEmpty=False, Tree=flip)  # disabled
number_slider_22 = Slider(5, range=0..10)  # disabled
line_2 = Line(ln_3)  # disabled
crv_2 = Curve(<curve referenced from the Rhino model>)  # disabled
number_slider_23 = Slider(0.87, range=0..3.14)  # disabled
crv_3 = Curve(<curve referenced from the Rhino model>)  # disabled
line_3 = Line(ln_2)  # disabled
number_slider_24 = Slider(0.94, range=0..3.14)  # disabled
divide_4 = DivideCurve(Curve=crv_2, Count=number_slider_22, Kinks=False)  # -> Points, Tangents, Parameters; disabled
xz = XZPlane(Origin=divide_4.Points)  # disabled
pcx = CurvePlane(Curve=crv_3, Plane=xz)  # -> flatten(Points), ParamsC, ParamsP; disabled
ln_4 = Line(StartPoint=divide_4.Points, EndPoint=pcx.Points)  # disabled
number_slider_25 = Slider(0.87, range=0..3.14)  # disabled
number_slider_26 = Slider(0.1, range=0..3.14)  # disabled
lng_3 = ListLength(List=ln_4)  # disabled
item_2 = ListItem(List=clean, Index=0, Wrap=True)  # disabled
item_3 = ListItem(List=line_2, Index=0, Wrap=True)  # disabled
item_4 = ListItem(List=line_3, Index=0, Wrap=True)  # disabled
number_slider_27 = Slider(1.45, range=0..3.14)  # disabled
series_2 = Series(Start=0, Step=number_slider_26, Count=lng_3)  # disabled
addition_2 = Addition(A=series_2, B=number_slider_24)  # disabled
line_4 = Line(flatten([clean, item_2]))  # disabled
lng_4 = ListLength(List=clean)  # disabled
line_5 = Line(flatten([line_2, item_3]))  # disabled
lng_5 = ListLength(List=line_2)  # disabled
line_6 = Line(flatten([line_3, item_4]))  # disabled
lng_6 = ListLength(List=line_3)  # disabled
pi_2 = Pi(Factor=1)  # -> expr("x*2", Output); disabled
pi_3 = Pi(Factor=1)  # -> expr("x*2", Output); disabled
panel_5 = Panel(line_4)  # disabled
pi_4 = Pi(Factor=1)  # -> expr("x*2", Output); disabled
lng_7 = ListLength(List=line_4)  # disabled
panel_6 = Panel(line_5)  # disabled
lng_8 = ListLength(List=line_5)  # disabled
vec_3 = VectorXYZ(XComponent=1, YComponent=0, ZComponent=0)  # -> Vector, Length; disabled
number_slider_28 = Slider(0.1, range=0..1)  # disabled
number_slider_29 = Slider(0.5, range=0..1)  # disabled
number_slider_30 = Slider(0.7, range=0..1)  # disabled
number_slider_31 = Slider(0.3, range=0..1)  # disabled
division_2 = Division(A=pi_2, B=lng_4)  # disabled
panel_7 = Panel(line_6)  # disabled
lng_9 = ListLength(List=line_6)  # disabled
division_3 = Division(A=pi_3, B=lng_5)  # disabled
series_3 = Series(Start=0, Step=division_2, Count=lng_7)  # disabled
addition_3 = Addition(A=series_3, B=number_slider_23)  # disabled
division_4 = Division(A=pi_4, B=lng_6)  # disabled
series_4 = Series(Start=0, Step=division_3, Count=lng_8)  # disabled
addition_4 = Addition(A=series_4, B=number_slider_25)  # disabled
panel_8 = Panel(division_2)  # disabled
Z_7 = UnitZ(Factor=1)  # disabled
series_5 = Series(Start=0, Step=division_4, Count=lng_9)  # disabled
addition_5 = Addition(A=series_5, B=number_slider_27)  # disabled
panel_9 = Panel(division_3)  # disabled
panel_10 = Panel(series_3)  # disabled
panel_11 = Panel(division_4)  # disabled
panel_12 = Panel(series_4)  # disabled
panel_13 = Panel("timber_beams")  # disabled
vrot_3 = Rotate(Vector=vec_3.Vector, Axis=Z_7, Angle=addition_2)  # disabled
panel_14 = Panel("timber_beams")  # disabled
button = Button()  # disabled
panel_15 = Panel(series_5)  # disabled
button_2 = Button()  # disabled
panel_16 = Panel("timber_beams")  # disabled
button_3 = Button()  # disabled
vec_4 = VectorXYZ(XComponent=1, YComponent=0, ZComponent=0)  # -> Vector, Length; disabled
number_slider_32 = Slider(0.1, range=0..1)  # disabled
number_slider_33 = Slider(0.4, range=0..1)  # disabled
number_slider_34 = Slider(0.3, range=0..1)  # disabled
number_slider_35 = Slider(0.7, range=0..1)  # disabled
vec_5 = VectorXYZ(XComponent=1, YComponent=0, ZComponent=0)  # -> Vector, Length; disabled
number_slider_36 = Slider(0.1, range=0..1)  # disabled
number_slider_37 = Slider(0.4, range=0..1)  # disabled
number_slider_38 = Slider(0.3, range=0..1)  # disabled
number_slider_39 = Slider(0.7, range=0..1)  # disabled
shift_9 = ShiftList(List=ln_4, Shift=-1, Wrap=False)  # disabled
shift_10 = ShiftList(List=vrot_3, Shift=1, Wrap=False)  # disabled
shift_11 = ShiftList(List=ln_4, Shift=1, Wrap=False)  # disabled
shift_12 = ShiftList(List=vrot_3, Shift=-1, Wrap=False)  # disabled
python_5 = GhPythonScript(reload_module_button=button, module_names=panel_13)  # -> out, a; disabled; same code as python
vec_6 = VectorXYZ(XComponent=1, YComponent=0, ZComponent=0)  # -> Vector, Length; disabled
number_slider_40 = Slider(0.1, range=0..1)  # disabled
number_slider_41 = Slider(0.6, range=0..1)  # disabled
number_slider_42 = Slider(0.3, range=0..1)  # disabled
number_slider_43 = Slider(0.9, range=0..1)  # disabled
python_6 = GhPythonScript(reload_module_button=button_2, module_names=panel_14)  # -> out, a; disabled; same code as python
Z_8 = UnitZ(Factor=1)  # disabled
python_7 = GhPythonScript(reload_module_button=button_3, module_names=panel_16)  # -> out, a; disabled; same code as python
Z_9 = UnitZ(Factor=1)  # disabled
Z_10 = UnitZ(Factor=1)  # disabled
vrot_4 = Rotate(Vector=vec_4.Vector, Axis=Z_8, Angle=addition_3)  # disabled
vrot_5 = Rotate(Vector=vec_5.Vector, Axis=Z_9, Angle=addition_4)  # disabled
python_8 = GhPythonScript(
    line1=shift_11,
    line2=shift_9,
    sec_dir1=shift_10,
    sec_dir2=shift_12,
    t=graft([number_slider_28, number_slider_31, number_slider_29, number_slider_30]))  # -> out, frames, lengths; inputs line1: Line, line2: Line, sec_dir1: Vector3d, sec_dir2: Vector3d; disabled; same code as python_3
vrot_6 = Rotate(Vector=vec_6.Vector, Axis=Z_10, Angle=addition_5)  # disabled
shift_13 = ShiftList(List=line_4, Shift=-1, Wrap=False)  # disabled
shift_14 = ShiftList(List=vrot_4, Shift=1, Wrap=False)  # disabled
shift_15 = ShiftList(List=line_4, Shift=1, Wrap=False)  # disabled
shift_16 = ShiftList(List=vrot_4, Shift=-1, Wrap=False)  # disabled
shift_17 = ShiftList(List=line_5, Shift=-1, Wrap=False)  # disabled
shift_18 = ShiftList(List=vrot_5, Shift=1, Wrap=False)  # disabled
shift_19 = ShiftList(List=line_5, Shift=1, Wrap=False)  # disabled
shift_20 = ShiftList(List=vrot_5, Shift=-1, Wrap=False)  # disabled
shift_21 = ShiftList(List=line_6, Shift=-1, Wrap=False)  # disabled
shift_22 = ShiftList(List=vrot_6, Shift=1, Wrap=False)  # disabled
shift_23 = ShiftList(List=line_6, Shift=1, Wrap=False)  # disabled
shift_24 = ShiftList(List=vrot_6, Shift=-1, Wrap=False)  # disabled
rectangle_2 = Rectangle(Plane=python_8.frames, XSize=Domain(-0.5, 0.5), YSize=Domain(-0.5, 0.5), Radius=0)  # -> Rectangle, Length; disabled
python_9 = GhPythonScript(line1=shift_15, line2=shift_13, sec_dir1=shift_14, sec_dir2=shift_16, t=graft(number_slider_33))  # -> out, frames, lengths; inputs line1: Line, line2: Line, sec_dir1: Vector3d, sec_dir2: Vector3d; disabled; same code as python_3
python_10 = GhPythonScript(line1=shift_19, line2=shift_17, sec_dir1=shift_18, sec_dir2=shift_20, t=graft(number_slider_36))  # -> out, frames, lengths; inputs line1: Line, line2: Line, sec_dir1: Vector3d, sec_dir2: Vector3d; disabled; same code as python_3
boxrec_2 = BoxRectangle(Rectangle=rectangle_2.Rectangle, Height=python_8.lengths)  # disabled
python_11 = GhPythonScript(
    line1=shift_23,
    line2=shift_21,
    sec_dir1=shift_22,
    sec_dir2=shift_24,
    t=graft([number_slider_43, number_slider_41, number_slider_42]))  # -> out, frames, lengths; inputs line1: Line, line2: Line, sec_dir1: Vector3d, sec_dir2: Vector3d; disabled; same code as python_3
brep_3 = Brep(boxrec_2)  # disabled
rectangle_3 = Rectangle(Plane=python_9.frames, XSize=Domain(-0.5, 0.5), YSize=Domain(-0.5, 0.5), Radius=0)  # -> Rectangle, Length; disabled
rectangle_4 = Rectangle(Plane=python_10.frames, XSize=Domain(-0.5, 0.5), YSize=Domain(-0.5, 0.5), Radius=0)  # -> Rectangle, Length; disabled
rectangle_5 = Rectangle(Plane=python_11.frames, XSize=Domain(-0.5, 0.5), YSize=Domain(-0.5, 0.5), Radius=0)  # -> Rectangle, Length; disabled
boxrec_3 = BoxRectangle(Rectangle=rectangle_3.Rectangle, Height=python_9.lengths)  # disabled
boxrec_4 = BoxRectangle(Rectangle=rectangle_4.Rectangle, Height=python_10.lengths)  # disabled
boxrec_5 = BoxRectangle(Rectangle=rectangle_5.Rectangle, Height=python_11.lengths)  # disabled
brep_4 = Brep(boxrec_3)  # disabled
brep_5 = Brep(boxrec_4)  # disabled
brep_6 = Brep(boxrec_5)  # disabled

# ==== cluster Cluster
A = ClusterInput()
P = ClusterInput()
multiplication = Multiplication(A=A, B=2)
A_2 = ClusterInput()
x = ClusterInput()
deplane = DeconstructPlane(Plane=P)  # -> Origin, XAxis, YAxis, ZAxis
addition = Addition(A=A_2, B=multiplication)
neg = Negative(Value=x)
multiplication_2 = Multiplication(A=deplane.ZAxis, B=neg)
G = ClusterInput()
move = Move(Geometry=G, Motion=multiplication_2)  # -> Geometry, Transform
rectangle = Rectangle(Plane=move.Geometry, XSize=Domain(-0.5, 0.5), YSize=Domain(-0.5, 0.5), Radius=0)  # -> Rectangle, Length
boxrec = BoxRectangle(Rectangle=rectangle.Rectangle, Height=addition)
B = ClusterOutput(boxrec)
