# Grasshopper definition FrameSetOut.gh (Grasshopper 1.0.7)

crv = Curve([<curve referenced from the Rhino model> x2])
yz = YZPlane(Origin=Point(0, 0, 0))
width = Slider(100, range=0..100)
height = Slider(140, range=0..1000)
deplane = DeconstructPlane(Plane=yz)  # -> Origin, XAxis, YAxis, ZAxis

width_2 = Slider(100, range=0..100)
yz_2 = YZPlane(Origin=Point(0, 0, 0))
# Base Horizontal
crv_2 = Curve([<curve referenced from the Rhino model> x3])
height_2 = Slider(120, range=0..1000)
xz = XZPlane(Origin=Point(0, 0, 0))
deplane_2 = DeconstructPlane(Plane=xz)  # -> Origin, XAxis, YAxis, ZAxis

yz_3 = YZPlane(Origin=Point(0, 0, 0))
xz_2 = XZPlane(Origin=Point(0, 0, 0))
width_3 = Slider(100, range=0..100)
# Base Columns
crv_3 = Curve([<curve referenced from the Rhino model> x6])
height_3 = Slider(100, range=0..1000)
deplane_3 = DeconstructPlane(Plane=xz_2)  # -> Origin, XAxis, YAxis, ZAxis

xy = XYPlane(Origin=Point(0, 0, 0))
crv_4 = Curve(<curve referenced from the Rhino model>)

division = Division(A=height_3, B=2)
offset = OffsetCurve(Curve=crv_3, Distance=expr("-x", division), Plane=xz_2, Corners=1)
offset_2 = OffsetCurve(Curve=crv_3, Distance=division, Plane=xz_2, Corners=1)
merge = Merge(Data1=offset, Data2=offset_2)

offset_3 = OffsetCurve(Curve=crv, Distance=1, Plane=yz, Corners=1)
offset_4 = OffsetCurve(Curve=crv, Distance=height, Plane=yz, Corners=1)
merge_2 = Merge(Data1=offset_3, Data2=offset_4)

offset_5 = OffsetCurve(Curve=crv_2, Distance=1, Plane=xz, Corners=1)
offset_6 = OffsetCurve(Curve=crv_2, Distance=height_2, Plane=xz, Corners=1)
merge_3 = Merge(Data1=offset_5, Data2=offset_6)

series = Series(Start=0, Step=Slider(700, range=0..1000), Count=Slider(7, range=0..100))

division_2 = Division(A=width, B=2)
amp = Amplitude(Vector=deplane.ZAxis, Amplitude=division_2)
rev = Reverse(Vector=amp)
move = Move(Geometry=merge_2, Motion=rev)  # -> Geometry, Transform

amp_2 = Amplitude(Vector=deplane.ZAxis, Amplitude=width)
loft = Loft(Curves=move.Geometry, Options={Adjust=False, Closed=False, LoftEnds=0, LoftSimp=0, LoftType=0, Rebuild=10, Refit=0.01})
extr = Extrude(Base=loft, Direction=amp_2)

Y = UnitY(Factor=series)

division_3 = Division(A=width_2, B=2)
amp_3 = Amplitude(Vector=deplane_2.ZAxis, Amplitude=division_3)
rev_2 = Reverse(Vector=amp_3)
move_2 = Move(Geometry=merge_3, Motion=rev_2)  # -> Geometry, Transform

amp_4 = Amplitude(Vector=deplane_2.ZAxis, Amplitude=width_2)
loft_2 = Loft(Curves=move_2.Geometry, Options={Adjust=False, Closed=False, LoftEnds=0, LoftSimp=0, LoftType=0, Rebuild=10, Refit=0.01})
extr_2 = Extrude(Base=loft_2, Direction=amp_4)

division_4 = Division(A=width_3, B=2)
amp_5 = Amplitude(Vector=deplane_3.ZAxis, Amplitude=division_4)
rev_3 = Reverse(Vector=amp_5)
move_3 = Move(Geometry=merge, Motion=rev_3)  # -> Geometry, Transform

amp_6 = Amplitude(Vector=deplane_3.ZAxis, Amplitude=width_3)
loft_3 = Loft(Curves=move_3.Geometry, Options={Adjust=False, Closed=False, LoftEnds=0, LoftSimp=0, LoftType=0, Rebuild=10, Refit=0.01})
extr_3 = Extrude(Base=loft_3, Direction=amp_6)

move_4 = Move(Geometry=crv_4, Motion=Y)  # -> Geometry, Transform

width_4 = Slider(100, range=0..100)
yz_4 = YZPlane(Origin=Point(0, 0, 0))
xz_3 = XZPlane(Origin=Point(0, 0, 0))
crv_5 = Curve([<curve referenced from the Rhino model> x2])
height_4 = Slider(120, range=0..1000)
deplane_4 = DeconstructPlane(Plane=yz_4)  # -> Origin, XAxis, YAxis, ZAxis

offset_7 = OffsetCurve(Curve=crv_5, Distance=1, Plane=yz_4, Corners=1)
offset_8 = OffsetCurve(Curve=crv_5, Distance=height_4, Plane=yz_4, Corners=1)
merge_4 = Merge(Data1=offset_7, Data2=offset_8)

division_5 = Division(A=width_4, B=2)
amp_7 = Amplitude(Vector=deplane_4.ZAxis, Amplitude=division_5)
rev_4 = Reverse(Vector=amp_7)
move_5 = Move(Geometry=merge_4, Motion=rev_4)  # -> Geometry, Transform

amp_8 = Amplitude(Vector=deplane_4.ZAxis, Amplitude=width_4)
loft_4 = Loft(Curves=move_5.Geometry, Options={Adjust=False, Closed=False, LoftEnds=0, LoftSimp=0, LoftType=0, Rebuild=10, Refit=0.01})
extr_4 = Extrude(Base=loft_4, Direction=amp_8)
