# Grasshopper definition FrameSetout1_DensePerlin.gh (Grasshopper 1.0.7)

crv = Curve(<curve referenced from the Rhino model>)
# Roof Adjustment: - Main Beam Slope - 4 Corner Height
# - Purlin Height - proper join with Beams
# - Trim Column at Beam Top - 6 pcs
# - Trim Perlin Ends
series = Series(Start=0, Step=Slider(700, range=0..1000), Count=Slider(7, range=0..100))
Y = UnitY(Factor=series)
move = Move(Geometry=crv, Motion=Y)  # -> Geometry, Transform
setting_out = Curve([<curve referenced from the Rhino model> x11])
setting_out_2 = Curve([<curve referenced from the Rhino model> x9])

height_control = Curve(<curve referenced from the Rhino model>)
height_control_2 = Curve(<curve referenced from the Rhino model>)
setting_out_3 = Curve([<curve referenced from the Rhino model> x8])
end = EndPoints(Curve=setting_out_3)  # -> Start, End
vec2pt = Vector2Pt(PointA=end.Start, PointB=end.End, Unitize=False)  # -> Vector, Length
Z = UnitZ(Factor=1)
pl = ConstructPlane(Origin=end.Start, XAxis=vec2pt.Vector, YAxis=Z)
pcx = CurvePlane(Curve=height_control, Plane=pl)  # -> Points, ParamsC, ParamsP
pcx_2 = CurvePlane(Curve=height_control_2, Plane=pl)  # -> Points, ParamsC, ParamsP
ln = Line(StartPoint=pcx.Points, EndPoint=pcx_2.Points)  # -> flatten(Line)

width = Slider(100, range=0..100)
yz = YZPlane(Origin=Point(0, 0, 0))
# Base Horizontal
crv_2 = Curve([<curve referenced from the Rhino model> x3])
height = Slider(120, range=0..1000)
xz = XZPlane(Origin=Point(0, 0, 0))
deplane = DeconstructPlane(Plane=xz)  # -> Origin, XAxis, YAxis, ZAxis

# ----
# Rafter
yz_2 = YZPlane(Origin=Point(0, 0, 0))
xz_2 = XZPlane(Origin=Point(0, 0, 0))
width_2 = Slider(100, range=0..100)
crv_3 = Curve(ln)
height_2 = Slider(120, range=0..1000)
deplane_2 = DeconstructPlane(Plane=xz_2)  # -> Origin, XAxis, YAxis, ZAxis

yz_3 = YZPlane(Origin=Point(0, 0, 0))
xz_3 = XZPlane(Origin=Point(0, 0, 0))
width_3 = Slider(100, range=0..100)
# Base Columns
crv_4 = Curve([<curve referenced from the Rhino model> x6])
height_3 = Slider(100, range=0..1000)
deplane_3 = DeconstructPlane(Plane=xz_3)  # -> Origin, XAxis, YAxis, ZAxis

xy = XYPlane(Origin=Point(0, 0, 0))
yz_4 = YZPlane(Origin=Point(0, 0, 0))
xz_4 = XZPlane(Origin=Point(0, 0, 0))
width_4 = Slider(100, range=0..100)

bottom_trim = Curve(<curve referenced from the Rhino model>)
bottom_trim_2 = Curve(<curve referenced from the Rhino model>)
clx = CurveLine(Curve=bottom_trim_2, Line=setting_out)  # -> Points, Params, Count
clx_2 = CurveLine(Curve=bottom_trim, Line=setting_out)  # -> Points, Params, Count
Z_2 = UnitZ(Factor=1)
line = LineSDL(Start=clx_2.Points, Direction=Z_2, Length=6000)
line_2 = LineSDL(Start=clx.Points, Direction=Z_2, Length=6000)

height_4 = Slider(100, range=0..1000)

height_control_3 = Curve(<curve referenced from the Rhino model>)
height_control_4 = Curve(<curve referenced from the Rhino model>)
crv_5 = Curve(setting_out)
end_2 = EndPoints(Curve=crv_5)  # -> Start, End
vec2pt_2 = Vector2Pt(PointA=end_2.Start, PointB=end_2.End, Unitize=False)  # -> Vector, Length
Z_3 = UnitZ(Factor=1)
pl_2 = ConstructPlane(Origin=end_2.Start, XAxis=vec2pt_2.Vector, YAxis=Z_3)
pcx_3 = CurvePlane(Curve=height_control_3, Plane=pl_2)  # -> Points, ParamsC, ParamsP
pcx_4 = CurvePlane(Curve=height_control_4, Plane=pl_2)  # -> Points, ParamsC, ParamsP
ln_2 = Line(StartPoint=pcx_3.Points, EndPoint=pcx_4.Points)

division = Division(A=height_3, B=2)
offset = OffsetCurve(Curve=crv_4, Distance=expr("-x", division), Plane=xz_3, Corners=1)
offset_2 = OffsetCurve(Curve=crv_4, Distance=division, Plane=xz_3, Corners=1)
merge = Merge(Data1=offset, Data2=offset_2)

offset_3 = OffsetCurve(Curve=crv_2, Distance=1, Plane=xz, Corners=1)
offset_4 = OffsetCurve(Curve=crv_2, Distance=height, Plane=xz, Corners=1)
merge_2 = Merge(Data1=offset_3, Data2=offset_4)

offset_5 = OffsetCurve(Curve=crv_3, Distance=1, Plane=xz_2, Corners=1)
offset_6 = OffsetCurve(Curve=crv_3, Distance=height_2, Plane=xz_2, Corners=1)
merge_3 = Merge(Data1=offset_5, Data2=offset_6)

deplane_4 = DeconstructPlane(Plane=yz_4)  # -> Origin, XAxis, YAxis, ZAxis

division_2 = Division(A=width, B=2)
amp = Amplitude(Vector=deplane.ZAxis, Amplitude=division_2)
rev = Reverse(Vector=amp)
move_2 = Move(Geometry=merge_2, Motion=rev)  # -> Geometry, Transform

amp_2 = Amplitude(Vector=deplane.ZAxis, Amplitude=width)
loft = Loft(Curves=move_2.Geometry, Options={Adjust=False, Closed=False, LoftEnds=0, LoftSimp=0, LoftType=0, Rebuild=10, Refit=0.01})
extr = Extrude(Base=loft, Direction=amp_2)

division_3 = Division(A=width_2, B=2)
amp_3 = Amplitude(Vector=deplane_2.ZAxis, Amplitude=division_3)
rev_2 = Reverse(Vector=amp_3)
move_3 = Move(Geometry=merge_3, Motion=rev_2)  # -> Geometry, Transform

amp_4 = Amplitude(Vector=deplane_2.ZAxis, Amplitude=width_2)
loft_2 = Loft(Curves=move_3.Geometry, Options={Adjust=False, Closed=False, LoftEnds=0, LoftSimp=0, LoftType=0, Rebuild=10, Refit=0.01})
extr_2 = Extrude(Base=loft_2, Direction=amp_4)

division_4 = Division(A=width_3, B=2)
amp_5 = Amplitude(Vector=deplane_3.ZAxis, Amplitude=division_4)
rev_3 = Reverse(Vector=amp_5)
move_4 = Move(Geometry=merge, Motion=rev_3)  # -> Geometry, Transform

amp_6 = Amplitude(Vector=deplane_3.ZAxis, Amplitude=width_3)
loft_3 = Loft(Curves=move_4.Geometry, Options={Adjust=False, Closed=False, LoftEnds=0, LoftSimp=0, LoftType=0, Rebuild=10, Refit=0.01})
extr_3 = Extrude(Base=loft_3, Direction=amp_6)

llx = LineLine(Line1=line, Line2=ln_2)  # -> ParamA, ParamB, PointA, PointB
llx_2 = LineLine(Line1=line_2, Line2=ln_2)  # -> ParamA, ParamB, PointA, PointB
ln_3 = Line(StartPoint=llx.PointA, EndPoint=llx_2.PointA)

crv_6 = Curve(ln_3)

offset_7 = OffsetCurve(Curve=crv_6, Distance=1, Plane=yz_4, Corners=1)
offset_8 = OffsetCurve(Curve=crv_6, Distance=height_4, Plane=yz_4, Corners=1)
merge_4 = Merge(Data1=offset_7, Data2=offset_8)

division_5 = Division(A=width_4, B=2)
amp_7 = Amplitude(Vector=deplane_4.ZAxis, Amplitude=division_5)
rev_4 = Reverse(Vector=amp_7)
move_5 = Move(Geometry=merge_4, Motion=rev_4)  # -> Geometry, Transform

amp_8 = Amplitude(Vector=deplane_4.ZAxis, Amplitude=width_4)
loft_4 = Loft(Curves=move_5.Geometry, Options={Adjust=False, Closed=False, LoftEnds=0, LoftSimp=0, LoftType=0, Rebuild=10, Refit=0.01})
extr_4 = Extrude(Base=loft_4, Direction=amp_8)

width_5 = Slider(100, range=0..100)
yz_5 = YZPlane(Origin=Point(0, 0, 0))
xz_5 = XZPlane(Origin=Point(0, 0, 0))
crv_7 = Curve([<curve referenced from the Rhino model> x2])
height_5 = Slider(120, range=0..1000)
deplane_5 = DeconstructPlane(Plane=yz_5)  # -> Origin, XAxis, YAxis, ZAxis

# ----
# Main Beams
yz_6 = YZPlane(Origin=Point(0, 0, 0))
crv_8 = Curve([<curve referenced from the Rhino model> x2])
width_6 = Slider(100, range=0..100)
height_6 = Slider(140, range=0..1000)
deplane_6 = DeconstructPlane(Plane=yz_6)  # -> Origin, XAxis, YAxis, ZAxis

offset_9 = OffsetCurve(Curve=crv_7, Distance=1, Plane=yz_5, Corners=1)
offset_10 = OffsetCurve(Curve=crv_7, Distance=height_5, Plane=yz_5, Corners=1)
merge_5 = Merge(Data1=offset_9, Data2=offset_10)

offset_11 = OffsetCurve(Curve=crv_8, Distance=1, Plane=yz_6, Corners=1)
offset_12 = OffsetCurve(Curve=crv_8, Distance=height_6, Plane=yz_6, Corners=1)
merge_6 = Merge(Data1=offset_11, Data2=offset_12)

division_6 = Division(A=width_5, B=2)
amp_9 = Amplitude(Vector=deplane_5.ZAxis, Amplitude=division_6)
rev_5 = Reverse(Vector=amp_9)
move_6 = Move(Geometry=merge_5, Motion=rev_5)  # -> Geometry, Transform

amp_10 = Amplitude(Vector=deplane_5.ZAxis, Amplitude=width_5)
loft_5 = Loft(Curves=move_6.Geometry, Options={Adjust=False, Closed=False, LoftEnds=0, LoftSimp=0, LoftType=0, Rebuild=10, Refit=0.01})
extr_5 = Extrude(Base=loft_5, Direction=amp_10)

division_7 = Division(A=width_6, B=2)
amp_11 = Amplitude(Vector=deplane_6.ZAxis, Amplitude=division_7)
rev_6 = Reverse(Vector=amp_11)
move_7 = Move(Geometry=merge_6, Motion=rev_6)  # -> Geometry, Transform

amp_12 = Amplitude(Vector=deplane_6.ZAxis, Amplitude=width_6)
loft_6 = Loft(Curves=move_7.Geometry, Options={Adjust=False, Closed=False, LoftEnds=0, LoftSimp=0, LoftType=0, Rebuild=10, Refit=0.01})
extr_6 = Extrude(Base=loft_6, Direction=amp_12)

bbx = BrepBrep(BrepA=flatten(extr_4), BrepB=extr_2)  # -> Curves, Points
bbx_2 = BrepBrep(BrepA=flatten(extr_6), BrepB=extr_2)  # -> Curves, Points

# ----
# Columns Trim
split = SplitList(List=flatten(extr_3), Index=3)  # -> graft(ListA), graft(ListB)
crv_9 = Curve(<curve referenced from the Rhino model>)
crv_10 = Curve(<curve referenced from the Rhino model>)
explode = Explode(Curve=crv_9, Recursive=True)  # -> Segments, Vertices
explode_2 = Explode(Curve=crv_10, Recursive=True)  # -> Segments, Vertices
item = ListItem(List=explode.Vertices, Index=0, Wrap=True)  # -> Item, Item1, Item2
item_2 = ListItem(List=explode_2.Vertices, Index=0, Wrap=True)  # -> Item, Item1, Item2
pl_3pt = Plane3Pt(PointA=item.Item1, PointB=item.Item, PointC=item.Item2)
pl_3pt_2 = Plane3Pt(PointA=item_2.Item1, PointB=item_2.Item, PointC=item_2.Item2)
sec = BrepPlane(Brep=split.ListB, Plane=pl_3pt)  # -> Curves, Points
sec_2 = BrepPlane(Brep=split.ListA, Plane=pl_3pt_2)  # -> Curves, Points

Z_4 = UnitZ(Factor=1000)
Z_5 = UnitZ(Factor=1000)
extr_7 = Extrude(Base=sec.Curves, Direction=Z_4)
extr_8 = Extrude(Base=sec_2.Curves, Direction=Z_5)

cap = CapHoles(Brep=extr_7)
cap_2 = CapHoles(Brep=extr_8)
sdiff = SolidDifference(BrepsA=split.ListA, BrepsB=cap_2)
sdiff_2 = SolidDifference(BrepsA=split.ListB, BrepsB=cap)
