# Grasshopper definition FrameSetout4_PurlinTwist.gh (Grasshopper 1.0.7)

crv = Curve(<curve referenced from the Rhino model>)
# Roof Adjustment: - Main Beam Slope - 4 Corner Height
# - Purlin Height - proper join with Beams
# - Trim Column at Beam Top - 6 pcs
# - Trim Perlin Ends
series = Series(Start=0, Step=Slider(700, range=0..1000), Count=Slider(7, range=0..100))
Y = UnitY(Factor=series)
move = Move(Geometry=crv, Motion=Y)  # -> Geometry, Transform
# Purlin
setting_out = Curve([<curve referenced from the Rhino model> x10])

width = Slider(100, range=0..100)
yz = YZPlane(Origin=Point(0, 0, 0))
# Base Horizontal
crv_2 = Curve([<curve referenced from the Rhino model> x3])
height = Slider(120, range=0..1000)
xz = XZPlane(Origin=Point(0, 0, 0))
deplane = DeconstructPlane(Plane=xz)  # -> Origin, XAxis, YAxis, ZAxis

# ----
# Height Control
height_control = Curve(<curve referenced from the Rhino model>)
height_control_2 = Curve(<curve referenced from the Rhino model>)
setting_out_2 = Curve([<curve referenced from the Rhino model> x8])
end = EndPoints(Curve=setting_out_2)  # -> Start, End
vec2pt = Vector2Pt(PointA=end.Start, PointB=end.End, Unitize=False)  # -> Vector, Length
Z = UnitZ(Factor=1)
pl = ConstructPlane(Origin=end.Start, XAxis=vec2pt.Vector, YAxis=Z)
pcx = CurvePlane(Curve=height_control, Plane=pl)  # -> Points, ParamsC, ParamsP
pcx_2 = CurvePlane(Curve=height_control_2, Plane=pl)  # -> Points, ParamsC, ParamsP
ln = Line(StartPoint=pcx.Points, EndPoint=pcx_2.Points)

# ----
# Bottom Trim
bottom_trim = Curve(<curve referenced from the Rhino model>)
bottom_trim_2 = Curve(<curve referenced from the Rhino model>)
clx = CurveLine(Curve=bottom_trim_2, Line=setting_out_2)  # -> Points, Params, Count
clx_2 = CurveLine(Curve=bottom_trim, Line=setting_out_2)  # -> Points, Params, Count
Z_2 = UnitZ(Factor=1)
line = LineSDL(Start=clx_2.Points, Direction=Z_2, Length=6000)
line_2 = LineSDL(Start=clx.Points, Direction=Z_2, Length=6000)

yz_2 = YZPlane(Origin=Point(0, 0, 0))
xz_2 = XZPlane(Origin=Point(0, 0, 0))
width_2 = Slider(100, range=0..100)
# Base Columns
crv_3 = Curve([<curve referenced from the Rhino model> x6])
height_2 = Slider(100, range=0..1000)
deplane_2 = DeconstructPlane(Plane=xz_2)  # -> Origin, XAxis, YAxis, ZAxis

xy = XYPlane(Origin=Point(0, 0, 0))

division = Division(A=height_2, B=2)
offset = OffsetCurve(Curve=crv_3, Distance=expr("-x", division), Plane=xz_2, Corners=1)
offset_2 = OffsetCurve(Curve=crv_3, Distance=division, Plane=xz_2, Corners=1)
merge = Merge(Data1=offset, Data2=offset_2)

# ----
# Bottom Trim
bottom_trim_3 = Curve(<curve referenced from the Rhino model>)
bottom_trim_4 = Curve(<curve referenced from the Rhino model>)
clx_3 = CurveLine(Curve=bottom_trim_3, Line=setting_out)  # -> Points, Params, Count
clx_4 = CurveLine(Curve=bottom_trim_4, Line=setting_out)  # -> Points, Params, Count
Z_3 = UnitZ(Factor=1)
line_3 = LineSDL(Start=clx_4.Points, Direction=Z_3, Length=6000)
line_4 = LineSDL(Start=clx_3.Points, Direction=Z_3, Length=6000)

offset_3 = OffsetCurve(Curve=crv_2, Distance=0, Plane=xz, Corners=1)
offset_4 = OffsetCurve(Curve=crv_2, Distance=height, Plane=xz, Corners=1)
merge_2 = Merge(Data1=offset_3, Data2=offset_4)

# ----
# Height Control
height_control_3 = Curve(<curve referenced from the Rhino model>)
height_control_4 = Curve(<curve referenced from the Rhino model>)
crv_4 = Curve(setting_out)
end_2 = EndPoints(Curve=crv_4)  # -> Start, End
vec2pt_2 = Vector2Pt(PointA=end_2.Start, PointB=end_2.End, Unitize=False)  # -> Vector, Length
ext = ExtendCurve(Curve=height_control_4, Type=2, Start=2000, End=2000)
Z_4 = UnitZ(Factor=1)
ext_2 = ExtendCurve(Curve=height_control_3, Type=2, Start=2000, End=2000)
pl_2 = ConstructPlane(Origin=end_2.Start, XAxis=vec2pt_2.Vector, YAxis=Z_4)
pcx_3 = CurvePlane(Curve=ext_2, Plane=pl_2)  # -> Points, ParamsC, ParamsP
pcx_4 = CurvePlane(Curve=ext, Plane=pl_2)  # -> Points, ParamsC, ParamsP
ln_2 = Line(StartPoint=pcx_3.Points, EndPoint=pcx_4.Points)  # -> simplify(graft(Line))

division_2 = Division(A=width, B=2)
amp = Amplitude(Vector=deplane.ZAxis, Amplitude=division_2)
rev = Reverse(Vector=amp)
move_2 = Move(Geometry=merge_2, Motion=rev)  # -> Geometry, Transform

amp_2 = Amplitude(Vector=deplane.ZAxis, Amplitude=width)
loft = Loft(Curves=move_2.Geometry, Options={Adjust=False, Closed=False, LoftEnds=0, LoftSimp=0, LoftType=0, Rebuild=10, Refit=0.01})
extr = Extrude(Base=loft, Direction=amp_2)

division_3 = Division(A=width_2, B=2)
amp_3 = Amplitude(Vector=deplane_2.ZAxis, Amplitude=division_3)
rev_2 = Reverse(Vector=amp_3)
move_3 = Move(Geometry=merge, Motion=rev_2)  # -> Geometry, Transform

amp_4 = Amplitude(Vector=deplane_2.ZAxis, Amplitude=width_2)
loft_2 = Loft(Curves=move_3.Geometry, Options={Adjust=False, Closed=False, LoftEnds=0, LoftSimp=0, LoftType=0, Rebuild=10, Refit=0.01})
extr_2 = Extrude(Base=loft_2, Direction=amp_4)

width_3 = Slider(100, range=0..100)
yz_3 = YZPlane(Origin=Point(0, 0, 0))
xz_3 = XZPlane(Origin=Point(0, 0, 0))
crv_5 = Curve([<curve referenced from the Rhino model> x2])
height_3 = Slider(120, range=0..1000)
deplane_3 = DeconstructPlane(Plane=yz_3)  # -> Origin, XAxis, YAxis, ZAxis

# ----
# Base Line
llx = LineLine(Line1=line, Line2=ln)  # -> ParamA, ParamB, PointA, PointB
llx_2 = LineLine(Line1=line_2, Line2=ln)  # -> ParamA, ParamB, PointA, PointB
ln_3 = Line(StartPoint=llx.PointA, EndPoint=llx_2.PointA)

# ----
# Untrimmed
ext_3 = ExtendCurve(Curve=ln_3, Type=0, Start=300, End=300)
yz_4 = YZPlane(Origin=Point(0, 0, 0))
xz_4 = XZPlane(Origin=Point(0, 0, 0))
height_4 = Slider(120, range=0..1000)
width_4 = Slider(100, range=0..100)
crv_6 = Curve(ext_3)
deplane_4 = DeconstructPlane(Plane=xz_4)  # -> Origin, XAxis, YAxis, ZAxis

offset_5 = OffsetCurve(Curve=crv_6, Distance=0, Plane=xz_4, Corners=1)
offset_6 = OffsetCurve(Curve=crv_6, Distance=height_4, Plane=xz_4, Corners=1)
merge_3 = Merge(Data1=offset_5, Data2=offset_6)

division_4 = Division(A=width_4, B=2)
amp_5 = Amplitude(Vector=deplane_4.ZAxis, Amplitude=division_4)
rev_3 = Reverse(Vector=amp_5)
move_4 = Move(Geometry=merge_3, Motion=rev_3)  # -> Geometry, Transform

amp_6 = Amplitude(Vector=deplane_4.ZAxis, Amplitude=width_4)
loft_3 = Loft(Curves=move_4.Geometry, Options={Adjust=False, Closed=False, LoftEnds=0, LoftSimp=0, LoftType=0, Rebuild=10, Refit=0.01})
extr_3 = Extrude(Base=loft_3, Direction=amp_6)

offset_7 = OffsetCurve(Curve=crv_5, Distance=0, Plane=yz_3, Corners=1)
offset_8 = OffsetCurve(Curve=crv_5, Distance=height_3, Plane=yz_3, Corners=1)
merge_4 = Merge(Data1=offset_7, Data2=offset_8)

llx_3 = LineLine(Line1=line_3, Line2=ln_2)  # -> ParamA, ParamB, PointA, PointB
llx_4 = LineLine(Line1=line_4, Line2=ln_2)  # -> ParamA, ParamB, PointA, PointB
ln_4 = Line(StartPoint=llx_3.PointA, EndPoint=llx_4.PointA)

# ----
# Untrimmed
edge_extension = Slider(1000, range=0..1000)
beam_width = Slider(100, range=0..100)
beam_height = Slider(100, range=0..1000)
yz_5 = YZPlane(Origin=Point(0, 0, 0))
ext_4 = ExtendCurve(Curve=ln_4, Type=0, Start=edge_extension, End=edge_extension)
crv_7 = Curve(ext_4)
deplane_5 = DeconstructPlane(Plane=yz_5)  # -> Origin, XAxis, YAxis, ZAxis
amp_7 = Amplitude(Vector=deplane_5.ZAxis, Amplitude=beam_width)

# ----
# Sub Division with Pattern
division_lines = Curve([<curve referenced from the Rhino model> x5])
gap = Slider(30, range=0..100)
# Beam 4 Edges
crv_8 = Curve(reparameterize(ext_4))
panel = Panel("""1,3
0,4""")

crv_9 = Curve(division_lines)
end_3 = EndPoints(Curve=crv_9)  # -> Start, End
vec2pt_3 = Vector2Pt(PointA=end_3.Start, PointB=end_3.End, Unitize=False)  # -> Vector, Length
Z_5 = UnitZ(Factor=1)
pl_3 = ConstructPlane(Origin=end_3.Start, XAxis=vec2pt_3.Vector, YAxis=Z_5)

path = DataPath(crv_8)
lng = ListLength(List=flatten(path))
repeat = RepeatData(Data=panel, Length=lng)  # -> graft(Data)
split = TextSplit(Text=repeat, Separators=",")
item = ListItem(List=pl_3, Index=split, Wrap=True)

pcx_5 = CurvePlane(Curve=crv_8, Plane=item)  # -> Points, simplify(ParamsC), ParamsP
pshift = ShiftPaths(Data=pcx_5.ParamsC, Offset=-1)
ins = InsertItems(List=pshift, Item="0", Indices="0", Wrap=True)
ins_2 = InsertItems(List=pshift, Item="1", Indices="-1", Wrap=True)
dom = ConstructDomain(DomainStart=ins, DomainEnd=ins_2)
subcrv = SubCurve(BaseCurve=crv_8, Domain=dom)

division_5 = Division(A=beam_width, B=2)
amp_8 = Amplitude(Vector=deplane_5.ZAxis, Amplitude=division_5)
rev_4 = Reverse(Vector=amp_8)

division_6 = Division(A=gap, B=2)
neg = Negative(Value=division_6)
ext_5 = ExtendCurve(Curve=subcrv, Type=0, Start=neg, End=neg)

# ----
# Centerline Mid Dip
crv_10 = Curve(simplify(ext_5))
mid_dip_amount = Slider(-40, range=-50..50)
split_2 = SplitList(List=crv_10, Index=1)  # -> ListA, ListB
rev_5 = ReverseList(List=split_2.ListB)
split_3 = SplitList(List=rev_5, Index=1)  # -> ListA, ListB
Z_6 = UnitZ(Factor=mid_dip_amount)
rev_6 = ReverseList(List=split_3.ListB)
geo = Geometry(split_3.ListA)
geo_2 = Geometry(split_2.ListA)
end_4 = EndPoints(Curve=geo_2)  # -> Start, End
end_5 = EndPoints(Curve=rev_6)  # -> Start, End
end_6 = EndPoints(Curve=geo)  # -> Start, End
move_5 = Move(Geometry=end_4.End, Motion=Z_6)  # -> Geometry, Transform
move_6 = Move(Geometry=end_5.Start, Motion=Z_6)  # -> Geometry, Transform
move_7 = Move(Geometry=end_5.End, Motion=Z_6)  # -> Geometry, Transform
move_8 = Move(Geometry=end_6.Start, Motion=Z_6)  # -> Geometry, Transform
ln_5 = Line(StartPoint=end_4.Start, EndPoint=move_5.Geometry)
ln_6 = Line(StartPoint=move_8.Geometry, EndPoint=end_6.End)
ln_7 = Line(StartPoint=move_6.Geometry, EndPoint=move_7.Geometry)

merge_5 = Merge(Data1=simplify(ln_5), Data2=simplify(ln_7), Data3=simplify(ln_6))

# ----
# Beam 4 Edges
crv_11 = Curve(merge_5)
rev_7 = Reverse(Vector=rev_4)
offset_9 = OffsetCurve(Curve=crv_11, Distance=0, Plane=yz_5, Corners=1)
offset_10 = OffsetCurve(Curve=crv_11, Distance=beam_height, Plane=yz_5, Corners=1)
merge_6 = Merge(Data1=offset_9, Data2=offset_10)
move_9 = Move(Geometry=merge_6, Motion=rev_7)  # -> Geometry, Transform
move_10 = Move(Geometry=merge_6, Motion=rev_4)  # -> Geometry, Transform
rev_8 = ReverseList(List=move_9.Geometry)
merge_7 = Merge(Data1=move_10.Geometry, Data2=rev_8)  # -> simplify(Result)
four_edge_curves = Curve(merge_7)

# ----
# Segments Solid
loft_4 = Loft(
    Curves=move_10.Geometry,
    Options={Adjust=False, Closed=False, LoftEnds=0, LoftSimp=0, LoftType=0, Rebuild=10, Refit=0.01})
extr_4 = Extrude(Base=loft_4, Direction=amp_7)  # -> simplify(Extrusion)
crossref = CrossReference(CrossMode=1)  # -> ListA, ListB
pshift_2 = ShiftPaths(Data=extr_4, Offset=-1)

# ----
# Diamond Boolean Diff
end_7 = EndPoints(Curve=four_edge_curves)  # -> Start, End
ln_8 = Line(StartPoint=end_7.End, EndPoint=end_7.Start)
ln_9 = Line(StartPoint=end_7.Start, EndPoint=end_7.End)
diamond_short_base = Slider(20, range=0..1000)
diamond_long_base = Slider(36, range=0..1000)
diamond_length = Slider(600, range=0..1000)
line_5 = Line(ln_9)
line_6 = Line(ln_8)
end_8 = EndPoints(Curve=line_5)  # -> simplify(Start), End
end_9 = EndPoints(Curve=line_6)  # -> simplify(Start), End
shift = ShiftList(List=end_9.Start, Shift=-1, Wrap=True)  # -> simplify(List)
shift_2 = ShiftList(List=end_9.Start, Shift=1, Wrap=True)  # -> simplify(List)
shift_3 = ShiftList(List=end_8.Start, Shift=1, Wrap=True)  # -> simplify(List)
shift_4 = ShiftList(List=end_8.Start, Shift=-1, Wrap=True)  # -> simplify(List)
ln_10 = Line(StartPoint=end_9.Start, EndPoint=shift_2)
ln_11 = Line(StartPoint=end_9.Start, EndPoint=shift)
ln_12 = Line(StartPoint=end_8.Start, EndPoint=shift_3)
ln_13 = Line(StartPoint=end_8.Start, EndPoint=shift_4)
eval = EvaluateLength(Curve=line_5, Length=diamond_length, Normalized=False)  # -> Point, Tangent, Parameter
eval_2 = EvaluateLength(Curve=ln_12, Length=diamond_short_base, Normalized=False)  # -> Point, Tangent, Parameter
eval_3 = EvaluateLength(Curve=ln_13, Length=diamond_long_base, Normalized=False)  # -> Point, Tangent, Parameter
eval_4 = EvaluateLength(Curve=line_6, Length=diamond_length, Normalized=False)  # -> Point, Tangent, Parameter
eval_5 = EvaluateLength(Curve=ln_10, Length=diamond_long_base, Normalized=False)  # -> Point, Tangent, Parameter
eval_6 = EvaluateLength(Curve=ln_11, Length=diamond_short_base, Normalized=False)  # -> Point, Tangent, Parameter
pl_3pt = Plane3Pt(PointA=eval.Point, PointB=eval_2.Point, PointC=eval_3.Point)
pl_3pt_2 = Plane3Pt(PointA=eval_4.Point, PointB=eval_6.Point, PointC=eval_5.Point)
srf4pt = _4PointSurface(CornerA=eval.Point, CornerB=eval_2.Point, CornerC=eval_3.Point)
srf4pt_2 = _4PointSurface(CornerA=eval_4.Point, CornerB=eval_5.Point, CornerC=eval_6.Point)
deplane_6 = DeconstructPlane(Plane=pl_3pt_2)  # -> Origin, XAxis, YAxis, ZAxis
deplane_7 = DeconstructPlane(Plane=pl_3pt)  # -> Origin, XAxis, YAxis, ZAxis
amp_9 = Amplitude(Vector=deplane_6.ZAxis, Amplitude=100)
amp_10 = Amplitude(Vector=deplane_7.ZAxis, Amplitude=100)
extr_5 = Extrude(Base=srf4pt, Direction=amp_10)
extr_6 = Extrude(Base=srf4pt_2, Direction=amp_9)
merge_8 = Merge(Data1=extr_5, Data2=extr_6)
sdiff = SolidDifference(BrepsA=graft(pshift_2), BrepsB=merge_8)
pshift_3 = ShiftPaths(Data=sdiff, Offset=-1)

division_7 = Division(A=width_3, B=2)
amp_11 = Amplitude(Vector=deplane_3.ZAxis, Amplitude=division_7)
rev_9 = Reverse(Vector=amp_11)
move_11 = Move(Geometry=merge_4, Motion=rev_9)  # -> Geometry, Transform

amp_12 = Amplitude(Vector=deplane_3.ZAxis, Amplitude=width_3)
loft_5 = Loft(
    Curves=move_11.Geometry,
    Options={Adjust=False, Closed=False, LoftEnds=0, LoftSimp=0, LoftType=0, Rebuild=10, Refit=0.01})
extr_7 = Extrude(Base=loft_5, Direction=amp_12)

# ----
# Main Beams
yz_6 = YZPlane(Origin=Point(0, 0, 0))
crv_12 = Curve([<curve referenced from the Rhino model> x2])
width_5 = Slider(100, range=0..100)
height_5 = Slider(140, range=0..1000)
deplane_8 = DeconstructPlane(Plane=yz_6)  # -> Origin, XAxis, YAxis, ZAxis

# ----
# Bottom Trim
bottom_trim_5 = Curve(<curve referenced from the Rhino model>)
bottom_trim_6 = Curve(<curve referenced from the Rhino model>)
end_10 = EndPoints(Curve=bottom_trim_5)  # -> Start, End
end_11 = EndPoints(Curve=bottom_trim_6)  # -> Start, End
vec2pt_4 = Vector2Pt(PointA=end_10.Start, PointB=end_10.End, Unitize=False)  # -> Vector, Length
vec2pt_5 = Vector2Pt(PointA=end_11.Start, PointB=end_11.End, Unitize=False)  # -> Vector, Length
Z_7 = UnitZ(Factor=1)
pl_4 = ConstructPlane(Origin=end_10.Start, XAxis=vec2pt_4.Vector, YAxis=Z_7)
pl_5 = ConstructPlane(Origin=end_11.Start, XAxis=vec2pt_5.Vector, YAxis=Z_7)

offset_11 = OffsetCurve(Curve=crv_12, Distance=1, Plane=yz_6, Corners=1)
offset_12 = OffsetCurve(Curve=crv_12, Distance=height_5, Plane=yz_6, Corners=1)
merge_9 = Merge(Data1=offset_11, Data2=offset_12)

# ----
# Rotate Pos + Neg -
offset_13 = OffsetCurve(Curve=merge_5, Distance=expr("x/2", beam_height), Plane=yz_5, Corners=1)
brep = Brep(pshift_3)
rotate_angle_deg = Slider(30, range=0..100)
pshift_4 = ShiftPaths(Data=offset_13, Offset=-1)  # -> simplify(Data)
neg_2 = Negative(Value=rotate_angle_deg)
rotax = RotateAxis(Geometry=brep, Angle=degrees(rotate_angle_deg), Axis=pshift_4)  # -> simplify(Geometry), Transform
rotax_2 = RotateAxis(Geometry=brep, Angle=degrees(neg_2), Axis=pshift_4)  # -> simplify(Geometry), Transform
cull_i = CullIndex(List=brep, Indices=0, Wrap=True)
cull_i_2 = CullIndex(List=cull_i, Indices=-1, Wrap=True)
item_2 = ListItem(List=rotax_2.Geometry, Index=0, Wrap=True)
item_3 = ListItem(List=rotax.Geometry, Index=-1, Wrap=True)
merge_10 = Merge(Data1=item_2, Data2=simplify(cull_i_2), Data3=item_3)  # -> graft(Result)

# ----
# Beam Plane for Triming
number_slider = Slider(25, range=0..1000)
end_12 = EndPoints(Curve=offset_12)  # -> Start, End
vec2pt_6 = Vector2Pt(PointA=end_12.Start, PointB=end_12.End, Unitize=False)  # -> Vector, Length
pl_6 = ConstructPlane(Origin=end_12.Start, XAxis=vec2pt_6.Vector, YAxis=deplane_8.ZAxis)
pl_offset = PlaneOffset(BasePlane=pl_6, Offset=number_slider)
split_4 = SplitList(List=flatten(pl_offset), Index=1)  # -> graft(ListA), graft(ListB)

division_8 = Division(A=width_5, B=2)
amp_13 = Amplitude(Vector=deplane_8.ZAxis, Amplitude=division_8)
rev_10 = Reverse(Vector=amp_13)
move_12 = Move(Geometry=merge_9, Motion=rev_10)  # -> Geometry, Transform

amp_14 = Amplitude(Vector=deplane_8.ZAxis, Amplitude=width_5)
loft_6 = Loft(
    Curves=move_12.Geometry,
    Options={Adjust=False, Closed=False, LoftEnds=0, LoftSimp=0, LoftType=0, Rebuild=10, Refit=0.01})
extr_8 = Extrude(Base=loft_6, Direction=amp_14)

# ----
# Edge Trim Boolean Intersect
number_slider_2 = Slider(10000, range=0..10000)
loft_7 = Loft(
    Curves=[bottom_trim_4, bottom_trim_3],
    Options={Adjust=False, Closed=False, LoftEnds=0, LoftSimp=0, LoftType=0, Rebuild=10, Refit=0.01})
Z_8 = UnitZ(Factor=number_slider_2)
division_9 = Division(A=number_slider_2, B=-2)
extr_9 = Extrude(Base=loft_7, Direction=Z_8)
Z_9 = UnitZ(Factor=division_9)
move_13 = Move(Geometry=extr_9, Motion=Z_9)  # -> Geometry, Transform
sint = SolidIntersection(BrepsA=move_13.Geometry, BrepsB=merge_10)

geo_3 = Geometry(graft(sint))

# ----
# Trimmed
sec = BrepPlane(Brep=extr_8, Plane=pl_5)  # -> Curves, Points
sec_2 = BrepPlane(Brep=extr_8, Plane=pl_4)  # -> Curves, Points
merge_11 = Merge(Data1=sec.Curves, Data2=sec_2.Curves)
loft_8 = Loft(Curves=merge_11, Options={Adjust=False, Closed=False, LoftEnds=0, LoftSimp=0, LoftType=0, Rebuild=10, Refit=0.01})
cap = CapHoles(Brep=loft_8)

yz_7 = YZPlane(Origin=Point(0, 0, 0))
xz_5 = XZPlane(Origin=Point(0, 0, 0))
width_6 = Slider(100, range=0..100)
# Wall Columns
crv_13 = Curve([<curve referenced from the Rhino model> x3])
height_6 = Slider(100, range=0..1000)
deplane_9 = DeconstructPlane(Plane=xz_5)  # -> Origin, XAxis, YAxis, ZAxis

xy_2 = XYPlane(Origin=Point(0, 0, 0))

division_10 = Division(A=height_6, B=2)
offset_14 = OffsetCurve(Curve=crv_13, Distance=expr("-x", division_10), Plane=xz_5, Corners=1)
offset_15 = OffsetCurve(Curve=crv_13, Distance=division_10, Plane=xz_5, Corners=1)
merge_12 = Merge(Data1=offset_14, Data2=offset_15)

relay = Relay()

division_11 = Division(A=width_6, B=2)
amp_15 = Amplitude(Vector=deplane_9.ZAxis, Amplitude=division_11)
rev_11 = Reverse(Vector=amp_15)
move_14 = Move(Geometry=merge_12, Motion=rev_11)  # -> Geometry, Transform

amp_16 = Amplitude(Vector=deplane_9.ZAxis, Amplitude=width_6)
loft_9 = Loft(
    Curves=move_14.Geometry,
    Options={Adjust=False, Closed=False, LoftEnds=0, LoftSimp=0, LoftType=0, Rebuild=10, Refit=0.01})
extr_10 = Extrude(Base=loft_9, Direction=amp_16)

sec_3 = BrepPlane(Brep=extr_10, Plane=split_4.ListA)  # -> Curves, Points
Z_10 = UnitZ(Factor=1000)
extr_11 = Extrude(Base=sec_3.Curves, Direction=Z_10)
cap_2 = CapHoles(Brep=extr_11)
sdiff_2 = SolidDifference(BrepsA=extr_10, BrepsB=cap_2)

# ----
# Rafter
eval_7 = EvaluateCurve(Curve=bottom_trim_2, Parameter=clx.Params)  # -> Point, Tangent, Angle
eval_8 = EvaluateCurve(Curve=bottom_trim, Parameter=clx_2.Params)  # -> Point, Tangent, Angle
Z_11 = UnitZ(Factor=1)
pl_7 = ConstructPlane(Origin=eval_7.Point, XAxis=Z_11, YAxis=eval_7.Tangent)
pl_8 = ConstructPlane(Origin=eval_8.Point, XAxis=Z_11, YAxis=eval_8.Tangent)

# ----
# Trimmed
sec_4 = BrepPlane(Brep=extr_3, Plane=pl_8)  # -> Curves, Points
sec_5 = BrepPlane(Brep=extr_3, Plane=pl_7)  # -> Curves, Points
merge_13 = Merge(Data1=sec_4.Curves, Data2=sec_5.Curves)
loft_10 = Loft(Curves=merge_13, Options={Adjust=False, Closed=False, LoftEnds=0, LoftSimp=0, LoftType=0, Rebuild=10, Refit=0.01})
cap_3 = CapHoles(Brep=loft_10)

trimmed_brep = Brep(cap_3)

sint_2 = SolidIntersection(BrepsA=flatten(cap), BrepsB=trimmed_brep)  # -> flatten(Result)
number_slider_3 = Slider(641589, range=0..1000000)
number_slider_4 = Slider(200000, range=0..1000000)
volume = Volume(Geometry=sint_2)  # -> Volume, Centroid
subtraction = Subtraction(A=number_slider_3, B=number_slider_4)
addition = Addition(A=number_slider_3, B=number_slider_4)
gradient = Gradient(
    LowerLimit=subtraction,
    UpperLimit=addition,
    Parameter=volume.Volume,
    stops=[0: RGB(252, 128, 215), 0.5: RGB(0, 255, 0), 1: RGB(255, 0, 0)])
preview = CustomPreview(Geometry=sint_2, Material=gradient)

bbx = BrepBrep(BrepA=flatten(cap), BrepB=trimmed_brep)  # -> Curves, Points

sint_3 = SolidIntersection(BrepsA=flatten(trimmed_brep), BrepsB=geo_3)  # -> flatten(Result)
bbx_2 = BrepBrep(BrepA=flatten(trimmed_brep), BrepB=geo_3)  # -> Curves, Points
number_slider_5 = Slider(500000, range=0..1000000)
number_slider_6 = Slider(300000, range=0..1000000)
volume_2 = Volume(Geometry=sint_3)  # -> Volume, Centroid
subtraction_2 = Subtraction(A=number_slider_5, B=number_slider_6)
addition_2 = Addition(A=number_slider_5, B=number_slider_6)
gradient_2 = Gradient(
    LowerLimit=subtraction_2,
    UpperLimit=addition_2,
    Parameter=volume_2.Volume,
    stops=[0: RGB(252, 128, 215), 0.339: RGB(0, 255, 0), 0.698: RGB(0, 255, 0), 1: RGB(255, 0, 0)])
preview_2 = CustomPreview(Geometry=sint_3, Material=gradient_2)

# ----
# Columns Trim
split_5 = SplitList(List=flatten(extr_2), Index=3)  # -> graft(ListA), graft(ListB)
crv_14 = Curve(<curve referenced from the Rhino model>)  # disabled
crv_15 = Curve(<curve referenced from the Rhino model>)  # disabled
explode = Explode(Curve=crv_14, Recursive=True)  # -> Segments, Vertices; disabled
explode_2 = Explode(Curve=crv_15, Recursive=True)  # -> Segments, Vertices; disabled
item_4 = ListItem(List=explode.Vertices, Index=0, Wrap=True)  # -> Item, Item1, Item2; disabled
item_5 = ListItem(List=explode_2.Vertices, Index=0, Wrap=True)  # -> Item, Item1, Item2; disabled
pl_3pt_3 = Plane3Pt(PointA=item_4.Item1, PointB=item_4.Item, PointC=item_4.Item2)  # disabled
pl_3pt_4 = Plane3Pt(PointA=item_5.Item1, PointB=item_5.Item, PointC=item_5.Item2)  # disabled
sec_6 = BrepPlane(Brep=split_5.ListB, Plane=split_4.ListB)  # -> Curves, Points
sec_7 = BrepPlane(Brep=split_5.ListA, Plane=split_4.ListA)  # -> Curves, Points

Z_12 = UnitZ(Factor=1000)
Z_13 = UnitZ(Factor=1000)
extr_12 = Extrude(Base=sec_6.Curves, Direction=Z_12)
extr_13 = Extrude(Base=sec_7.Curves, Direction=Z_13)

cap_4 = CapHoles(Brep=extr_12)
cap_5 = CapHoles(Brep=extr_13)
sdiff_3 = SolidDifference(BrepsA=split_5.ListA, BrepsB=cap_5)
sdiff_4 = SolidDifference(BrepsA=split_5.ListB, BrepsB=cap_4)
