# Grasshopper definition Shelter.gh (Grasshopper 1.0.7)

# ----
# Beam's Frame
number_slider = Slider(31, range=0..100)
vector_xyz = VectorXYZ(XComponent=Slider(4, range=-10..10), YComponent=Slider(0, range=-10..10), ZComponent=Slider(0, range=-10..10))  # -> Vector, Length
construct_point = ConstructPoint(XCoordinate=Slider(0, range=0..100), YCoordinate=Slider(100, range=0..100), ZCoordinate=number_slider)
plane_normal = PlaneNormal(Origin=construct_point, ZAxis=vector_xyz.Vector)

vector_xyz_2 = VectorXYZ(XComponent=Slider(10, range=-10..10), YComponent=Slider(-7, range=-10..10), ZComponent=Slider(8, range=-10..10))  # -> Vector, Length
construct_point_2 = ConstructPoint(XCoordinate=Slider(25, range=0..100), YCoordinate=Slider(9, range=0..100), ZCoordinate=Slider(0, range=0..100))
plane_normal_2 = PlaneNormal(Origin=construct_point_2, ZAxis=vector_xyz_2.Vector)

# ----
# Cutting Frame in WCF (will be auto converted to beam OCF)
number_slider_2 = Slider(25, range=0..100)
vector_xyz_3 = VectorXYZ(XComponent=Slider(-3, range=-10..10), YComponent=Slider(-5, range=-10..10), ZComponent=Slider(8, range=-10..10))  # -> Vector, Length
construct_point_3 = ConstructPoint(XCoordinate=number_slider_2, YCoordinate=Slider(0, range=0..100), ZCoordinate=Slider(0, range=0..100))
plane_normal_3 = PlaneNormal(Origin=construct_point_3, ZAxis=vector_xyz_3.Vector)

# ----
# Reload Python Modules (if Module Code is Changed)
python_module_to_reload = Panel("""compas
compas_fab
roslibpy
integral_timber_joints""")
# Development Tools
reload = Button()
py = PythonScript(reload_module_button=reload, module_names=python_module_to_reload)  # inputs module_names: list
# ---------- py: Python ----------
import compas_ghpython
from compas_ghpython import unload_modules
if reload_module_button:
    for module in module_names:
        unload_modules(module)
# ---------- end py ----------

# ----
# Check Path and Environment
compas_version = GhPythonScript()  # -> out, compas_version, compas_fab_version, compas_path, compas_fab_path, compas_env_name, python_directory
# ---------- compas_version: Python ----------
__author__ = "leungp"
__version__ = "2020.04.20"

import rhinoscriptsyntax as rs
import compas
import compas_fab
compas_version  = compas.__version__
compas_fab_version = compas_fab.__version__
import os
compas_path = os.path.abspath(compas.__file__)
compas_fab_path = os.path.abspath(compas_fab.__file__)

import compas_bootstrapper
compas_env_name = compas_bootstrapper.ENVIRONMENT_NAME
python_directory = compas_bootstrapper.PYTHON_DIRECTORY
# ---------- end compas_version ----------
compas_environment_name = Panel(compas_version.compas_env_name)
compas_version_2 = Panel(compas_version.compas_version)
compas_fab_version = Panel(compas_version.compas_fab_version)
compas_path = Panel(compas_version.compas_path)
compas_fab_path = Panel(compas_version.compas_fab_path)
python_directory = Panel(compas_version.python_directory)

y_size = Slider(6000, range=0..10000)
x_size = Slider(2600, range=0..10000)
division = Division(A=y_size, B=2)
division_2 = Division(A=x_size, B=2)
dom = ConstructDomain(DomainStart=division, DomainEnd=expr("-x", division))
dom_2 = ConstructDomain(DomainStart=division_2, DomainEnd=expr("-x", division_2))
neg = Negative(Value=division_2)
rectangle = Rectangle(Plane=PlaneXY(0, 0, 0), XSize=dom_2, YSize=dom, Radius=0)  # -> Rectangle, Length
pt = ConstructPoint(XCoordinate=division_2, YCoordinate=expr("-x", division), ZCoordinate=Slider(3021, range=0..5000))
pt_2 = ConstructPoint(XCoordinate=division_2, YCoordinate=division, ZCoordinate=Slider(2500, range=0..5000))
pt_3 = ConstructPoint(XCoordinate=neg, YCoordinate=expr("-x", division), ZCoordinate=Slider(1432, range=0..5000))
pt_4 = ConstructPoint(XCoordinate=neg, YCoordinate=division, ZCoordinate=Slider(3000, range=0..5000))
range = Range(Domain=dom, Steps=Slider(7, range=0..25))
beam = GhPythonScript(
    plane=plane_normal,
    length=Slider(1000, range=0..1000),
    width=Slider(100, range=0..200),
    height=Slider(111, range=0..200),
    name="b1")  # -> out, beam, assembly; inputs plane: Plane
# ---------- beam: Python ----------
from compas_rhino.geometry import RhinoMesh, RhinoPlane

from integral_timber_joints.geometry import Beam
from integral_timber_joints.assembly import Assembly

frame = RhinoPlane.from_geometry(plane).to_compas()

beam = Beam(frame, length, width, height, name)

assembly = Assembly()
assembly.add_beam(beam)
assembly.update_beam_mesh_with_joints(name, True)
# ---------- end beam ----------
secondary_beam_move_up = Slider(40, range=0..100)
pt_5 = ConstructPoint(XCoordinate=0, YCoordinate=range, ZCoordinate=0)
ln = Line(StartPoint=pt_2, EndPoint=pt)
ln_2 = Line(StartPoint=pt_4, EndPoint=pt_3)
xz = XZPlane(Origin=pt_5)

main_beam_extension = Slider(200, range=0..1000)
crv = Curve([ln, ln_2])
ext = ExtendCurve(Curve=crv, Type=0, Start=main_beam_extension, End=main_beam_extension)
beam_width = Slider(100, range=0..200)
beam_height = Slider(140, range=0..200)
Z = UnitZ(Factor=1)
beam_2 = GhPythonScript(centerline=ext, guide_vector=Z, width=beam_width, height=beam_height, name=["b0", "b1"])  # -> out, beam, assembly; inputs centerline: Line, guide_vector: Vector3d
# ---------- beam_2: Python ----------
from compas_rhino.geometry import RhinoMesh, RhinoPlane, RhinoLine, RhinoVector

from integral_timber_joints.geometry import Beam
from integral_timber_joints.assembly import Assembly

_centerline = RhinoLine.from_geometry(centerline).to_compas()
_guide_vector = RhinoVector.from_geometry(guide_vector).to_compas()

beam = Beam.from_centerline(_centerline, _guide_vector, width, height)
beam.name = name

assembly = Assembly()
assembly.add_beam(beam)
assembly.update_beam_mesh_with_joints(name, True)
# ---------- end beam_2 ----------

beamcut_plane = GhPythonScript(assembly=beam.assembly, beam_id="b1", cut_planes=[plane_normal_3, plane_normal_2])  # -> out, assembly_out; inputs cut_planes: list of Plane
# ---------- beamcut_plane: Python ----------
from integral_timber_joints.geometry import Beam, Beamcut_plane 
from compas_rhino.geometry import RhinoPlane
from compas.geometry import Plane
from copy import deepcopy

assembly_out = deepcopy(assembly)
assembly_out.remove_all_beam_cuts(beam_id)

for cut_plane in cut_planes:
    compas_frame = RhinoPlane.from_geometry(cut_plane).to_compas()
    cutplane_wcf = Plane(compas_frame.point, compas_frame.normal)
    assembly_out.add_ocf_beam_cut_from_wcf_plane(beam_id, cutplane_wcf)

assembly_out.update_beam_mesh_with_joints(beam_id)
# ---------- end beamcut_plane ----------
Z_2 = UnitZ(Factor=secondary_beam_move_up)
pcx = CurvePlane(Curve=ln_2, Plane=xz)  # -> Points, ParamsC, ParamsP
pcx_2 = CurvePlane(Curve=ln, Plane=xz)  # -> Points, ParamsC, ParamsP
crv_2 = Curve([ln, ln_2])

item = ListItem(List=pt_5, Index=[0, 1], Wrap=True)
item_2 = ListItem(List=pt_5, Index=[-1, -2], Wrap=True)
avr = Average(Input=item)
avr_2 = Average(Input=item_2)
xz_2 = XZPlane(Origin=avr)
xz_3 = XZPlane(Origin=avr_2)
pcx_3 = CurvePlane(Curve=crv_2, Plane=xz_2)  # -> Points, ParamsC, ParamsP
pcx_4 = CurvePlane(Curve=crv_2, Plane=xz_3)  # -> Points, ParamsC, ParamsP
xy = XYPlane(Origin=Point(0, 0, 0))
project = Project(Geometry=pcx_3.Points, Plane=xy)  # -> Geometry, Transform
project_2 = Project(Geometry=pcx_4.Points, Plane=xy)  # -> Geometry, Transform
ln_3 = Line(StartPoint=pcx_3.Points, EndPoint=project.Geometry)
ln_4 = Line(StartPoint=pcx_4.Points, EndPoint=project_2.Geometry)
column_crv = Curve(flatten([ln_4, ln_3]))

column_extension = Slider(225, range=0..1000)
crv_3 = Curve(flatten(column_crv))
ext_2 = ExtendCurve(Curve=crv_3, Type=0, Start=column_extension, End=0)
lng = ListLength(List=crv_3)
beam_width_2 = Slider(100, range=0..200)
beam_height_2 = Slider(100, range=0..200)
series = Series(Start=0, Step=1, Count=lng)
X = UnitX(Factor=1)
concat = Concatenate(FragmentA="c", FragmentB=series)
beam_3 = GhPythonScript(centerline=ext_2, guide_vector=X, width=beam_width_2, height=beam_height_2, name=concat)  # -> out, beam, assembly; inputs centerline: Line, guide_vector: Vector3d; same code as beam_2

pt_6 = ConstructPoint(XCoordinate=0, YCoordinate=0, ZCoordinate=Slider(200, range=0..1000))
pt_7 = ConstructPoint(XCoordinate=0, YCoordinate=0, ZCoordinate=Slider(400, range=0..1000))
ln_5 = Line(StartPoint=pcx_2.Points, EndPoint=pcx.Points)  # -> flatten(Line)

secondary_beam_extension = Slider(429, range=0..1000)
secondary_beam_move_up_2 = Slider(50, range=0..100)
ext_3 = ExtendCurve(Curve=ln_5, Type=0, Start=secondary_beam_extension, End=secondary_beam_extension)
Z_3 = UnitZ(Factor=secondary_beam_move_up_2)
move = Move(Geometry=ext_3, Motion=Z_3)  # -> Geometry, Transform
crv_4 = Curve(move.Geometry)
lng_2 = ListLength(List=crv_4)
beam_width_3 = Slider(100, range=0..200)
beam_height_3 = Slider(100, range=0..200)
series_2 = Series(Start=2, Step=1, Count=lng_2)
Z_4 = UnitZ(Factor=1)
concat_2 = Concatenate(FragmentA="b", FragmentB=series_2)
beam_4 = GhPythonScript(centerline=crv_4, guide_vector=Z_4, width=beam_width_3, height=beam_height_3, name=concat_2)  # -> out, beam, assembly; inputs centerline: Line, guide_vector: Vector3d; same code as beam_2

basic_assembly_preview = GhPythonScript(assembly=beamcut_plane.assembly_out, beam_ids="b1")  # -> out, beam_mesh_prev; inputs beam_ids: list
# ---------- basic_assembly_preview: Python ----------
from compas_ghpython.utilities import draw_mesh

beam_mesh_prev = []

for beam_id in beam_ids:
    beam = assembly.beam(beam_id)
    beam_mesh_prev.append(draw_mesh(* beam.cached_mesh.to_vertices_and_faces()))
# ---------- end basic_assembly_preview ----------
xy_2 = XYPlane(Origin=pt_6)
xy_3 = XYPlane(Origin=pt_7)
project_3 = Project(Geometry=pcx_3.Points, Plane=xy_2)  # -> Geometry, Transform
project_4 = Project(Geometry=pcx_4.Points, Plane=xy_2)  # -> Geometry, Transform
project_5 = Project(Geometry=pcx_3.Points, Plane=xy_3)  # -> Geometry, Transform
project_6 = Project(Geometry=pcx_4.Points, Plane=xy_3)  # -> Geometry, Transform
flip = FlipMatrix(Data=[project_5.Geometry, project_6.Geometry])
secondary_beam_extension_2 = Slider(180, range=0..1000)
secondary_beam_move_up_3 = Slider(50, range=0..100)
pline = PolyLine(Vertices=[project_4.Geometry, project_3.Geometry], Closed=False)
custom_preview = CustomPreview(Geometry=basic_assembly_preview.beam_mesh_prev, Material=ColourSwatch(SwatchColor=RGBA(102, 255, 0, 148)))
pline_2 = PolyLine(Vertices=flip, Closed=False)
Z_5 = UnitZ(Factor=1)
sil_crv = Curve(flatten([pline, pline_2]))
ext_4 = ExtendCurve(Curve=ln_5, Type=0, Start=secondary_beam_extension_2, End=secondary_beam_extension_2)
Z_6 = UnitZ(Factor=secondary_beam_move_up_3)
move_2 = Move(Geometry=ext_4, Motion=Z_6)  # -> Geometry, Transform
crv_5 = Curve(move_2.Geometry)
divide = DivideCurve(Curve=crv_5, Count=Slider(10, range=0..20), Kinks=False)  # -> Points, Tangents, Parameters
panel = Panel("""1
0
0""")
panel_2 = Panel("""0
0
1""")
flip_2 = FlipMatrix(Data=divide.Points)
lng_3 = ListLength(List=flip_2)  # -> flatten(Length)
python = GhPythonScript(lengths=lng_3)  # -> out, a; inputs lengths: list
# ---------- python: Python ----------
if lengths[0] == 2:
    pattern = [[2]]

elif lengths[0] == 3:
    pattern = [[3]]

elif lengths[0] == 4:
    pattern = [[2,2]]

elif lengths[0] == 5:
    pattern = [[2,3],
               [3,2]]

elif lengths[0] == 6:
    pattern = [[2,2,2],
               [3,3]]

elif lengths[0] == 7:
#    pattern = [[2,2,3],
#               [2,3,2],
#               [3,2,2]]
    pattern = [[2,2,3],
               [3,2,2]]
               

elif lengths[0] == 8:
#    pattern = [[2,3,3],
#               [3,2,3],
#               [3,3,2]]
    pattern = [[2,3,3],
               [3,3,2]]

elif lengths[0] == 9:
    pattern = [[2,2,2,3],
               [2,2,3,2],
               [2,3,2,2],
               [3,2,2,2]]

elif lengths[0] == 10:
    pattern = [[2,3,2,3],
               [3,2,3,2]]
               
import ghpythonlib.treehelpers as th

import Rhino

layerTree = [list() for _ in lengths]

for i in range(len(lengths)):
    layerTree[i].extend(pattern[i % len(pattern)])

layerTree = th.list_to_tree(layerTree, source=[0,0])
a = layerTree
# ---------- end python ----------
ma = MassAddition(Input=python.a)  # -> Result, simplify(PartialResults)
subtraction = Subtraction(A=ma.PartialResults, B=python.a)  # -> simplify(Result)
subtraction_2 = Subtraction(A=ma.PartialResults, B=1)  # -> simplify(Result)
item_3 = ListItem(List=flip_2, Index=subtraction, Wrap=True)
item_4 = ListItem(List=flip_2, Index=subtraction_2, Wrap=True)
ln_6 = Line(StartPoint=item_3, EndPoint=item_4)
crv_6 = Curve(flatten(ln_6))
panel_3 = Panel("""0
1
2""")
cull_i = CullIndex(List=flip_2, Indices=graft(panel_3), Wrap=True)
cull = CullPattern(List=cull_i, CullPattern=panel)
cull_2 = CullPattern(List=cull_i, CullPattern=panel_2)
ln_7 = Line(StartPoint=cull, EndPoint=cull_2)
panel_4 = Panel(subtraction)

crv_7 = Curve(flatten(crv_6))
main_beam_extension_2 = Slider(198, range=0..1000)
lng_4 = ListLength(List=crv_7)
beam_width_4 = Slider(100, range=0..200)
beam_height_4 = Slider(100, range=0..200)
series_3 = Series(Start=0, Step=1, Count=lng_4)
X_2 = UnitX(Factor=1)
concat_3 = Concatenate(FragmentA="p", FragmentB=series_3)

move_3 = Move(Geometry=crv_7, Motion=Z_2)  # -> Geometry, Transform

crv_8 = Curve(flatten(sil_crv))
column_extension_2 = Slider(300, range=0..1000)
ext_5 = ExtendCurve(Curve=crv_8, Type=0, Start=column_extension_2, End=column_extension_2)
lng_5 = ListLength(List=crv_8)
beam_width_5 = Slider(100, range=0..200)
beam_height_5 = Slider(140, range=0..200)
series_4 = Series(Start=0, Step=1, Count=lng_5)
concat_4 = Concatenate(FragmentA="s", FragmentB=series_4)

end = EndPoints(Curve=ext_5)  # -> Start, End
ln_8 = Line(StartPoint=end.Start, EndPoint=end.End)
line = Line(ln_8)

beam_5 = GhPythonScript(centerline=line, guide_vector=Z_5, width=beam_width_5, height=beam_height_5, name=concat_4)  # -> out, beam, assembly; inputs centerline: Line, guide_vector: Vector3d; same code as beam_2

ext_6 = ExtendCurve(Curve=move_3.Geometry, Type=0, Start=main_beam_extension_2, End=main_beam_extension_2)

end_2 = EndPoints(Curve=ext_6)  # -> Start, End
ln_9 = Line(StartPoint=end_2.Start, EndPoint=end_2.End)
line_2 = Line(ln_9)

beam_6 = GhPythonScript(centerline=line_2, guide_vector=X_2, width=beam_width_4, height=beam_height_4, name=concat_3)  # -> out, beam, assembly; inputs centerline: Line, guide_vector: Vector3d; same code as beam_2

assembly = GhPythonScript(beams=[beam_2.beam, beam_4.beam, beam_3.beam, beam_6.beam, beam_5.beam])  # -> out, assembly_out, a; inputs beams: list
# ---------- assembly: Python ----------
from compas_rhino.geometry import RhinoMesh, RhinoPlane

from integral_timber_joints.geometry import Beam
from integral_timber_joints.assembly import Assembly
from copy import deepcopy


if not assembly:
    assembly_out = Assembly()
else:
    assembly_out = deepcopy(assembly_out)
for beam in beams:
    assembly_out.add_beam(beam)
#    assembly_out.update_beam_mesh_with_joints(beam.name, True)
# ---------- end assembly ----------
basic_assembly_preview_2 = GhPythonScript(assembly=assembly.assembly_out)  # -> out, beam_mesh_prev; inputs beam_ids: list
# ---------- basic_assembly_preview_2: Python ----------
from compas_ghpython.utilities import draw_mesh

beam_mesh_prev = []

if not beam_ids:
    beam_ids = assembly.beam_ids()
    
for beam_id in beam_ids:
    beam = assembly.beam(beam_id)
    beam_mesh_prev.append(draw_mesh(* beam.cached_mesh.to_vertices_and_faces()))
# ---------- end basic_assembly_preview_2 ----------
preview = CustomPreview(Geometry=basic_assembly_preview_2.beam_mesh_prev, Material=ColourSwatch(SwatchColor=RGB(176, 136, 84)))
