# Grasshopper definition Nonplanar_joint_intersection.gh (Grasshopper 1.0.7)
# plug-ins: Kangaroo2 Components

geometry = Geometry([<mesh referenced from the Rhino model> x20])
geometry_2 = Geometry(graft(geometry))
volume = Volume(Geometry=geometry_2)  # -> Volume, Centroid
face_normals = FaceNormals(Mesh=geometry_2)  # -> Centers, Normals
removeduplicatepts = RemoveDuplicatePts(Points=face_normals.Normals, Tolerance=0.01)
plane_normal = PlaneNormal(Origin=volume.Centroid, ZAxis=removeduplicatepts)
bounding_box = BoundingBox(Content=geometry_2, Plane=plane_normal)  # -> Box, Box_2
deconstruct_box = DeconstructBox(Box=bounding_box.Box)  # -> Plane, X, Y, Z
number = Number(deconstruct_box.Z)
shift_paths = ShiftPaths(Data=number, Offset=-1)
sort_list = SortList(Keys=simplify(shift_paths), ValuesA=simplify(removeduplicatepts))  # -> Keys, ValuesA
list_item = ListItem(List=sort_list.ValuesA, Index=0, Wrap=True)  # -> Item1, Item
cross_product = CrossProduct(VectorA=list_item.Item1, VectorB=list_item.Item, Unitize=False)  # -> Vector, Length
construct_plane = ConstructPlane(Origin=volume.Centroid, XAxis=list_item.Item1, YAxis=cross_product.Vector)
bounding_box_2 = BoundingBox(Content=geometry_2, Plane=construct_plane)  # -> Box, Box_2
box_corners = BoxCorners(Box=bounding_box_2.Box)  # -> CornerA, CornerB, CornerC, CornerD, CornerE, CornerF, CornerG, CornerH
average = Average(Input=[box_corners.CornerA, box_corners.CornerD, box_corners.CornerE, box_corners.CornerH])
deconstruct_box_2 = DeconstructBox(Box=bounding_box_2.Box)  # -> Plane, X, Y, Z
construct_plane_2 = ConstructPlane(Origin=box_corners.CornerA, XAxis=list_item.Item1, YAxis=cross_product.Vector)
line_sdl = LineSDL(Start=average, Direction=list_item.Item1, Length=deconstruct_box_2.X)
beam_frame = Plane(simplify(construct_plane_2))
beam_frame_2 = Plane(simplify(beam_frame))
cross_reference = CrossReference(ListListA=flatten(beam_frame_2), ListListB=flatten(beam_frame_2), CrossMode=5)  # -> graft(ListListA), graft(ListListB)
cross_reference_2 = CrossReference(ListA=geometry, ListB=geometry, CrossMode=5)  # -> graft(ListA), graft(ListB)
cross_reference_3 = CrossReference(ListListA=flatten(line_sdl), ListListB=flatten(line_sdl), CrossMode=5)  # -> graft(ListListA), graft(ListListB)
mesh_intersection = MeshIntersection(MeshesA=cross_reference_2.ListA, MeshesB=cross_reference_2.ListB)
deconstruct_plane = DeconstructPlane(Plane=cross_reference.ListListA)  # -> Origin, XAxis, YAxis, ZAxis
line_line = LineLine(Line1=cross_reference_3.ListListA, Line2=cross_reference_3.ListListB)  # -> ParamA, ParamB, PointA, PointB
list_length = ListLength(List=mesh_intersection)
construct_plane_3 = ConstructPlane(Origin=line_line.PointA, XAxis=deconstruct_plane.XAxis, YAxis=deconstruct_plane.YAxis)
vector_2pt = Vector2Pt(PointA=line_line.PointA, PointB=line_line.PointB, Unitize=False)  # -> Vector, Length
cross_product_2 = CrossProduct(VectorA=vector_2pt.Vector, VectorB=deconstruct_plane.XAxis, Unitize=False)  # -> Vector, Length
split_list = SplitList(List=cross_reference_2.ListA, Index=list_length)  # -> ListA, ListB
split_list_2 = SplitList(List=cross_reference_2.ListB, Index=list_length)  # -> ListA, ListB
split_list_3 = SplitList(List=construct_plane_3, Index=list_length)  # -> ListA, ListB
line = Line(StartPoint=line_line.PointA, EndPoint=line_line.PointB)
orient = Orient(Geometry=split_list.ListA, Source=split_list_3.ListA, Target=PlaneXY(0, 0, 0))  # -> simplify(Geometry), Transform
geometry_3 = Geometry(split_list.ListA)
orient_2 = Orient(Geometry=split_list_2.ListA, Source=split_list_3.ListA, Target=PlaneXY(0, 0, 0))  # -> simplify(Geometry), Transform
orient_3 = Orient(Geometry=mesh_intersection, Source=split_list_3.ListA, Target=PlaneXY(0, 0, 0))  # -> simplify(Geometry), Transform
split_list_4 = SplitList(List=vector_2pt.Length, Index=list_length)  # -> ListA, ListB
orient_4 = Orient(Geometry=line, Source=split_list_3.ListA, Target=PlaneXY(0, 0, 0))  # -> simplify(Geometry), Transform
number_slider = Slider(5, range=0..40)
split_list_5 = SplitList(List=line, Index=list_length)  # -> ListA, ListB
panel = Panel(geometry_3)
list_item_2 = ListItem(List=flatten(orient.Geometry), Index=number_slider, Wrap=False)
list_item_3 = ListItem(List=flatten(orient_2.Geometry), Index=number_slider, Wrap=False)
list_item_4 = ListItem(List=flatten(orient_3.Geometry), Index=number_slider, Wrap=False)
list_item_5 = ListItem(List=flatten(split_list_4.ListA), Index=number_slider, Wrap=False)
list_item_6 = ListItem(List=flatten(orient_4.Geometry), Index=number_slider, Wrap=False)
panel_2 = Panel(list_item_5)
custom_preview = CustomPreview(Geometry=list_item_3, Material=ColourSwatch(SwatchColor=RGBA(0, 133, 148, 57)))
custom_preview_2 = CustomPreview(Geometry=list_item_2, Material=ColourSwatch(SwatchColor=RGBA(148, 91, 0, 57)))
custom_preview_3 = CustomPreview(Geometry=list_item_4, Material=ColourSwatch(SwatchColor=RGBA(59, 0, 148, 57)))
custom_preview_4 = CustomPreview(Geometry=list_item_6, Material=ColourSwatch(SwatchColor=RGB(255, 255, 255)))
