# Grasshopper definition Shelter3_Square.gh (Grasshopper 1.0.7)

y_size = Slider(3800, range=0..10000)
x_size = Slider(3500, range=0..10000)
division = Division(A=y_size, B=2)
division_2 = Division(A=x_size, B=2)
dom = ConstructDomain(DomainStart=division, DomainEnd=expr("-x", division))
neg = Negative(Value=division_2)
pt = ConstructPoint(XCoordinate=division_2, YCoordinate=expr("-x", division), ZCoordinate=Slider(3500, range=0..5000))
number_slider = Slider(56, range=0..100)
pt_2 = ConstructPoint(XCoordinate=division_2, YCoordinate=division, ZCoordinate=Slider(3000, range=0..5000))
pt_3 = ConstructPoint(XCoordinate=neg, YCoordinate=expr("-x", division), ZCoordinate=Slider(800, range=0..5000))
pt_4 = ConstructPoint(XCoordinate=neg, YCoordinate=division, ZCoordinate=Slider(3500, range=0..5000))
range = Range(Domain=dom, Steps=Slider(6, range=0..25))
unit_z = UnitZ(Factor=Slider(3000, range=0..10000))
pt_5 = ConstructPoint(XCoordinate=0, YCoordinate=range, ZCoordinate=0)
ln = Line(StartPoint=pt_2, EndPoint=pt)
ln_2 = Line(StartPoint=pt_4, EndPoint=pt_3)
number_slider_2 = Slider(20, range=0..100)
xz = XZPlane(Origin=pt_5)
negative = Negative(Value=number_slider)
circle = Circle(Plane=PlaneXY(0, 0, 0), Radius=Slider(4000, range=0..10000))
move = Move(Geometry=circle, Motion=unit_z)  # -> Geometry, Transform
pcx = CurvePlane(Curve=ln_2, Plane=xz)  # -> Points, ParamsC, ParamsP
pcx_2 = CurvePlane(Curve=ln, Plane=xz)  # -> Points, ParamsC, ParamsP
rotate = Rotate(Geometry=move.Geometry, Angle=degrees(number_slider), Plane=PlaneXY(0, 0, 0))  # -> Geometry, Transform
curve = Curve(<curve referenced from the Rhino model>)
rotate_2 = Rotate(Geometry=move.Geometry, Angle=degrees(negative), Plane=PlaneXY(0, 0, 0))  # -> Geometry, Transform
divide_curve = DivideCurve(Curve=circle, Count=number_slider_2, Kinks=False)  # -> Points, Tangents, Parameters
ln_3 = Line(StartPoint=pcx_2.Points, EndPoint=pcx.Points)  # -> flatten(Line)
loft = Loft(Curves=ln_3, Options={Adjust=False, Closed=False, LoftEnds=0, LoftSimp=0, LoftType=0, Rebuild=10, Refit=0.01})
divide_curve_2 = DivideCurve(Curve=rotate.Geometry, Count=number_slider_2, Kinks=False)  # -> Points, Tangents, Parameters
project = Project(Curve=curve, Brep=loft, Direction=Vector(0, 0, 1))
divide_curve_3 = DivideCurve(Curve=rotate_2.Geometry, Count=number_slider_2, Kinks=False)  # -> Points, Tangents, Parameters
number_slider_3 = Slider(500, range=0..1000)
number_slider_4 = Slider(380, range=0..1000)
line = Line(StartPoint=divide_curve.Points, EndPoint=divide_curve_2.Points)
line_2 = Line(StartPoint=divide_curve.Points, EndPoint=divide_curve_3.Points)
extend_curve = ExtendCurve(Curve=[ln_2, ln], Type=0, Start=number_slider_3, End=number_slider_3)

crv = Curve(extend_curve)
beam_width = Slider(100, range=0..200)
beam_height = Slider(140, range=0..200)
Z = UnitZ(Factor=1)
beam = GhPythonScript(centerline=crv, guide_vector=Z, width=beam_width, height=beam_height, name=["b0", "b1"])  # -> out, beam, assembly, uncut_mesh; inputs centerline: Line, guide_vector: Vector3d
# ---------- beam: Python ----------
from compas_rhino.geometry import RhinoMesh, RhinoPlane, RhinoLine, RhinoVector

from integral_timber_joints.geometry import Beam
from integral_timber_joints.assembly import Assembly
from compas_ghpython.utilities import draw_mesh

_centerline = RhinoLine.from_geometry(centerline).to_compas()
_guide_vector = RhinoVector.from_geometry(guide_vector).to_compas()

beam = Beam.from_centerline(_centerline, _guide_vector, width, height)
beam.name = name

assembly = Assembly()
assembly.add_beam(beam)
assembly.update_beam_mesh_with_joints(name, True)
uncut_mesh = draw_mesh(* beam.cached_mesh.to_vertices_and_faces())
# ---------- end beam ----------

number_slider_5 = Slider(7, range=0..10)
extend_curve_2 = ExtendCurve(Curve=ln_3, Type=0, Start=number_slider_4, End=number_slider_4)
secondary_beam_move_up = Slider(70, range=0..100)
number_slider_6 = Slider(270, range=0..1000)
secondary_beam_move_up_2 = Slider(70, range=0..100)
split_list = SplitList(List=line, Index=number_slider_5)  # -> ListA, ListB
split_list_2 = SplitList(List=line_2, Index=number_slider_5)  # -> ListA, ListB
geometry = Geometry(split_list.ListA)
geometry_2 = Geometry(split_list_2.ListA)
Z_2 = UnitZ(Factor=secondary_beam_move_up)
move_2 = Move(Geometry=extend_curve_2, Motion=Z_2)  # -> Geometry, Transform
extend_curve_3 = ExtendCurve(Curve=move_2.Geometry, Type=0, Start=number_slider_6, End=number_slider_6)
Z_3 = UnitZ(Factor=secondary_beam_move_up_2)
move_3 = Move(Geometry=move_2.Geometry, Motion=Z_3)  # -> Geometry, Transform
crv_2 = Curve(move_3.Geometry)

divide = DivideCurve(Curve=crv_2, Count=Slider(6, range=0..10), Kinks=False)  # -> Points, Tangents, Parameters
flip = FlipMatrix(Data=divide.Points)
lng = ListLength(List=flip)  # -> flatten(Length)
python = GhPythonScript(lengths=lng)  # -> out, a; inputs lengths: list
# ---------- python: Python ----------
if lengths[0] == 2:
    pattern = [[2]]

elif lengths[0] == 3:
    pattern = [[3]]

elif lengths[0] == 4:
    pattern = [[2,2]]

elif lengths[0] == 5:
    pattern = [[2,3],
               [3,2]]

elif lengths[0] == 6:
    pattern = [[2,2,2],
               [3,3]]

elif lengths[0] == 7:
#    pattern = [[2,2,3],
#               [2,3,2],
#               [3,2,2]]
    pattern = [[2,2,3],
               [3,2,2]]
               

elif lengths[0] == 8:
#    pattern = [[2,3,3],
#               [3,2,3],
#               [3,3,2]]
    pattern = [[2,3,3],
               [3,3,2]]

elif lengths[0] == 9:
    pattern = [[2,2,2,3],
               [2,2,3,2],
               [2,3,2,2],
               [3,2,2,2]]

elif lengths[0] == 10:
    pattern = [[2,3,2,3],
               [3,2,3,2]]
               
import ghpythonlib.treehelpers as th

import Rhino

layerTree = [list() for _ in lengths]

for i in range(len(lengths)):
    layerTree[i].extend(pattern[i % len(pattern)])

layerTree = th.list_to_tree(layerTree, source=[0,0])
a = layerTree
# ---------- end python ----------
ma = MassAddition(Input=python.a)  # -> Result, simplify(PartialResults)
subtraction = Subtraction(A=ma.PartialResults, B=python.a)  # -> simplify(Result)
subtraction_2 = Subtraction(A=ma.PartialResults, B=1)  # -> simplify(Result)
item = ListItem(List=flip, Index=subtraction, Wrap=True)
item_2 = ListItem(List=flip, Index=subtraction_2, Wrap=True)
ln_4 = Line(StartPoint=item, EndPoint=item_2)

basic_assembly_preview = GhPythonScript()  # -> out, error, beam_mesh_prev; inputs beam_ids: list
# ---------- basic_assembly_preview: Python ----------
from compas_ghpython.utilities import draw_mesh

beam_mesh_prev = []

if not beam_ids:
    beam_ids = assembly.beam_ids()

error = []
for beam_id in beam_ids:
    beam = assembly.beam(beam_id)
    try:
        assembly.update_beam_mesh_with_joints(beam_id)
        beam_mesh_prev.append(draw_mesh(* beam.cached_mesh.to_vertices_and_faces()))
    except:
        error.append("Beam (%s) fail to create visualization" % beam_id)
# ---------- end basic_assembly_preview ----------
crv_3 = Curve(flatten(ln_4))
number_slider_7 = Slider(285, range=0..1000)
unweld = UnweldMesh(Mesh=basic_assembly_preview.beam_mesh_prev, Angle=0.01)
preview = CustomPreview(Geometry=unweld, Material=ColourSwatch(SwatchColor=RGB(176, 136, 84)))
extend_curve_4 = ExtendCurve(Curve=crv_3, Type=0, Start=number_slider_7, End=number_slider_7)

crv_4 = Curve(extend_curve_3)
beam_width_2 = Slider(100, range=0..200)
beam_height_2 = Slider(100, range=0..200)
Z_4 = UnitZ(Factor=1)

list_length = ListLength(List=crv_4)
series = Series(Start=0, Step=1, Count=list_length)
concatenate = Concatenate(FragmentA="c", FragmentB=series)

beam_2 = GhPythonScript(centerline=crv_4, guide_vector=Z_4, width=beam_width_2, height=beam_height_2, name=concatenate)  # -> out, beam, assembly, uncut_mesh; inputs centerline: Line, guide_vector: Vector3d; same code as beam

assembly = GhPythonScript(beams=flatten([beam.beam, beam_2.beam]))  # -> out, assembly_out, a; inputs beams: list
# ---------- assembly: Python ----------
from compas_rhino.geometry import RhinoMesh, RhinoPlane

from integral_timber_joints.geometry import Beam
from integral_timber_joints.assembly import Assembly
from copy import deepcopy


if assembly is None:
    assembly_out = Assembly()
else:
    assembly_out = deepcopy(assembly)

for beam in beams:
    assembly_out.add_beam(beam)
#    assembly_out.update_beam_mesh_with_joints(beam.name, True)
# ---------- end assembly ----------

crv_5 = Curve(extend_curve_4)
beam_width_3 = Slider(100, range=0..200)
beam_height_3 = Slider(100, range=0..200)
Z_5 = UnitZ(Factor=1)

list_length_2 = ListLength(List=crv_5)
series_2 = Series(Start=0, Step=1, Count=list_length_2)
concatenate_2 = Concatenate(FragmentA="c", FragmentB=series_2)

beam_3 = GhPythonScript(centerline=crv_5, guide_vector=Z_5, width=beam_width_3, height=beam_height_3, name=concatenate_2)  # -> out, beam, assembly, uncut_mesh; inputs centerline: Line, guide_vector: Vector3d; same code as beam
