# Grasshopper definition Shelter5_Symetrical.gh (Grasshopper 1.0.7)

# ----
# Reload Python Modules (if Module Code is Changed)
python_module_to_reload = Panel("""compas
compas_fab
roslibpy
integral_timber_joints""")
# Development Tools
reload = Button()
py = PythonScript(reload_module_button=reload, module_names=python_module_to_reload)  # inputs module_names: list
# ---------- py: Python ----------
import compas_ghpython
from compas_ghpython import unload_modules
if reload_module_button:
    for module in module_names:
        unload_modules(module)
# ---------- end py ----------

# ----
# Check Path and Environment
compas_version = GhPythonScript()  # -> out, compas_version, compas_fab_version, compas_path, compas_fab_path, compas_env_name, python_directory
# ---------- compas_version: Python ----------
__author__ = "leungp"
__version__ = "2020.04.20"

import rhinoscriptsyntax as rs
import compas
import compas_fab
compas_version  = compas.__version__
compas_fab_version = compas_fab.__version__
import os
compas_path = os.path.abspath(compas.__file__)
compas_fab_path = os.path.abspath(compas_fab.__file__)

import compas_bootstrapper
compas_env_name = compas_bootstrapper.ENVIRONMENT_NAME
python_directory = compas_bootstrapper.PYTHON_DIRECTORY
# ---------- end compas_version ----------
compas_environment_name = Panel(compas_version.compas_env_name)
compas_version_2 = Panel(compas_version.compas_version)
compas_fab_version = Panel(compas_version.compas_fab_version)
compas_path = Panel(compas_version.compas_path)
compas_fab_path = Panel(compas_version.compas_fab_path)
python_directory = Panel(compas_version.python_directory)

y_size = Slider(5000, range=0..10000)
x_size = Slider(2600, range=0..10000)
division = Division(A=y_size, B=2)
division_2 = Division(A=x_size, B=2)
flip = FlipCurve()  # -> Curve, Flag
dom = ConstructDomain(DomainStart=division, DomainEnd=expr("-x", division))
dom_2 = ConstructDomain(DomainStart=division_2, DomainEnd=expr("-x", division_2))
neg = Negative(Value=division_2)
rectangle = Rectangle(Plane=PlaneXY(0, 0, 0), XSize=dom_2, YSize=dom, Radius=0)  # -> Rectangle, Length
pt = ConstructPoint(XCoordinate=division_2, YCoordinate=expr("-x", division), ZCoordinate=Slider(3000, range=0..5000))
pt_2 = ConstructPoint(XCoordinate=division_2, YCoordinate=division, ZCoordinate=Slider(600, range=0..5000))
pt_3 = ConstructPoint(XCoordinate=neg, YCoordinate=expr("-x", division), ZCoordinate=Slider(600, range=0..5000))
pt_4 = ConstructPoint(XCoordinate=neg, YCoordinate=division, ZCoordinate=Slider(3000, range=0..5000))
range = Range(Domain=dom, Steps=Slider(7, range=0..25))
secondary_beam_move_up = Slider(50, range=0..100)
pt_5 = ConstructPoint(XCoordinate=0, YCoordinate=range, ZCoordinate=0)
ln = Line(StartPoint=pt_2, EndPoint=pt)
ln_2 = Line(StartPoint=pt_4, EndPoint=pt_3)
xz = XZPlane(Origin=pt_5)

main_beam_extension = Slider(300, range=0..1000)
crv = Curve([ln, ln_2])
ext = ExtendCurve(Curve=crv, Type=0, Start=main_beam_extension, End=main_beam_extension)
beam_width = Slider(100, range=0..200)
beam_height = Slider(140, range=0..200)
Z = UnitZ(Factor=1)
beam = GhPythonScript(centerline=ext, guide_vector=Z, width=beam_width, height=beam_height, name=["b0", "b1"])  # -> out, beam, assembly, uncut_mesh; inputs centerline: Line, guide_vector: Vector3d
# ---------- beam: Python ----------
from compas_rhino.geometry import RhinoMesh, RhinoPlane, RhinoLine, RhinoVector

from integral_timber_joints.geometry import Beam
from integral_timber_joints.assembly import Assembly
from compas_ghpython.utilities import draw_mesh

_centerline = RhinoLine.from_geometry(centerline).to_compas()
_guide_vector = RhinoVector.from_geometry(guide_vector).to_compas()

beam = Beam.from_centerline(_centerline, _guide_vector, width, height)
beam.name = name

assembly = Assembly()
assembly.add_beam(beam)
assembly.update_beam_mesh_with_joints(name, True)
uncut_mesh = draw_mesh(* beam.cached_mesh.to_vertices_and_faces())
# ---------- end beam ----------

Z_2 = UnitZ(Factor=secondary_beam_move_up)
pcx = CurvePlane(Curve=ln_2, Plane=xz)  # -> Points, ParamsC, ParamsP
pcx_2 = CurvePlane(Curve=ln, Plane=xz)  # -> Points, ParamsC, ParamsP
crv_2 = Curve([ln, ln_2])

item = ListItem(List=pt_5, Index=[2, 1], Wrap=True)
item_2 = ListItem(List=pt_5, Index=[-1, -2], Wrap=True)
avr = Average(Input=item)
avr_2 = Average(Input=item_2)
xz_2 = XZPlane(Origin=avr)
xz_3 = XZPlane(Origin=avr_2)
pcx_3 = CurvePlane(Curve=crv_2, Plane=xz_2)  # -> Points, ParamsC, ParamsP
pcx_4 = CurvePlane(Curve=crv_2, Plane=xz_3)  # -> Points, ParamsC, ParamsP
xy = XYPlane(Origin=Point(0, 0, 0))
project = Project(Geometry=pcx_3.Points, Plane=xy)  # -> Geometry, Transform
project_2 = Project(Geometry=pcx_4.Points, Plane=xy)  # -> Geometry, Transform
ln_3 = Line(StartPoint=pcx_3.Points, EndPoint=project.Geometry)
ln_4 = Line(StartPoint=pcx_4.Points, EndPoint=project_2.Geometry)
column_crv = Curve(flatten([ln_4, ln_3]))

column_extension = Slider(225, range=0..1000)
crv_3 = Curve(flatten(column_crv))
ext_2 = ExtendCurve(Curve=crv_3, Type=0, Start=column_extension, End=0)
lng = ListLength(List=crv_3)
beam_width_2 = Slider(100, range=0..200)
beam_height_2 = Slider(100, range=0..200)
series = Series(Start=0, Step=1, Count=lng)
X = UnitX(Factor=1)
concat = Concatenate(FragmentA="c", FragmentB=series)
beam_2 = GhPythonScript(centerline=ext_2, guide_vector=X, width=beam_width_2, height=beam_height_2, name=concat)  # -> out, beam, assembly, uncut_mesh; inputs centerline: Line, guide_vector: Vector3d; same code as beam

pt_6 = ConstructPoint(XCoordinate=0, YCoordinate=0, ZCoordinate=Slider(200, range=0..1000))
pt_7 = ConstructPoint(XCoordinate=0, YCoordinate=0, ZCoordinate=Slider(400, range=0..1000))
ln_5 = Line(StartPoint=pcx_2.Points, EndPoint=pcx.Points)  # -> flatten(Line)

secondary_beam_extension = Slider(429, range=0..1000)
secondary_beam_move_up_2 = Slider(50, range=0..100)
ext_3 = ExtendCurve(Curve=ln_5, Type=0, Start=secondary_beam_extension, End=secondary_beam_extension)
Z_3 = UnitZ(Factor=secondary_beam_move_up_2)
move = Move(Geometry=ext_3, Motion=Z_3)  # -> Geometry, Transform
crv_4 = Curve(move.Geometry)
lng_2 = ListLength(List=crv_4)
beam_width_3 = Slider(100, range=0..200)
beam_height_3 = Slider(100, range=0..200)
series_2 = Series(Start=2, Step=1, Count=lng_2)
Z_4 = UnitZ(Factor=1)
concat_2 = Concatenate(FragmentA="b", FragmentB=series_2)
beam_3 = GhPythonScript(centerline=crv_4, guide_vector=Z_4, width=beam_width_3, height=beam_height_3, name=concat_2)  # -> out, beam, assembly, uncut_mesh; inputs centerline: Line, guide_vector: Vector3d; same code as beam

xy_2 = XYPlane(Origin=pt_6)
xy_3 = XYPlane(Origin=pt_7)
crv_5 = Curve([ln, ln_2])
project_3 = Project(Geometry=pcx_3.Points, Plane=xy_2)  # -> Geometry, Transform
project_4 = Project(Geometry=pcx_4.Points, Plane=xy_2)  # -> Geometry, Transform
project_5 = Project(Geometry=pcx_3.Points, Plane=xy_3)  # -> Geometry, Transform
project_6 = Project(Geometry=pcx_4.Points, Plane=xy_3)  # -> Geometry, Transform
flip_2 = FlipMatrix(Data=[project_5.Geometry, project_6.Geometry])
secondary_beam_extension_2 = Slider(180, range=0..1000)
secondary_beam_move_up_3 = Slider(50, range=0..100)
pline = PolyLine(Vertices=[project_4.Geometry, project_3.Geometry], Closed=False)
pline_2 = PolyLine(Vertices=flip_2, Closed=False)
Z_5 = UnitZ(Factor=1)
Z_6 = UnitZ(Factor=1)
sil_crv = Curve(flatten([pline, pline_2]))
ext_4 = ExtendCurve(Curve=ln_5, Type=0, Start=secondary_beam_extension_2, End=secondary_beam_extension_2)
Z_7 = UnitZ(Factor=secondary_beam_move_up_3)
move_2 = Move(Geometry=ext_4, Motion=Z_7)  # -> Geometry, Transform
crv_6 = Curve(move_2.Geometry)
divide = DivideCurve(Curve=crv_6, Count=Slider(8, range=0..20), Kinks=False)  # -> Points, Tangents, Parameters
panel = Panel("""1
0
0""")
panel_2 = Panel("""0
0
1""")
flip_3 = FlipMatrix(Data=divide.Points)
lng_3 = ListLength(List=flip_3)  # -> flatten(Length)
python = GhPythonScript(lengths=lng_3)  # -> out, a; inputs lengths: list
# ---------- python: Python ----------
if lengths[0] == 2:
    pattern = [[2]]

elif lengths[0] == 3:
    pattern = [[3]]

elif lengths[0] == 4:
    pattern = [[2,2]]

elif lengths[0] == 5:
    pattern = [[2,3],
               [3,2]]

elif lengths[0] == 6:
    pattern = [[2,2,2],
               [3,3]]

elif lengths[0] == 7:
#    pattern = [[2,2,3],
#               [2,3,2],
#               [3,2,2]]
    pattern = [[2,2,3],
               [3,2,2]]
               

elif lengths[0] == 8:
#    pattern = [[2,3,3],
#               [3,2,3],
#               [3,3,2]]
    pattern = [[2,3,3],
               [3,3,2]]

elif lengths[0] == 9:
    pattern = [[2,2,2,3],
               [2,2,3,2],
               [2,3,2,2],
               [3,2,2,2]]

elif lengths[0] == 10:
    pattern = [[2,3,2,3],
               [3,2,3,2]]
               
import ghpythonlib.treehelpers as th

import Rhino

layerTree = [list() for _ in lengths]

for i in range(len(lengths)):
    layerTree[i].extend(pattern[i % len(pattern)])

layerTree = th.list_to_tree(layerTree, source=[0,0])
a = layerTree
# ---------- end python ----------
basic_assembly_preview = GhPythonScript(assembly=beam.assembly)  # -> out, beam_mesh_prev; inputs beam_ids: list
# ---------- basic_assembly_preview: Python ----------
from compas_ghpython.artists import MeshArtist

beam_mesh_prev = []
if beam_ids == []:
    beam_ids = assembly.beam_ids()
    
for beam_id in beam_ids:
    beam = assembly.beam(beam_id)
    beam_mesh_prev.append(MeshArtist(beam.cached_mesh).draw())
# ---------- end basic_assembly_preview ----------
basic_assembly_preview_2 = GhPythonScript(assembly=beam_2.assembly)  # -> out, beam_mesh_prev; inputs beam_ids: list; same code as basic_assembly_preview
basic_assembly_preview_3 = GhPythonScript(assembly=beam_3.assembly)  # -> out, beam_mesh_prev; inputs beam_ids: list; same code as basic_assembly_preview
ma = MassAddition(Input=python.a)  # -> Result, simplify(PartialResults)
subtraction = Subtraction(A=ma.PartialResults, B=python.a)  # -> simplify(Result)
subtraction_2 = Subtraction(A=ma.PartialResults, B=1)  # -> simplify(Result)
item_3 = ListItem(List=flip_3, Index=subtraction, Wrap=True)
item_4 = ListItem(List=flip_3, Index=subtraction_2, Wrap=True)
ln_6 = Line(StartPoint=item_3, EndPoint=item_4)
crv_7 = Curve(flatten(ln_6))
panel_3 = Panel("""0
1
2""")
cull_i = CullIndex(List=flip_3, Indices=graft(panel_3), Wrap=True)
cull = CullPattern(List=cull_i, CullPattern=panel)
cull_2 = CullPattern(List=cull_i, CullPattern=panel_2)
ln_7 = Line(StartPoint=cull, EndPoint=cull_2)
panel_4 = Panel(subtraction)
number_slider = Slider(0, range=0..10)  # disabled
number_slider_2 = Slider(0, range=0..1)  # disabled
item_5 = ListItem(List=beam_3.beam, Index=number_slider, Wrap=True)  # disabled
item_6 = ListItem(List=beam.beam, Index=number_slider_2, Wrap=True)  # disabled

number_slider_3 = Slider(70, range=0..100)  # disabled
join_2_2_nonplanarlap = GhPythonScript(beam_move=item_5, beam_stay=item_6, joint_thickness=number_slider_3)  # -> out, assembly, joint1_mesh, joint2_mesh, test; disabled
# ---------- join_2_2_nonplanarlap: Python ----------
from compas_ghpython import unload_modules
unload_modules('integral_timber_joints')
from integral_timber_joints.assembly import Assembly
from integral_timber_joints.geometry import non_planar_lap_joint_from_beam_beam_intersection

assembly = Assembly()
assembly.add_beam(beam_move)
assembly.add_beam(beam_stay)

joint_m, joint_s = non_planar_lap_joint_from_beam_beam_intersection(beam_move, beam_stay, joint_thickness)

assembly.add_joint_pair(joint_m, joint_s, beam_move.name, beam_stay.name)

from compas_ghpython.artists import MeshArtist

joint1_mesh = [MeshArtist(mesh).draw() for mesh in joint_m.get_feature_meshes(assembly.beam(beam_move.name))]
joint2_mesh = [MeshArtist(mesh).draw() for mesh in joint_s.get_feature_meshes(assembly.beam(beam_stay.name))]

assembly.update_beam_mesh_with_joints(beam_move.name, True)
assembly.update_beam_mesh_with_joints(beam_stay.name, True)

#
#
#try:
#    assembly.update_beam_mesh_with_joints(beam_move.name, True)
#except:
#    print("beam_move mesh update fail")
#
#try:
#    assembly.update_beam_mesh_with_joints(beam_stay.name, True)
#except:
#    print("beam_stay mesh update fail")
# ---------- end join_2_2_nonplanarlap ----------
basic_assembly_preview_4 = GhPythonScript(assembly=join_2_2_nonplanarlap.assembly)  # -> out, beam_mesh_prev; inputs beam_ids: list; disabled; same code as basic_assembly_preview
swatch = ColourSwatch(SwatchColor=RGBA(0, 255, 204, 148))  # disabled
preview = CustomPreview(Material=swatch)  # disabled

crv_8 = Curve(flatten(crv_7))
main_beam_extension_2 = Slider(300, range=0..1000)
lng_4 = ListLength(List=crv_8)
beam_width_4 = Slider(100, range=0..200)
beam_height_4 = Slider(100, range=0..200)
series_3 = Series(Start=0, Step=1, Count=lng_4)
X_2 = UnitX(Factor=1)
concat_3 = Concatenate(FragmentA="p", FragmentB=series_3)

move_3 = Move(Geometry=crv_8, Motion=Z_2)  # -> Geometry, Transform

crv_9 = Curve(flatten(sil_crv))
column_extension_2 = Slider(300, range=0..1000)
ext_5 = ExtendCurve(Curve=crv_9, Type=0, Start=column_extension_2, End=column_extension_2)
lng_5 = ListLength(List=crv_9)
beam_width_5 = Slider(100, range=0..200)
beam_height_5 = Slider(140, range=0..200)
series_4 = Series(Start=0, Step=1, Count=lng_5)
concat_4 = Concatenate(FragmentA="s", FragmentB=series_4)

end = EndPoints(Curve=ext_5)  # -> Start, End
ln_8 = Line(StartPoint=end.Start, EndPoint=end.End)
line = Line(ln_8)

beam_4 = GhPythonScript(centerline=line, guide_vector=Z_6, width=beam_width_5, height=beam_height_5, name=concat_4)  # -> out, beam, assembly, uncut_mesh; inputs centerline: Line, guide_vector: Vector3d; same code as beam

basic_assembly_preview_5 = GhPythonScript(assembly=beam_4.assembly)  # -> out, beam_mesh_prev; inputs beam_ids: list; same code as basic_assembly_preview

ext_6 = ExtendCurve(Curve=move_3.Geometry, Type=0, Start=main_beam_extension_2, End=main_beam_extension_2)

end_2 = EndPoints(Curve=ext_6)  # -> Start, End
ln_9 = Line(StartPoint=end_2.Start, EndPoint=end_2.End)
line_2 = Line(ln_9)

beam_5 = GhPythonScript(centerline=line_2, guide_vector=Z_5, width=beam_width_4, height=beam_height_4, name=concat_3)  # -> out, beam, assembly, uncut_mesh; inputs centerline: Line, guide_vector: Vector3d; same code as beam

basic_assembly_preview_6 = GhPythonScript(assembly=beam_5.assembly)  # -> out, beam_mesh_prev; inputs beam_ids: list; same code as basic_assembly_preview

number_slider_4 = Slider(4, range=0..10)  # disabled
number_slider_5 = Slider(6, range=0..10)  # disabled
split = SplitList(List=beam_5.beam, Index=number_slider_5)  # -> ListA, ListB; disabled
assembly = GhPythonScript(beams=flatten([beam.beam, beam_3.beam, beam_2.beam, beam_4.beam]))  # -> out, assembly_out, a; inputs beams: list; disabled
# ---------- assembly: Python ----------
from compas_rhino.geometry import RhinoMesh, RhinoPlane

from integral_timber_joints.geometry import Beam
from integral_timber_joints.assembly import Assembly
from copy import deepcopy


if assembly is None:
    assembly_out = Assembly()
else:
    assembly_out = deepcopy(assembly)

for beam in beams:
    assembly_out.add_beam(beam)
#    assembly_out.update_beam_mesh_with_joints(beam.name, True)
# ---------- end assembly ----------
number_slider_6 = Slider(3, range=0..10)  # disabled
number_slider_7 = Slider(50, range=0..100)  # disabled
crossref = CrossReference(ListA=beam.beam, ListB=beam_3.beam, CrossMode=1)  # -> ListA, ListB; disabled
number_slider_8 = Slider(70, range=0..100)  # disabled
crossref_2 = CrossReference(ListA=beam.beam, ListB=beam_2.beam, CrossMode=1)  # -> ListA, ListB; disabled
crossref_3 = CrossReference(ListA=beam_2.beam, ListB=beam_4.beam, CrossMode=1)  # -> ListA, ListB; disabled
toggle = BooleanToggle(True)  # disabled
item_7 = ListItem(List=beam_5.beam, Index=number_slider_4, Wrap=True)  # disabled
toggle_2 = BooleanToggle(True)  # disabled
crossref_4 = CrossReference(ListA=beam_3.beam, ListB=split.ListA, CrossMode=1)  # -> ListA, ListB; disabled
item_8 = ListItem(List=beam_3.beam, Index=number_slider_6, Wrap=True)  # disabled
number_slider_9 = Slider(50, range=0..100)  # disabled
number_slider_10 = Slider(65, range=0..100)  # disabled
toggle_3 = BooleanToggle(True)  # disabled
toggle_4 = BooleanToggle(True)  # disabled
assembly_2 = GhPythonScript()  # -> out, assembly_out, a; inputs beams: list; disabled; same code as assembly
auto_lap_joint = GhPythonScript(m_beams=crossref_4.ListB, s_beams=crossref_4.ListA, joint_thickness=number_slider_8, has_screw=toggle)  # -> out, assembly_out; inputs m_beams: list, s_beams: list; disabled
# ---------- auto_lap_joint: Python ----------
from compas_rhino.geometry import RhinoMesh, RhinoPlane
from integral_timber_joints.geometry import non_planar_lap_joint_from_beam_beam_intersection, Joint_halflap_from_beam_beam_intersection
from integral_timber_joints.geometry import Beam
from integral_timber_joints.assembly import Assembly
from copy import deepcopy

assert len(m_beams) == len(s_beams)

if assembly is None:
    assembly_out = Assembly()
else:
    assembly_out = deepcopy(assembly)

for beam in m_beams + s_beams:
    if beam.name not in assembly_out.beam_ids():
        assembly_out.add_beam(beam)
        print ("Beam (%s) Added to assembly" % beam.name)

for i in range (len(m_beams)):
    m_beam = m_beams[i]
    s_beam = s_beams[i]
    # Skip Self intersection
    if m_beam.name == s_beam.name:
        continue
    # Find joint and add it to assembly
    joint_m, joint_s = Joint_halflap_from_beam_beam_intersection(m_beam, s_beam)
    if joint_m is not None and joint_s is not None:
        joint_m.has_screw = has_screw
        joint_s.has_screw = has_screw
        assembly_out.add_joint_pair(joint_m, joint_s, m_beam.name, s_beam.name)
        print ("Planar Lap Joint added for Beam(%s-%s)" % (m_beam.name, s_beam.name))
        continue
        
    joint_m, joint_s = non_planar_lap_joint_from_beam_beam_intersection(m_beam, s_beam, joint_thickness)
    if joint_m is not None and joint_s is not None:
        joint_m.has_screw = has_screw
        joint_s.has_screw = has_screw
        assembly_out.add_joint_pair(joint_m, joint_s, m_beam.name, s_beam.name)
        print ("Non Planar Lap Joint added for Beam(%s-%s)" % (m_beam.name, s_beam.name))
        continue
# ---------- end auto_lap_joint ----------
np_lap = GhPythonScript(
    assembly=assembly.assembly_out,
    m_beams=crossref.ListB,
    s_beams=crossref.ListA,
    joint_thickness=number_slider_10,
    has_screw=toggle_3)  # -> out, assembly_out; inputs m_beams: list, s_beams: list, has_screw: Boolean; disabled
# ---------- np_lap: Python ----------
from compas_rhino.geometry import RhinoMesh, RhinoPlane
from integral_timber_joints.geometry import non_planar_lap_joint_from_beam_beam_intersection
from integral_timber_joints.geometry import Beam
from integral_timber_joints.assembly import Assembly
from copy import deepcopy

assert len(m_beams) == len(s_beams)

if assembly is None:
    assembly_out = Assembly()
else:
    assembly_out = deepcopy(assembly)

for beam in m_beams + s_beams:
    if beam.name not in assembly_out.beam_ids():
        assembly_out.add_beam(beam)
        print ("Beam (%s) Added to assembly" % beam.name)

for i in range (len(m_beams)):
    m_beam = m_beams[i]
    s_beam = s_beams[i]
    # Skip Self intersection
    if m_beam.name == s_beam.name:
        continue
    # Find joint and add it to assembly
    joint_m, joint_s = non_planar_lap_joint_from_beam_beam_intersection(m_beam, s_beam, joint_thickness)

    if joint_m is not None and joint_s is not None:
        joint_m.has_screw = has_screw
        joint_s.has_screw = has_screw
        assembly_out.add_joint_pair(joint_m, joint_s, m_beam.name, s_beam.name)
        print ("Joint added for Beam(%s-%s)" % (m_beam.name, s_beam.name))
# ---------- end np_lap ----------
auto_lap_joint_2 = GhPythonScript(
    assembly=np_lap.assembly_out,
    m_beams=crossref_2.ListA,
    s_beams=crossref_2.ListB,
    joint_thickness=number_slider_9,
    has_screw=toggle_4)  # -> out, assembly_out; inputs m_beams: list, s_beams: list; disabled
# ---------- auto_lap_joint_2: Python ----------
from compas_rhino.geometry import RhinoMesh, RhinoPlane
from integral_timber_joints.geometry import non_planar_lap_joint_from_beam_beam_intersection, Joint_halflap_from_beam_beam_intersection
from integral_timber_joints.geometry import Beam
from integral_timber_joints.assembly import Assembly
from copy import deepcopy

assert len(m_beams) == len(s_beams)

if assembly is None:
    assembly_out = Assembly()
else:
    assembly_out = deepcopy(assembly)

for beam in m_beams + s_beams:
    if beam.name not in assembly_out.beam_ids():
        assembly_out.add_beam(beam)
        print ("Beam (%s) Added to assembly" % beam.name)

for i in range (len(m_beams)):
    m_beam = m_beams[i]
    s_beam = s_beams[i]
    # Skip Self intersection
    if m_beam.name == s_beam.name:
        continue
    # Find joint and add it to assembly
    joint_m, joint_s = Joint_halflap_from_beam_beam_intersection(m_beam, s_beam)
    if joint_m is not None and joint_s is not None:
        joint_m.has_screw = has_screw
        joint_m.screw_head_side = True
        joint_s.has_screw = has_screw
        joint_s.screw_head_side = False
        assembly_out.add_joint_pair(joint_m, joint_s, m_beam.name, s_beam.name)
        print ("Planar Lap Joint added for Beam(%s-%s)" % (m_beam.name, s_beam.name))
        continue
        
    joint_m, joint_s = non_planar_lap_joint_from_beam_beam_intersection(m_beam, s_beam, joint_thickness)
    if joint_m is not None and joint_s is not None:
        joint_m.has_screw = has_screw
        joint_s.has_screw = has_screw
        assembly_out.add_joint_pair(joint_m, joint_s, m_beam.name, s_beam.name)
        print ("Non Planar Lap Joint added for Beam(%s-%s)" % (m_beam.name, s_beam.name))
        continue
# ---------- end auto_lap_joint_2 ----------
auto_lap_joint_3 = GhPythonScript(
    assembly=auto_lap_joint_2.assembly_out,
    m_beams=crossref_3.ListA,
    s_beams=crossref_3.ListB,
    joint_thickness=number_slider_7,
    has_screw=toggle_2)  # -> out, assembly_out; inputs m_beams: list, s_beams: list; disabled; same code as auto_lap_joint
basic_assembly_preview_7 = GhPythonScript(assembly=auto_lap_joint.assembly_out)  # -> out, beam_mesh_prev; inputs beam_ids: list; disabled
# ---------- basic_assembly_preview_7: Python ----------
from compas_ghpython.utilities import draw_mesh

beam_mesh_prev = []

if not beam_ids:
    beam_ids = assembly.beam_ids()
    
for beam_id in beam_ids:
    beam = assembly.beam(beam_id)
    try:
        assembly.update_beam_mesh_with_joints(beam_id)
        beam_mesh_prev.append(draw_mesh(* beam.cached_mesh.to_vertices_and_faces()))
    except:
        print ("Beam (%s) fail to create visualization" % beam_id)
# ---------- end basic_assembly_preview_7 ----------
basic_assembly_preview_8 = GhPythonScript(assembly=auto_lap_joint_3.assembly_out)  # -> out, error, beam_mesh_prev; inputs beam_ids: list; disabled
# ---------- basic_assembly_preview_8: Python ----------
from compas_ghpython.utilities import draw_mesh

beam_mesh_prev = []

if not beam_ids:
    beam_ids = assembly.beam_ids()

error = []
for beam_id in beam_ids:
    beam = assembly.beam(beam_id)
    try:
        assembly.update_beam_mesh_with_joints(beam_id)
        beam_mesh_prev.append(draw_mesh(* beam.cached_mesh.to_vertices_and_faces()))
    except:
        error.append("Beam (%s) fail to create visualization" % beam_id)
# ---------- end basic_assembly_preview_8 ----------
unweld = UnweldMesh(Mesh=basic_assembly_preview_7.beam_mesh_prev, Angle=0.01)  # disabled
panel_5 = Panel(basic_assembly_preview_7.out)  # disabled
swatch_2 = ColourSwatch(SwatchColor=RGB(176, 136, 84))  # disabled
unweld_2 = UnweldMesh(Mesh=basic_assembly_preview_8.beam_mesh_prev, Angle=0.01)  # disabled
panel_6 = Panel(basic_assembly_preview_8.error)  # disabled
preview_2 = CustomPreview(Geometry=unweld_2, Material=swatch_2)  # disabled
join_2_2_nonplanarlap_2 = GhPythonScript()  # -> out, assembly, joint1_mesh, joint2_mesh, test; inputs has_screw: Boolean; disabled
# ---------- join_2_2_nonplanarlap_2: Python ----------
from compas_ghpython import unload_modules
unload_modules('integral_timber_joints')
from integral_timber_joints.assembly import Assembly
from integral_timber_joints.geometry import non_planar_lap_joint_from_beam_beam_intersection

from copy import deepcopy
beam_move = deepcopy(beam_move)
beam_stay = deepcopy(beam_stay)

assembly = Assembly()
assembly.add_beam(beam_move)
assembly.add_beam(beam_stay)

joint_m, joint_s = non_planar_lap_joint_from_beam_beam_intersection(beam_move, beam_stay, joint_thickness)
joint_m.has_screw = has_screw
joint_s.has_screw = has_screw

assembly.add_joint_pair(joint_m, joint_s, beam_move.name, beam_stay.name)

from compas_ghpython.artists import MeshArtist

joint1_mesh = [MeshArtist(mesh).draw() for mesh in joint_m.get_feature_meshes(assembly.beam(beam_move.name))]
joint2_mesh = [MeshArtist(mesh).draw() for mesh in joint_s.get_feature_meshes(assembly.beam(beam_stay.name))]
try:
    assembly.update_beam_mesh_with_joints(beam_move.name, True)
    assembly.update_beam_mesh_with_joints(beam_stay.name, True)
except:
    pass
# ---------- end join_2_2_nonplanarlap_2 ----------
