# Grasshopper definition igps_points_RFL_ITJ.gh (Grasshopper 1.0.7)

platform_and_tool_storage = Panel("""25340.073;7141.085;580.501
25380.246;7126.724;580.548
25380.246;7126.724;580.548
25299.982;7134.495;580.567
25385.232;7121.534;548.132
25385.232;7121.534;548.132
25294.208;7121.634;549.030
25294.227;7121.647;549.052
25201.884;7256.117;556.118
25240.806;7266.567;580.917
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""")
python = PythonScript(str_list=platform_and_tool_storage)  # -> points; inputs str_list: list
# ---------- python: Python ----------
import Rhino.Geometry as rg

points = []

for line in str_list:
    values = line.split(";")
    
    pt = rg.Point3d( float(values[0]), float(values[1]), float(values[2]) )
    
    if pt.X != 0.0 and pt.Y != 0.0 and pt.Z != 0.0:
        points.append(pt)
# ---------- end python ----------
points = Data(python)
ghpython_script = GhPythonScript(igps_points=points)  # -> robotworld_points; inputs igps_points: list of Point3d
# ---------- ghpython_script: Python ----------
import compas.geometry as cg
import ghpythonlib.components as ghcomp
import Rhino.Geometry as rg
from compas_ghpython import draw_frame



# iGPS world - Robot worls offsets
robot_11_igps_wobj0 = ((-2614.766, -2058.444, 29.420), (1.0, -0.000028, 0.000047, -0.000034))
robot_12_igps_wobj0 = ((-2609.441, -2057.051, 28.106), (1.0, -0.000026, -0.000042, 0.000059))


def transf(obj, rg_T, cg_T):
    if isinstance(obj, rg.Plane):
        return ghcomp.Transform(obj, rg_T)

    elif isinstance(obj, rg.Brep):
        return ghcomp.Transform(obj, rg_T)

    elif isinstance(obj, rg.Mesh):
        return ghcomp.Transform(obj, rg_T)

    elif isinstance(obj, rg.Point3d):
        return ghcomp.Transform(obj, rg_T)

    elif "compas" in str(type(obj)):
        return obj.transformed(cg_T)

    else:
        raise NotImplementedError


def iGPSWorld_to_RobotWorld(obj, robot="robot_11"):

    if robot == "robot_11":
        robot_igps_wobj0 = robot_11_igps_wobj0
    elif robot == "robot_12":
        robot_igps_wobj0 = robot_12_igps_wobj0
    else:
        raise NotImplementedError

    # iGPSworld to RobotWorld transformation
    rg_iGPS_to_robot_world_vector = rg.Vector3d(*robot_igps_wobj0[0])
    
    
    
    
    to_frame = cg.Frame.from_quaternion(robot_11_igps_wobj0[1], point=robot_11_igps_wobj0[0])
    to_plane = draw_frame(to_frame)
    
    rg_iGPS_to_robot_world_T = rg.Transform.PlaneToPlane(rg.Plane.WorldXY, to_plane)
    
    cg_iGPS_to_robot_world_T = None
    """
    cg_iGPS_to_robot_world_T = cg.Transformation.from_matrix([
        [1, 0, 0, rg_iGPS_to_robot_world_vector.X],
        [0, 1, 0, rg_iGPS_to_robot_world_vector.Y],
        [0, 0, 1, rg_iGPS_to_robot_world_vector.Z],
        [0, 0, 0, 1]])
        """

    if isinstance(obj, list):
        # print " --- iGPSWorld_to_RobotWorld for list"
        return [transf(item, rg_iGPS_to_robot_world_T, cg_iGPS_to_robot_world_T) for item in obj]
    elif obj is None:
        # print " --- iGPSWorld_to_RobotWorld for none"
        return None
    else:
        # print " --- iGPSWorld_to_RobotWorld for single object"
        return transf(obj, rg_iGPS_to_robot_world_T, cg_iGPS_to_robot_world_T)


def RobotWorld_to_iGPSWorld(obj, robot="robot_11"):

    if robot == "robot_11":
        robot_igps_wobj0 = robot_11_igps_wobj0
    elif robot == "robot_12":
        robot_igps_wobj0 = robot_12_igps_wobj0
    else:
        raise NotImplementedError

    # RobotWorld to iGPSworld transformation
    rg_robot_world_to_iGPS_vector = -rg.Vector3d(*robot_igps_wobj0[0])
    rg_robot_to_igps_world_T = rg.Transform.Translation(rg_robot_world_to_iGPS_vector)
    cg_robot_to_igps_world_T = cg.Transformation.from_matrix(
        [[1, 0, 0, rg_robot_world_to_iGPS_vector.X],
         [0, 1, 0, rg_robot_world_to_iGPS_vector.Y],
         [0, 0, 1, rg_robot_world_to_iGPS_vector.Z],
         [0, 0, 0, 1]])

    if isinstance(obj, list):
        # print " --- RobotWorld to iGPSworld for list"
        return [transf(item, rg_robot_to_igps_world_T, cg_robot_to_igps_world_T) for item in obj]
    elif obj is None:
        # print " --- RobotWorld to iGPSworld for none"
        return None
    else:
        # print " --- RobotWorld to iGPSworld for single object"
        return transf(obj, rg_robot_to_igps_world_T, cg_robot_to_igps_world_T)



robotworld_points = iGPSWorld_to_RobotWorld(igps_points)
# ---------- end ghpython_script ----------
data = Data(ghpython_script)
