# Grasshopper definition BakeConfigurationFK.gh (Grasshopper 1.0.7)
# plug-ins: Human

panel = Panel("C:\Users\leungp\Documents\GitHub\integral_timber_joints\external")

panel_2 = Panel("C:\Users\harry\Dropbox (MIT)\code_ws_dropbox\itj_ws\integral_timber_joints\external\itj_design_study\210128_RemodelFredPavilion\YJ_tmp\pavilion_process.json")

# ----
# Development Tools
# Reload Python Modules (if Module Code is Changed)
python_module_to_reload = Panel("""compas
compas_fab
roslibpy
integral_timber_joints""")
reload = Button()
py = PythonScript(reload_module_button=reload, module_names=python_module_to_reload)  # inputs module_names: list
# ---------- py: Python ----------
import compas_ghpython
from compas_ghpython import unload_modules
if reload_module_button:
    for module in module_names:
        unload_modules(module)
# ---------- end py ----------

# ----
# Check Path and Environment
compas_version = GhPythonScript()  # -> out, compas_version, compas_fab_version, compas_path, compas_fab_path, compas_env_name, python_directory
# ---------- compas_version: Python ----------
__author__ = "leungp"
__version__ = "2020.04.20"

import rhinoscriptsyntax as rs
import compas
import compas_fab
compas_version  = compas.__version__
compas_fab_version = compas_fab.__version__
import os
compas_path = os.path.abspath(compas.__file__)
compas_fab_path = os.path.abspath(compas_fab.__file__)

import compas_bootstrapper
compas_env_name = compas_bootstrapper.ENVIRONMENT_NAME
python_directory = compas_bootstrapper.PYTHON_DIRECTORY
# ---------- end compas_version ----------
compas_environment_name = Panel(compas_version.compas_env_name)
compas_version_2 = Panel(compas_version.compas_version)
compas_fab_version = Panel(compas_version.compas_fab_version)
compas_path = Panel(compas_version.compas_path)
compas_fab_path = Panel(compas_version.compas_fab_path)
python_directory = Panel(compas_version.python_directory)

panel_3 = Panel("C:\Users\leungp\Documents\GitHub\integral_timber_joints\external")

# ----
# Load config from saved file
rhino_doc_dir = RhinoDocDir()  # -> rhino_doc_dir
# ---------- rhino_doc_dir: Python ----------
import scriptcontext as sc
from os import path

rhino_doc_dir = path.abspath(path.dirname(sc.doc.Path))
# ---------- end rhino_doc_dir ----------
list = ValueList({"c1_CL3_storage_configuration", "c2_CL3_storage_configuration", "c3_CL3M_storage_configuration", "c4_CL3M_storage_configuration", "g1_PG500_storage_configuration", "g2_PG1000_storage_configuration", "g3_PG1500_storage_configuration", "s1_SL1_storage_configuration", "s2_SL1_storage_configuration", "s3_SL1_storage_configuration", "s4_SL1_G200_storage_configuration", "g1_PG500_pickup_configuration", "g2_PG1000_pickup_configuration", "g3_PG1500_pickup_configuration"}, selected="g3_PG1500_pickup_configuration")
ghpython_script = GhPythonScript(current_path=rhino_doc_dir)  # -> out, path
# ---------- ghpython_script: Python ----------
import os

path = os.path.abspath(os.path.join(current_path, '..', '..', 'external',))
# ---------- end ghpython_script ----------
D = Concatenate(FragmentA=rhino_doc_dir, FragmentB="\", FragmentC=list, FragmentD=".json")
python = GhPythonScript(path=D)  # -> out, configuration
# ---------- python: Python ----------
import json
from compas.utilities.encoders import DataDecoder
with open(path, 'r') as f:
    configuration = json.load(f, cls=DataDecoder)
    print (configuration)
# ---------- end python ----------
panel_4 = Panel(D)

# ---- group: Config in meters
# Configuration (meter rad)
ea_z = Slider(-2.68, range=-5..-1.7)
ea_y = Slider(-5.42, range=-9.5..0)
gantry_x = Slider(19.28, range=0..40)
panel_5 = Panel("""2,bridge1_joint_EA_X
2,robot11_joint_EA_Y
2,robot11_joint_EA_Z
0,robot11_joint_1
0,robot11_joint_2
0,robot11_joint_3
0,robot11_joint_4
0,robot11_joint_5
0,robot11_joint_6""")
a4 = Slider(0, range=-6.98..6.98)
a5 = Slider(0, range=-2.18..2.18)
a2 = Slider(-0.872665, range=-1.57..2.61)
a3 = Slider(0.872665, range=-3.14..1.3)
a1 = Slider(0, range=-3.14..3.14)
a6 = Slider(0, range=-6.98..6.98)
merge = Merge(
    Data1=flatten(gantry_x),
    Data2=flatten(ea_y),
    Data3=flatten(ea_z),
    Data4=flatten(a1),
    Data5=flatten(a2),
    Data6=flatten(a3),
    Data7=flatten(a4),
    Data8=flatten(a5),
    Data9=flatten(a6))
ghpython_script_2 = GhPythonScript(joint_type_names=panel_5, joint_values=merge)  # -> out, new_config; inputs joint_type_names: list, joint_values: list
# ---------- ghpython_script_2: Python ----------
from compas.robots import Configuration

joint_types= [int(str.split(',')[0]) for str in joint_type_names]
joint_names= [str.split(',')[1] for str in joint_type_names]


new_config = Configuration(joint_values, joint_types, joint_names)
print(new_config)
# ---------- end ghpython_script_2 ----------

# ----
# Robot
load_robot = Button()
ghpython_script_3 = PythonScript(load=load_robot, pkg_path=panel, pkg_name="rfl_description", urdf_file="rfl_pybullet.urdf", srdf_file="rfl.srdf")  # -> out, robot, configuration_in_m_deg
# ---------- ghpython_script_3: Python ----------
from scriptcontext import sticky as st
import os
import compas

from compas.robots import RobotModel
from compas.robots import GithubPackageMeshLoader
from compas.robots import LocalPackageMeshLoader
from compas_fab.robots import Robot
from compas_fab.robots import RobotSemantics
from compas_ghpython.artists import RobotModelArtist

# Robot meshes are usually in meters
# Set a high percision to prevent parsing errors
# and configure Rhino itself in meters
compas.PRECISION = '12f'

# Store robot in component-based key
robot_key = 'robot_{}'.format(str(ghenv.Component.InstanceGuid))

if robot_key not in st:
    st[robot_key] = None

if load:
    # Also load geometry
    loader = LocalPackageMeshLoader(os.path.join(pkg_path, 'rfl_description'), pkg_name)
    abb_loader = LocalPackageMeshLoader(os.path.join(pkg_path), "abb_irb4600_40_255")
    
    # Create robot model from URDF
    model = RobotModel.from_urdf_string(loader.load_urdf(urdf_file).read())
    model.load_geometry(loader, abb_loader)

    artist = RobotModelArtist(model)
    robot_semantics = None
    if srdf_file:
        robot_semantics = RobotSemantics.from_srdf_file(loader.build_path('urdf', srdf_file), model)
    
    robot = Robot(model, artist, semantics=robot_semantics)
    robot.scale(1000)
    st[robot_key] = robot

robot = st[robot_key]
configuration_in_m_deg = robot.zero_configuration().scaled(0.001)



#repo    = 'ros-industrial/abb'
#package = 'abb_irb6600_support'
#branch  = 'kinetic-devel'
#
#github = GithubPackageMeshLoader(repo, package, branch)
#
#model = RobotModel.from_urdf_file(github.load_urdf('irb6640.urdf'))
#model.load_geometry(github)
#artist = RobotModelArtist(model)
#robot = Robot(model, artist)
# ---------- end ghpython_script_3 ----------
robot = Data(ghpython_script_3.robot)

# ----
# converter
number_slider = Slider(50, range=0..100)
rad = Radians(Degrees=number_slider)
radians = Panel(rad)

# ----
# Robot
load_robot_2 = Button()
ghpython_script_4 = PythonScript(load=load_robot_2, pkg_path=panel_3, pkg_name="rfl_description", urdf_file="rfl_pybullet.urdf", srdf_file="rfl.srdf")  # -> out, robot, configuration_in_m_deg; same code as ghpython_script_3
robot_2 = Data(ghpython_script_4.robot)

# ----
# FK Frame from URDF
panel_6 = Panel("robot11")
fk = GhPythonScript(robot=robot_2, configuration=ghpython_script_2.new_config, group=panel_6)  # -> out, ee_frame
# ---------- fk: Python ----------
print (configuration)
ee_frame = robot.forward_kinematics(configuration.scaled(1000), group)

print (ee_frame)

from compas_ghpython import draw_frame
ee_frame = draw_frame(ee_frame)
# ---------- end fk ----------
scale = Scale(Geometry=fk.ee_frame, Center=Point(0, 0, 0), Factor=Slider(0.001, range=0..0.001))  # -> Geometry, Transform

# ----
# Bake FK Frame as two lines
pln_robot_frame = Plane(scale.Geometry)
bake = Button()
pdecon = Deconstruct(Point=pln_robot_frame)  # -> XComponent, YComponent, ZComponent
deplane = DeconstructPlane(Plane=pln_robot_frame)  # -> Origin, XAxis, YAxis, ZAxis
merge_2 = Merge(Data1=deplane.XAxis, Data2=deplane.YAxis)
panel_7 = Panel("""x
y""")
line = LineSDL(Start=deplane.Origin, Direction=merge_2, Length=50)
createatts = CreateAttributes(Name=panel_7, LayerName="ToolStorage::FKFrames", enableFullPath=True)
bake_2 = BakeGeometry(Bake=bake, Geometry=line, Attributes=createatts, DeleteOldBakes=False, PreserveTrees=False)

# ----
# FK Frame from URDF
panel_8 = Panel("robot11")
fk_2 = GhPythonScript(robot=robot, configuration=python.configuration, group=panel_8)  # -> out, ee_frame; same code as fk
scale_2 = Scale(Geometry=fk_2.ee_frame, Center=Point(0, 0, 0), Factor=Slider(0.001, range=0..0.001))  # -> Geometry, Transform

# ----
# Bake FK Frame as two lines
pln_robot_frame_2 = Plane(scale_2.Geometry)
bake_3 = Button()
pdecon_2 = Deconstruct(Point=pln_robot_frame_2)  # -> XComponent, YComponent, ZComponent
deplane_2 = DeconstructPlane(Plane=pln_robot_frame_2)  # -> Origin, XAxis, YAxis, ZAxis
merge_3 = Merge(Data1=deplane_2.XAxis, Data2=deplane_2.YAxis)
panel_9 = Panel("""x
y""")
line_2 = LineSDL(Start=deplane_2.Origin, Direction=merge_3, Length=50)
createatts_2 = CreateAttributes(Name=panel_9, LayerName="ToolStorage::FKFrames", enableFullPath=True)
bake_4 = BakeGeometry(Bake=bake_3, Geometry=line_2, Attributes=createatts_2, DeleteOldBakes=False, PreserveTrees=False)

# ---- group: Config in meters
# Configuration (meter rad)
ea_z_2 = Slider(-4.849, range=-5..-1.7)  # disabled
ea_y_2 = Slider(-12, range=-12..0)  # disabled
a5_2 = Slider(0, range=-2.18..2.18)  # disabled
a4_2 = Slider(0, range=-6.98..6.98)  # disabled
a3_2 = Slider(1.134, range=-3.14..1.3)  # disabled
a2_2 = Slider(-1.134, range=-1.57..2.61)  # disabled
a1_2 = Slider(0, range=-3.14..3.14)  # disabled
a6_2 = Slider(0, range=-6.98..6.98)  # disabled
panel_10 = Panel("""2,robot12_joint_EA_Y
2,robot12_joint_EA_Z
0,robot12_joint_1
0,robot12_joint_2
0,robot12_joint_3
0,robot12_joint_4
0,robot12_joint_5
0,robot12_joint_6""")  # disabled
merge_4 = Merge(Data1=ea_y_2, Data2=ea_z_2, Data3=a1_2, Data4=a2_2, Data5=a3_2, Data6=a4_2, Data7=a5_2, Data8=a6_2)  # disabled

# Configuration (meter rad)
ea_z_3 = Slider(-4.21, range=-5..-1.7)  # disabled
ea_y_3 = Slider(0, range=-9.5..0)  # disabled
gantry_x_2 = Slider(35, range=0..40)  # disabled
a5_3 = Slider(0, range=-2.18..2.18)  # disabled
a4_3 = Slider(0, range=-6.98..6.98)  # disabled
a2_3 = Slider(0, range=-1.57..2.61)  # disabled
a3_3 = Slider(0, range=-3.14..1.3)  # disabled
a1_3 = Slider(0, range=-3.14..3.14)  # disabled
a6_3 = Slider(0, range=-6.98..6.98)  # disabled
panel_11 = Panel("""2,bridge2_joint_EA_X
2,robot21_joint_EA_Y
2,robot21_joint_EA_Z
0,robot21_joint_1
0,robot21_joint_2
0,robot21_joint_3
0,robot21_joint_4
0,robot21_joint_5
0,robot21_joint_6""")  # disabled
merge_5 = Merge(Data1=gantry_x_2, Data2=ea_y_3, Data3=ea_z_3, Data4=a1_3, Data5=a2_3, Data6=a3_3, Data7=a4_3, Data8=a5_3, Data9=a6_3)  # disabled

# Configuration (meter rad)
ea_z_4 = Slider(-4.22, range=-5..-1.7)  # disabled
ea_y_4 = Slider(-9, range=-9.5..0)  # disabled
a5_4 = Slider(0, range=-2.18..2.18)  # disabled
a4_4 = Slider(0, range=-6.98..6.98)  # disabled
a3_4 = Slider(0, range=-3.14..1.3)  # disabled
a2_4 = Slider(0, range=-1.57..2.61)  # disabled
a1_4 = Slider(0, range=-3.14..3.14)  # disabled
a6_4 = Slider(0, range=-6.98..6.98)  # disabled
panel_12 = Panel("""2,robot22_joint_EA_Y
2,robot22_joint_EA_Z
0,robot22_joint_1
0,robot22_joint_2
0,robot22_joint_3
0,robot22_joint_4
0,robot22_joint_5
0,robot22_joint_6""")  # disabled
merge_6 = Merge(Data1=ea_y_4, Data2=ea_z_4, Data3=a1_4, Data4=a2_4, Data5=a3_4, Data6=a4_4, Data7=a5_4, Data8=a6_4)  # disabled

# ----
number_slider_2 = Slider(1, range=0..100)  # disabled
number_slider_3 = Slider(83, range=0..100)  # disabled
number_slider_4 = Slider(0, range=0..100)  # disabled
number_slider_5 = Slider(30, range=0..30)  # disabled
number_slider_6 = Slider(82, range=0..100)  # disabled
number_slider_7 = Slider(52, range=0..100)  # disabled
series = Series(Start=number_slider_7, Step=1, Count=number_slider_5)  # disabled
merge_7 = Merge(Data1=number_slider_4, Data2=number_slider_2, Data3=series, Data4=number_slider_6, Data5=number_slider_3)  # -> flatten(Result); disabled

ghpython_script_5 = GhPythonScript(joint_type_names=panel_10, joint_values=merge_4)  # -> out, new_config; inputs joint_type_names: list, joint_values: list; disabled; same code as ghpython_script_2
relay = Relay()  # disabled
ghpython_script_6 = GhPythonScript(joint_type_names=panel_12, joint_values=merge_6)  # -> out, new_config; inputs joint_type_names: list, joint_values: list; disabled; same code as ghpython_script_2
ghpython_script_7 = GhPythonScript(joint_type_names=panel_11, joint_values=merge_5)  # -> out, new_config; inputs joint_type_names: list, joint_values: list; disabled; same code as ghpython_script_2
merge_8 = Merge(
    Data1=ghpython_script_2.new_config,
    Data2=ghpython_script_5.new_config,
    Data3=ghpython_script_7.new_config,
    Data4=ghpython_script_6.new_config)  # disabled
merge_9 = Merge(Data1=ghpython_script_3.configuration_in_m_deg, Data2=merge_8)  # disabled
python_2 = GhPythonScript(configurations=flatten(merge_9))  # -> out, merged_configuration; inputs configurations: list; disabled
# ---------- python_2: Python ----------
merged_configuration = configurations[0]
for config in configurations[1:]:
    merged_configuration.merge(config)
# ---------- end python_2 ----------

# ----
# Robot Visualisation
show_end_effector_frame = BooleanToggle(True)  # disabled
show_base_frame = BooleanToggle(False)  # disabled
show_collision = BooleanToggle(True)  # disabled
show_frames = BooleanToggle(False)  # disabled
show_visual = BooleanToggle(False)  # disabled
visualize = PythonScript(
    robot=robot,
    configurations=merge_8,
    show_visual=show_visual,
    show_collision=show_collision,
    show_frames=show_frames,
    show_base_frame=show_base_frame,
    show_end_effector_frame=show_end_effector_frame)  # -> out, visual, collision, frames, ee_frame, base_frame; inputs configurations: list; disabled
# ---------- visualize: Python ----------
"""Visualizes a robot.
    Inputs:
        robot: The robot
        configuration: :class:`compas_fab.robots.Configuration`
            The robot's full configuration to display.
        show_visual: bool
           Whether or not to show the robot's visual meshes.
        show_collision: bool
           Whether or not to show the robot's collision meshes.
        show_frames: bool
           Whether or not to show the robot's joint frames.
        show_base_frame: bool
           Whether or not to show the robot's base frame.
        show_end_effector_frame: bool
            Whether or not to show the robot's end-effector frame.
    Output:
        visual: The robot's visual meshes.
        collision: The robot's collision meshes.
        frames: The robot's joint frames.
        base_frame: The robot's base frame.
        ee_frame: The robot's end-effector frame.
"""
from __future__ import print_function
from compas.geometry import Frame
print (robot.group_names)
if robot:
    configuration = robot.zero_configuration()
    for partial_config in configurations:
        configuration.merge(partial_config.scaled(1000))
    print (configuration)
    
    group = group or robot.main_group_name
#    robot.update(configuration, group, visual=show_visual, collision=show_collision)
    robot.artist.update(configuration, visual=show_visual, collision=show_collision)
    print(robot.get_end_effector_link_name(group))
    if show_visual:
        visual = robot.artist.draw_visual()

    if show_collision:
        collision = robot.artist.draw_collision()

    if show_frames:
        axes = robot.transformed_axes(configuration, group)
        frames = robot.transformed_frames(configuration, group)

    if show_base_frame:
        frames = robot.transformed_frames(configuration, group)
        base_frame = frames[0]

    if show_end_effector_frame:
        ee_frame = robot.forward_kinematics(configuration, group)
        ee_frame = Frame.from_data(ee_frame.data)
        
        print ("End-effector", ee_frame)
# ---------- end visualize ----------
number_slider_8 = Slider(1, range=0..1)  # disabled
draw = GhPythonScript(frames=[visualize.frames, visualize.ee_frame, visualize.base_frame], scale=number_slider_8)  # -> P, V, C, W, flatten(planes); inputs frames: list; disabled
# ---------- draw: Python ----------
from System.Drawing import Color
from compas_ghpython import draw_frame

red = Color.FromArgb(255, 0, 0)
green = Color.FromArgb(0, 255, 0)
blue = Color.FromArgb(0, 0, 255)

P = []
V = []
C = []
planes = []

scale = float(scale)

for frame in frames:
    if not frame:
        continue
    plane = draw_frame(frame)
    P += [plane.Origin] * 3
    V.append(plane.XAxis * scale)
    V.append(plane.YAxis * scale)
    V.append(plane.ZAxis * scale)
    C += [red, green, blue]
    planes.append(plane)

W = 3
# ---------- end draw ----------
ghpython_script_8 = GhPythonScript(frame=visualize.ee_frame)  # -> out, plane; disabled
# ---------- ghpython_script_8: Python ----------
from compas_ghpython import draw_frame
plane = draw_frame(frame)
# ---------- end ghpython_script_8 ----------
geometry = Geometry(visualize.collision)  # disabled
geometry_2 = Geometry(visualize.visual)  # disabled
scale_3 = Scale(Geometry=draw.P, Center=Point(0, 0, 0), Factor=1000)  # -> Geometry, Transform; disabled
scale_4 = Scale(Geometry=geometry, Center=Point(0, 0, 0), Factor=1000)  # -> Geometry, Transform; disabled
scale_5 = Scale(Geometry=geometry_2, Center=Point(0, 0, 0), Factor=1000)  # -> Geometry, Transform; disabled
vector_display_ex = VectorDisplayEx(Point=scale_3.Geometry, Vector=draw.V, Colour=draw.C, Width=draw.W)  # disabled
cull_index = CullIndex(List=scale_5.Geometry, Indices=merge_7, Wrap=True)  # disabled
cull_index_2 = CullIndex(List=scale_4.Geometry, Indices=merge_7, Wrap=True)  # disabled
colour_swatch = ColourSwatch(SwatchColor=RGBA(176, 99, 99, 42))  # disabled
colour_swatch_2 = ColourSwatch(SwatchColor=RGBA(50, 119, 168, 137))  # disabled
custom_preview = CustomPreview(Geometry=cull_index, Material=colour_swatch_2)  # disabled
custom_preview_2 = CustomPreview(Geometry=cull_index_2, Material=colour_swatch)  # disabled

# ----
# Print Configuration
ghpython_script_9 = GhPythonScript(configuration=python_2.merged_configuration)  # -> out, json_dumps; disabled
# ---------- ghpython_script_9: Python ----------
print (configuration)

import json
from compas.utilities import DataEncoder
json_dumps = json.dumps(configuration, cls=DataEncoder)
# ---------- end ghpython_script_9 ----------
panel_13 = Panel(ghpython_script_9.out)  # disabled

panel_14 = Panel(draw.P)  # disabled
