# Grasshopper definition RobotFilmingTool.gh (Grasshopper 1.0.7)

# ----
# Development Tools
# Reload Python Modules (if Module Code is Changed)
python_module_to_reload = Panel("""compas
compas_fab
roslibpy
integral_timber_joints""")
reload = Button()
py = PythonScript(reload_module_button=reload, module_names=python_module_to_reload)  # inputs module_names: list
# ---------- py: Python ----------
import compas_ghpython
from compas_ghpython import unload_modules
if reload_module_button:
    for module in module_names:
        unload_modules(module)
# ---------- end py ----------

# ----
# Check Path and Environment
compas_version = GhPythonScript()  # -> out, compas_version, compas_fab_version, compas_path, compas_fab_path, compas_env_name, python_directory
# ---------- compas_version: Python ----------
__author__ = "leungp"
__version__ = "2020.04.20"

import rhinoscriptsyntax as rs
import compas
import compas_fab
compas_version  = compas.__version__
compas_fab_version = compas_fab.__version__
import os
compas_path = os.path.abspath(compas.__file__)
compas_fab_path = os.path.abspath(compas_fab.__file__)

import compas_bootstrapper
compas_env_name = compas_bootstrapper.ENVIRONMENT_NAME
python_directory = compas_bootstrapper.PYTHON_DIRECTORY
# ---------- end compas_version ----------
compas_environment_name = Panel(compas_version.compas_env_name)
compas_version_2 = Panel(compas_version.compas_version)
compas_fab_version = Panel(compas_version.compas_fab_version)
compas_path = Panel(compas_version.compas_path)
compas_fab_path = Panel(compas_version.compas_fab_path)
python_directory = Panel(compas_version.python_directory)

# ----
# Connect to RFL robot via ROS (Execution)
panel = Panel("192.168.0.120")
restart = Button()
ros = PythonScript(ip=panel, restart=restart)  # -> out, ros_client
# ---------- ros: Python ----------
import sys
import time
import scriptcontext as sc

from compas_fab.backends import RosClient

from System import TimeSpan
from System.Threading import ManualResetEventSlim


key = 'rosclient_%s' % str(ghenv.Component.InstanceGuid)
previous_client = sc.sticky.get(key, None)
if previous_client:
    previous_client.terminate()

ros_client = RosClient(ip, 9090)
sc.sticky[key] = ros_client

waitLock = ManualResetEventSlim(False)

ros_client.on_ready(lambda: waitLock.Set())

if not waitLock.Wait(TimeSpan.FromSeconds(5)):
    raise Exception('Unable to connect to ROS')


print "ROS is connected:", ros_client.is_connected
# ---------- end ros ----------
panel_2 = Panel(ros.out)
init_robot = Button()
ghpython_script = GhPythonScript(ros_client=ros.ros_client, init_robot=init_robot, namespace="/rob1")  # -> abb_client; inputs init_robot: Boolean
# ---------- ghpython_script: Python ----------
from compas_rrc import *

if ros_client:
    abb_client = AbbClient(ros_client, namespace)
# ---------- end ghpython_script ----------

# ----
# Get Current Values
get_robot_frame = Button()
ghpython_script_2 = GhPythonScript(get_robot_frame=get_robot_frame, robot=ghpython_script)  # -> out, external_axis, joints, frame; inputs get_robot_frame: Boolean
# ---------- ghpython_script_2: Python ----------
from scriptcontext import sticky as st
from compas_rrc import *
from compas_ghpython import draw_frame

# sticky prep function
def get_sticky(attribute_name):
    guid = str(ghenv.Component.InstanceGuid)
    sticky_key = guid + "_" + attribute_name
    if sticky_key not in st:
        st[sticky_key] = None
        return None
    else:
        return st[sticky_key]


def set_sticky(attribute_name, value):
    guid = str(ghenv.Component.InstanceGuid)
    sticky_key = guid + "_" + attribute_name
    st[sticky_key] = value

if get_robot_frame:
    # Set Tool 0 in World 0
    robot.send(SetWorkObject('wobj0'))
    robot.send(SetTool('tool0'))
    
    # get current robot pose
    f, e = robot.send_and_wait(GetRobtarget(), timeout=10)
    set_sticky('frame', f)

    j, e = robot.send_and_wait(GetJoints(), timeout=10)
    set_sticky('joints', j)
    set_sticky('external_axis', e)
    
frame = draw_frame(get_sticky('frame'))
external_axis = list(get_sticky('external_axis'))
joints = list(get_sticky('joints'))
# ---------- end ghpython_script_2 ----------
item = ListItem(List=ghpython_script_2.external_axis, Index=0, Wrap=True)  # -> Item, Item1, Item2
deplane = DeconstructPlane(Plane=ghpython_script_2.frame)  # -> Origin, XAxis, YAxis, ZAxis
ea = Panel(ghpython_script_2.external_axis)
neg = Negative(Value=item.Item2)
neg_2 = Negative(Value=item.Item1)
pt = ConstructPoint(XCoordinate=item.Item, YCoordinate=neg_2, ZCoordinate=neg)
J = Panel(ghpython_script_2.joints)
subtraction = Subtraction(A=pt, B=deplane.Origin)
rougly_robotbase = Point(pt)
robotbase_offset = Vector(subtraction)

number_slider = Slider(500, range=0..1000)
current_external_axes = Number(ghpython_script_2.external_axis)

# ----
# Frame Pt and Z vector
pln = Plane(ghpython_script_2.frame)
ghpython_script_3 = GhPythonScript(robotworld_points=pln)  # -> igps_points; inputs robotworld_points: list of Point3d
# ---------- ghpython_script_3: Python ----------
import compas.geometry as cg
import ghpythonlib.components as ghcomp
import Rhino.Geometry as rg
from compas_ghpython import draw_frame



# iGPS world - Robot worls offsets
robot_11_igps_wobj0 = ((-2614.766, -2058.444, 29.420), (1.0, -0.000028, 0.000047, -0.000034))
robot_12_igps_wobj0 = ((-2609.441, -2057.051, 28.106), (1.0, -0.000026, -0.000042, 0.000059))


def transf(obj, rg_T, cg_T):
    if isinstance(obj, rg.Plane):
        return ghcomp.Transform(obj, rg_T)

    elif isinstance(obj, rg.Brep):
        return ghcomp.Transform(obj, rg_T)

    elif isinstance(obj, rg.Mesh):
        return ghcomp.Transform(obj, rg_T)

    elif isinstance(obj, rg.Point3d):
        return ghcomp.Transform(obj, rg_T)

    elif "compas" in str(type(obj)):
        return obj.transformed(cg_T)

    else:
        raise NotImplementedError


def iGPSWorld_to_RobotWorld(obj, robot="robot_11"):

    if robot == "robot_11":
        robot_igps_wobj0 = robot_11_igps_wobj0
    elif robot == "robot_12":
        robot_igps_wobj0 = robot_12_igps_wobj0
    else:
        raise NotImplementedError

    # iGPSworld to RobotWorld transformation
    rg_iGPS_to_robot_world_vector = rg.Vector3d(*robot_igps_wobj0[0])
    
    
    
    
    to_frame = cg.Frame.from_quaternion(robot_11_igps_wobj0[1], point=robot_11_igps_wobj0[0])
    to_plane = draw_frame(to_frame)
    
    rg_iGPS_to_robot_world_T = rg.Transform.PlaneToPlane(rg.Plane.WorldXY, to_plane)
    
    cg_iGPS_to_robot_world_T = None
    """
    cg_iGPS_to_robot_world_T = cg.Transformation.from_matrix([
        [1, 0, 0, rg_iGPS_to_robot_world_vector.X],
        [0, 1, 0, rg_iGPS_to_robot_world_vector.Y],
        [0, 0, 1, rg_iGPS_to_robot_world_vector.Z],
        [0, 0, 0, 1]])
        """

    if isinstance(obj, list):
        # print " --- iGPSWorld_to_RobotWorld for list"
        return [transf(item, rg_iGPS_to_robot_world_T, cg_iGPS_to_robot_world_T) for item in obj]
    elif obj is None:
        # print " --- iGPSWorld_to_RobotWorld for none"
        return None
    else:
        # print " --- iGPSWorld_to_RobotWorld for single object"
        return transf(obj, rg_iGPS_to_robot_world_T, cg_iGPS_to_robot_world_T)


def RobotWorld_to_iGPSWorld(obj, robot="robot_11"):

    if robot == "robot_11":
        robot_igps_wobj0 = robot_11_igps_wobj0
    elif robot == "robot_12":
        robot_igps_wobj0 = robot_12_igps_wobj0
    else:
        raise NotImplementedError

    # RobotWorld to iGPSworld transformation
    rg_robot_world_to_iGPS_vector = -rg.Vector3d(*robot_igps_wobj0[0])
    rg_robot_to_igps_world_T = rg.Transform.Translation(rg_robot_world_to_iGPS_vector)
    cg_robot_to_igps_world_T = cg.Transformation.from_matrix(
        [[1, 0, 0, rg_robot_world_to_iGPS_vector.X],
         [0, 1, 0, rg_robot_world_to_iGPS_vector.Y],
         [0, 0, 1, rg_robot_world_to_iGPS_vector.Z],
         [0, 0, 0, 1]])

    if isinstance(obj, list):
        # print " --- RobotWorld to iGPSworld for list"
        return [transf(item, rg_robot_to_igps_world_T, cg_robot_to_igps_world_T) for item in obj]
    elif obj is None:
        # print " --- RobotWorld to iGPSworld for none"
        return None
    else:
        # print " --- RobotWorld to iGPSworld for single object"
        return transf(obj, rg_robot_to_igps_world_T, cg_robot_to_igps_world_T)


igps_points = RobotWorld_to_iGPSWorld(robotworld_points)
# ---------- end ghpython_script_3 ----------

rougly_robotbase_2 = Point(pt)
deplane_2 = DeconstructPlane(Plane=pln)  # -> Origin, XAxis, YAxis, ZAxis
ghpython_script_4 = GhPythonScript(robotworld_points=rougly_robotbase_2)  # -> igps_points; inputs robotworld_points: list of Point3d; same code as ghpython_script_3
amp = Amplitude(Vector=deplane_2.XAxis, Amplitude=number_slider)
amp_2 = Amplitude(Vector=deplane_2.YAxis, Amplitude=number_slider)
merge = Merge(
    Data1=flatten("# External Axis"),
    Data2=flatten(ghpython_script_2.external_axis),
    Data3=flatten("# Joint Values"),
    Data4=flatten(ghpython_script_2.joints))  # -> flatten(Result)
vdisex = VectorDisplayEx(Point=ghpython_script_3, Vector=amp, Colour=RGB(255, 0, 0), Width=2)
vdisex_2 = VectorDisplayEx(Point=ghpython_script_3, Vector=amp_2, Colour=RGB(89, 255, 0), Width=2)
panel_3 = Panel(robotbase_offset)
devec = DeconstructVector()  # -> XComponent, YComponent, ZComponent
vdis = VectorDisplay()
ea_2 = Panel(merge)
panel_4 = Panel("869")
panel_5 = Panel("-1048")
panel_6 = Panel("1400")
number_slider_2 = Slider(12, range=0..20)
number_slider_3 = Slider(12, range=0..20)
number_slider_4 = Slider(12, range=0..20)
crv = Curve(<curve referenced from the Rhino model>)
pt_2 = Point(<point referenced from the Rhino model>)
crv_2 = Curve(<curve referenced from the Rhino model>)
pt_3 = Point(<point referenced from the Rhino model>)
crv_3 = Curve(<curve referenced from the Rhino model>)
pt_4 = Point(<point referenced from the Rhino model>)
pt_5 = ConstructPoint(XCoordinate="-1000", YCoordinate="-1000", ZCoordinate="400")
pt_6 = ConstructPoint(XCoordinate="869", YCoordinate="-1048", ZCoordinate="1700")
divide = DivideCurve(Curve=crv, Count=number_slider_2, Kinks=False)  # -> Points, Tangents, Parameters
pt_7 = ConstructPoint(XCoordinate="1700", YCoordinate="650", ZCoordinate="1800")
pt_8 = ConstructPoint(XCoordinate="2400", YCoordinate="200", ZCoordinate="900")
pt_9 = ConstructPoint(XCoordinate="2000", YCoordinate="800", ZCoordinate="800")
pt_10 = ConstructPoint(XCoordinate="1000", YCoordinate="650", ZCoordinate="2000")
divide_2 = DivideCurve(Curve=crv_2, Count=number_slider_3, Kinks=False)  # -> Points, Tangents, Parameters
pt_11 = ConstructPoint(XCoordinate="-1000", YCoordinate="-1000", ZCoordinate="400")
pt_12 = ConstructPoint(XCoordinate="-1200", YCoordinate="-1400", ZCoordinate="2180")
divide_3 = DivideCurve(Curve=crv_3, Count=number_slider_4, Kinks=False)  # -> Points, Tangents, Parameters
vec2pt = Vector2Pt(PointA=divide.Points, PointB=pt_2, Unitize=False)  # -> Vector, Length
merge_2 = Merge(Data1=pt_5, Data2=pt_6)
vec2pt_2 = Vector2Pt(PointA=divide_2.Points, PointB=pt_3, Unitize=False)  # -> Vector, Length
merge_3 = Merge(Data1=pt_7, Data2=pt_8, Data3=pt_9, Data4=pt_10)
ln = Line(StartPoint=pt_2, EndPoint=divide.Points)
range = Range(Domain=Domain(0, 1), Steps=number_slider_2)
ln_2 = Line(StartPoint=pt_3, EndPoint=divide_2.Points)
range_2 = Range(Domain=Domain(0, 1), Steps=number_slider_3)
vec2pt_3 = Vector2Pt(PointA=divide_3.Points, PointB=pt_4, Unitize=False)  # -> Vector, Length
merge_4 = Merge(Data1=pt_11, Data2=pt_12)
Z = UnitZ(Factor=1)
Z_2 = UnitZ(Factor="-1")
ln_3 = Line(StartPoint=pt_4, EndPoint=divide_3.Points)
range_3 = Range(Domain=Domain(0, 1), Steps=number_slider_4)
# GANTRY_X_LIMIT = (13, 26)
# GANTRY_Y_LIMIT = (-9.5, 0)
# GANTRY_Z_LIMIT = (-4.895, -1.7)
ea_3 = Panel(merge)
vec_tool_z = Vector(vec2pt.Vector)
Z_3 = UnitZ(Factor=1)
vec_tool_z_2 = Vector(vec2pt_2.Vector)
interp = InterpolateData(Data=merge_2, Parameter=range, Interpolation=4)
interp_2 = InterpolateData(Data=merge_3, Parameter=range_2, Interpolation=4)
vec_tool_z_3 = Vector(vec2pt_3.Vector)
interp_3 = InterpolateData(Data=merge_4, Parameter=range_3, Interpolation=4)
xprod = CrossProduct(VectorA=Z, VectorB=vec_tool_z, Unitize=False)  # -> Vector, Length
xprod_2 = CrossProduct(VectorA=Z_2, VectorB=vec_tool_z_2, Unitize=False)  # -> Vector, Length
xprod_3 = CrossProduct(VectorA=Z_3, VectorB=vec_tool_z_3, Unitize=False)  # -> Vector, Length
move = Move(Geometry=divide.Points, Motion=interp)  # -> Geometry, Transform
vec_tool_y = Vector(xprod.Vector)
move_2 = Move(Geometry=divide_2.Points, Motion=interp_2)  # -> Geometry, Transform
vec_tool_y_2 = Vector(xprod_2.Vector)
move_3 = Move(Geometry=divide_3.Points, Motion=interp_3)  # -> Geometry, Transform
vec_tool_y_3 = Vector(xprod_3.Vector)
ln_4 = Line(StartPoint=move_2.Geometry, EndPoint=divide_2.Points)
xprod_4 = CrossProduct(VectorA=vec_tool_y, VectorB=vec_tool_z, Unitize=False)  # -> Vector, Length
xprod_5 = CrossProduct(VectorA=vec_tool_y_2, VectorB=vec_tool_z_2, Unitize=False)  # -> Vector, Length
panel_13 = Panel(interp)
panel_14 = Panel(interp_2)
xprod_6 = CrossProduct(VectorA=vec_tool_y_3, VectorB=vec_tool_z_3, Unitize=False)  # -> Vector, Length
vec_tool_x = Vector(xprod_4.Vector)
panel_15 = Panel(interp_3)
vec_tool_x_2 = Vector(xprod_5.Vector)
vec_tool_x_3 = Vector(xprod_6.Vector)
pl = ConstructPlane(Origin=divide.Points, XAxis=vec_tool_x, YAxis=vec_tool_y)
panel_16 = Panel("""{22622.542074, 5362.478013, 3942.828311}
{22625.940171, 5808.496019, 4187.57021}
{22600.331033, 6251.066065, 4391.75715}
{22467.774679, 6707.505878, 4577.762723}
{22142.828425, 7187.929249, 4755.257991}
{21596.729706, 7666.332921, 4873.201195}
{20854.79412, 8071.366796, 4847.688687}
{19960.336112, 8344.449802, 4669.231314}
{18968.739005, 8491.799635, 4406.691998}
{17864.531147, 8567.554411, 4153.460048}
{16669.913427, 8604.781697, 3933.43563}
{15457.754046, 8605.509351, 3715.805367}
{14301.139002, 8562.867237, 3460.211673}""")
pl_2 = ConstructPlane(Origin=divide_2.Points, XAxis=vec_tool_x_2, YAxis=vec_tool_y_2)
pl_3 = ConstructPlane(Origin=divide_3.Points, XAxis=vec_tool_x_3, YAxis=vec_tool_y_3)

# ----
# Conversion to RobotWorld
ghpython_script_5 = GhPythonScript(igps_points=pl)  # -> robotworld_points; inputs igps_points: list of Point3d
# ---------- ghpython_script_5: Python ----------
import compas.geometry as cg
import ghpythonlib.components as ghcomp
import Rhino.Geometry as rg
from compas_ghpython import draw_frame



# iGPS world - Robot worls offsets
robot_11_igps_wobj0 = ((-2614.766, -2058.444, 29.420), (1.0, -0.000028, 0.000047, -0.000034))
robot_12_igps_wobj0 = ((-2609.441, -2057.051, 28.106), (1.0, -0.000026, -0.000042, 0.000059))


def transf(obj, rg_T, cg_T):
    if isinstance(obj, rg.Plane):
        return ghcomp.Transform(obj, rg_T)

    elif isinstance(obj, rg.Brep):
        return ghcomp.Transform(obj, rg_T)

    elif isinstance(obj, rg.Mesh):
        return ghcomp.Transform(obj, rg_T)

    elif isinstance(obj, rg.Point3d):
        return ghcomp.Transform(obj, rg_T)

    elif "compas" in str(type(obj)):
        return obj.transformed(cg_T)

    else:
        raise NotImplementedError


def iGPSWorld_to_RobotWorld(obj, robot="robot_11"):

    if robot == "robot_11":
        robot_igps_wobj0 = robot_11_igps_wobj0
    elif robot == "robot_12":
        robot_igps_wobj0 = robot_12_igps_wobj0
    else:
        raise NotImplementedError

    # iGPSworld to RobotWorld transformation
    rg_iGPS_to_robot_world_vector = rg.Vector3d(*robot_igps_wobj0[0])
    
    
    
    
    to_frame = cg.Frame.from_quaternion(robot_11_igps_wobj0[1], point=robot_11_igps_wobj0[0])
    to_plane = draw_frame(to_frame)
    
    rg_iGPS_to_robot_world_T = rg.Transform.PlaneToPlane(rg.Plane.WorldXY, to_plane)
    
    cg_iGPS_to_robot_world_T = None
    """
    cg_iGPS_to_robot_world_T = cg.Transformation.from_matrix([
        [1, 0, 0, rg_iGPS_to_robot_world_vector.X],
        [0, 1, 0, rg_iGPS_to_robot_world_vector.Y],
        [0, 0, 1, rg_iGPS_to_robot_world_vector.Z],
        [0, 0, 0, 1]])
        """

    if isinstance(obj, list):
        # print " --- iGPSWorld_to_RobotWorld for list"
        return [transf(item, rg_iGPS_to_robot_world_T, cg_iGPS_to_robot_world_T) for item in obj]
    elif obj is None:
        # print " --- iGPSWorld_to_RobotWorld for none"
        return None
    else:
        # print " --- iGPSWorld_to_RobotWorld for single object"
        return transf(obj, rg_iGPS_to_robot_world_T, cg_iGPS_to_robot_world_T)


def RobotWorld_to_iGPSWorld(obj, robot="robot_11"):

    if robot == "robot_11":
        robot_igps_wobj0 = robot_11_igps_wobj0
    elif robot == "robot_12":
        robot_igps_wobj0 = robot_12_igps_wobj0
    else:
        raise NotImplementedError

    # RobotWorld to iGPSworld transformation
    rg_robot_world_to_iGPS_vector = -rg.Vector3d(*robot_igps_wobj0[0])
    rg_robot_to_igps_world_T = rg.Transform.Translation(rg_robot_world_to_iGPS_vector)
    cg_robot_to_igps_world_T = cg.Transformation.from_matrix(
        [[1, 0, 0, rg_robot_world_to_iGPS_vector.X],
         [0, 1, 0, rg_robot_world_to_iGPS_vector.Y],
         [0, 0, 1, rg_robot_world_to_iGPS_vector.Z],
         [0, 0, 0, 1]])

    if isinstance(obj, list):
        # print " --- RobotWorld to iGPSworld for list"
        return [transf(item, rg_robot_to_igps_world_T, cg_robot_to_igps_world_T) for item in obj]
    elif obj is None:
        # print " --- RobotWorld to iGPSworld for none"
        return None
    else:
        # print " --- RobotWorld to iGPSworld for single object"
        return transf(obj, rg_robot_to_igps_world_T, cg_robot_to_igps_world_T)



robotworld_points = iGPSWorld_to_RobotWorld(igps_points)
# ---------- end ghpython_script_5 ----------
pl_origin = PlaneOrigin(Base=pl, Origin=ghpython_script_5)

# ----
# Conversion to RobotWorld
ghpython_script_6 = GhPythonScript(igps_points=pl_2)  # -> robotworld_points; inputs igps_points: list of Point3d; same code as ghpython_script_5
pl_origin_2 = PlaneOrigin(Base=pl_2, Origin=ghpython_script_6)

# ----
# Conversion to RobotWorld
ghpython_script_7 = GhPythonScript(igps_points=pl_3)  # -> robotworld_points; inputs igps_points: list of Point3d; same code as ghpython_script_5
pl_origin_3 = PlaneOrigin(Base=pl_3, Origin=ghpython_script_7)

number_slider_5 = Slider(12, range=0..12)
number_slider_6 = Slider(12, range=0..12)
number_slider_7 = Slider(12, range=0..12)
goto_robot_frame = Button()
goto_robot_frame_2 = Button()
goto_robot_frame_3 = Button()
goto_robot_frame_4 = Button()
goto_robot_frame_5 = Button()
goto_robot_frame_6 = Button()
goto_robot_frame_7 = Button()
goto_robot_frame_8 = Button()

get_robot_frame_2 = Button()
ghpython_script_8 = GhPythonScript(get_robot_frame=get_robot_frame_2, robot=ghpython_script)  # -> out, external_axis, joints, frame; inputs get_robot_frame: Boolean; same code as ghpython_script_2
split = SplitList(List=ghpython_script_8.external_axis, Index=3)  # -> ListA, ListB

# ----
# Goto Configuration
output_folder = Panel("C:\Users\leungp\Documents\GitHub\integral_timber_joints\external\itj_design_study\210419_HyparHut\taught_configurations\")
list = ValueList({"g1_PG500_storage_configuration.json", "g2_PG1000_storage_configuration.json", "g3_PG1500_storage_configuration.json", "c1_CL3_storage_configuration.json", "c2_CL3_storage_configuration.json", "c3_CL3M_storage_configuration.json", "c4_CL3M_storage_configuration.json", "s1_SL1_storage_configuration.json", "s2_SL1_storage_configuration.json", "s3_SL1_storage_configuration.json", "s4_SL1_G200_storage_configuration.json", "robot11_initial_configuration.json", "g1_PG500_pickup_configuration.json", "g2_PG1000_pickup_configuration.json", "g3_PG1500_pickup_configuration.json"}, selected="g2_PG1000_pickup_configuration.json")
concat = Concatenate(FragmentA=output_folder, FragmentB=list)
load_configuration = GhPythonScript(json_path=concat)  # -> out, configuration
# ---------- load_configuration: Python ----------
import json
from compas.utilities.encoders import DataDecoder
with open(json_path, 'r') as f:
    configuration = json.load(f, cls=DataDecoder)
# ---------- end load_configuration ----------
goto_robot_frame_9 = Button()
ghpython_script_9 = GhPythonScript(
    goto_configuration=goto_robot_frame_9,
    robot=ghpython_script,
    configuration=load_configuration.configuration,
    speed=Slider(1000, range=0..1000))  # -> out, external_axis, joints; inputs goto_configuration: Boolean
# ---------- ghpython_script_9: Python ----------
from scriptcontext import sticky as st
from compas_rrc import *
from compas_ghpython import draw_frame
from compas_rhino.geometry import RhinoPlane
from math import degrees
# sticky prep function
def get_sticky(attribute_name):
    guid = str(ghenv.Component.InstanceGuid)
    sticky_key = guid + "_" + attribute_name
    if sticky_key not in st:
        st[sticky_key] = None
        return None
    else:
        return st[sticky_key]

def set_sticky(attribute_name, value):
    guid = str(ghenv.Component.InstanceGuid)
    sticky_key = guid + "_" + attribute_name
    st[sticky_key] = value

print (configuration)

external_axes = []
external_axes.append(configuration['bridge1_joint_EA_X']* 1000)
external_axes.append(configuration['robot11_joint_EA_Y']* 1000)
external_axes.append(configuration['robot11_joint_EA_Z']* 1000)
ext_axes = ExternalAxes(external_axes)

joint_values = []
joint_values.append(degrees(configuration['robot11_joint_1']))
joint_values.append(degrees(configuration['robot11_joint_2']))
joint_values.append(degrees(configuration['robot11_joint_3']))
joint_values.append(degrees(configuration['robot11_joint_4']))
joint_values.append(degrees(configuration['robot11_joint_5']))
joint_values.append(degrees(configuration['robot11_joint_6']))
robot_joints = RobotJoints(joint_values)

instruction = MoveToJoints(robot_joints, external_axes, speed, Zone.FINE)
print (instruction)
if goto_configuration:
    
    # Go to target frame
    robot.send(instruction)

    # Get the finished pose Joint and external Values
    j, e = robot.send_and_wait(GetJoints(), timeout=10)
    if j is None:
        print ("Motion did not complete before Timeout 10 sec.")
    set_sticky('joints', j)
    set_sticky('external_axis', e)
if get_sticky('external_axis') is None:
    external_axis = None
    joints = None
else:
    external_axis = list(get_sticky('external_axis'))
    joints = list(get_sticky('joints'))
# ---------- end ghpython_script_9 ----------

# ----
# Convertion to Meters / Radians
# Joint values expressed in radians or meters, depending on the respective type.
# 
#     REVOLUTE = 0
#     CONTINUOUS = 1
#     PRISMATIC = 2
#     FIXED = 3
#     FLOATING = 4
#     PLANAR = 5
ea_6 = Panel(split.ListA)
J_2 = Panel(ghpython_script_8.joints)
joint_names = Panel("""bridge1_joint_EA_X
robot11_joint_EA_Y
robot11_joint_EA_Z
robot11_joint_1
robot11_joint_2
robot11_joint_3
robot11_joint_4
robot11_joint_5
robot11_joint_6""")
division = Division(A=ea_6, B=1000)
rad = Radians(Degrees=J_2)
joint_types = Panel("""2
2
2
0
0
0
0
0
0""")
merge_5 = Merge(Data1=flatten(division), Data2=flatten(rad))
configuration = GhPythonScript(values=merge_5, joint_names=joint_names, joint_types=joint_types)  # -> out, configuration, configuration_json; inputs values: list, joint_names: list, joint_types: list of Int32
# ---------- configuration: Python ----------
from compas_fab.robots import Configuration
from compas.utilities.encoders import DataEncoder
import json
configuration = Configuration(values, joint_types, joint_names)
assert len(values) == len(joint_types)
assert len(values) == len(joint_names)
configuration_json = json.dumps(configuration, cls=DataEncoder)
# ---------- end configuration ----------

# ----
# Save Configuration
# Convert values to a configuration (Robot11)
# Values from rrc
# Save to File
make_sure_save_it_to_the_right_target_no = ValueList({"g1_PG500_storage_configuration.json", "g2_PG1000_storage_configuration.json", "g3_PG1500_storage_configuration.json", "c1_CL3_storage_configuration.json", "c2_CL3_storage_configuration.json", "c3_CL3M_storage_configuration.json", "c4_CL3M_storage_configuration.json", "s1_SL1_storage_configuration.json", "s2_SL1_storage_configuration.json", "s3_SL1_storage_configuration.json", "s4_SL1_G200_storage_configuration.json", "robot11_initial_configuration.json", "g1_PG500_pickup_configuration.json", "g2_PG1000_pickup_configuration.json", "g3_PG1500_pickup_configuration.json", "s4_SL1_G200_pickup_configuration.json"}, selected="s4_SL1_G200_pickup_configuration.json")  # "Make sure save it to the right target (No overwrite protection)"
output_folder_2 = Panel("C:\Users\leungp\Documents\GitHub\integral_timber_joints\external\itj_design_study\210419_HyparHut\taught_configurations\")
save = Button()
concat_2 = Concatenate(FragmentA=output_folder_2, FragmentB=make_sure_save_it_to_the_right_target_no)
python = GhPythonScript(configuration=configuration.configuration, json_path=concat_2, save=save)  # -> out, a
# ---------- python: Python ----------
import json
from compas.utilities.encoders import DataEncoder
if save:
    with open(json_path, 'w') as f:
        json.dump(configuration, f, cls=DataEncoder, indent=4, sort_keys=True)
# ---------- end python ----------
panel_17 = Panel(configuration.configuration_json)

# ----
# Goto a Frame
pln_2 = Plane(Plane(origin=(24890.13851, 8828.937972, 634.2163896), x=(0, -0.9396924119, 0.3420207172), y=(0, -0.3420207172, -0.9396924119)))
pln_3 = Plane(pln_2)
goto_robot_frame_10 = Button()
deplane_3 = DeconstructPlane(Plane=pln_3)  # -> Origin, XAxis, YAxis, ZAxis
pt_13 = ConstructPoint(XCoordinate="-2600", YCoordinate="-1700", ZCoordinate="2800")
move_4 = Move(Geometry=deplane_3.Origin, Motion=pt_13)  # -> Geometry, Transform
rougly_robotbase_3 = Point(move_4.Geometry)
pdecon = Deconstruct(Point=rougly_robotbase_3)  # -> XComponent, YComponent, ZComponent
neg_3 = Negative(Value=pdecon.ZComponent)
neg_4 = Negative(Value=pdecon.YComponent)
panel_18 = Panel("""0
0
0""")
merge_6 = Merge(Data1=pdecon.XComponent, Data2=neg_4, Data3=neg_3, Data4=panel_18)
pln_4 = Plane(pln_2)
external_axes = Number(merge_6)
panel_19 = Panel(external_axes)

# ----
# Rough Estiamte only
ghpython_script_10 = GhPythonScript(igps_points=pln_4)  # -> robotworld_points; inputs igps_points: list of Point3d; same code as ghpython_script_5

pl_origin_4 = PlaneOrigin(Base=pln_4, Origin=ghpython_script_10)

ghpython_script_11 = GhPythonScript(
    goto_robot_frame=goto_robot_frame_10,
    robot=ghpython_script,
    frame=pl_origin_4,
    external_axes=current_external_axes,
    speed=Slider(300, range=0..1000))  # -> out, external_axis, joints; inputs goto_robot_frame: Boolean, frame: Plane, external_axes: list
# ---------- ghpython_script_11: Python ----------
from scriptcontext import sticky as st
from compas_rrc import *
from compas_ghpython import draw_frame
from compas_rhino.geometry import RhinoPlane
# sticky prep function
def get_sticky(attribute_name):
    guid = str(ghenv.Component.InstanceGuid)
    sticky_key = guid + "_" + attribute_name
    if sticky_key not in st:
        st[sticky_key] = None
        return None
    else:
        return st[sticky_key]

def set_sticky(attribute_name, value):
    guid = str(ghenv.Component.InstanceGuid)
    sticky_key = guid + "_" + attribute_name
    st[sticky_key] = value

if goto_robot_frame:
    # Set Tool 0 in World 0
    robot.send(SetWorkObject('wobj0'))
    robot.send(SetTool('tool0'))
    
    # Go to target frame
    target_frame = RhinoPlane.from_geometry(frame).to_compas()
    ext_axes = ExternalAxes(*external_axes)
    robot.send(MoveToRobtarget(target_frame, ext_axes, speed, Zone.FINE, motion_type=Motion.LINEAR))
    
    # Get the finished pose Joint and external Values
    j, e = robot.send_and_wait(GetJoints(), timeout=10)
    if j is None:
        print ("Motion did not complete before Timeout 10 sec.")
    set_sticky('joints', j)
    set_sticky('external_axis', e)
if get_sticky('external_axis') is None:
    external_axis = None
    joints = None
else:
    external_axis = list(get_sticky('external_axis'))
    joints = list(get_sticky('joints'))
# ---------- end ghpython_script_11 ----------

# ----
# Goto Frames
pln_5 = Plane(pl_origin)
# Gantry Offset
panel_20 = Panel("869")
pln_6 = Plane(pln_5)
pt_14 = ConstructPoint(XCoordinate=panel_20, YCoordinate="-1048", ZCoordinate="1850")
deplane_4 = DeconstructPlane(Plane=pln_6)  # -> Origin, XAxis, YAxis, ZAxis
move_5 = Move(Geometry=deplane_4.Origin, Motion=panel_13)  # -> Geometry, Transform
goto_robot_frame_11 = Button()
rougly_robotbase_4 = Point(move_5.Geometry)

# ----
# GANTRY_X_LIMIT = (13, 26)
# GANTRY_Y_LIMIT = (-9.5, 0)
# GANTRY_Z_LIMIT = (-4.895, -1.7)
panel_21 = Panel(move_5.Geometry)
item_2 = ListItem(List=pln_5, Index=number_slider_5, Wrap=True)
item_3 = ListItem(List=panel_21, Index=number_slider_5, Wrap=True)

pdecon_2 = Deconstruct(Point=panel_21)  # -> XComponent, YComponent, ZComponent
neg_5 = Negative(Value=pdecon_2.ZComponent)
neg_6 = Negative(Value=pdecon_2.YComponent)
ghpython_script_12 = GhPythonScript(
    goto_robot_frame=goto_robot_frame_11,
    robot=ghpython_script,
    frames=pln_5,
    external_axes_x=pdecon_2.XComponent,
    external_axes_y=neg_6,
    external_axes_z=neg_5,
    reverse=Toggle(True),
    speed=Slider(1000, range=0..1000))  # -> out, external_axis, joints; inputs goto_robot_frame: Boolean, frames: list of Plane, external_axes_x: list, external_axes_y: list, external_axes_z: list, reverse: Boolean
# ---------- ghpython_script_12: Python ----------
from scriptcontext import sticky as st
from compas_rrc import *
from compas_ghpython import draw_frame
from compas_rhino.geometry import RhinoPlane
# sticky prep function
def get_sticky(attribute_name):
    guid = str(ghenv.Component.InstanceGuid)
    sticky_key = guid + "_" + attribute_name
    if sticky_key not in st:
        st[sticky_key] = None
        return None
    else:
        return st[sticky_key]

def set_sticky(attribute_name, value):
    guid = str(ghenv.Component.InstanceGuid)
    sticky_key = guid + "_" + attribute_name
    st[sticky_key] = value

if goto_robot_frame:
    # Set Tool 0 in World 0
    robot.send(SetWorkObject('wobj0'))
    robot.send(SetTool('tool0'))
    
    # Go to target frame
    if reverse:
        data = reversed (zip(frames, external_axes_x, external_axes_y, external_axes_z))
    else:
        data = zip(frames, external_axes_x, external_axes_y, external_axes_z)
        
    for frame, x, y, z in data:
        target_frame = RhinoPlane.from_geometry(frame).to_compas()
        ext_axes = ExternalAxes([x,y,z,0,0,0])
        robot.send(MoveToRobtarget(target_frame, ext_axes, speed, Zone.Z1, motion_type=Motion.LINEAR))
# ---------- end ghpython_script_12 ----------

ghpython_script_13 = GhPythonScript(
    goto_robot_frame=goto_robot_frame_6,
    robot=ghpython_script,
    frame=item_2,
    external_axes=item_3,
    speed=Slider(300, range=0..1000))  # -> out, external_axis, joints; inputs goto_robot_frame: Boolean, frame: Plane, external_axes: Point3d
# ---------- ghpython_script_13: Python ----------
from scriptcontext import sticky as st
from compas_rrc import *
from compas_ghpython import draw_frame
from compas_rhino.geometry import RhinoPlane
# sticky prep function
def get_sticky(attribute_name):
    guid = str(ghenv.Component.InstanceGuid)
    sticky_key = guid + "_" + attribute_name
    if sticky_key not in st:
        st[sticky_key] = None
        return None
    else:
        return st[sticky_key]

def set_sticky(attribute_name, value):
    guid = str(ghenv.Component.InstanceGuid)
    sticky_key = guid + "_" + attribute_name
    st[sticky_key] = value

if goto_robot_frame:
    # Set Tool 0 in World 0
    robot.send(SetWorkObject('wobj0'))
    robot.send(SetTool('tool0'))
    
    # Go to target frame
    target_frame = RhinoPlane.from_geometry(frame).to_compas()
    ext_axes = ExternalAxes([external_axes.X, -external_axes.Y, -external_axes.Z, 0, 0, 0])
    robot.send(MoveToRobtarget(target_frame, ext_axes, speed, Zone.Z1, motion_type=Motion.LINEAR))
# ---------- end ghpython_script_13 ----------

# ----
# Goto Frames
pln_7 = Plane(pl_origin_2)
# Gantry Offset
panel_22 = Panel("869")
pln_8 = Plane(pln_7)
pt_15 = ConstructPoint(XCoordinate=panel_22, YCoordinate="-1048", ZCoordinate="1850")
deplane_5 = DeconstructPlane(Plane=pln_8)  # -> Origin, XAxis, YAxis, ZAxis
move_6 = Move(Geometry=deplane_5.Origin, Motion=panel_14)  # -> Geometry, Transform
goto_robot_frame_12 = Button()
rougly_robotbase_5 = Point(move_6.Geometry)

panel_23 = Panel(move_6.Geometry)
panel_24 = Panel(move_6.Geometry)
item_4 = ListItem(List=pln_7, Index=number_slider_7, Wrap=True)
item_5 = ListItem(List=panel_24, Index=number_slider_7, Wrap=True)

pdecon_3 = Deconstruct(Point=panel_24)  # -> XComponent, YComponent, ZComponent
neg_7 = Negative(Value=pdecon_3.ZComponent)
neg_8 = Negative(Value=pdecon_3.YComponent)
ghpython_script_14 = GhPythonScript(
    goto_robot_frame=goto_robot_frame_12,
    robot=ghpython_script,
    frames=pln_7,
    external_axes_x=pdecon_3.XComponent,
    external_axes_y=neg_8,
    external_axes_z=neg_7,
    reverse=Toggle(True),
    speed=Slider(1000, range=0..1000))  # -> out, external_axis, joints; inputs goto_robot_frame: Boolean, frames: list of Plane, external_axes_x: list, external_axes_y: list, external_axes_z: list, reverse: Boolean; same code as ghpython_script_12

ghpython_script_15 = GhPythonScript(
    goto_robot_frame=goto_robot_frame_7,
    robot=ghpython_script,
    frame=item_4,
    external_axes=item_5,
    speed=Slider(1000, range=0..1000))  # -> out, external_axis, joints; inputs goto_robot_frame: Boolean, frame: Plane, external_axes: Point3d; same code as ghpython_script_13

# ----
# Goto Frames
pln_9 = Plane(pl_origin_3)
# Gantry Offset
panel_25 = Panel("869")
pln_10 = Plane(pln_9)
pt_16 = ConstructPoint(XCoordinate=panel_25, YCoordinate="-1048", ZCoordinate="1850")
deplane_6 = DeconstructPlane(Plane=pln_10)  # -> Origin, XAxis, YAxis, ZAxis
move_7 = Move(Geometry=deplane_6.Origin, Motion=panel_15)  # -> Geometry, Transform
goto_robot_frame_13 = Button()
rougly_robotbase_6 = Point(move_7.Geometry)

# ----
# GANTRY_X_LIMIT = (13, 26)
# GANTRY_Y_LIMIT = (-9.5, 0)
# GANTRY_Z_LIMIT = (-4.895, -1.7)
panel_26 = Panel(move_7.Geometry)
item_6 = ListItem(List=pln_9, Index=number_slider_6, Wrap=True)
item_7 = ListItem(List=panel_26, Index=number_slider_6, Wrap=True)

pdecon_4 = Deconstruct(Point=panel_26)  # -> XComponent, YComponent, ZComponent
neg_9 = Negative(Value=pdecon_4.ZComponent)
neg_10 = Negative(Value=pdecon_4.YComponent)
ghpython_script_16 = GhPythonScript(
    goto_robot_frame=goto_robot_frame_13,
    robot=ghpython_script,
    frames=pln_9,
    external_axes_x=pdecon_4.XComponent,
    external_axes_y=neg_10,
    external_axes_z=neg_9,
    reverse=Toggle(True),
    speed=Slider(1000, range=0..1000))  # -> out, external_axis, joints; inputs goto_robot_frame: Boolean, frames: list of Plane, external_axes_x: list, external_axes_y: list, external_axes_z: list, reverse: Boolean; same code as ghpython_script_12

move_only_external_axis = GhPythonScript(
    goto_robot_frame=goto_robot_frame,
    robot=ghpython_script,
    frames=pln_9,
    external_axes_start="14147,-1250,-4763",
    external_axes_end="20000,-1250,-4763",
    speed=Slider(1000, range=0..1000))  # -> out, external_axis, joints; inputs goto_robot_frame: Boolean, frames: list of Plane, external_axes_start: Point3d, external_axes_end: Point3d
# ---------- move_only_external_axis: Python ----------
from scriptcontext import sticky as st
from compas_rrc import *
from compas_ghpython import draw_frame
from compas_rhino.geometry import RhinoPlane
# sticky prep function
def get_sticky(attribute_name):
    guid = str(ghenv.Component.InstanceGuid)
    sticky_key = guid + "_" + attribute_name
    if sticky_key not in st:
        st[sticky_key] = None
        return None
    else:
        return st[sticky_key]

def set_sticky(attribute_name, value):
    guid = str(ghenv.Component.InstanceGuid)
    sticky_key = guid + "_" + attribute_name
    st[sticky_key] = value

if goto_robot_frame:
    # Set Tool 0 in World 0
    robot.send(SetWorkObject('wobj0'))
    robot.send(SetTool('tool0'))
    
    j, e = robot.send_and_wait(GetJoints(), timeout=10)
    ext_axes = ExternalAxes([external_axes_start[0],external_axes_start[1], external_axes_start[2],0,0,0])
    robot.send(MoveToJoints(j, ext_axes, speed, Zone.Z1))
    ext_axes = ExternalAxes([external_axes_end[0],external_axes_end[1], external_axes_end[2],0,0,0])
    robot.send(MoveToJoints(j, ext_axes, speed, Zone.Z1))
# ---------- end move_only_external_axis ----------
move_only_external_axis_2 = GhPythonScript(
    goto_robot_frame=goto_robot_frame_2,
    robot=ghpython_script,
    frames=pln_9,
    external_axes_start="24800,-5833,-4800",
    external_axes_end="15000,-5833,-4800",
    speed=Slider(1000, range=0..1000))  # -> out, external_axis, joints; inputs goto_robot_frame: Boolean, frames: list of Plane, external_axes_start: Point3d, external_axes_end: Point3d; same code as move_only_external_axis
move_only_external_axis_3 = GhPythonScript(
    goto_robot_frame=goto_robot_frame_3,
    robot=ghpython_script,
    frames=pln_9,
    external_axes_start="16054,-6500,-4890",
    external_axes_end="24000,-6500,-4890",
    speed=Slider(1000, range=0..1000))  # -> out, external_axis, joints; inputs goto_robot_frame: Boolean, frames: list of Plane, external_axes_start: Point3d, external_axes_end: Point3d; same code as move_only_external_axis
move_only_external_axis_4 = GhPythonScript(
    goto_robot_frame=goto_robot_frame_4,
    robot=ghpython_script,
    frames=pln_9,
    external_axes_start="20000,-118,-3803",
    external_axes_end="14147,-118,-3803",
    speed=Slider(1000, range=0..1000))  # -> out, external_axis, joints; inputs goto_robot_frame: Boolean, frames: list of Plane, external_axes_start: Point3d, external_axes_end: Point3d; same code as move_only_external_axis
move_only_external_axis_5 = GhPythonScript(
    goto_robot_frame=goto_robot_frame_5,
    robot=ghpython_script,
    frames=pln_9,
    external_axes_start="24000,-6500,-4890",
    external_axes_end="16054,-6500,-4890",
    speed=Slider(1000, range=0..1000))  # -> out, external_axis, joints; inputs goto_robot_frame: Boolean, frames: list of Plane, external_axes_start: Point3d, external_axes_end: Point3d; same code as move_only_external_axis
ghpython_script_17 = GhPythonScript(
    goto_robot_frame=goto_robot_frame_8,
    robot=ghpython_script,
    frame=item_6,
    external_axes=item_7,
    speed=Slider(300, range=0..1000))  # -> out, external_axis, joints; inputs goto_robot_frame: Boolean, frame: Plane, external_axes: Point3d; same code as ghpython_script_13
