# Grasshopper definition read_process.gh (Grasshopper 1.0.7)
# plug-ins: karambaGH

panel = Panel("C:\Users\leungp\Documents\GitHub\integral_timber_joints\external\itj_design_study\210906_DemoForDavide")
concat = Concatenate(FragmentA=panel, FragmentB="\", FragmentC="demo_process.json")

panel_2 = Panel(concat)

# ----
# Development Tools
# Reload Python Modules (if Module Code is Changed)
python_module_to_reload = Panel("""compas
compas_fab
roslibpy
integral_timber_joints""")
reload = Button()
py = PythonScript(reload_module_button=reload, module_names=python_module_to_reload)  # inputs module_names: list
# ---------- py: Python ----------
import compas_ghpython
from compas_ghpython import unload_modules
if reload_module_button:
    for module in module_names:
        unload_modules(module)
# ---------- end py ----------

# ----
# Check Path and Environment
compas_version = GhPythonScript()  # -> out, compas_version, compas_fab_version, compas_path, compas_fab_path, compas_env_name, python_directory
# ---------- compas_version: Python ----------
__author__ = "leungp"
__version__ = "2020.04.20"

import rhinoscriptsyntax as rs
import compas
import compas_fab
compas_version  = compas.__version__
compas_fab_version = compas_fab.__version__
import os
compas_path = os.path.abspath(compas.__file__)
compas_fab_path = os.path.abspath(compas_fab.__file__)

import compas_bootstrapper
compas_env_name = compas_bootstrapper.ENVIRONMENT_NAME
python_directory = compas_bootstrapper.PYTHON_DIRECTORY
# ---------- end compas_version ----------
compas_environment_name = Panel(compas_version.compas_env_name)
compas_version_2 = Panel(compas_version.compas_version)
compas_fab_version = Panel(compas_version.compas_fab_version)
compas_path = Panel(compas_version.compas_path)
compas_fab_path = Panel(compas_version.compas_fab_path)
python_directory = Panel(compas_version.python_directory)

panel_3 = Panel()
assemble = AssembleModelKaramba3D(LimitDistance_m=0.005)  # -> Model, Info, Mass_kg, CenterOfGravity
beam_joints = BeamJointsKaramba3D(
    ElementIdentifiers=panel_3,
    CtKNMAtStartingNode=Vector(0, 0, 0),
    CrKNmRadAtStartingNode=Vector(0, 0, 0),
    CtKNMAtEndNode=Vector(0, 0, 0),
    CrKNmRadAtEndNode=Vector(0, 0, 0),
    menu=[buttons(off, off, off, off, off, off), buttons(off, off, off, off, off, off)])

# ----
# Load Process
load_process = Button()
ghpython_script = PythonScript(load=load_process, process_path=panel_2)  # -> out, process
# ---------- ghpython_script: Python ----------
from scriptcontext import sticky as st
import compas
import json
import os
from compas.utilities import DataDecoder, DataEncoder

# Robot meshes are usually in meters
# Set a high percision to prevent parsing errors
# and configure Rhino itself in meters
compas.PRECISION = '12f'

# Store robot in component-based key
process_key = 'process_{}'.format(str(ghenv.Component.InstanceGuid))

if process_key not in st:
    st[process_key] = None

if load:
    with open(process_path, 'r') as f:
        process = json.load(f, cls=DataDecoder)
    st[process_key] = process

process = st[process_key]
# ---------- end ghpython_script ----------

# ----
# Beam / Joint ID
assembly = GhPythonScript(process=ghpython_script.process)  # -> out, beam_ids, joint_ids, joint_id0, joint_id1, assembly_sequence
# ---------- assembly: Python ----------
beam_ids = list(process.assembly.beam_ids())
joint_ids = ["%s-%s" % j_id for j_id in process.assembly.joint_ids()]
joint_id0 = [j_id[0] for j_id in process.assembly.joint_ids()]
joint_id1 = [j_id[1] for j_id in process.assembly.joint_ids()]
assembly_sequence = process.assembly.sequence
# ---------- end assembly ----------

preview_one_beam = GhPythonScript(process=ghpython_script.process, beam_id="b1")  # -> out, beam_mesh_prev, beam_centerline, beam_frame, beam_length, beam_height, beam_width, beam_centerline_segments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
# ---------- preview_one_beam: Python ----------
from compas_ghpython.artists import MeshArtist
from compas_ghpython.artists import LineArtist
from compas_ghpython.artists import FrameArtist
from compas_rhino.geometry import RhinoPlane
from compas.geometry import Line

assembly = process.assembly
if beam_id is not None:

    beam = assembly.beam(beam_id)
    assembly.get_beam_mesh_in_wcf(beam_id)
    beam_mesh_prev = MeshArtist(beam.cached_mesh).draw()
    beam_centerline = LineArtist(beam.get_center_line()).draw()
    beam_frame = FrameArtist(beam.frame).draw()
    beam_length = beam.length
    beam_height = beam.height
    beam_width = beam.width
    joints_on_beam = [joint.name for joint in assembly.get_joints_of_beam(beam_id)]
    neighbours_on_beam_before = assembly.get_already_built_neighbors(beam_id)
    neighbours_on_beam_after = assembly.get_unbuilt_neighbors(beam_id)
    
    # Center line segments (Only with Joint_halflap)
    segment_location = [0]
    for joint in assembly.get_joints_of_beam(beam_id):
        if joint.__class__.__name__ == "Joint_halflap":
            segment_location.append(joint.distance)
    segment_location.append(beam.length)
    segment_location.sort()
    beam_centerline_segments = []
    for i in range(len(segment_location)-1):
        start = beam.get_center_line().point(segment_location[i] / beam.length)
        end = beam.get_center_line().point(segment_location[i+1] / beam.length)
        beam_centerline_segments.append(LineArtist(Line(start,end)).draw())
# ---------- end preview_one_beam ----------
# beam_length : X Axis
# beam_height :  Y Axis
# beam_width :  Z Axis
brep_pbake = GhPythonScript(process=ghpython_script.process, beam_ids="b1", bake=Button())  # -> out, beam_nurbs; inputs beam_ids: list
# ---------- brep_pbake: Python ----------
#from compas_ghpython import unload_modules
#unload_modules('integral_timber_joints')
from compas_ghpython.utilities import draw_mesh
import scriptcontext
import Rhino
from integral_timber_joints.rhino.assembly_artist import AssemblyNurbsArtist

if bake:
    scriptcontext.doc = Rhino.RhinoDoc.ActiveDoc
    beam_nurbs = []
    assembly = process.assembly
    aa = AssemblyNurbsArtist(assembly)
    
    if not beam_ids:
        beam_ids = assembly.beam_ids()
        
    for beam_id in beam_ids:
        nurbs = aa.draw_beam(beam_id)
        beam_nurbs.append(nurbs)
    scriptcontext.doc = ghdoc
# ---------- end brep_pbake ----------
panel_4 = Panel(preview_one_beam.neighbours_on_beam_after)
deplane = DeconstructPlane(Plane=preview_one_beam.beam_frame)  # -> Origin, XAxis, YAxis, ZAxis
preview = CustomPreview(Geometry=preview_one_beam.beam_centerline_segments, Material=ColourSwatch(SwatchColor=RGBA(102, 255, 0, 148)))
