# Grasshopper definition IntermediateWaypoint.gh (Grasshopper 1.0.7)
# plug-ins: Pufferfish, MetaHopper

panel = Panel("C:\Users\harry\Dropbox (MIT)\code_ws_dropbox\itj_ws\integral_timber_joints\external\itj_design_study\210128_RemodelFredPavilion\YJ_tmp\pavilion_process.json")
rhino_doc_dir = RhinoDocDir()  # -> rhino_doc_dir
# ---------- rhino_doc_dir: Python ----------
import scriptcontext as sc
from os import path

rhino_doc_dir = path.abspath(path.dirname(sc.doc.Path))
# ---------- end rhino_doc_dir ----------
ghpython_script = GhPythonScript(x=rhino_doc_dir)  # -> out, a
# ---------- ghpython_script: Python ----------
import os

a = os.path.abspath(os.path.join(x, '..', '..'))
# ---------- end ghpython_script ----------

panel_2 = Panel(ghpython_script.a)

# ----
# Load Start End config of a selected Movement
load_movement = Button()
python = GhPythonScript(refresh=load_movement)  # -> out, process
# ---------- python: Python ----------
from integral_timber_joints.rhino.load import get_process
from integral_timber_joints.process import RobotClampAssemblyProcess

if not refresh:
    process = get_process() # type: RobotClampAssemblyProcess
# ---------- end python ----------
robotic_movement_explorer = GhPythonScript(process=python.process, movement_id="A205_M1")  # -> out, starting_frame, starting_config, starting_config_numbers, ending_config, ending_config_numbers, target_frame, points, meshes
# ---------- robotic_movement_explorer: Python ----------
from integral_timber_joints.process import RoboticFreeMovement, RoboticLinearMovement, RoboticMovement
from integral_timber_joints.rhino.load import get_process, get_process_artist
import Rhino.Geometry as rg
from compas.datastructures import mesh_weld
from compas_ghpython.artists import MeshArtist
from compas_ghpython import draw_frame
import os
from integral_timber_joints.rhino.load import get_activedoc_process_path

movement = process.get_movement_by_movement_id(movement_id)
artist = get_process_artist()

points = []
meshes = []
print type(movement)
if isinstance(movement, RoboticMovement):
    # Load neighbour movements
    external_movement_path = os.path.join(get_activedoc_process_path(), '..\\results')
    process.load_external_movements(external_movement_path, movement_id)
    
    # Output planned configurations
    start_scene = process.get_movement_start_scene(movement)
    starting_config = process.get_movement_start_robot_config(movement)
    starting_config_numbers = list(starting_config.values())
    print (starting_config)
    ending_config = process.get_movement_end_robot_config(movement)
    ending_config_numbers = list(ending_config.values())
    print (ending_config)

    

    attached_meshes = artist._get_state_attached_objects_meshes(start_scene, attached_objects_only=True)
    for object_id in attached_meshes:
        object_state, _meshes = attached_meshes[object_id]
        for mesh in _meshes:
            # Point Output
            welded_mesh = mesh_weld(mesh, 15)
            vertices, faces = welded_mesh.to_vertices_and_faces()
            for vertex in vertices:
                points.append(rg.Point3d(* vertex))
            # Mesh output
            r_mesh = MeshArtist(mesh).draw()
            meshes.append(r_mesh)
    starting_frame = draw_frame(start_scene['robot','f'])
    target_frame = draw_frame(movement.target_frame)
# ---------- end robotic_movement_explorer ----------

wp_index = Slider(0, range=0..1)

# ----
# Robot
load_robot = Button()
planning_group = Panel("robot11_eaXYZ")
ghpython_script_2 = PythonScript(load=load_robot, pkg_path=panel_2, pkg_name="rfl_description", urdf_file="rfl_pybullet.urdf", srdf_file="rfl.srdf")  # -> out, robot, configuration_in_m_deg
# ---------- ghpython_script_2: Python ----------
from scriptcontext import sticky as st
import os
import compas

from compas.robots import RobotModel
from compas.robots import GithubPackageMeshLoader
from compas.robots import LocalPackageMeshLoader
from compas_fab.robots import Robot
from compas_fab.robots import RobotSemantics
from compas_ghpython.artists import RobotModelArtist

# Robot meshes are usually in meters
# Set a high percision to prevent parsing errors
# and configure Rhino itself in meters
compas.PRECISION = '12f'

# Store robot in component-based key
robot_key = 'robot_{}'.format(str(ghenv.Component.InstanceGuid))

if robot_key not in st:
    st[robot_key] = None

if load:
    # Also load geometry
    loader = LocalPackageMeshLoader(os.path.join(pkg_path, 'rfl_description'), pkg_name)
    abb_loader = LocalPackageMeshLoader(os.path.join(pkg_path), "abb_irb4600_40_255")
    
    # Create robot model from URDF
    model = RobotModel.from_urdf_string(loader.load_urdf(urdf_file).read())
    model.load_geometry(loader, abb_loader)

    artist = RobotModelArtist(model)
    robot_semantics = None
    if srdf_file:
        robot_semantics = RobotSemantics.from_srdf_file(loader.build_path('urdf', srdf_file), model)
    
    robot = Robot(model, artist, semantics=robot_semantics)
    robot.scale(1000)
    st[robot_key] = robot

robot = st[robot_key]
configuration_in_m_deg = robot.zero_configuration().scaled(0.001)



#repo    = 'ros-industrial/abb'
#package = 'abb_irb6600_support'
#branch  = 'kinetic-devel'
#
#github = GithubPackageMeshLoader(repo, package, branch)
#
#model = RobotModel.from_urdf_file(github.load_urdf('irb6640.urdf'))
#model.load_geometry(github)
#artist = RobotModelArtist(model)
#robot = Robot(model, artist)
# ---------- end ghpython_script_2 ----------
robot = Data(ghpython_script_2.robot)

get_connected_objects = GetConnectedObjects(Objects=wp_index)

starting_config = Panel(robotic_movement_explorer.starting_config_numbers)
endting_config = Panel(robotic_movement_explorer.ending_config_numbers)
set_jogger_to_start_config = Button()
set_jogger_to_end_config = Button()
panel_3 = Panel("""bridge1_joint_EA_X
robot11_joint_EA_Y
robot11_joint_EA_Z
robot11_joint_1
robot11_joint_2
robot11_joint_3
robot11_joint_4
robot11_joint_5
robot11_joint_6""")
objbynn = GetObjectByNickname(NickName=panel_3)
filter = StreamFilter(Gate=set_jogger_to_start_config, Stream1=flatten(objbynn))
filter_2 = StreamFilter(Gate=set_jogger_to_end_config, Stream1=flatten(objbynn))
set_slider = SetSliderProperties(Slider=filter, Value=starting_config)
set_slider_2 = SetSliderProperties(Slider=filter_2, Value=endting_config)

# ----
# Development Tools
# Reload Python Modules (if Module Code is Changed)
python_module_to_reload = Panel("""compas
compas_fab
roslibpy
integral_timber_joints""")
reload = Button()
py = PythonScript(reload_module_button=reload, module_names=python_module_to_reload)  # inputs module_names: list
# ---------- py: Python ----------
import compas_ghpython
from compas_ghpython import unload_modules
if reload_module_button:
    for module in module_names:
        unload_modules(module)
# ---------- end py ----------

# ----
# Check Path and Environment
compas_version = GhPythonScript()  # -> out, compas_version, compas_fab_version, compas_path, compas_fab_path, compas_env_name, python_directory
# ---------- compas_version: Python ----------
__author__ = "leungp"
__version__ = "2020.04.20"

import rhinoscriptsyntax as rs
import compas
import compas_fab
compas_version  = compas.__version__
compas_fab_version = compas_fab.__version__
import os
compas_path = os.path.abspath(compas.__file__)
compas_fab_path = os.path.abspath(compas_fab.__file__)

import compas_bootstrapper
compas_env_name = compas_bootstrapper.ENVIRONMENT_NAME
python_directory = compas_bootstrapper.PYTHON_DIRECTORY
# ---------- end compas_version ----------
compas_environment_name = Panel(compas_version.compas_env_name)
compas_version_2 = Panel(compas_version.compas_version)
compas_fab_version = Panel(compas_version.compas_fab_version)
compas_path = Panel(compas_version.compas_path)
compas_fab_path = Panel(compas_version.compas_fab_path)
python_directory = Panel(compas_version.python_directory)

set_jogger_to_waypoint = Button()
panel_4 = Panel(robotic_movement_explorer.out)
filter_3 = StreamFilter(Gate=set_jogger_to_waypoint, Stream1=flatten(objbynn))
rad = Radians(Degrees=Slider(35, range=0..100))
set_waypoint_2 = Button()
set_waypoint_3 = Button()
set_waypoint_1 = Button()
robot11_joint_ea_z = Slider(-4.485, range=-4.8..-1.7)
bridge1_joint_ea_x = Slider(17.036, range=10..25)
robot11_joint_ea_y = Slider(-4.437, range=-9.5..0)
robot11_joint_5 = Slider(1.476, range=-2.094..2.094)
robot11_joint_4 = Slider(0, range=-3.15..3.15)
robot11_joint_3 = Slider(-2.928, range=-3.05..1.22)
robot11_joint_2 = Slider(-0.119, range=-1.48..1.48)
robot11_joint_1 = Slider(-2.945, range=-3.054..3.054)
robot11_joint_6 = Slider(1.373, range=-3.15..3.15)
merge = Merge(
    Data1=flatten(bridge1_joint_ea_x),
    Data2=flatten(robot11_joint_ea_y),
    Data3=flatten(robot11_joint_ea_z),
    Data4=flatten(robot11_joint_1),
    Data5=flatten(robot11_joint_2),
    Data6=flatten(robot11_joint_3),
    Data7=flatten(robot11_joint_4),
    Data8=flatten(robot11_joint_5),
    Data9=flatten(robot11_joint_6))

# ----
# Configuration (meter rad)
panel_5 = Panel("""2,bridge1_joint_EA_X
2,robot11_joint_EA_Y
2,robot11_joint_EA_Z
0,robot11_joint_1
0,robot11_joint_2
0,robot11_joint_3
0,robot11_joint_4
0,robot11_joint_5
0,robot11_joint_6""")
ghpython_script_3 = GhPythonScript(joint_type_names=panel_5, joint_values=merge)  # -> out, new_config; inputs joint_type_names: list, joint_values: list
# ---------- ghpython_script_3: Python ----------
from compas.robots import Configuration

joint_types= [int(str.split(',')[0]) for str in joint_type_names]
joint_names= [str.split(',')[1] for str in joint_type_names]


new_config = Configuration(joint_values, joint_types, joint_names)
print(new_config)
# ---------- end ghpython_script_3 ----------

panel_6 = Panel(ghpython_script_3.out)

# ---- group: Config in meters
# Configuration (meter rad)
ea_z = Slider(-4.21, range=-5..-1.7)
ea_y = Slider(0, range=-9.5..0)
gantry_x = Slider(35, range=0..40)
a5 = Slider(0, range=-2.18..2.18)
a4 = Slider(0, range=-6.98..6.98)
a3 = Slider(0, range=-3.14..1.3)
a2 = Slider(0, range=-1.57..2.61)
a1 = Slider(0, range=-3.14..3.14)
a6 = Slider(0, range=-6.98..6.98)
panel_7 = Panel("""2,bridge2_joint_EA_X
2,robot21_joint_EA_Y
2,robot21_joint_EA_Z
0,robot21_joint_1
0,robot21_joint_2
0,robot21_joint_3
0,robot21_joint_4
0,robot21_joint_5
0,robot21_joint_6""")
merge_2 = Merge(Data1=gantry_x, Data2=ea_y, Data3=ea_z, Data4=a1, Data5=a2, Data6=a3, Data7=a4, Data8=a5, Data9=a6)
ghpython_script_4 = GhPythonScript(joint_type_names=panel_7, joint_values=merge_2)  # -> out, new_config; inputs joint_type_names: list, joint_values: list; same code as ghpython_script_3
panel_8 = Panel(ghpython_script_4.out)

# Configuration (meter rad)
ea_z_2 = Slider(-4.22, range=-5..-1.7)
ea_y_2 = Slider(-9, range=-9.5..0)
a5_2 = Slider(0, range=-2.18..2.18)
a4_2 = Slider(0, range=-6.98..6.98)
a2_2 = Slider(0, range=-1.57..2.61)
a3_2 = Slider(0, range=-3.14..1.3)
a1_2 = Slider(0, range=-3.14..3.14)
a6_2 = Slider(0, range=-6.98..6.98)
panel_9 = Panel("""2,robot22_joint_EA_Y
2,robot22_joint_EA_Z
0,robot22_joint_1
0,robot22_joint_2
0,robot22_joint_3
0,robot22_joint_4
0,robot22_joint_5
0,robot22_joint_6""")
merge_3 = Merge(Data1=ea_y_2, Data2=ea_z_2, Data3=a1_2, Data4=a2_2, Data5=a3_2, Data6=a4_2, Data7=a5_2, Data8=a6_2)
ghpython_script_5 = GhPythonScript(joint_type_names=panel_9, joint_values=merge_3)  # -> out, new_config; inputs joint_type_names: list, joint_values: list; same code as ghpython_script_3
panel_10 = Panel(ghpython_script_5.out)

# Configuration (meter rad)
ea_z_3 = Slider(-4.849, range=-5..-1.7)
ea_y_3 = Slider(-12, range=-12..0)
a5_3 = Slider(0, range=-2.18..2.18)
a4_3 = Slider(0, range=-6.98..6.98)
a3_3 = Slider(1.134, range=-3.14..1.3)
a2_3 = Slider(-1.134, range=-1.57..2.61)
a1_3 = Slider(0, range=-3.14..3.14)
a6_3 = Slider(0, range=-6.98..6.98)
panel_11 = Panel("""2,robot12_joint_EA_Y
2,robot12_joint_EA_Z
0,robot12_joint_1
0,robot12_joint_2
0,robot12_joint_3
0,robot12_joint_4
0,robot12_joint_5
0,robot12_joint_6""")
merge_4 = Merge(Data1=ea_y_3, Data2=ea_z_3, Data3=a1_3, Data4=a2_3, Data5=a3_3, Data6=a4_3, Data7=a5_3, Data8=a6_3)
ghpython_script_6 = GhPythonScript(joint_type_names=panel_11, joint_values=merge_4)  # -> out, new_config; inputs joint_type_names: list, joint_values: list; same code as ghpython_script_3
panel_12 = Panel(ghpython_script_6.out)

# ----
merge_5 = Merge(
    Data1=ghpython_script_3.new_config,
    Data2=ghpython_script_6.new_config,
    Data3=ghpython_script_4.new_config,
    Data4=ghpython_script_5.new_config)

# ----
# Robot Visualisation
show_end_effector_frame = BooleanToggle(True)
show_base_frame = BooleanToggle(False)
show_collision = BooleanToggle(True)
show_frames = BooleanToggle(False)
show_visual = BooleanToggle(False)
visualize = PythonScript(
    robot=robot,
    group=planning_group,
    configurations=merge_5,
    show_visual=show_visual,
    show_collision=show_collision,
    show_frames=show_frames,
    show_base_frame=show_base_frame,
    show_end_effector_frame=show_end_effector_frame)  # -> out, visual, collision, frames, ee_frame, base_frame; inputs configurations: list
# ---------- visualize: Python ----------
"""Visualizes a robot.
    Inputs:
        robot: The robot
        configuration: :class:`compas_fab.robots.Configuration`
            The robot's full configuration to display.
        show_visual: bool
           Whether or not to show the robot's visual meshes.
        show_collision: bool
           Whether or not to show the robot's collision meshes.
        show_frames: bool
           Whether or not to show the robot's joint frames.
        show_base_frame: bool
           Whether or not to show the robot's base frame.
        show_end_effector_frame: bool
            Whether or not to show the robot's end-effector frame.
    Output:
        visual: The robot's visual meshes.
        collision: The robot's collision meshes.
        frames: The robot's joint frames.
        base_frame: The robot's base frame.
        ee_frame: The robot's end-effector frame.
"""
from __future__ import print_function
from compas.geometry import Frame, Scale
print (robot.group_names)
if robot:
    configuration = robot.zero_configuration()
    for partial_config in configurations:
        configuration.merge(partial_config.scaled(1000))
    print (configuration)
    
    group = group or robot.main_group_name
#    robot.update(configuration, group, visual=show_visual, collision=show_collision)
    robot.artist.update(configuration, visual=show_visual, collision=show_collision)
    print(robot.get_end_effector_link_name(group))
    if show_visual:
        visual = robot.artist.draw_visual()

    if show_collision:
        collision = robot.artist.draw_collision()

    if show_frames:
        axes = robot.transformed_axes(configuration, group)
        frames = robot.transformed_frames(configuration, group)

    if show_base_frame:
        frames = robot.transformed_frames(configuration, group)
        base_frame = frames[0]

    if show_end_effector_frame:
        ee_frame = robot.forward_kinematics(configuration, group)
        ee_frame = Frame.from_data(ee_frame.data)
        ee_frame.transform(Scale.from_factors([1/1000] * 3))
        print ("End-effector", ee_frame)
# ---------- end visualize ----------
draw = GhPythonScript(frames=[visualize.frames, visualize.ee_frame, visualize.base_frame], scale=Slider(1, range=0..1))  # -> P, V, C, W, flatten(planes); inputs frames: list
# ---------- draw: Python ----------
from System.Drawing import Color
from compas_ghpython import draw_frame

red = Color.FromArgb(255, 0, 0)
green = Color.FromArgb(0, 255, 0)
blue = Color.FromArgb(0, 0, 255)

P = []
V = []
C = []
planes = []

scale = float(scale)

for frame in frames:
    if not frame:
        continue
    plane = draw_frame(frame)
    P += [plane.Origin] * 3
    V.append(plane.XAxis * scale)
    V.append(plane.YAxis * scale)
    V.append(plane.ZAxis * scale)
    C += [red, green, blue]
    planes.append(plane)

W = 3
# ---------- end draw ----------
ghpython_script_7 = GhPythonScript(frame=visualize.ee_frame)  # -> out, plane
# ---------- ghpython_script_7: Python ----------
from compas_ghpython import draw_frame
plane = draw_frame(frame)
# ---------- end ghpython_script_7 ----------
geometry = Geometry(visualize.visual)
geometry_2 = Geometry(visualize.collision)
scale = Scale(Geometry=draw.P, Center=Point(0, 0, 0), Factor=1000)  # -> Geometry, Transform
vector_display_ex = VectorDisplayEx(Point=scale.Geometry, Vector=draw.V, Colour=draw.C, Width=draw.W)

merge_6 = Merge(Data1=ghpython_script_2.configuration_in_m_deg, Data2=merge_5)
python_2 = GhPythonScript(configurations=flatten(merge_6))  # -> out, merged_configuration; inputs configurations: list
# ---------- python_2: Python ----------
merged_configuration = configurations[0]
for config in configurations[1:]:
    merged_configuration.merge(config)
# ---------- end python_2 ----------
configuration = Data(python_2.merged_configuration)

# ----
# FK Frame from URDF to display attached meshes.
panel_13 = Panel(planning_group)
fk = GhPythonScript(robot=robot, configuration=configuration, group=panel_13)  # -> out, ee_frame
# ---------- fk: Python ----------
print (configuration)
ee_frame = robot.forward_kinematics(configuration.scaled(1000), group)

print (ee_frame)

from compas_ghpython import draw_frame
ee_frame = draw_frame(ee_frame)
# ---------- end fk ----------
scale_2 = Scale(Geometry=fk.ee_frame, Center=Point(0, 0, 0), Factor=Slider(0.001, range=0..0.001))  # -> Geometry, Transform
pln = Plane(scale_2.Geometry)
orient = Orient(Geometry=robotic_movement_explorer.meshes, Source=robotic_movement_explorer.starting_frame, Target=pln)  # -> Geometry, Transform
attached_collision_meshes = Geometry(orient.Geometry)

# ----
# Print Configuration
ghpython_script_8 = GhPythonScript(configuration=python_2.merged_configuration)  # -> out, json_dumps
# ---------- ghpython_script_8: Python ----------
print (configuration)

import json
from compas.utilities import DataEncoder
json_dumps = json.dumps(configuration, cls=DataEncoder)
# ---------- end ghpython_script_8 ----------
panel_14 = Panel(ghpython_script_8.out)

# ----
# Click these buttons to save the Jogger Config as Waypoint.
one_waypoint = GhPythonScript(process=python.process, movement_id="A205_M1", waypoint_configs=ghpython_script_3.new_config, set=set_waypoint_1)  # -> out, intermediate_planning_waypoint
# ---------- one_waypoint: Python ----------
from integral_timber_joints.process import RoboticFreeMovement, RoboticLinearMovement, RoboticMovement
from integral_timber_joints.rhino.load import get_process, get_process_artist
import Rhino.Geometry as rg
from compas.datastructures import mesh_weld
from compas_ghpython.artists import MeshArtist
from compas_ghpython import draw_frame


movement = process.get_movement_by_movement_id(movement_id)

print ("Movement (%s) Type: %s" % (movement_id, movement.__class__.__name__))
if isinstance(movement, RoboticMovement):
    print (movement.tag)
    intermediate_planning_waypoint = movement.intermediate_planning_waypoint
    print ("Current intermediate_planning_waypoint: %s" % intermediate_planning_waypoint)
    if set:
        movement.intermediate_planning_waypoint = [waypoint_configs]
# ---------- end one_waypoint ----------
two_waypoint = GhPythonScript(
    process=python.process,
    movement_id="A205_M1",
    waypoint_config=ghpython_script_3.new_config,
    set1=set_waypoint_1,
    set2=set_waypoint_2)  # -> out, intermediate_planning_waypoint; disabled
# ---------- two_waypoint: Python ----------
from integral_timber_joints.process import RoboticFreeMovement, RoboticLinearMovement, RoboticMovement
from integral_timber_joints.rhino.load import get_process, get_process_artist
import Rhino.Geometry as rg
from compas.datastructures import mesh_weld
from compas_ghpython.artists import MeshArtist
from compas_ghpython import draw_frame


movement = process.get_movement_by_movement_id(movement_id)

print ("Movement (%s) Type: %s" % (movement_id, movement.__class__.__name__))
if isinstance(movement, RoboticMovement):
    print (movement.tag)
    intermediate_planning_waypoint = movement.intermediate_planning_waypoint
    print ("Current intermediate_planning_waypoint: %s" % intermediate_planning_waypoint)
    if set1 or set2:
        if len(movement.intermediate_planning_waypoint) != 2:
            movement.intermediate_planning_waypoint = [None, None]
    if set1:
        movement.intermediate_planning_waypoint[0] = waypoint_config
    if set2:
        movement.intermediate_planning_waypoint[1] = waypoint_config
# ---------- end two_waypoint ----------
two_waypoint_2 = GhPythonScript(
    process=python.process,
    movement_id="A205_M1",
    waypoint_config=ghpython_script_3.new_config,
    set1=set_waypoint_1,
    set2=set_waypoint_2,
    set3=set_waypoint_3)  # -> out, intermediate_planning_waypoint; disabled
# ---------- two_waypoint_2: Python ----------
from integral_timber_joints.process import RoboticFreeMovement, RoboticLinearMovement, RoboticMovement
from integral_timber_joints.rhino.load import get_process, get_process_artist
import Rhino.Geometry as rg
from compas.datastructures import mesh_weld
from compas_ghpython.artists import MeshArtist
from compas_ghpython import draw_frame


movement = process.get_movement_by_movement_id(movement_id)

print ("Movement (%s) Type: %s" % (movement_id, movement.__class__.__name__))
if isinstance(movement, RoboticMovement):
    print (movement.tag)
    intermediate_planning_waypoint = movement.intermediate_planning_waypoint
    print ("Current intermediate_planning_waypoint: %s" % intermediate_planning_waypoint)
    if set1 or set2 or set3:
        if len(movement.intermediate_planning_waypoint) != 3:
            movement.intermediate_planning_waypoint = [None, None, None]
    if set1:
        movement.intermediate_planning_waypoint[0] = waypoint_config
    if set2:
        movement.intermediate_planning_waypoint[1] = waypoint_config
    if set3:
        movement.intermediate_planning_waypoint[2] = waypoint_config
# ---------- end two_waypoint_2 ----------

merge_7 = Merge(
    Data1=one_waypoint.intermediate_planning_waypoint,
    Data2=two_waypoint.intermediate_planning_waypoint,
    Data3=two_waypoint_2.intermediate_planning_waypoint)
last_index = LastIndex(List=merge_7)
item = ListItem(List=merge_7, Index=wp_index, Wrap=False)
set_slider_properties = SetSliderProperties(Slider=get_connected_objects, Range=last_index)
config_to_values = GhPythonScript(config=item, joint_names=panel_3)  # -> out, values; inputs joint_names: list
# ---------- config_to_values: Python ----------
values = list(config.values())
if joint_names != []:
    values = [config[joint_name] for joint_name in joint_names]
# ---------- end config_to_values ----------
set_slider_3 = SetSliderProperties(Slider=filter_3, Value=config_to_values.values)
merge_8 = Merge(Data1=one_waypoint.out, Data2=two_waypoint.out, Data3=two_waypoint_2.out)

panel_15 = Panel(merge_8)
