# Grasshopper definition TrajectoryVisualizerWithRhino.gh (Grasshopper 1.0.7)
# plug-ins: MetaHopper

# Load the Process file from Rhino and Activate Visualize Trajector at least once.
button = Button()
python = GhPythonScript(refresh=button)  # -> out, process
# ---------- python: Python ----------
from integral_timber_joints.rhino.load import get_process
from integral_timber_joints.process import RobotClampAssemblyProcess

if not refresh:
    process = get_process() # type: RobotClampAssemblyProcess
# ---------- end python ----------
movement = GhPythonScript(process=python.process, movement_id="A119_M0")  # -> out, prev_movement, prev_movement_id, next_movement, next_movement_id
# ---------- movement: Python ----------
from integral_timber_joints.process import RoboticFreeMovement, RoboticLinearMovement, RoboticMovement
from integral_timber_joints.rhino.load import get_process, get_process_artist
import Rhino.Geometry as rg
from compas.datastructures import mesh_weld
from compas.geometry import Transformation, Frame
from compas_ghpython import draw_frame

movement = process.get_movement_by_movement_id(movement_id)
artist = get_process_artist()

frames = []

if isinstance(movement, RoboticMovement):
    prev_movement = process.get_prev_robotic_movement(movement)
    prev_movement_id = prev_movement.movement_id
    next_movement = process.get_next_robotic_movement(movement)
    next_movement_id = next_movement.movement_id
# ---------- end movement ----------
trajectory_joint_values_too_close = GhPythonScript(process=python.process, movement_id="A119_M0")  # -> out, a, x, y, z, graft(j1), graft(j2), graft(j3)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
# ---------- trajectory_joint_values_too_close: Python ----------
from integral_timber_joints.process import RoboticFreeMovement, RoboticLinearMovement, RoboticMovement
problems = []
diffs = [[],[],[],[],[],[],[],[],[]]
# threshold

x,y,z,j1,j2,j3,j4,j5,j6 = [],[],[],[],[],[],[],[],[]
joint_values = [x,y,z,j1,j2,j3,j4,j5,j6]
close_joint_count = [] 

movement = process.get_movement_by_movement_id(movement_id)
if isinstance(movement, RoboticMovement) and (movement.trajectory is not None):

    t = movement.trajectory
    
    # Joint values of the first point
    last_values = list(t.points[0].values())
    for p in range(0, len(t.points)-1):
        # Joint values of this point
        values = list(t.points[p].values())
        joint_types = t.points[0].joint_types
        
        number_of_close_points = 0
        
        # Iterate through joints
        for i in range (9):
            joint_values[i].append(values[i])
            
            # Compute diffs
            if p > 0:
                diff = abs(last_values[i] - values[i])
                diffs[i].append(diff)
                threshold = dist_threshold if joint_types[i] == 2 else angle_threshold
                if diff < threshold:
                    number_of_close_points +=1
#                    problems.append ("Jump at seq #%i, %s, Point %i, Joint %s: Jump = %.4g (threshold=%s)" % (action.seq_n, movement.movement_id, p, t.joint_names[i], diff, threshold))
                
        last_values = values
        close_joint_count.append(number_of_close_points)
#avg_jump = [sum(diffs[i]) / len(diffs[i]) for i in range(9)]
#max_jump = [max(diffs[i]) for i in range(9)]
# ---------- end trajectory_joint_values_too_close ----------
panel = Panel(trajectory_joint_values_too_close.out)
traj_point = GhPythonScript(process=python.process, movement_id=movement.prev_movement_id)  # -> out, original_target_frame, frames
# ---------- traj_point: Python ----------
from integral_timber_joints.process import RoboticFreeMovement, RoboticLinearMovement, RoboticMovement
from integral_timber_joints.rhino.load import get_process, get_process_artist
import Rhino.Geometry as rg
from compas.datastructures import mesh_weld
from compas.geometry import Transformation, Frame
from compas_ghpython import draw_frame

movement = process.get_movement_by_movement_id(movement_id)
artist = get_process_artist()

frames = []

if isinstance(movement, RoboticMovement) and (movement.trajectory is not None):
    t = movement.trajectory
    print ("trajectory has %i points" % len(t.points))
    for config in t.points:
        configuration = process.robot_initial_config.merged(config)
        trajectory_frame = process.robot_model.forward_kinematics(configuration.scaled(1000), process.ROBOT_END_LINK)
        print (trajectory_frame)
        frames.append(draw_frame(trajectory_frame))
#        t_t0cp_at_final_from_world = Transformation.from_frame(movement.target_frame).inverse()
#        t_world_from_t0cp_at_traj = Transformation.from_frame(trajectory_frame)
#        t = t_world_from_t0cp_at_traj * t_t0cp_at_final_from_world

if isinstance(movement, RoboticMovement):
    original_target_frame = draw_frame(movement.target_frame)
# ---------- end traj_point ----------
number_slider = Slider(0, range=0..140)
traj_point_2 = GhPythonScript(process=python.process, movement_id="A119_M0")  # -> out, original_target_frame, frames; same code as traj_point

list_length = ListLength(List=traj_point_2.frames)
subtraction = Subtraction(A=list_length, B=1)
construct_domain = ConstructDomain(DomainStart=0, DomainEnd=subtraction)
get_connected_objects = GetConnectedObjects(Objects=number_slider)
set_slider_properties = SetSliderProperties(Slider=get_connected_objects, Range=construct_domain)

traj_point_3 = GhPythonScript(process=python.process, movement_id="A119_M0")  # -> out, points
# ---------- traj_point_3: Python ----------
from integral_timber_joints.process import RoboticFreeMovement, RoboticLinearMovement, RoboticMovement
from integral_timber_joints.rhino.load import get_process, get_process_artist
import Rhino.Geometry as rg
from compas.datastructures import mesh_weld

movement = process.get_movement_by_movement_id(movement_id)
artist = get_process_artist()

points = []

if isinstance(movement, RoboticMovement) and (movement.trajectory is not None):

    t = movement.trajectory
    scene = process.get_movement_start_scene(movement)
    attached_meshes = artist._get_state_attached_objects_meshes(scene, attached_objects_only=True)
    for object_id in attached_meshes:
        object_state, meshes = attached_meshes[object_id]
        for mesh in meshes:
            welded_mesh = mesh_weld(mesh, 15)
            vertices, faces = welded_mesh.to_vertices_and_faces()
            for vertex in vertices:
                points.append(rg.Point3d(* vertex))
# ---------- end traj_point_3 ----------
data = Data(simplify([trajectory_joint_values_too_close.j1, trajectory_joint_values_too_close.j2, trajectory_joint_values_too_close.j3, trajectory_joint_values_too_close.j4, trajectory_joint_values_too_close.j5, trajectory_joint_values_too_close.j6]))
flip = FlipMatrix(Data=data)
split = SplitList(List=flip, Index=number_slider)  # -> ListA, ListB
split_2 = SplitList(List=trajectory_joint_values_too_close.x, Index=number_slider)  # -> ListA, ListB
split_3 = SplitList(List=trajectory_joint_values_too_close.y, Index=number_slider)  # -> ListA, ListB
split_4 = SplitList(List=trajectory_joint_values_too_close.z, Index=number_slider)  # -> ListA, ListB

item = ListItem(List=traj_point_2.frames, Index=0, Wrap=True)
item_2 = ListItem(List=traj_point_2.frames, Index=number_slider, Wrap=False)
orient = Orient(Geometry=traj_point_3.points, Source=item, Target=item_2)  # -> Geometry, Transform

pln = Plane(traj_point.original_target_frame)
pln_2 = Plane(traj_point_2.original_target_frame)
graph = QuickGraph(trajectory_joint_values_too_close.z, SortOrder=0)
graph_2 = QuickGraph(flip, SortOrder=0)
graph_3 = QuickGraph(trajectory_joint_values_too_close.x, SortOrder=0)
graph_4 = QuickGraph(trajectory_joint_values_too_close.y, SortOrder=0)
dist = Distance(PointA=pln, PointB=pln_2)
panel_2 = Panel(dist)
item_3 = ListItem(List=traj_point_2.frames, Index=0, Wrap=True)  # -> Item1, Item
dist_2 = Distance(PointA=item_3.Item1, PointB=item_3.Item)
graph_5 = QuickGraph(split_4.ListA, SortOrder=0)
graph_6 = QuickGraph(split.ListA, SortOrder=0)
graph_7 = QuickGraph(split_2.ListA, SortOrder=0)
graph_8 = QuickGraph(split_3.ListA, SortOrder=0)
panel_3 = Panel(dist_2)
