# Grasshopper definition RobotTeachingTool.gh (Grasshopper 1.0.7)
# plug-ins: Human

# ----
# Development Tools
# Reload Python Modules (if Module Code is Changed)
python_module_to_reload = Panel("""compas
compas_fab
roslibpy
integral_timber_joints""")
reload = Button()
py = PythonScript(reload_module_button=reload, module_names=python_module_to_reload)  # inputs module_names: list
# ---------- py: Python ----------
import compas_ghpython
from compas_ghpython import unload_modules
if reload_module_button:
    for module in module_names:
        unload_modules(module)
# ---------- end py ----------

# ----
# Check Path and Environment
compas_version = GhPythonScript()  # -> out, compas_version, compas_fab_version, compas_path, compas_fab_path, compas_env_name, python_directory
# ---------- compas_version: Python ----------
__author__ = "leungp"
__version__ = "2020.04.20"

import rhinoscriptsyntax as rs
import compas
import compas_fab
compas_version  = compas.__version__
compas_fab_version = compas_fab.__version__
import os
compas_path = os.path.abspath(compas.__file__)
compas_fab_path = os.path.abspath(compas_fab.__file__)

import compas_bootstrapper
compas_env_name = compas_bootstrapper.ENVIRONMENT_NAME
python_directory = compas_bootstrapper.PYTHON_DIRECTORY
# ---------- end compas_version ----------
compas_environment_name = Panel(compas_version.compas_env_name)
compas_version_2 = Panel(compas_version.compas_version)
compas_fab_version = Panel(compas_version.compas_fab_version)
compas_path = Panel(compas_version.compas_path)
compas_fab_path = Panel(compas_version.compas_fab_path)
python_directory = Panel(compas_version.python_directory)

# ----
# Goto a Frame
goto_robot_frame = Button()

# ----
# Frame from XY Arrows
frame_curves_named_x_and_y = Curve([<curve referenced from the Rhino model> x2])
z_offset = Slider(-118, range=-200..0)
frame_from_crv = FrameFromCrv(frame_curves_named_x_and_y=frame_curves_named_x_and_y)
deconstruct_plane = DeconstructPlane(Plane=frame_from_crv)  # -> Origin, XAxis, YAxis, ZAxis
amplitude = Amplitude(Vector=deconstruct_plane.ZAxis, Amplitude=z_offset)
move = Move(Geometry=frame_from_crv, Motion=amplitude)  # -> Geometry, Transform
pln = Plane(move.Geometry)

# ----
# Ext Axis From Tool Tip Offset
number_slider = Slider(-2686, range=-3000..-1800)
pln_2 = Plane(pln)
panel = Panel("-2600")
panel_2 = Panel("-2200")
panel_3 = Panel("3200")
deplane = DeconstructPlane(Plane=pln_2)  # -> Origin, XAxis, YAxis, ZAxis
pt = ConstructPoint(XCoordinate=number_slider, YCoordinate=Slider(-2203, range=-2800..-1800), ZCoordinate=Slider(2960, range=2000..4000))
move_2 = Move(Geometry=deplane.Origin, Motion=pt)  # -> Geometry, Transform
rougly_robotbase = Point(move_2.Geometry)
pdecon = Deconstruct(Point=rougly_robotbase)  # -> XComponent, YComponent, ZComponent
neg = Negative(Value=pdecon.ZComponent)
neg_2 = Negative(Value=pdecon.YComponent)
panel_4 = Panel("""0
0
0""")
merge = Merge(Data1=pdecon.XComponent, Data2=neg_2, Data3=neg, Data4=panel_4)
ext_axis_from_tool_tip_offset = Number(merge)
panel_5 = Panel(ext_axis_from_tool_tip_offset)

# ----
# Connect to RFL robot via ROS (Execution)
panel_6 = Panel("192.168.0.120")
restart = Button()
ros = PythonScript(ip=panel_6, restart=restart)  # -> out, ros_client
# ---------- ros: Python ----------
import sys
import time
import scriptcontext as sc

from compas_fab.backends import RosClient

from System import TimeSpan
from System.Threading import ManualResetEventSlim


key = 'rosclient_%s' % str(ghenv.Component.InstanceGuid)
previous_client = sc.sticky.get(key, None)
if previous_client:
    previous_client.terminate()

ros_client = RosClient(ip, 9090)
sc.sticky[key] = ros_client

waitLock = ManualResetEventSlim(False)

ros_client.on_ready(lambda: waitLock.Set())

if not waitLock.Wait(TimeSpan.FromSeconds(5)):
    raise Exception('Unable to connect to ROS')


print "ROS is connected:", ros_client.is_connected
# ---------- end ros ----------
panel_7 = Panel(ros.out)
init_robot = Button()
ghpython_script = GhPythonScript(ros_client=ros.ros_client, init_robot=init_robot, namespace="/rob1")  # -> abb_client; inputs init_robot: Boolean
# ---------- ghpython_script: Python ----------
from compas_rrc import *

if ros_client:
    abb_client = AbbClient(ros_client, namespace)
# ---------- end ghpython_script ----------

get_robot_frame = Button()
ghpython_script_2 = GhPythonScript(get_robot_frame=get_robot_frame, robot=ghpython_script)  # -> out, external_axis, joints, frame; inputs get_robot_frame: Boolean
# ---------- ghpython_script_2: Python ----------
from scriptcontext import sticky as st
from compas_rrc import *
from compas_ghpython import draw_frame

# sticky prep function
def get_sticky(attribute_name):
    guid = str(ghenv.Component.InstanceGuid)
    sticky_key = guid + "_" + attribute_name
    if sticky_key not in st:
        st[sticky_key] = None
        return None
    else:
        return st[sticky_key]


def set_sticky(attribute_name, value):
    guid = str(ghenv.Component.InstanceGuid)
    sticky_key = guid + "_" + attribute_name
    st[sticky_key] = value

if get_robot_frame:
    # Set Tool 0 in World 0
    robot.send(SetWorkObject('wobj0'))
    robot.send(SetTool('tool0'))
    
    # get current robot pose
    f, e = robot.send_and_wait(GetRobtarget(), timeout=10)
    set_sticky('frame', f)

    j, e = robot.send_and_wait(GetJoints(), timeout=10)
    set_sticky('joints', j)
    set_sticky('external_axis', e)
    
frame = draw_frame(get_sticky('frame'))
external_axis = list(get_sticky('external_axis'))
joints = list(get_sticky('joints'))
# ---------- end ghpython_script_2 ----------
split = SplitList(List=ghpython_script_2.external_axis, Index=3)  # -> ListA, ListB

# ----
# Goto Configuration
output_folder = Panel("C:\Users\leungp\Documents\GitHub\integral_timber_joints\external\itj_design_study\210419_HyparHut\taught_configurations\")
output_folder_2 = Panel("C:\Users\leungp\Documents\GitHub\integral_timber_joints\external\itj_design_study\220407_CantiBoxRight\taught_configurations\")
list = ValueList({"g1_PG500_storage_configuration.json", "g2_PG1000_storage_configuration.json", "g3_PG1500_storage_configuration.json", "c1_CL3_storage_configuration.json", "c2_CL3_storage_configuration.json", "c3_CL3M_storage_configuration.json", "c4_CL3M_storage_configuration.json", "s1_SL1_storage_configuration.json", "s2_SL1_storage_configuration.json", "s3_SL1_storage_configuration.json", "s4_SL1_G200_storage_configuration.json", "robot11_initial_configuration.json", "g1_PG500_pickup_configuration.json", "g2_PG1000_pickup_configuration.json", "g3_PG1500_pickup_configuration.json"}, selected="s4_SL1_G200_storage_configuration.json")
concat = Concatenate(FragmentA=output_folder_2, FragmentB=list)
load_configuration = GhPythonScript(json_path=concat)  # -> out, configuration
# ---------- load_configuration: Python ----------
import json
from compas.utilities.encoders import DataDecoder
with open(json_path, 'r') as f:
    configuration = json.load(f, cls=DataDecoder)
# ---------- end load_configuration ----------
goto_robot_frame_2 = Button()
ghpython_script_3 = GhPythonScript(
    goto_configuration=goto_robot_frame_2,
    robot=ghpython_script,
    configuration=load_configuration.configuration,
    speed=Slider(1000, range=0..1000))  # -> out, external_axis, joints; inputs goto_configuration: Boolean
# ---------- ghpython_script_3: Python ----------
from scriptcontext import sticky as st
from compas_rrc import *
from compas_ghpython import draw_frame
from compas_rhino.geometry import RhinoPlane
from math import degrees
# sticky prep function
def get_sticky(attribute_name):
    guid = str(ghenv.Component.InstanceGuid)
    sticky_key = guid + "_" + attribute_name
    if sticky_key not in st:
        st[sticky_key] = None
        return None
    else:
        return st[sticky_key]

def set_sticky(attribute_name, value):
    guid = str(ghenv.Component.InstanceGuid)
    sticky_key = guid + "_" + attribute_name
    st[sticky_key] = value

print (configuration)

external_axes = []
external_axes.append(configuration['bridge1_joint_EA_X']* 1000)
external_axes.append(configuration['robot11_joint_EA_Y']* 1000)
external_axes.append(configuration['robot11_joint_EA_Z']* 1000)
ext_axes = ExternalAxes(external_axes)

joint_values = []
joint_values.append(degrees(configuration['robot11_joint_1']))
joint_values.append(degrees(configuration['robot11_joint_2']))
joint_values.append(degrees(configuration['robot11_joint_3']))
joint_values.append(degrees(configuration['robot11_joint_4']))
joint_values.append(degrees(configuration['robot11_joint_5']))
joint_values.append(degrees(configuration['robot11_joint_6']))
robot_joints = RobotJoints(joint_values)

instruction = MoveToJoints(robot_joints, external_axes, speed, Zone.FINE)
print (instruction)
if goto_configuration:
    
    # Go to target frame
    robot.send(instruction)

    # Get the finished pose Joint and external Values
    j, e = robot.send_and_wait(GetJoints(), timeout=10)
    if j is None:
        print ("Motion did not complete before Timeout 10 sec.")
    set_sticky('joints', j)
    set_sticky('external_axis', e)
if get_sticky('external_axis') is None:
    external_axis = None
    joints = None
else:
    external_axis = list(get_sticky('external_axis'))
    joints = list(get_sticky('joints'))
# ---------- end ghpython_script_3 ----------

# ----
# Get Current Values
get_robot_frame_2 = Button()
ghpython_script_4 = GhPythonScript(get_robot_frame=get_robot_frame_2, robot=ghpython_script)  # -> out, external_axis, joints, frame; inputs get_robot_frame: Boolean; same code as ghpython_script_2
item = ListItem(List=ghpython_script_4.external_axis, Index=0, Wrap=True)  # -> Item, Item1, Item2
ea = Panel(ghpython_script_4.external_axis)
neg_3 = Negative(Value=item.Item2)
neg_4 = Negative(Value=item.Item1)
pt_2 = ConstructPoint(XCoordinate=item.Item, YCoordinate=neg_4, ZCoordinate=neg_3)
J = Panel(ghpython_script_4.joints)
rougly_robotbase_2 = Point(pt_2)

pln_3 = Plane(pln)
current_external_axes = Number(ghpython_script_4.external_axis)

# ----
# Rough Estiamte only
ghpython_script_5 = GhPythonScript(igps_points=pln_3)  # -> robotworld_points; inputs igps_points: list of Point3d
# ---------- ghpython_script_5: Python ----------
import compas.geometry as cg
import ghpythonlib.components as ghcomp
import Rhino.Geometry as rg
from compas_ghpython import draw_frame



# iGPS world - Robot worls offsets
robot_11_igps_wobj0 = ((-2614.766, -2058.444, 29.420), (1.0, -0.000028, 0.000047, -0.000034))
robot_12_igps_wobj0 = ((-2609.441, -2057.051, 28.106), (1.0, -0.000026, -0.000042, 0.000059))


def transf(obj, rg_T, cg_T):
    if isinstance(obj, rg.Plane):
        return ghcomp.Transform(obj, rg_T)

    elif isinstance(obj, rg.Brep):
        return ghcomp.Transform(obj, rg_T)

    elif isinstance(obj, rg.Mesh):
        return ghcomp.Transform(obj, rg_T)

    elif isinstance(obj, rg.Point3d):
        return ghcomp.Transform(obj, rg_T)

    elif "compas" in str(type(obj)):
        return obj.transformed(cg_T)

    else:
        raise NotImplementedError


def iGPSWorld_to_RobotWorld(obj, robot="robot_11"):

    if robot == "robot_11":
        robot_igps_wobj0 = robot_11_igps_wobj0
    elif robot == "robot_12":
        robot_igps_wobj0 = robot_12_igps_wobj0
    else:
        raise NotImplementedError

    # iGPSworld to RobotWorld transformation
    rg_iGPS_to_robot_world_vector = rg.Vector3d(*robot_igps_wobj0[0])
    
    
    
    
    to_frame = cg.Frame.from_quaternion(robot_11_igps_wobj0[1], point=robot_11_igps_wobj0[0])
    to_plane = draw_frame(to_frame)
    
    rg_iGPS_to_robot_world_T = rg.Transform.PlaneToPlane(rg.Plane.WorldXY, to_plane)
    
    cg_iGPS_to_robot_world_T = None
    """
    cg_iGPS_to_robot_world_T = cg.Transformation.from_matrix([
        [1, 0, 0, rg_iGPS_to_robot_world_vector.X],
        [0, 1, 0, rg_iGPS_to_robot_world_vector.Y],
        [0, 0, 1, rg_iGPS_to_robot_world_vector.Z],
        [0, 0, 0, 1]])
        """

    if isinstance(obj, list):
        # print " --- iGPSWorld_to_RobotWorld for list"
        return [transf(item, rg_iGPS_to_robot_world_T, cg_iGPS_to_robot_world_T) for item in obj]
    elif obj is None:
        # print " --- iGPSWorld_to_RobotWorld for none"
        return None
    else:
        # print " --- iGPSWorld_to_RobotWorld for single object"
        return transf(obj, rg_iGPS_to_robot_world_T, cg_iGPS_to_robot_world_T)


def RobotWorld_to_iGPSWorld(obj, robot="robot_11"):

    if robot == "robot_11":
        robot_igps_wobj0 = robot_11_igps_wobj0
    elif robot == "robot_12":
        robot_igps_wobj0 = robot_12_igps_wobj0
    else:
        raise NotImplementedError

    # RobotWorld to iGPSworld transformation
    rg_robot_world_to_iGPS_vector = -rg.Vector3d(*robot_igps_wobj0[0])
    rg_robot_to_igps_world_T = rg.Transform.Translation(rg_robot_world_to_iGPS_vector)
    cg_robot_to_igps_world_T = cg.Transformation.from_matrix(
        [[1, 0, 0, rg_robot_world_to_iGPS_vector.X],
         [0, 1, 0, rg_robot_world_to_iGPS_vector.Y],
         [0, 0, 1, rg_robot_world_to_iGPS_vector.Z],
         [0, 0, 0, 1]])

    if isinstance(obj, list):
        # print " --- RobotWorld to iGPSworld for list"
        return [transf(item, rg_robot_to_igps_world_T, cg_robot_to_igps_world_T) for item in obj]
    elif obj is None:
        # print " --- RobotWorld to iGPSworld for none"
        return None
    else:
        # print " --- RobotWorld to iGPSworld for single object"
        return transf(obj, rg_robot_to_igps_world_T, cg_robot_to_igps_world_T)



robotworld_points = iGPSWorld_to_RobotWorld(igps_points)
# ---------- end ghpython_script_5 ----------

# ----
# Rough Estiamte only
pln_4 = Plane(ghpython_script_4.frame)
ghpython_script_6 = GhPythonScript(robotworld_points=pln_4)  # -> igps_points; inputs robotworld_points: list of Point3d
# ---------- ghpython_script_6: Python ----------
import compas.geometry as cg
import ghpythonlib.components as ghcomp
import Rhino.Geometry as rg
from compas_ghpython import draw_frame



# iGPS world - Robot worls offsets
robot_11_igps_wobj0 = ((-2614.766, -2058.444, 29.420), (1.0, -0.000028, 0.000047, -0.000034))
robot_12_igps_wobj0 = ((-2609.441, -2057.051, 28.106), (1.0, -0.000026, -0.000042, 0.000059))


def transf(obj, rg_T, cg_T):
    if isinstance(obj, rg.Plane):
        return ghcomp.Transform(obj, rg_T)

    elif isinstance(obj, rg.Brep):
        return ghcomp.Transform(obj, rg_T)

    elif isinstance(obj, rg.Mesh):
        return ghcomp.Transform(obj, rg_T)

    elif isinstance(obj, rg.Point3d):
        return ghcomp.Transform(obj, rg_T)

    elif "compas" in str(type(obj)):
        return obj.transformed(cg_T)

    else:
        raise NotImplementedError


def iGPSWorld_to_RobotWorld(obj, robot="robot_11"):

    if robot == "robot_11":
        robot_igps_wobj0 = robot_11_igps_wobj0
    elif robot == "robot_12":
        robot_igps_wobj0 = robot_12_igps_wobj0
    else:
        raise NotImplementedError

    # iGPSworld to RobotWorld transformation
    rg_iGPS_to_robot_world_vector = rg.Vector3d(*robot_igps_wobj0[0])
    
    
    
    
    to_frame = cg.Frame.from_quaternion(robot_11_igps_wobj0[1], point=robot_11_igps_wobj0[0])
    to_plane = draw_frame(to_frame)
    
    rg_iGPS_to_robot_world_T = rg.Transform.PlaneToPlane(rg.Plane.WorldXY, to_plane)
    
    cg_iGPS_to_robot_world_T = None
    """
    cg_iGPS_to_robot_world_T = cg.Transformation.from_matrix([
        [1, 0, 0, rg_iGPS_to_robot_world_vector.X],
        [0, 1, 0, rg_iGPS_to_robot_world_vector.Y],
        [0, 0, 1, rg_iGPS_to_robot_world_vector.Z],
        [0, 0, 0, 1]])
        """

    if isinstance(obj, list):
        # print " --- iGPSWorld_to_RobotWorld for list"
        return [transf(item, rg_iGPS_to_robot_world_T, cg_iGPS_to_robot_world_T) for item in obj]
    elif obj is None:
        # print " --- iGPSWorld_to_RobotWorld for none"
        return None
    else:
        # print " --- iGPSWorld_to_RobotWorld for single object"
        return transf(obj, rg_iGPS_to_robot_world_T, cg_iGPS_to_robot_world_T)


def RobotWorld_to_iGPSWorld(obj, robot="robot_11"):

    if robot == "robot_11":
        robot_igps_wobj0 = robot_11_igps_wobj0
    elif robot == "robot_12":
        robot_igps_wobj0 = robot_12_igps_wobj0
    else:
        raise NotImplementedError

    # RobotWorld to iGPSworld transformation
    rg_robot_world_to_iGPS_vector = -rg.Vector3d(*robot_igps_wobj0[0])
    rg_robot_to_igps_world_T = rg.Transform.Translation(rg_robot_world_to_iGPS_vector)
    cg_robot_to_igps_world_T = cg.Transformation.from_matrix(
        [[1, 0, 0, rg_robot_world_to_iGPS_vector.X],
         [0, 1, 0, rg_robot_world_to_iGPS_vector.Y],
         [0, 0, 1, rg_robot_world_to_iGPS_vector.Z],
         [0, 0, 0, 1]])

    if isinstance(obj, list):
        # print " --- RobotWorld to iGPSworld for list"
        return [transf(item, rg_robot_to_igps_world_T, cg_robot_to_igps_world_T) for item in obj]
    elif obj is None:
        # print " --- RobotWorld to iGPSworld for none"
        return None
    else:
        # print " --- RobotWorld to iGPSworld for single object"
        return transf(obj, rg_robot_to_igps_world_T, cg_robot_to_igps_world_T)


igps_points = RobotWorld_to_iGPSWorld(robotworld_points)
# ---------- end ghpython_script_6 ----------

# ----
# Convertion to Meters / Radians
# Joint values expressed in radians or meters, depending on the respective type.
# 
#     REVOLUTE = 0
#     CONTINUOUS = 1
#     PRISMATIC = 2
#     FIXED = 3
#     FLOATING = 4
#     PLANAR = 5
ea_2 = Panel(split.ListA)
J_2 = Panel(ghpython_script_2.joints)
joint_names = Panel("""bridge1_joint_EA_X
robot11_joint_EA_Y
robot11_joint_EA_Z
robot11_joint_1
robot11_joint_2
robot11_joint_3
robot11_joint_4
robot11_joint_5
robot11_joint_6""")
division = Division(A=ea_2, B=1000)
rad = Radians(Degrees=J_2)
joint_types = Panel("""2
2
2
0
0
0
0
0
0""")
merge_2 = Merge(Data1=flatten(division), Data2=flatten(rad))
configuration = GhPythonScript(values=merge_2, joint_names=joint_names, joint_types=joint_types)  # -> out, configuration, configuration_json; inputs values: list, joint_names: list, joint_types: list of Int32
# ---------- configuration: Python ----------
from compas_fab.robots import Configuration
from compas.utilities.encoders import DataEncoder
import json
configuration = Configuration(values, joint_types, joint_names)
assert len(values) == len(joint_types)
assert len(values) == len(joint_names)
configuration_json = json.dumps(configuration, cls=DataEncoder)
# ---------- end configuration ----------

# ----
# Save Configuration
# Convert values to a configuration (Robot11)
# Values from rrc
# Save to File
make_sure_save_it_to_the_right_target_no = ValueList({"g1_PG500_storage_configuration.json", "g2_PG1000_storage_configuration.json", "g3_PG1500_storage_configuration.json", "c1_CL3_storage_configuration.json", "c2_CL3_storage_configuration.json", "c3_CL3M_storage_configuration.json", "c4_CL3M_storage_configuration.json", "s1_SL1_storage_configuration.json", "s2_SL1_storage_configuration.json", "s3_SL1_storage_configuration.json", "s4_SL1_G200_storage_configuration.json", "robot11_initial_configuration.json", "g1_PG500_pickup_configuration.json", "g2_PG1000_pickup_configuration.json", "g3_PG1500_pickup_configuration.json", "s4_SL1_G200_pickup_configuration.json"}, selected="c2_CL3_storage_configuration.json")  # "Make sure save it to the right target (No overwrite protection)"
output_folder_3 = Panel("C:\Users\leungp\Documents\GitHub\integral_timber_joints\external\itj_design_study\220407_CantiBoxRight\taught_configurations\")
save = Button()
concat_2 = Concatenate(FragmentA=output_folder_3, FragmentB=make_sure_save_it_to_the_right_target_no)
python = GhPythonScript(configuration=configuration.configuration, json_path=concat_2, save=save)  # -> out, a
# ---------- python: Python ----------
import json
from compas.utilities.encoders import DataEncoder
if save:
    with open(json_path, 'w') as f:
        json.dump(configuration, f, cls=DataEncoder, indent=4, sort_keys=True)
# ---------- end python ----------
panel_8 = Panel(configuration.configuration_json)

pl_origin = PlaneOrigin(Base=pln_3, Origin=ghpython_script_5)
merge_3 = Merge(
    Data1=flatten("# External Axis"),
    Data2=flatten(ghpython_script_4.external_axis),
    Data3=flatten("# Joint Values"),
    Data4=flatten(ghpython_script_4.joints))  # -> flatten(Result)
panel_9 = Panel(pl_origin)
ghpython_script_7 = GhPythonScript(
    goto_robot_frame=goto_robot_frame,
    robot=ghpython_script,
    frame=pl_origin,
    external_axes=current_external_axes,
    speed=Slider(300, range=0..1000))  # -> out, external_axis, joints; inputs goto_robot_frame: Boolean, frame: Plane, external_axes: list
# ---------- ghpython_script_7: Python ----------
from scriptcontext import sticky as st
from compas_rrc import *
from compas_ghpython import draw_frame
from compas_rhino.geometry import RhinoPlane
# sticky prep function
def get_sticky(attribute_name):
    guid = str(ghenv.Component.InstanceGuid)
    sticky_key = guid + "_" + attribute_name
    if sticky_key not in st:
        st[sticky_key] = None
        return None
    else:
        return st[sticky_key]

def set_sticky(attribute_name, value):
    guid = str(ghenv.Component.InstanceGuid)
    sticky_key = guid + "_" + attribute_name
    st[sticky_key] = value

if goto_robot_frame:
    # Set Tool 0 in World 0
    robot.send(SetWorkObject('wobj0'))
    robot.send(SetTool('tool0'))
    
    # Go to target frame
    target_frame = RhinoPlane.from_geometry(frame).to_compas()
    ext_axes = ExternalAxes(*external_axes)
    robot.send(MoveToRobtarget(target_frame, ext_axes, speed, Zone.FINE, motion_type=Motion.LINEAR))
    
    # Get the finished pose Joint and external Values
    j, e = robot.send_and_wait(GetJoints(), timeout=10)
    if j is None:
        print ("Motion did not complete before Timeout 10 sec.")
    set_sticky('joints', j)
    set_sticky('external_axis', e)
if get_sticky('external_axis') is None:
    external_axis = None
    joints = None
else:
    external_axis = list(get_sticky('external_axis'))
    joints = list(get_sticky('joints'))
# ---------- end ghpython_script_7 ----------
ea_3 = Panel(merge_3)
panel_10 = Panel("C:\Users\harry\Dropbox (MIT)\code_ws_dropbox\itj_ws\integral_timber_joints\external\itj_design_study\210128_RemodelFredPavilion\YJ_tmp\pavilion_process.json")

panel_11 = Panel("C:\Users\leungp\Documents\GitHub\integral_timber_joints\external")

# ----
# Robot
load_robot = Button()
ghpython_script_8 = PythonScript(load=load_robot, pkg_path=panel_11, pkg_name="rfl_description", urdf_file="rfl_pybullet.urdf", srdf_file="rfl.srdf")  # -> out, robot, configuration_in_m_deg
# ---------- ghpython_script_8: Python ----------
from scriptcontext import sticky as st
import os
import compas

from compas.robots import RobotModel
from compas.robots import GithubPackageMeshLoader
from compas.robots import LocalPackageMeshLoader
from compas_fab.robots import Robot
from compas_fab.robots import RobotSemantics
from compas_ghpython.artists import RobotModelArtist

# Robot meshes are usually in meters
# Set a high percision to prevent parsing errors
# and configure Rhino itself in meters
compas.PRECISION = '12f'

# Store robot in component-based key
robot_key = 'robot_{}'.format(str(ghenv.Component.InstanceGuid))

if robot_key not in st:
    st[robot_key] = None

if load:
    # Also load geometry
    loader = LocalPackageMeshLoader(os.path.join(pkg_path, 'rfl_description'), pkg_name)
    abb_loader = LocalPackageMeshLoader(os.path.join(pkg_path), "abb_irb4600_40_255")
    
    # Create robot model from URDF
    model = RobotModel.from_urdf_string(loader.load_urdf(urdf_file).read())
    model.load_geometry(loader, abb_loader)

    artist = RobotModelArtist(model)
    robot_semantics = None
    if srdf_file:
        robot_semantics = RobotSemantics.from_srdf_file(loader.build_path('urdf', srdf_file), model)
    
    robot = Robot(model, artist, semantics=robot_semantics)
    robot.scale(1000)
    st[robot_key] = robot

robot = st[robot_key]
configuration_in_m_deg = robot.zero_configuration().scaled(0.001)



#repo    = 'ros-industrial/abb'
#package = 'abb_irb6600_support'
#branch  = 'kinetic-devel'
#
#github = GithubPackageMeshLoader(repo, package, branch)
#
#model = RobotModel.from_urdf_file(github.load_urdf('irb6640.urdf'))
#model.load_geometry(github)
#artist = RobotModelArtist(model)
#robot = Robot(model, artist)
# ---------- end ghpython_script_8 ----------
robot = Data(ghpython_script_8.robot)

rad_2 = Radians(Degrees=ghpython_script_4.joints)
division_2 = Division(A=ghpython_script_4.external_axis, B=1000)
item_2 = ListItem(List=division_2, Index=0, Wrap=True)  # -> Item, Item1, Item2
item_3 = ListItem(List=rad_2, Index=0, Wrap=True)  # -> Item, Item1, Item2, Item3, Item4, Item5
rad_3 = Radians(Degrees=Slider(35, range=0..100))

# ----
# FK Frame from URDF
# Bake FK Frame as two lines
panel_12 = Panel("robot11")
fk = GhPythonScript(robot=robot, configuration=load_configuration.configuration, group=panel_12)  # -> out, ee_frame
# ---------- fk: Python ----------
print (configuration)
ee_frame = robot.forward_kinematics(configuration.scaled(1000), group)

print (ee_frame)

from compas_ghpython import draw_frame
ee_frame = draw_frame(ee_frame)
# ---------- end fk ----------
scale = Scale(Geometry=fk.ee_frame, Center=Point(0, 0, 0), Factor=Slider(0.001, range=0..0.001))  # -> Geometry, Transform

merge_4 = Merge(
    Data1=flatten(item_2.Item),
    Data2=flatten(item_2.Item1),
    Data3=flatten(item_2.Item2),
    Data4=flatten(item_3.Item),
    Data5=flatten(item_3.Item1),
    Data6=flatten(item_3.Item2),
    Data7=flatten(item_3.Item3),
    Data8=flatten(item_3.Item4),
    Data9=flatten(item_3.Item5))

bake = Button()
pln_robot_frame = Plane(scale.Geometry)
pdecon_2 = Deconstruct(Point=pln_robot_frame)  # -> XComponent, YComponent, ZComponent
deplane_2 = DeconstructPlane(Plane=pln_robot_frame)  # -> Origin, XAxis, YAxis, ZAxis
merge_5 = Merge(Data1=deplane_2.XAxis, Data2=deplane_2.YAxis)
panel_13 = Panel("""x
y""")
line = LineSDL(Start=deplane_2.Origin, Direction=merge_5, Length=50)
createatts = CreateAttributes(Name=panel_13, LayerName="TaughtPositionFK", enableFullPath=False)
bake_2 = BakeGeometry(Bake=bake, Geometry=line, Attributes=createatts, DeleteOldBakes=False, PreserveTrees=False)

ghpython_script_9 = GhPythonScript(robot_model=robot, joint_values=merge_4)  # -> out, new_config, merged_config; inputs joint_values: list
# ---------- ghpython_script_9: Python ----------
from compas_fab.robots import Configuration

robot_11_joint_names= ['bridge1_joint_EA_X', 'robot11_joint_EA_Y', 'robot11_joint_EA_Z', 'robot11_joint_1', 'robot11_joint_2', 'robot11_joint_3', 'robot11_joint_4', 'robot11_joint_5', 'robot11_joint_6']
robot_11_joint_types= [2, 2, 2, 0, 0, 0, 0, 0, 0]


new_config = Configuration(joint_values, robot_11_joint_types, robot_11_joint_names).scaled(1000)
zero_confg = robot_model.zero_configuration()
merged_config = zero_confg.copy()
merged_config.merge(new_config)
print(new_config)
print(merged_config.to_data())
# ---------- end ghpython_script_9 ----------

# ---- group: Config in meters
# Configuration (meter rad)
ea_z = Slider(-4.11, range=-5..-1.7)
ea_y = Slider(0, range=-9.5..0)
gantry_x = Slider(15.683, range=0..40)
a5 = Slider(0, range=-2.18..2.18)
a4 = Slider(0, range=-6.98..6.98)
a3 = Slider(0, range=-3.14..1.3)
a2 = Slider(0, range=-1.57..2.61)
a1 = Slider(0, range=-3.14..3.14)
a6 = Slider(0, range=-6.98..6.98)
panel_14 = Panel("""2,bridge1_joint_EA_X
2,robot11_joint_EA_Y
2,robot11_joint_EA_Z
0,robot11_joint_1
0,robot11_joint_2
0,robot11_joint_3
0,robot11_joint_4
0,robot11_joint_5
0,robot11_joint_6""")
panel_15 = Panel(ghpython_script_9.out)
merge_6 = Merge(
    Data1=flatten(gantry_x),
    Data2=flatten(ea_y),
    Data3=flatten(ea_z),
    Data4=flatten(a1),
    Data5=flatten(a2),
    Data6=flatten(a3),
    Data7=flatten(a4),
    Data8=flatten(a5),
    Data9=flatten(a6))

# Configuration (meter rad)
ea_z_2 = Slider(-4.849, range=-5..-1.7)
ea_y_2 = Slider(-12, range=-12..0)
a5_2 = Slider(0, range=-2.18..2.18)
a4_2 = Slider(0, range=-6.98..6.98)
a2_2 = Slider(-1.134, range=-1.57..2.61)
a3_2 = Slider(1.134, range=-3.14..1.3)
a1_2 = Slider(0, range=-3.14..3.14)
a6_2 = Slider(0, range=-6.98..6.98)
panel_16 = Panel("""2,robot12_joint_EA_Y
2,robot12_joint_EA_Z
0,robot12_joint_1
0,robot12_joint_2
0,robot12_joint_3
0,robot12_joint_4
0,robot12_joint_5
0,robot12_joint_6""")
merge_7 = Merge(Data1=ea_y_2, Data2=ea_z_2, Data3=a1_2, Data4=a2_2, Data5=a3_2, Data6=a4_2, Data7=a5_2, Data8=a6_2)

# ----
ghpython_script_10 = GhPythonScript(joint_type_names=panel_14, joint_values=merge_4)  # -> out, new_config; inputs joint_type_names: list, joint_values: list
# ---------- ghpython_script_10: Python ----------
from compas.robots import Configuration

joint_types= [int(str.split(',')[0]) for str in joint_type_names]
joint_names= [str.split(',')[1] for str in joint_type_names]


new_config = Configuration(joint_values, joint_types, joint_names)
print(new_config)
# ---------- end ghpython_script_10 ----------
ghpython_script_11 = GhPythonScript(joint_type_names=panel_16, joint_values=merge_7)  # -> out, new_config; inputs joint_type_names: list, joint_values: list; same code as ghpython_script_10

# ---- group: Config in meters
# Configuration (meter rad)
ea_z_3 = Slider(-4.21, range=-5..-1.7)
ea_y_3 = Slider(0, range=-9.5..0)
gantry_x_2 = Slider(35, range=0..40)
a5_3 = Slider(0, range=-2.18..2.18)
a4_3 = Slider(0, range=-6.98..6.98)
a3_3 = Slider(0, range=-3.14..1.3)
a2_3 = Slider(0, range=-1.57..2.61)
a1_3 = Slider(0, range=-3.14..3.14)
a6_3 = Slider(0, range=-6.98..6.98)
panel_18 = Panel("""2,bridge2_joint_EA_X
2,robot21_joint_EA_Y
2,robot21_joint_EA_Z
0,robot21_joint_1
0,robot21_joint_2
0,robot21_joint_3
0,robot21_joint_4
0,robot21_joint_5
0,robot21_joint_6""")
merge_8 = Merge(Data1=gantry_x_2, Data2=ea_y_3, Data3=ea_z_3, Data4=a1_3, Data5=a2_3, Data6=a3_3, Data7=a4_3, Data8=a5_3, Data9=a6_3)

# Configuration (meter rad)
ea_z_4 = Slider(-4.22, range=-5..-1.7)
ea_y_4 = Slider(-9, range=-9.5..0)
a5_4 = Slider(0, range=-2.18..2.18)
a4_4 = Slider(0, range=-6.98..6.98)
a2_4 = Slider(0, range=-1.57..2.61)
a3_4 = Slider(0, range=-3.14..1.3)
a1_4 = Slider(0, range=-3.14..3.14)
a6_4 = Slider(0, range=-6.98..6.98)
panel_20 = Panel("""2,robot22_joint_EA_Y
2,robot22_joint_EA_Z
0,robot22_joint_1
0,robot22_joint_2
0,robot22_joint_3
0,robot22_joint_4
0,robot22_joint_5
0,robot22_joint_6""")
merge_9 = Merge(Data1=ea_y_4, Data2=ea_z_4, Data3=a1_4, Data4=a2_4, Data5=a3_4, Data6=a4_4, Data7=a5_4, Data8=a6_4)

# ----
ghpython_script_12 = GhPythonScript(joint_type_names=panel_20, joint_values=merge_9)  # -> out, new_config; inputs joint_type_names: list, joint_values: list; same code as ghpython_script_10
ghpython_script_13 = GhPythonScript(joint_type_names=panel_18, joint_values=merge_8)  # -> out, new_config; inputs joint_type_names: list, joint_values: list; same code as ghpython_script_10
merge_10 = Merge(
    Data1=ghpython_script_10.new_config,
    Data2=ghpython_script_11.new_config,
    Data3=ghpython_script_13.new_config,
    Data4=ghpython_script_12.new_config)

# ----
# Robot Visualisation
show_end_effector_frame = BooleanToggle(True)
show_base_frame = BooleanToggle(False)
show_collision = BooleanToggle(True)
show_frames = BooleanToggle(False)
show_visual = BooleanToggle(False)
visualize = PythonScript(
    robot=robot,
    configurations=merge_10,
    show_visual=show_visual,
    show_collision=show_collision,
    show_frames=show_frames,
    show_base_frame=show_base_frame,
    show_end_effector_frame=show_end_effector_frame)  # -> out, visual, collision, frames, ee_frame, base_frame; inputs configurations: list
# ---------- visualize: Python ----------
"""Visualizes a robot.
    Inputs:
        robot: The robot
        configuration: :class:`compas_fab.robots.Configuration`
            The robot's full configuration to display.
        show_visual: bool
           Whether or not to show the robot's visual meshes.
        show_collision: bool
           Whether or not to show the robot's collision meshes.
        show_frames: bool
           Whether or not to show the robot's joint frames.
        show_base_frame: bool
           Whether or not to show the robot's base frame.
        show_end_effector_frame: bool
            Whether or not to show the robot's end-effector frame.
    Output:
        visual: The robot's visual meshes.
        collision: The robot's collision meshes.
        frames: The robot's joint frames.
        base_frame: The robot's base frame.
        ee_frame: The robot's end-effector frame.
"""
from __future__ import print_function
from compas.geometry import Frame
print (robot.group_names)
if robot:
    configuration = robot.zero_configuration()
    for partial_config in configurations:
        configuration.merge(partial_config.scaled(1000))
    print (configuration)
    
    group = group or robot.main_group_name
#    robot.update(configuration, group, visual=show_visual, collision=show_collision)
    robot.artist.update(configuration, visual=show_visual, collision=show_collision)
    print(robot.get_end_effector_link_name(group))
    if show_visual:
        visual = robot.artist.draw_visual()

    if show_collision:
        collision = robot.artist.draw_collision()

    if show_frames:
        axes = robot.transformed_axes(configuration, group)
        frames = robot.transformed_frames(configuration, group)

    if show_base_frame:
        frames = robot.transformed_frames(configuration, group)
        base_frame = frames[0]

    if show_end_effector_frame:
        ee_frame = robot.forward_kinematics(configuration, group)
        ee_frame = Frame.from_data(ee_frame.data)
        
        print ("End-effector", ee_frame)
# ---------- end visualize ----------
draw = GhPythonScript(frames=[visualize.frames, visualize.ee_frame, visualize.base_frame], scale=Slider(1, range=0..1))  # -> P, V, C, W, flatten(planes); inputs frames: list
# ---------- draw: Python ----------
from System.Drawing import Color
from compas_ghpython import draw_frame

red = Color.FromArgb(255, 0, 0)
green = Color.FromArgb(0, 255, 0)
blue = Color.FromArgb(0, 0, 255)

P = []
V = []
C = []
planes = []

scale = float(scale)

for frame in frames:
    if not frame:
        continue
    plane = draw_frame(frame)
    P += [plane.Origin] * 3
    V.append(plane.XAxis * scale)
    V.append(plane.YAxis * scale)
    V.append(plane.ZAxis * scale)
    C += [red, green, blue]
    planes.append(plane)

W = 3
# ---------- end draw ----------
ghpython_script_14 = GhPythonScript(frame=visualize.ee_frame)  # -> out, plane
# ---------- ghpython_script_14: Python ----------
from compas_ghpython import draw_frame
plane = draw_frame(frame)
# ---------- end ghpython_script_14 ----------
geometry = Geometry(visualize.visual)
geometry_2 = Geometry(visualize.collision)
scale_2 = Scale(Geometry=draw.P, Center=Point(0, 0, 0), Factor=1000)  # -> Geometry, Transform
vector_display_ex = VectorDisplayEx(Point=scale_2.Geometry, Vector=draw.V, Colour=draw.C, Width=draw.W)

merge_11 = Merge(Data1=ghpython_script_8.configuration_in_m_deg, Data2=merge_10)
python_2 = GhPythonScript(configurations=flatten(merge_11))  # -> out, merged_configuration; inputs configurations: list
# ---------- python_2: Python ----------
merged_configuration = configurations[0]
for config in configurations[1:]:
    merged_configuration.merge(config)
# ---------- end python_2 ----------

# ----
# Print Configuration
ghpython_script_15 = GhPythonScript(configuration=python_2.merged_configuration)  # -> out, json_dumps
# ---------- ghpython_script_15: Python ----------
print (configuration)

import json
from compas.utilities import DataEncoder
json_dumps = json.dumps(configuration, cls=DataEncoder)
# ---------- end ghpython_script_15 ----------
panel_22 = Panel(ghpython_script_15.out)

panel_23 = Panel(draw.P)

# ==== cluster FrameFromCrv
frame_curves_named_x_and_y = ClusterInput()
frame_curves_named_x_and_y_2 = Curve(frame_curves_named_x_and_y)
filtername = FilterByName(Geometry=frame_curves_named_x_and_y_2, Name="y")
filtername_2 = FilterByName(Geometry=frame_curves_named_x_and_y_2, Name="x")
end = EndPoints(Curve=filtername_2)  # -> Start, End
end_2 = EndPoints(Curve=filtername)  # -> Start, End
pl_3pt = Plane3Pt(PointA=end.Start, PointB=end.End, PointC=end_2.End)
pl = ClusterOutput(pl_3pt)
